# Dynamo graph R0.0 Copy Site Coordinates.dyn "9.0 Copy Site Coordinates" (Dynamo 3.7.0.11777)

reference_revit_file = Filename("C:\Users\Conor.mcenery\DC\ACCDocs\MWP.ie\27038-FRD2A\Project Files\01-WIP\01-CIVIL-CE\01-MODELS-M3\04-3D SUPPORT\01-REF REV\FRD2A-S11-SST_ALL.rvt")  # graph input
unit_mm_or_m = StringInput("M")  # graph input
copy_site_coordinates = Python(IN[0]=reference_revit_file, IN[1]=unit_mm_or_m)  # CPython3
# ---------- copy_site_coordinates.python (158 lines) ----------
"""
Dynamo for Revit - Python Script node (engine: CPython3)

Copies the Site Survey Point, Project Base Point, and GIS/geo coordinate
system from a reference .rvt file into the current document, in one step -
equivalent to Manage > Coordinates > Acquire Coordinates in the Revit UI.

How it works: temporarily links the reference file, calls
Document.AcquireCoordinates() against that link instance (this single call
is what actually copies Survey Point, Project Base Point and the GIS
coordinate system together - there is no need to set each one separately),
then removes the temporary link so nothing permanent is left behind. Also
sets the project's Length display format (Project Units > Common > Length)
to match the chosen unit, and afterwards reads back the resulting Survey
Point position and reports it in that unit, so you can confirm what was
actually acquired.

Inputs:
  IN[0] : file path (string) to the reference .rvt to acquire coordinates from
  IN[1] : Unit for the project's Length format and the reported coordinates -
          "mm" or "M" (optional, default "M")

Output:
  OUT : dict with "Status" on success (includes the reported coordinates) or "Error" on failure
"""
import clr
import os
import math

clr.AddReference("RevitAPI")
from Autodesk.Revit.DB import (
    RevitLinkOptions, RevitLinkType, RevitLinkInstance, ModelPathUtils, XYZ,
    FormatOptions, UnitTypeId, SymbolTypeId, SpecTypeId
)

clr.AddReference("RevitServices")
from RevitServices.Persistence import DocumentManager
from RevitServices.Transactions import TransactionManager

host_doc = DocumentManager.Instance.CurrentDBDocument

file_path_str = IN[0]
unit_str = IN[1] if len(IN) > 1 and IN[1] else "M"

output = {}
is_valid = False


def _set_length_units(doc, unit_key):
    # Same probing pattern as this library's "set project units" tool - the
    # exact SymbolTypeId member name varies by Revit version/language, so try
    # each known candidate rather than assuming one.
    if unit_key == "mm":
        unit_type_id = UnitTypeId.Millimeters
        accuracy = 1.0
        symbol_candidates = ["Millimeter", "Millimeters", "MM"]
    else:
        unit_type_id = UnitTypeId.Meters
        accuracy = 0.001
        symbol_candidates = ["Meter", "Meters", "M", "MSup1"]

    units = doc.GetUnits()
    format_options = FormatOptions(unit_type_id)
    format_options.Accuracy = accuracy

    symbol_id = None
    for candidate in symbol_candidates:
        if hasattr(SymbolTypeId, candidate):
            symbol_id = getattr(SymbolTypeId, candidate)
            break
    if symbol_id is not None:
        format_options.SetSymbolTypeId(symbol_id)

    units.SetFormatOptions(SpecTypeId.Length, format_options)
    doc.SetUnits(units)

unit_key = str(unit_str).strip().lower()
if unit_key in ("mm", "millimeter", "millimetre", "millimeters", "millimetres"):
    ft_to_unit = 304.8
    unit_label = "mm"
elif unit_key in ("m", "meter", "metre", "meters", "metres"):
    ft_to_unit = 0.3048
    unit_label = "M"
else:
    output["Error"] = "Unit '{}' not recognized - use 'mm' or 'M'.".format(unit_str)
    ft_to_unit = None
    unit_label = None

if ft_to_unit is None:
    pass
elif file_path_str is None:
    output["Error"] = "IN[0] is blank. Connect a File Path (string) to IN[0]."
elif not isinstance(file_path_str, str):
    output["Error"] = "IN[0] is the wrong format. Expected a string file path, got: " + str(type(file_path_str))
elif not file_path_str.strip():
    output["Error"] = "IN[0] is blank. Connect a File Path (string) to IN[0]."
elif not file_path_str.lower().endswith(".rvt"):
    output["Error"] = "IN[0] must point to a .rvt file. Got: " + file_path_str
elif not os.path.isfile(file_path_str):
    output["Error"] = "File not found on disk: " + file_path_str
else:
    is_valid = True

if is_valid:
    model_path = ModelPathUtils.ConvertUserVisiblePathToModelPath(file_path_str)

    TransactionManager.Instance.EnsureInTransaction(host_doc)

    try:
        # 1. Set the project's Length display format to match the chosen unit
        # (Project Units > Common > Length).
        _set_length_units(host_doc, unit_key)

        # 2. Create/load the RevitLinkType for the reference file.
        link_options = RevitLinkOptions(False)
        link_type_result = RevitLinkType.Create(host_doc, model_path, link_options)
        link_type_id = link_type_result.ElementId

        # 3. Place a temporary RevitLinkInstance so it can be referenced by
        # AcquireCoordinates (RevitLinkInstance.Create only takes
        # (Document, ElementId) - there is no ImportPlacement overload).
        link_instance = RevitLinkInstance.Create(host_doc, link_type_id)

        # 4. This single call copies the Survey Point, Project Base Point,
        # and GIS coordinate system from the linked file into host_doc -
        # the same as Manage > Coordinates > Acquire Coordinates in the UI.
        host_doc.AcquireCoordinates(link_instance.Id)

        # 5. Clean up - remove the temporary link instance and link type so
        # the acquired coordinate system is kept without a permanent link.
        host_doc.Delete(link_instance.Id)
        host_doc.Delete(link_type_id)

        # 6. Read back the resulting Survey Point position (internal feet)
        # and report it in the requested unit, so you can confirm what
        # actually got acquired without having to check Manage > Coordinates.
        pos = host_doc.ActiveProjectLocation.GetProjectPosition(XYZ.Zero)
        ns_val = pos.NorthSouth * ft_to_unit
        ew_val = pos.EastWest * ft_to_unit
        elev_val = pos.Elevation * ft_to_unit
        angle_deg = math.degrees(pos.Angle)  # pos.Angle is radians, in Revit's raw parameter convention

        TransactionManager.Instance.TransactionTaskDone()

        output["Status"] = (
            "Survey Point, Project Base Point and GIS coordinate system acquired from '{}'. "
            "Project Length units set to {unit}. "
            "Resulting Survey Point - N/S: {:.3f} {unit}, E/W: {:.3f} {unit}, Elev: {:.3f} {unit}, "
            "Angle (Revit's raw parameter value): {:.4f} deg."
        ).format(
            os.path.basename(file_path_str), ns_val, ew_val, elev_val, angle_deg, unit=unit_label
        )

    except Exception as e:
        TransactionManager.Instance.TransactionTaskDone()
        output["Error"] = "Failed to acquire coordinates: " + str(e)

OUT = output
# ----------------------------------------
watch = Watch(copy_site_coordinates)  # graph output
