# Dynamo graph 1.0 Move Survey point_V5.07.dyn (Dynamo 3.6.2.11575)

# group: To Revit
xyz_e_w_n_s_elev_project_base = StringInput("""83487.960,332147.281
,311.303""")  # "XYZ_E/W,N/S,Elev_Project Base Point"; graph input
angle = DoubleInput(347.21)  # graph input
# note: Is a String, not a number
# note: 04/08/20206
# Conor Mcenery, to set up a project folder to a Giving layout
# *Create note Ctrl+W
# *no package
# *Work on Revit 2024 to 2026 and on
xyz_e_w_n_s_elev_survey_point = StringInput("83675.9501,331793.1684,0")  # "XYZ_E/W,N/S,Elev Survey Point - Internal Input"
revit = Filename("..\..\Downloads\STB1A-SST-S11-C_C.rvt")  # graph input

# group: Review
space = CodeBlock { ","; }
split = String.Split(string=xyz_e_w_n_s_elev_project_base, separator0=space)
toNumber = String.ToNumber(string=split)
xyz_enz = CodeBlock(list=toNumber) { x = list[0]; y = list[1]; z = list[2]; }

# group: Project Base Point
y_north_south = Watch(xyz_enz.y)
x_east_west = Watch(xyz_enz.x)
z_elevation = Watch(xyz_enz.z)
# note: Python Code
# note: Survey in revit Follow Survey YXZ and in cad it is XYZ
NEZ_YXZ_ANFLE = Python(IN[0]=y_north_south, IN[1]=x_east_west, IN[2]=z_elevation, IN[3]=angle)  # CPython3
# ---------- NEZ_YXZ_ANFLE.python (74 lines) ----------
import math
import clr

# Import Revit Services for Dynamo
clr.AddReference("RevitServices")
from RevitServices.Persistence import DocumentManager
from RevitServices.Transactions import TransactionManager

# Import Revit API
clr.AddReference("RevitAPI")
from Autodesk.Revit.DB import *

# Inputs (Assume meters for N/S, E/W, Elev and degrees for Angle)
ns_meters = float(IN[0])
ew_meters = float(IN[1])
elev_meters = float(IN[2])
angle_deg = float(IN[3])

# 1. Convert length inputs from Meters to Internal Units (Feet)
ns = ns_meters / 0.3048
ew = ew_meters / 0.3048
elev = elev_meters / 0.3048

# 2. Normalize and invert the angle for Revit's True North direction convention
# (360 - angle resolves the 12.79 vs 347.21 degree rotational inversion)
normalized_angle = angle_deg % 360.0
revit_angle_deg = (360.0 - normalized_angle) if normalized_angle != 0 else 0.0
angle_rad = math.radians(revit_angle_deg)

doc = DocumentManager.Instance.CurrentDBDocument

# Find Survey Point using IsShared property
collector = FilteredElementCollector(doc).OfClass(BasePoint)
survey_point = None

for bp in collector:
    if bp.IsShared:
        survey_point = bp
        break

if survey_point is None:
    OUT = "Survey Point not found."
else:
    TransactionManager.Instance.EnsureInTransaction(doc)

    # Update Position via Active ProjectLocation
    active_location = doc.ActiveProjectLocation
    proj_position = active_location.GetProjectPosition(XYZ.Zero)

    proj_position.NorthSouth = ns
    proj_position.EastWest = ew
    proj_position.Elevation = elev
    proj_position.Angle = angle_rad

    active_location.SetProjectPosition(XYZ.Zero, proj_position)

    # Update parameter values directly on the Survey Point element
    ns_param = survey_point.get_Parameter(BuiltInParameter.BASEPOINT_NORTHSOUTH_PARAM)
    ew_param = survey_point.get_Parameter(BuiltInParameter.BASEPOINT_EASTWEST_PARAM)
    elev_param = survey_point.get_Parameter(BuiltInParameter.BASEPOINT_ELEVATION_PARAM)
    angle_param = survey_point.get_Parameter(BuiltInParameter.BASEPOINT_ANGLETON_PARAM)

    if ns_param and not ns_param.IsReadOnly:
        ns_param.Set(ns)
    if ew_param and not ew_param.IsReadOnly:
        ew_param.Set(ew)
    if elev_param and not elev_param.IsReadOnly:
        elev_param.Set(elev)
    if angle_param and not angle_param.IsReadOnly:
        angle_param.Set(angle_rad)

    TransactionManager.Instance.TransactionTaskDone()

    OUT = "Survey Point updated successfully."
# ----------------------------------------
watch = Watch(NEZ_YXZ_ANFLE)

# group: Review
space_2 = CodeBlock { ","; }
split_2 = String.Split(string=xyz_e_w_n_s_elev_survey_point, separator0=space_2)
toNumber_2 = String.ToNumber(string=split_2)
xyz_enz_2 = CodeBlock(list=toNumber_2) { x = list[0]; y = list[1]; z = list[2]; }

# group: Survey Point - Internal
y_north_south_2 = Watch(xyz_enz_2.y)
x_east_west_2 = Watch(xyz_enz_2.x)
z_elevation_2 = Watch(xyz_enz_2.z)
# note: Python Code
# note: Survey in revit Follow Survey YXZ and in cad it is XYZ
NEZ_YXZ_ANFLE_2 = Python(YN=y_north_south_2, XE=x_east_west_2, ELV=z_elevation_2, Angle=angle)  # CPython3
# ---------- NEZ_YXZ_ANFLE_2.python (88 lines) ----------
"""
Dynamo Python Script node
Sets the Survey Point's N/S, E/W, Elevation, and Angle to True North.

Inputs (IN):
  IN[0] = North/South offset, in meters
  IN[1] = East/West offset, in meters
  IN[2] = Elevation, in meters
  IN[3] = Angle to True North, in degrees

Uses RevitServices.TransactionManager instead of a raw Transaction object,
because Dynamo already wraps Python Script nodes in its own transaction -
starting a second Transaction manually throws:
  "InvalidOperationException: Starting a new transaction is not permitted."
"""

import math
import clr

clr.AddReference("RevitServices")
from RevitServices.Persistence import DocumentManager
from RevitServices.Transactions import TransactionManager

clr.AddReference("RevitAPI")
from Autodesk.Revit.DB import *

# Inputs (Convert Meters to Feet - Revit's internal length unit)
ns_feet = float(IN[0]) / 0.3048
ew_feet = float(IN[1]) / 0.3048
elev_feet = float(IN[2]) / 0.3048
angle_deg = float(IN[3])

doc = DocumentManager.Instance.CurrentDBDocument

# 1. Find the Survey Point
collector = FilteredElementCollector(doc).OfClass(BasePoint)
survey_point = next((bp for bp in collector if bp.IsShared), None)

if survey_point is None:
    OUT = "Survey Point not found."
else:
    TransactionManager.Instance.EnsureInTransaction(doc)

    try:
        # Unpin & Unclip
        if survey_point.Pinned:
            survey_point.Pinned = False
        survey_point.Clipped = False

        # Force position back to Internal Origin (0,0,0)
        pos = survey_point.Position
        if not pos.IsAlmostEqualTo(XYZ.Zero):
            ElementTransformUtils.MoveElement(doc, survey_point.Id, XYZ.Zero.Subtract(pos))

        # True North Rotation Angle (Radians)
        normalized_angle = angle_deg % 360.0
        revit_angle_deg = (360.0 - normalized_angle) if normalized_angle != 0 else 0.0
        angle_rad = math.radians(revit_angle_deg)

        # 2. Direct Parameter Updates
        param_map = {
            BuiltInParameter.BASEPOINT_NORTHSOUTH_PARAM: ns_feet,
            BuiltInParameter.BASEPOINT_EASTWEST_PARAM: ew_feet,
            BuiltInParameter.BASEPOINT_ELEVATION_PARAM: elev_feet,
            BuiltInParameter.BASEPOINT_ANGLETON_PARAM: angle_rad
        }

        for builtin_param, value in param_map.items():
            p = survey_point.get_Parameter(builtin_param)
            if p and not p.IsReadOnly:
                p.Set(value)

        # Re-clip and Re-pin
        survey_point.Clipped = True
        survey_point.Pinned = True

        # 3. Regenerate WHILE transaction is active
        doc.Regenerate()

        OUT = "Survey Point coordinates updated."

    except Exception as e:
        OUT = "Failed to update Survey Point: {}".format(e)

    finally:
        # Commits on success, rolls back cleanly on failure - either way
        # Dynamo's transaction is closed out properly for the next run.
        TransactionManager.Instance.TransactionTaskDone()
# ----------------------------------------
watch_2 = Watch(NEZ_YXZ_ANFLE_2)

# group: Optional, but do. Change unit to (M) and add New Level Lable to Ref Survey Point
boolean = BoolSelector(true)
sets_revit_project_units_length = Python(IN[1]=boolean)  # "Sets Revit Project Units -> Length -> Meters, 3 decimal places"; CPython3; unwired: IN[0]
# ---------- sets_revit_project_units_length.python (74 lines) ----------
"""
Dynamo Python Script Node
Sets Revit Project Units -> Length -> Meters, 3 decimal places, symbol "m"

Usage in Dynamo:
1. IN[0]: Document (Optional - defaults to Active Document if unwired/null).
2. IN[1]: Boolean toggle (True to run, False to skip).
3. Run the graph.

Compatible Engine: IronPython 2 & CPython 3 (Revit 2021+)
"""

import clr

clr.AddReference('RevitAPI')
clr.AddReference('RevitServices')

from Autodesk.Revit.DB import FormatOptions, UnitTypeId, SymbolTypeId, SpecTypeId, ForgeTypeId
from RevitServices.Persistence import DocumentManager
from RevitServices.Transactions import TransactionManager

# 1. Check Boolean Run Toggle (IN[1])
run_script = IN[1] if isinstance(IN, list) and len(IN) > 1 else True

if not bool(run_script):
    OUT = "Script skipped (Boolean set to False)."
else:
    # 2. Resolve Input Document (IN[0] or Active Document fallback)
    input_doc = IN[0] if isinstance(IN, list) and len(IN) > 0 and IN[0] is not None else None

    if input_doc is not None:
        doc = getattr(input_doc, "InternalElement", input_doc)
    else:
        doc = DocumentManager.Instance.CurrentDBDocument

    # 3. Modify Project Units within a Transaction
    TransactionManager.Instance.EnsureInTransaction(doc)

    try:
        units = doc.GetUnits()

        # Create FormatOptions: Meters with 3 decimal places (Accuracy = 0.001)
        format_options = FormatOptions(UnitTypeId.Meters)
        format_options.Accuracy = 0.001

        # Probe for the meter unit symbol ("m")
        symbol_id = None
        for candidate in ["Meter", "Meters", "M", "MSup1"]:
            if hasattr(SymbolTypeId, candidate):
                symbol_id = getattr(SymbolTypeId, candidate)
                break

        if symbol_id is not None:
            format_options.SetSymbolTypeId(symbol_id)
            symbol_note = "Symbol set to 'm'."
        else:
            format_options.SetSymbolTypeId(ForgeTypeId())
            symbol_note = "No 'm' symbol constant found; symbol left default/blank."

        # Zero-suppression formatting flags
        format_options.SuppressTrailingZeros = False
        format_options.SuppressLeadingZero = False

        # Apply formatting to Length spec and commit to document
        units.SetFormatOptions(SpecTypeId.Length, format_options)
        doc.SetUnits(units)

        OUT = "Success: Project length units set to Meters (3 decimal places). " + symbol_note

    except Exception as e:
        OUT = "Failed to set units: {}".format(str(e))

    finally:
        TransactionManager.Instance.TransactionTaskDone()
# ----------------------------------------
add_mwp_circle_head_survey_point = Python()  # CPython3; frozen; unwired: IN[0]
# ---------- add_mwp_circle_head_survey_point.python (75 lines) ----------
import clr

# Import Revit API
clr.AddReference("RevitAPI")
from Autodesk.Revit.DB import *

# Import Revit Services
clr.AddReference("RevitServices")
from RevitServices.Persistence import DocumentManager
from RevitServices.Transactions import TransactionManager

doc = DocumentManager.Instance.CurrentDBDocument

# Target Level Type name to check/create
target_type_name = "MWP_Circle Head - Survey point"
symbol_at_end_1 = IN[0] if IN[0] is not None else True  # Default to True/Checked

# Fetch all LevelTypes in the project
level_types = FilteredElementCollector(doc).OfClass(LevelType).ToElements()

# Helper function to get Element Name across Python versions
def get_elem_name(elem):
    param = elem.get_Parameter(BuiltInParameter.SYMBOL_NAME_PARAM)
    if param and param.HasValue:
        return param.AsString()
    try:
        return elem.get_Name()
    except AttributeError:
        return str(elem.Name)

# Check if target LevelType already exists
existing_type = None
for ltype in level_types:
    if get_elem_name(ltype) == target_type_name:
        existing_type = ltype
        break

# Start Revit Transaction
TransactionManager.Instance.EnsureInTransaction(doc)

out_message = ""

if existing_type:
    target_type = existing_type
    out_message = f"Level Type '{target_type_name}' already exists."
else:
    # Duplicate the first available Level Type as a template
    template_type = level_types[0]
    target_type = template_type.Duplicate(target_type_name)
    out_message = f"Level Type '{target_type_name}' created successfully."

# --- Apply Type Properties ---

# 1. Set "Symbol at End 1 Default"
param_end1 = target_type.get_Parameter(BuiltInParameter.DATUM_BUBBLE_END_1)
if not param_end1:
    param_end1 = target_type.LookupParameter("Symbol at End 1 Default")

if param_end1 and not param_end1.IsReadOnly:
    param_end1.Set(1 if symbol_at_end_1 else 0)

# 2. Set "Elevation Base" to Survey Point
param_base = target_type.get_Parameter(BuiltInParameter.LEVEL_RELATIVE_BASE_TYPE)
if not param_base:
    param_base = target_type.LookupParameter("Elevation Base")

if param_base and not param_base.IsReadOnly:
    # 0 = Project Base Point, 1 = Survey Point, 2 = Internal Origin
    param_base.Set(1)

# Commit Transaction
TransactionManager.Instance.TransactionTaskDone()

# Return result message and element
OUT = [out_message, target_type]
# ----------------------------------------
# note: Is a String, not a number
python_script = Python()  # CPython3; frozen; unwired: IN[0]
# ---------- python_script.python (79 lines) ----------
import clr

# Import Revit API
clr.AddReference("RevitAPI")
from Autodesk.Revit.DB import *

# Import Revit Services
clr.AddReference("RevitServices")
from RevitServices.Persistence import DocumentManager
from RevitServices.Transactions import TransactionManager

doc = DocumentManager.Instance.CurrentDBDocument

# Target Level Type name (Reads from IN[0] or defaults)
target_type_name = IN[0] if IN[0] else "MWP_Circle Head - Survey point"

# Helper function to safely get Element Name across Python versions
def get_elem_name(elem):
    param = elem.get_Parameter(BuiltInParameter.SYMBOL_NAME_PARAM)
    if param and param.HasValue:
        return param.AsString()
    try:
        return elem.get_Name()
    except AttributeError:
        return str(elem.Name)

# 1. Fetch all Level Types
level_types = FilteredElementCollector(doc).OfClass(LevelType).ToElements()

# Find existing target Level Type
target_type = None
for ltype in level_types:
    if get_elem_name(ltype) == target_type_name:
        target_type = ltype
        break

# Start Transaction
TransactionManager.Instance.EnsureInTransaction(doc)

# 2. Create Level Type if missing
if not target_type:
    template_type = level_types[0]
    target_type = template_type.Duplicate(target_type_name)

# 3. Configure Type Parameters for target Level Type
# Set Symbol at End 1 Default
param_end1 = target_type.get_Parameter(BuiltInParameter.DATUM_BUBBLE_END_1)
if not param_end1:
    param_end1 = target_type.LookupParameter("Symbol at End 1 Default")
if param_end1 and not param_end1.IsReadOnly:
    param_end1.Set(1)  # 1 = Checked

# Set Elevation Base to Survey Point (1 = Survey Point)
param_base = target_type.get_Parameter(BuiltInParameter.LEVEL_RELATIVE_BASE_TYPE)
if not param_base:
    param_base = target_type.LookupParameter("Elevation Base")
if param_base and not param_base.IsReadOnly:
    param_base.Set(1)

# 4. Find all Level instances and assign the new Type parameter directly
all_levels = FilteredElementCollector(doc).OfClass(Level).WhereElementIsNotElementType().ToElements()

updated_count = 0
for level in all_levels:
    if level.GetTypeId() != target_type.Id:
        # Use BuiltInParameter.ELEM_TYPE_PARAM to assign type ID safely in CPython3
        type_param = level.get_Parameter(BuiltInParameter.ELEM_TYPE_PARAM)
        if type_param and not type_param.IsReadOnly:
            type_param.Set(target_type.Id)
            updated_count += 1

# Commit Transaction
TransactionManager.Instance.TransactionTaskDone()

# Return summary output
OUT = [
    f"Target Type: '{target_type_name}' ready.",
    f"Successfully changed {updated_count} levels to '{target_type_name}'."
]
# ----------------------------------------
string = StringInput("MWP_Circle Head - Survey point")
pick_add_mwp_circle_head_survey = Python(IN[0]=boolean, IN[1]=string)  # "Pick - Add MWP_Circle Head - Survey point"; CPython3
# ---------- pick_add_mwp_circle_head_survey.python (81 lines) ----------
import clr

# Import Revit API
clr.AddReference("RevitAPI")
from Autodesk.Revit.DB import *

# Import Revit Services
clr.AddReference("RevitServices")
from RevitServices.Persistence import DocumentManager
from RevitServices.Transactions import TransactionManager

doc = DocumentManager.Instance.CurrentDBDocument

# Inputs
symbol_at_end_1 = IN[0] if IN[0] is not None else True
target_type_name = IN[1] if (len(IN) > 1 and IN[1]) else "MWP_Circle Head - Survey point"

# Helper function to safely get Element Name
def get_elem_name(elem):
    param = elem.get_Parameter(BuiltInParameter.SYMBOL_NAME_PARAM)
    if param and param.HasValue:
        return param.AsString()
    try:
        return elem.get_Name()
    except AttributeError:
        return str(elem.Name)

# 1. Fetch all Level Types
level_types = FilteredElementCollector(doc).OfClass(LevelType).ToElements()

target_type = None
for ltype in level_types:
    if get_elem_name(ltype) == target_type_name:
        target_type = ltype
        break

# Start Transaction
TransactionManager.Instance.EnsureInTransaction(doc)

# 2. Duplicate Level Type if missing
if not target_type:
    template_type = level_types[0]
    target_type = template_type.Duplicate(target_type_name)

# 3. Configure Type Parameters
param_end1 = target_type.get_Parameter(BuiltInParameter.DATUM_BUBBLE_END_1)
if not param_end1:
    param_end1 = target_type.LookupParameter("Symbol at End 1 Default")

if param_end1 and not param_end1.IsReadOnly:
    param_end1.Set(1 if symbol_at_end_1 else 0)

param_base = target_type.get_Parameter(BuiltInParameter.LEVEL_RELATIVE_BASE_TYPE)
if not param_base:
    param_base = target_type.LookupParameter("Elevation Base")

if param_base and not param_base.IsReadOnly:
    param_base.Set(1) # 1 = Survey Point

# 4. Fetch all Level elements in document and force Type assignment
all_levels = FilteredElementCollector(doc).OfClass(Level).WhereElementIsNotElementType().ToElements()

updated_count = 0
for elem in all_levels:
    # Ensure we are referencing the real document element
    level = doc.GetElement(elem.Id)
    
    if level.GetTypeId() != target_type.Id:
        # Set parameter directly on the element
        type_param = level.get_Parameter(BuiltInParameter.ELEM_TYPE_PARAM)
        if type_param and not type_param.IsReadOnly:
            type_param.Set(target_type.Id)
            updated_count += 1

# Commit Transaction
TransactionManager.Instance.TransactionTaskDone()

OUT = [
    f"Target Type: '{target_type_name}' configured.",
    f"Successfully updated {updated_count} out of {len(all_levels)} levels."
]
# ----------------------------------------

acquireSharedCoordinates_fixed = Python(IN[0]=revit)  # CPython3
# ---------- acquireSharedCoordinates_fixed.python (70 lines) ----------
import clr
import os

# Import Revit API
clr.AddReference("RevitAPI")
from Autodesk.Revit.DB import *

# Import Revit Services & Transaction Manager
clr.AddReference("RevitServices")
from RevitServices.Persistence import DocumentManager
from RevitServices.Transactions import TransactionManager

# Host Document & App
host_doc = DocumentManager.Instance.CurrentDBDocument

# Input: File Path string from IN[0]
file_path_str = IN[0]

output = {}

# Validate IN[0]: must be a non-blank string, a .rvt file, and must exist on disk
is_valid = False
if file_path_str is None:
    output["Error"] = "IN[0] is blank. Connect a File Path (string) to IN[0]."
elif not isinstance(file_path_str, str):
    output["Error"] = "IN[0] is the wrong format. Expected a string file path, got: " + str(type(file_path_str))
elif not file_path_str.strip():
    output["Error"] = "IN[0] is blank. Connect a File Path (string) to IN[0]."
elif not file_path_str.lower().endswith(".rvt"):
    output["Error"] = "IN[0] must point to a .rvt file. Got: " + file_path_str
elif not os.path.isfile(file_path_str):
    output["Error"] = "File not found on disk: " + file_path_str
else:
    is_valid = True

if is_valid:
    model_path = ModelPathUtils.ConvertUserVisiblePathToModelPath(file_path_str)

    TransactionManager.Instance.EnsureInTransaction(host_doc)

    try:
        # 1. Create/Load the RevitLinkType
        link_options = RevitLinkOptions(False)
        link_type_result = RevitLinkType.Create(host_doc, model_path, link_options)
        link_type_id = link_type_result.ElementId

        # 2. Place a temporary RevitLinkInstance in the host document.
        # RevitLinkInstance.Create only takes (Document, ElementId) - there is
        # no ImportPlacement overload. That mismatched signature was the error.
        link_instance = RevitLinkInstance.Create(host_doc, link_type_id)

        # 3. Acquire shared coordinates from the linked file
        host_doc.AcquireCoordinates(link_instance.Id)

        # 4. Clean up - remove the temporary link instance and link type so you
        # keep the acquired coordinate system without leaving a permanent link.
        host_doc.Delete(link_instance.Id)
        host_doc.Delete(link_type_id)

        TransactionManager.Instance.TransactionTaskDone()

        output["Status"] = "Coordinates successfully acquired from linked file!"

    except Exception as e:
        TransactionManager.Instance.TransactionTaskDone()
        output["Error"] = "Failed to create link or acquire coordinates: " + str(e)

# (if is_valid is False, output["Error"] was already set by the checks above)

OUT = output
# ----------------------------------------
watch_3 = Watch(acquireSharedCoordinates_fixed)
