# Dynamo graph C10.0 Civil3D_Attach_Image_Exact_Scale_V28.dyn (Dynamo 3.7.0.11777)
# Run the graph, pick any georeferenced TIF in the Open dialog, confirm the coordinate check, and the image is attached in Civil 3D at true position and scale (metres).

# group: 1 INPUTS
# Run the graph: an Open dialog asks for the TIF. Create = False only checks coordinates; Create = True checks, asks, then attaches.
layer_for_image = StringInput("AERIAL_IMAGE")  # graph input
create = BoolSelector(true)  # graph input

# group: 2 WRITE SCRIPT
# Reads the GeoTIFF and writes a .scr next to it.
write_scr_no_dialogs = Python(IN[0]=layer_for_image, IN[1]=create)  # CPython3
# ---------- write_scr_no_dialogs.python (315 lines) ----------
import os
import struct

# Civil 3D Dynamo (CPython3) - write an AutoCAD .scr that attaches a north-up
# georeferenced TIFF at exact position and scale. Uses no .NET libraries. Drawing units must be metres.
# IN[0] = layer name, IN[1] = Create (True attaches). The TIF is picked when the graph runs.

TYPE_SIZES = {1: 1, 2: 1, 3: 2, 4: 4, 5: 8, 6: 1, 7: 1, 8: 2, 9: 4, 10: 8, 11: 4, 12: 8, 16: 8}
TYPE_FMT = {1: 'B', 3: 'H', 4: 'I', 6: 'b', 8: 'h', 9: 'i', 11: 'f', 12: 'd', 16: 'Q'}


def tiff_info(path):
    with open(path, 'rb') as f:
        hdr = f.read(8)
        if hdr[:2] not in (b'II', b'MM'):
            raise ValueError('Not a TIFF file')
        bo = '<' if hdr[:2] == b'II' else '>'
        magic = struct.unpack(bo + 'H', hdr[2:4])[0]
        if magic == 43:
            raise ValueError('BigTIFF (>4 GB format) - AutoCAD cannot attach it. '
                             'Re-export as a standard TIFF or split into tiles.')
        if magic != 42:
            raise ValueError('Unsupported TIFF format')

        f.seek(struct.unpack(bo + 'I', hdr[4:8])[0])
        count = struct.unpack(bo + 'H', f.read(2))[0]
        tags = {}
        for _ in range(count):
            tag, typ, num, val = struct.unpack(bo + 'HHI4s', f.read(12))
            if typ not in TYPE_FMT:
                continue
            size = TYPE_SIZES[typ] * num
            if size > 4:
                here = f.tell()
                f.seek(struct.unpack(bo + 'I', val)[0])
                data = f.read(size)
                f.seek(here)
            else:
                data = val[:size]
            if len(data) == size:
                tags[tag] = struct.unpack(bo + TYPE_FMT[typ] * num, data)
    return tags


def geokeys(tags):
    """Return {keyid: value} for short-valued GeoKeys (tag 34735)."""
    d = tags.get(34735)
    out = {}
    if not d or len(d) < 4:
        return out
    n = d[3]
    for k in range(n):
        e = d[4 + 4 * k: 8 + 4 * k]
        if len(e) == 4 and e[1] == 0:
            out[e[0]] = e[3]
    return out


def world_file(path):
    base, ext = os.path.splitext(path)
    for name in (base + '.tfw', base + '.tifw', base + '.wld', path + 'w'):
        if os.path.isfile(name):
            with open(name) as f:
                v = [float(x) for x in f.read().split()]
            if len(v) < 6:
                raise ValueError('World file needs six numbers: ' + name)
            a, d, b, e, x, y = v[:6]
            if abs(b) > 1e-10 or abs(d) > 1e-10:
                raise ValueError('Rotated world file not supported')
            if a <= 0 or e >= 0:
                raise ValueError('Expected positive X and negative Y pixel size in world file')
            # world file references the CENTRE of the top-left pixel
            return x - a / 2.0, y - e / 2.0, a, -e, os.path.basename(name)
    return None


def georef(path, tags):
    keys = geokeys(tags)
    warnings = []
    if keys.get(1024) == 2:
        warnings.append('WARNING: GeoTIFF is in a GEOGRAPHIC CRS (lat/long degrees). '
                        'It will land near 0,0 at tiny size. Reproject to your metric grid '
                        '(e.g. ITM EPSG:2157) before attaching.')

    wf = world_file(path)
    if wf:
        left, top, sx, sy, src = wf
        return left, top, sx, sy, 'World file ' + src, warnings

    if 34264 in tags:
        m = tags[34264]
        if abs(m[1]) > 1e-12 or abs(m[4]) > 1e-12:
            raise ValueError('GeoTIFF is rotated (transform matrix) - not supported')
        sx, sy = m[0], -m[5]
        left, top = m[3], m[7]
        src = 'GeoTIFF transform matrix'
    elif 33550 in tags and 33922 in tags:
        sx, sy = tags[33550][:2]
        i, j, k, x, y, z = tags[33922][:6]
        left = x - i * sx
        top = y + j * sy
        src = 'GeoTIFF pixel scale + tiepoint'
    else:
        raise ValueError('No georeference found: TIFF has no GeoTIFF tags and no .tfw next to it')

    if sx <= 0 or sy <= 0:
        raise ValueError('Invalid GeoTIFF pixel scale')
    if keys.get(1025) == 2:  # RasterPixelIsPoint: tiepoint is pixel centre
        left -= sx / 2.0
        top += sy / 2.0
        src += ' (PixelIsPoint)'
    return left, top, sx, sy, src, warnings


def format_checks(tags):
    """AutoCAD only draws ordinary 1/8-bit bitonal, grey, palette or RGB(A) images."""
    bits = tags.get(258, (1,))
    spp = tags.get(277, (1,))[0]
    fmt = tags.get(339, (1,))[0]
    comp = tags.get(259, (1,))[0]
    photo = tags.get(262, (None,))[0]
    comp_names = {1: 'none', 5: 'LZW', 7: 'JPEG', 8: 'Deflate', 32946: 'Deflate',
                  32773: 'PackBits', 34887: 'LERC', 50000: 'ZSTD', 50001: 'WebP', 34925: 'LZMA'}
    desc = 'Format: {} band(s), {}-bit, sample type {}, compression {}'.format(
        spp, bits[0], {1: 'uint', 2: 'int', 3: 'float'}.get(fmt, fmt),
        comp_names.get(comp, comp))
    problems = []
    if fmt == 3:
        problems.append('32-bit FLOAT data (a DEM/analysis raster, not a picture)')
    elif max(bits) > 8:
        problems.append('{}-bit per band (AutoCAD needs 8-bit)'.format(max(bits)))
    if spp > 4 or (spp == 2):
        problems.append('{} bands (AutoCAD needs 1, 3 or 4)'.format(spp))
    if comp in (34887, 50000, 50001, 34925, 8, 32946):
        problems.append('{} compression may not be readable by AutoCAD'.format(comp_names[comp]))
    if photo == 6 and comp != 7:
        problems.append('YCbCr colour space')
    out = [desc]
    if problems:
        out.append('WARNING - AutoCAD will probably show an EMPTY or blank image: ' +
                   '; '.join(problems) + '. Re-export as 8-bit RGB, LZW or no compression '
                   '(QGIS: Export > Save As > Rendered image; GDAL: '
                   'gdal_translate -ot Byte -scale -co COMPRESS=LZW in.tif out.tif).')
    return out


CRS_NAMES = {2157: 'Irish Transverse Mercator (ITM)', 29902: 'Irish Grid (TM65)',
             29903: 'Irish Grid (TM75)', 27700: 'British National Grid',
             3857: 'Web Mercator', 4326: 'WGS84 lat/long'}


def crs_text(tags):
    keys = geokeys(tags)
    code = keys.get(3072) or keys.get(2048)
    if code and code != 32767:
        return 'Grid: EPSG:{} {}'.format(code, CRS_NAMES.get(code, ''))
    if keys:
        return 'Grid: user-defined in GeoTIFF (no EPSG code)'
    return 'Grid: not stated in file (world file only) - make sure it matches the drawing'


def position_checks(left, bottom, w, h):
    out = []
    if abs(left) < 1000 and abs(bottom) < 1000:
        out.append('WARNING: image sits near 0,0 - the TIF is probably NOT coordinated '
                   'to a real grid.')
    if w < 1 or h < 1:
        out.append('WARNING: image is under 1 m across - coordinates are probably degrees, not metres.')
    return out


def analyse(path):
    tags = tiff_info(path)
    if 256 not in tags or 257 not in tags:
        raise ValueError('TIFF missing width/height tags')
    cols = int(tags[256][0])
    rows = int(tags[257][0])
    left, top, sx, sy, src, warn = georef(path, tags)
    bottom = top - rows * sy
    w, h = cols * sx, rows * sy
    info = [
        'COORDINATES: OK - georeferenced',
        'Source: ' + src,
        crs_text(tags),
        'Pixels: {} x {}'.format(cols, rows),
        'Bottom-left: {:.3f}, {:.3f}'.format(left, bottom),
        'Top-right:   {:.3f}, {:.3f}'.format(left + w, top),
        'Size: {:.3f} m x {:.3f} m'.format(w, h),
        'Pixel size: X={:.6f}, Y={:.6f}'.format(sx, sy),
    ] + format_checks(tags) + warn + position_checks(left, bottom, w, h)
    return dict(left=left, bottom=bottom, width=w, height=h, sx=sx, sy=sy, info=info)


def lisp_str(t):
    return '"' + t.replace('\\', '/').replace('"', '') + '"'


def write_script(path, layer, g):
    x, y = g['left'], g['bottom']
    sx, sy = g['sx'], g['sy']
    x2, y2 = x + g['width'], y + g['height']
    lisp = (
        '(progn (vl-load-com)'
        ' (command "_.-LAYER" "_Thaw" {l} "_ON" {l} "_Make" {l} "")'
        ' (setvar "IMAGEFRAME" 1)'
        ' (setq ms (vla-get-ModelSpace (vla-get-ActiveDocument (vlax-get-acad-object))))'
        ' (setq img (vl-catch-all-apply (function vla-AddRaster)'
        ' (list ms {p} (vlax-3d-point {x:.6f} {y:.6f} 0.0) 1.0 0.0)))'
        ' (if (vl-catch-all-error-p img)'
        ' (princ (strcat "\\nERROR attaching image: " (vl-catch-all-error-message img)))'
        ' (progn'
        ' (vla-put-Layer img {l})'
        ' (setq e (vlax-vla-object->ename img) ed (entget e))'
        ' (setq ed (subst (list 10 {x:.6f} {y:.6f} 0.0) (assoc 10 ed) ed))'
        ' (setq ed (subst (list 11 {sx:.12f} 0.0 0.0) (assoc 11 ed) ed))'
        ' (setq ed (subst (list 12 0.0 {sy:.12f} 0.0) (assoc 12 ed) ed))'
        ' (entmod ed) (entupd e)'
        ' (command "_.ZOOM" "_Window" (list {x:.3f} {y:.3f}) (list {x2:.3f} {y2:.3f}))'
        ' (princ "\\nIMAGE ATTACHED AT EXACT SCALE")))'
        ' (princ))'
    ).format(p=lisp_str(path), l=lisp_str(layer), x=x, y=y, sx=sx, sy=sy, x2=x2, y2=y2)
    lines = [lisp]
    out = os.path.splitext(path)[0] + '_attach.scr'
    # plain ANSI, no BOM: a BOM breaks the first command of an AutoCAD script
    with open(out, 'w', encoding='mbcs' if os.name == 'nt' else 'latin-1', newline='\r\n') as f:
        f.write('\n'.join(lines) + '\n')
    return out


LAST_DIR_FILE = os.path.join(os.environ.get('APPDATA', os.path.expanduser('~')),
                             'C3D_AttachTif_lastfolder.txt')


def pick_tif():
    """Standard Windows Open dialog (comdlg32 via ctypes - no .NET, no tkinter)."""
    import ctypes
    from ctypes import wintypes

    class OPENFILENAMEW(ctypes.Structure):
        _fields_ = [('lStructSize', wintypes.DWORD), ('hwndOwner', wintypes.HWND),
                    ('hInstance', wintypes.HINSTANCE), ('lpstrFilter', ctypes.c_void_p),
                    ('lpstrCustomFilter', ctypes.c_void_p), ('nMaxCustFilter', wintypes.DWORD),
                    ('nFilterIndex', wintypes.DWORD), ('lpstrFile', ctypes.c_void_p),
                    ('nMaxFile', wintypes.DWORD), ('lpstrFileTitle', ctypes.c_void_p),
                    ('nMaxFileTitle', wintypes.DWORD), ('lpstrInitialDir', ctypes.c_void_p),
                    ('lpstrTitle', ctypes.c_void_p), ('Flags', wintypes.DWORD),
                    ('nFileOffset', wintypes.WORD), ('nFileExtension', wintypes.WORD),
                    ('lpstrDefExt', ctypes.c_void_p), ('lCustData', wintypes.LPARAM),
                    ('lpfnHook', ctypes.c_void_p), ('lpTemplateName', ctypes.c_void_p),
                    ('pvReserved', ctypes.c_void_p), ('dwReserved', wintypes.DWORD),
                    ('FlagsEx', wintypes.DWORD)]

    start = ''
    try:
        with open(LAST_DIR_FILE) as f:
            start = f.read().strip()
    except Exception:
        pass
    if not os.path.isdir(start):
        start = os.path.join(os.path.expanduser('~'), 'Documents')

    filt = ctypes.create_unicode_buffer('TIFF images (*.tif;*.tiff)\0*.tif;*.tiff\0All files (*.*)\0*.*\0\0')
    file_buf = ctypes.create_unicode_buffer(1024)
    init = ctypes.create_unicode_buffer(start)
    title = ctypes.create_unicode_buffer('Select the georeferenced TIF to attach')

    ofn = OPENFILENAMEW()
    ofn.lStructSize = ctypes.sizeof(OPENFILENAMEW)
    ofn.hwndOwner = ctypes.windll.user32.GetForegroundWindow()  # Dynamo / Player window
    ofn.lpstrFilter = ctypes.addressof(filt)
    ofn.nFilterIndex = 1
    ofn.lpstrFile = ctypes.addressof(file_buf)
    ofn.nMaxFile = 1024
    ofn.lpstrInitialDir = ctypes.addressof(init)
    ofn.lpstrTitle = ctypes.addressof(title)
    ofn.Flags = 0x00080000 | 0x00001000 | 0x00000800 | 0x00000008  # EXPLORER|FILEMUSTEXIST|PATHMUSTEXIST|NOCHANGEDIR

    if not ctypes.windll.comdlg32.GetOpenFileNameW(ctypes.byref(ofn)):
        return None
    path = file_buf.value
    try:
        with open(LAST_DIR_FILE, 'w') as f:
            f.write(os.path.dirname(path))
    except Exception:
        pass
    return path


def run():
    layer = str(IN[0] or 'AERIAL_IMAGE').strip() or 'AERIAL_IMAGE'
    try:
        path = pick_tif()
    except Exception as ex:
        return ['ERROR: could not open the file picker: ' + str(ex)]
    if not path:
        return ['CANCELLED: no TIF selected.']
    if not os.path.isfile(path):
        return ['ERROR: TIFF not found: ' + path]
    if not path.lower().endswith(('.tif', '.tiff')):
        return ['ERROR: Select a .tif or .tiff file']
    try:
        g = analyse(path)
        if not IN[1]:
            return ['File: ' + path] + g['info'] + ['Check only (Create = False) - nothing attached.']
        out = write_script(path, layer, g)
        return ['File: ' + path] + g['info'] + [
            'SCRIPT CREATED: ' + out,
            'Node 2 runs it automatically. If node 2 errors: type SCRIPT and pick this file.',
            'Running it again adds another copy of the image.',
        ]
    except Exception as ex:
        return ['ERROR: ' + str(ex)]


OUT = run()
# ----------------------------------------

# group: 3 RESULT
# Shows image extents, format warnings and the .scr path. In Civil 3D: SCRIPT > pick that file.
result = Watch(write_scr_no_dialogs)

# group: 4 CHECK + ATTACH
# Pops up the coordinate check. Yes = attach in Civil 3D, No = cancel.
check_coordinates_attach = Python(IN[0]=write_scr_no_dialogs)  # CPython3
# ---------- check_coordinates_attach.python (98 lines) ----------
# Shows a coordinate-check message in Civil 3D, then (on Yes) hands the SCRIPT
# command to the Civil 3D window via a Windows WM_COPYDATA message (no .NET).
# IN[0] = output list from the "Write .scr" node
import os
import ctypes
from ctypes import wintypes

user32 = ctypes.windll.user32
lines = [str(l) for l in (IN[0] if isinstance(IN[0], list) else [IN[0]])]
tag = 'SCRIPT CREATED: '
scr = None
for l in lines:
    if l.startswith(tag):
        scr = l[len(tag):]

MB_OK, MB_YESNO, IDYES = 0x0, 0x4, 6
ICON_ERR, ICON_Q, ICON_WARN, ICON_INFO = 0x10, 0x20, 0x30, 0x40
TOP = 0x40000 | 0x10000  # MB_TOPMOST | MB_SETFOREGROUND - never hidden behind windows


class COPYDATASTRUCT(ctypes.Structure):
    _fields_ = [('dwData', ctypes.c_size_t),
                ('cbData', wintypes.DWORD),
                ('lpData', ctypes.c_void_p)]


def find_cad_window():
    pid = os.getpid()
    found = []
    PROC = ctypes.WINFUNCTYPE(wintypes.BOOL, wintypes.HWND, wintypes.LPARAM)

    def cb(hwnd, lparam):
        p = wintypes.DWORD()
        user32.GetWindowThreadProcessId(hwnd, ctypes.byref(p))
        if p.value == pid and user32.IsWindowVisible(hwnd) and not user32.GetWindow(hwnd, 4):
            n = user32.GetWindowTextLengthW(hwnd)
            buf = ctypes.create_unicode_buffer(n + 1)
            user32.GetWindowTextW(hwnd, buf, n + 1)
            t = buf.value
            if 'Dynamo' not in t and ('Autodesk' in t or 'Civil 3D' in t or 'AutoCAD' in t):
                found.append((hwnd, t))
        return True

    user32.EnumWindows(PROC(cb), 0)
    return found[0] if found else (None, None)


def msg(text, title, flags, owner=None):
    return user32.MessageBoxW(owner, text, title, flags | TOP)


def send(hwnd, text):
    buf = ctypes.create_unicode_buffer(text)
    cds = COPYDATASTRUCT(1, ctypes.sizeof(buf), ctypes.cast(buf, ctypes.c_void_p))
    res = ctypes.c_size_t()
    user32.SendMessageTimeoutW.argtypes = [wintypes.HWND, wintypes.UINT, wintypes.WPARAM,
                                           wintypes.LPARAM, wintypes.UINT, wintypes.UINT,
                                           ctypes.POINTER(ctypes.c_size_t)]
    return bool(user32.SendMessageTimeoutW(hwnd, 0x004A, 0, ctypes.addressof(cds),
                                           0x0002, 3000, ctypes.byref(res)))


def run():
    hwnd, title = find_cad_window()
    report = '\n'.join(l for l in lines if not l.startswith(tag)
                       and not l.startswith('Node 2') and not l.startswith('Running it'))
    name = 'TIF coordinate check'

    if any(l.startswith('CANCELLED') for l in lines):
        return 'Cancelled - no TIF selected.'

    if any(l.startswith('ERROR') for l in lines):
        msg('This TIF can NOT be attached at real coordinates.\n\n' + report,
            name + ' - FAILED', MB_OK | ICON_ERR, hwnd)
        return 'Check failed - see message.'

    warned = any('WARNING' in l for l in lines)
    if not scr:
        msg(report, name, MB_OK | (ICON_WARN if warned else ICON_INFO), hwnd)
        return 'Checked only (Create = False).'

    head = ('Coordinates found, but check the warnings below.\n\n' if warned
            else 'The TIF is coordinated.\n\n')
    if msg(head + report + '\n\nAttach it to the drawing now?', name,
           MB_YESNO | (ICON_WARN if warned else ICON_Q), hwnd) != IDYES:
        return 'Cancelled - nothing attached. Script kept: ' + scr

    if not hwnd:
        return 'Could not find the Civil 3D window. Run it by hand: SCRIPT > ' + scr
    if send(hwnd, '(command "_.SCRIPT" "{}")\n'.format(scr.replace('\\', '/'))):
        return 'Sent to ' + title + ' - the image attaches when this run finishes.'
    return 'Civil 3D did not accept the message. Run it by hand: SCRIPT > ' + scr


try:
    OUT = run()
except Exception as ex:
    OUT = 'Auto-run failed ({}). Run it by hand: SCRIPT > {}'.format(ex, scr)
# ----------------------------------------
run_status = Watch(check_coordinates_attach)
