# Dynamo graph C11.0_Civil3D_Export_Profile_Endpoint_FIX_V2.dyn "C11.206 Civil3D_Export_Alignment_Selection_Diagnostics" (Dynamo 3.7.0.11777)
# Single/multiple XY+Z export. Multiple selection accepts alignments, profile views and layout profiles. Watch messages identify skipped profile types, alignments with no profiles and per-profile export results.
# packages: DynamoIronPython2.7 3.2.1

station_Interval = DoubleInput(0)  # graph input
# note: CIVIL 3D - XY + Z EXPORT
# Multiple selection switch:
# TRUE = window/crossing-select alignments, profile views or layout profiles.
# All layout profiles on each selected view's alignment are exported once.
# FALSE = click one layout profile curve (not the view grid).
# Station Interval:
# 0 = critical stations, including curve boundaries and interior samples.
# Positive value = also add regularly spaced stations in metres.
# Run, select, then choose an output folder.
# Each profile produces XY and Z reports with actual profile entities.
# Existing same-name reports in the chosen folder are replaced.
# Cancel selection or folder selection to stop without exporting.
# Output: profile names, Z paths, XY paths, messages.
# Watch messages now show selection, skip reasons and named export errors.
multiple_selection_true_single = BoolSelector(true)  # "Multiple selection (True) / Single profile (False)"; graph input
export_xy_z_single_or_multiple = Python(IN[0]=station_Interval, IN[1]=multiple_selection_true_single)  # IronPython2
# ---------- export_xy_z_single_or_multiple.python (592 lines) ----------
# C11.206 - single or multiple selection; actual profile entities
# Window-select Profile View(s); other selected objects are ignored.
# Exports ONLY Civil 3D UI Profile Type = Layout (API ProfileType.FG).
# Station_Interval = 0.0: geometry-critical stations only; >0: also regular stations.
# Output: [profile names, Z report paths, XY report paths, messages].

# ExportProfileReport v3.7 - Profile View Window Select - LAYOUT / API FG ONLY
import sys
import System
import clr
clr.AddReference('AcMgd')
clr.AddReference('AcDbMgd')
clr.AddReference('AcCoreMgd')
clr.AddReference('AeccDbMgd')
clr.AddReference('System.Windows.Forms')

import System.Windows.Forms as WinForms
import Autodesk.AutoCAD.ApplicationServices as AcAppServ
import Autodesk.AutoCAD.DatabaseServices as AcDb
import Autodesk.AutoCAD.EditorInput as AcEd
import Autodesk.Civil.ApplicationServices as CivAppServ
import Autodesk.Civil.DatabaseServices as CivDb


def _signedPlanRadius(radius, p0, pm, p1):
    # The receiving Revit graph expects left-positive, right-negative.
    # Infer orientation from actual XY geometry, not the unsigned API Radius.
    if any(v is None for p in (p0, pm, p1) for v in p):
        raise ValueError("Cannot determine arc direction: missing XY coordinates")
    cross = ((pm[0] - p0[0]) * (p1[1] - pm[1]) -
             (pm[1] - p0[1]) * (p1[0] - pm[0]))
    if abs(cross) < 1e-12:
        raise ValueError("Cannot determine arc direction: collinear arc samples")
    return abs(radius) if cross > 0.0 else -abs(radius)

def _arcPlanRadius(arc, pointAt, start, end):
    # Civil 3D stores direction on the arc itself. Short/near-straight arcs
    # can have collinear sampled coordinates at drawing precision.
    radius = abs(float(_safeProp(arc, "Radius")))
    try:
        clockwise = _safeProp(arc, "Clockwise")
    except Exception:
        # Compatibility fallback only when the native property is unavailable.
        return _signedPlanRadius(radius, pointAt(start),
                                 pointAt((start + end) * 0.5), pointAt(end))
    if clockwise is None:
        raise ValueError("Arc Clockwise property is unavailable at {0}-{1}".format(start, end))
    return -radius if bool(clockwise) else radius

def _reportStations(start, end, interval, segments, pvis):
    # Keep exact critical stations, even when a regular sample is very close.
    import math
    step = 3.0 if interval is None or interval == '' else float(interval)
    if math.isnan(step) or math.isinf(step) or step < 0.0:
        raise ValueError("Station_Interval must be finite and zero or positive")
    if end <= start:
        raise ValueError("Profile end station must exceed its start station")
    critical = [start, end]
    critical.extend(s for s, e in pvis if start < s < end)
    for a, b, kind, radius in segments:
        critical.extend(s for s in (a, b) if start < s < end)
        lo, hi = max(start, a), min(end, b)
        if kind == 'Arc' and hi > lo:
            critical.append((lo + hi) * 0.5)
    stations = []
    for s in sorted(critical):
        if not stations or s - stations[-1] > 1e-8:
            stations.append(s)
    if step > 0.0:
        count = int(math.ceil((end - start) / step))
        if count > 1000000:
            raise ValueError("Station_Interval would create over one million points")
        regular = [start + i * step for i in range(1, count)]
        import bisect
        for s in regular:
            k = bisect.bisect_left(stations, s)
            if s < end and (k == 0 or abs(s - stations[k-1]) > 1e-8) and (k == len(stations) or abs(stations[k] - s) > 1e-8):
                stations.insert(k, s)
    return stations

def _segmentAt(station, segments):
    # Outgoing segment owns a shared boundary: PC=Curve and PT=Line.
    for index, seg in enumerate(segments):
        a, b, kind, radius = seg
        if a - 1e-8 <= station < b - 1e-8:
            return seg
        if index == len(segments) - 1 and abs(station - b) <= 1e-8:
            return seg
    raise ValueError("No horizontal entity at station {0}".format(station))

stationInterval = IN[0]
multipleSelection = bool(IN[1]) if len(IN) > 1 else True

doc = AcAppServ.Application.DocumentManager.MdiActiveDocument
db = doc.Database
ed = doc.Editor

def _safeCall(obj, methodName, args=None):
    try:
        m = getattr(obj, methodName)
        return m(*(args or []))
    except AttributeError:
        mi = obj.GetType().GetMethod(methodName)
        if mi is None:
            raise
        if args:
            return mi.Invoke(obj, System.Array[object](args))
        return mi.Invoke(obj, None)

def _safeProp(obj, propName):
    try:
        return getattr(obj, propName)
    except AttributeError:
        pi = obj.GetType().GetProperty(propName)
        if pi is None:
            raise
        return pi.GetValue(obj, None)

def _safeIndex(obj, i):
    try:
        return obj[i]
    except (AttributeError, TypeError):
        mi = obj.GetType().GetMethod("get_Item")
        if mi is None:
            raise
        return mi.Invoke(obj, System.Array[object]([i]))

def _formatStation(station):
    sign = "-" if station < 0 else ""
    s = abs(station)
    major = int(s // 1000)
    minor = s - major * 1000
    return "{0}{1}+{2:06.2f}".format(sign, major, minor)

def _bearingString(dx, dy):
    ang = System.Math.Atan2(dx, dy)
    if ang < 0:
        ang += 2 * System.Math.PI
    degTotal = ang * 180.0 / System.Math.PI
    d = int(degTotal)
    remMin = (degTotal - d) * 60.0
    m = int(remMin)
    s = (remMin - m) * 60.0
    return "{0}\u00b0 {1}' {2:.3f}\"".format(d, m, s)

def _formatGradient(gradVal):
    if gradVal is None or gradVal == "":
        return ""
    return "{0:.2f} %".format(gradVal * 100)


# WINDOW-SELECTION VERSION v3.5 - PROFILE VIEW -> ALIGNMENT -> FG (UI "Layout")
# Civil 3D Properties displays design profiles as "Profile Type = Layout".
# In the .NET API the corresponding ProfileType enum member is FG (value 1), NOT "Layout".
# Window/crossing-select Profile View(s); extra selected objects are ignored.
profileIds = []
selectionNotes = []
selectedProfileViews = []
ignoredCount = 0


def _isLayoutProfile(pobj):
    try:
        pt = _safeProp(pobj, "ProfileType")
        # Civil 3D API: EG=0, FG=1, Superimposed=2, File=3,
        # CorridorFeature=4, OffsetProfile=6, CurbReturnProfile=7.
        # UI "Layout" == API FG.
        try:
            if int(pt) == 1:
                return True
        except Exception:
            pass
        s = str(pt).strip().lower()
        return s == "fg" or s.endswith(".fg")
    except Exception:
        return False


def _addProfileIfLayout(profileId, tr, sourceNote):
    pname = str(profileId)
    try:
        pobj = tr.GetObject(profileId, AcDb.OpenMode.ForRead)
        pname = str(_safeProp(pobj, "Name"))
        if not clr.GetClrType(CivDb.Profile).IsAssignableFrom(pobj.GetType()):
            selectionNotes.append("SKIPPED {}: not a profile; from {}".format(pname,sourceNote))
            return False
        if not _isLayoutProfile(pobj):
            selectionNotes.append("SKIPPED {}: ProfileType={} (only Layout/FG exported); from {}".format(pname,_safeProp(pobj,"ProfileType"),sourceNote))
            return False
        if profileId not in profileIds:
            profileIds.append(profileId)
            selectionNotes.append("SELECTED {}: from {}".format(pname,sourceNote))
        return True
    except Exception as ex:
        selectionNotes.append("SELECTION ERROR {} from {}: {}".format(pname,sourceNote,ex))
        return False

def _addAlignmentProfiles(alignment, tr, sourceNote):
    name = str(_safeProp(alignment,"Name"))
    pids = list(_safeCall(alignment,"GetProfileIds"))
    before = len(profileIds)
    if not pids:
        selectionNotes.append("NO PROFILES: alignment {} ({})".format(name,sourceNote))
    for pid in pids:
        _addProfileIfLayout(pid,tr,"alignment " + name + "; " + sourceNote)
    selectionNotes.append("ALIGNMENT {}: {} attached profiles; {} newly selected Layout profiles".format(name,len(pids),len(profileIds)-before))

def _selectExportObjects(editor, multiple):
    if multiple:
        options = AcEd.PromptSelectionOptions()
        options.MessageForAdding = "\nWINDOW/CROSSING select Alignments, Profile Views or layout profiles, then press ENTER: "
        result = editor.GetSelection(options)
        return list(result.Value.GetObjectIds()) if result.Status == AcEd.PromptStatus.OK else []
    options = AcEd.PromptEntityOptions("\nSelect ONE layout profile curve to export: ")
    options.SetRejectMessage("\nSelect a Civil 3D Profile curve, not the profile-view grid.")
    options.AddAllowedClass(clr.GetClrType(CivDb.Profile), True)
    result = editor.GetEntity(options)
    return [result.ObjectId] if result.Status == AcEd.PromptStatus.OK else []

selectedObjectIds = _selectExportObjects(ed, multipleSelection)
if selectedObjectIds:
    with db.TransactionManager.StartOpenCloseTransaction() as selTr:
        for oid in selectedObjectIds:
            try:
                obj = selTr.GetObject(oid, AcDb.OpenMode.ForRead)
                objType = obj.GetType()

                if clr.GetClrType(CivDb.ProfileView).IsAssignableFrom(objType):
                    selectedProfileViews.append(oid)
                    try:
                        pvName = str(_safeProp(obj, "Name"))
                    except Exception:
                        pvName = "Profile View"

                    # Robust route: ProfileView.AlignmentId -> Alignment.GetProfileIds().
                    # This avoids depending on GraphOverrides, which did not expose the
                    # profiles reliably in the previous version.
                    try:
                        alignmentId = _safeProp(obj, "AlignmentId")
                        alignment = selTr.GetObject(alignmentId, AcDb.OpenMode.ForRead)
                        _addAlignmentProfiles(alignment, selTr, "Profile View: " + pvName)
                    except Exception as ex:
                        selectionNotes.append("WARNING - could not read alignment profiles from {0}: {1}".format(pvName, ex))

                elif clr.GetClrType(CivDb.Alignment).IsAssignableFrom(objType):
                    _addAlignmentProfiles(obj, selTr, "direct alignment selection")
                elif clr.GetClrType(CivDb.Profile).IsAssignableFrom(objType):
                    # Directly selected profile is also allowed, but still only FG/Layout.
                    _addProfileIfLayout(oid, selTr, "direct selection")
                else:
                    ignoredCount += 1
            except Exception as ex:
                ignoredCount += 1
                selectionNotes.append("SELECTION ERROR for object {}: {}".format(oid,ex))
        selTr.Commit()

profileNames = []
entitiesReportPaths = []
stationsReportPaths = []
errors = []
if not profileIds:
    errors.append('No Layout profiles found. Civil 3D UI "Layout" corresponds to API ProfileType.FG (value 1). Single mode: select the layout profile curve. Multiple mode: window-select Profile Views or layout profiles. Other profile types are ignored.')
    errors.append("Selected Profile Views: {0}; ignored other objects: {1}".format(len(selectedProfileViews), ignoredCount))

if profileIds:
    defaultDir = System.IO.Path.GetDirectoryName(db.Filename)
    outDir = defaultDir
    folderDialog = WinForms.FolderBrowserDialog()
    folderDialog.Description = "Select ONE folder to save ALL Profile Report Excel files"
    folderDialog.SelectedPath = defaultDir
    if folderDialog.ShowDialog() == WinForms.DialogResult.OK and folderDialog.SelectedPath:
        outDir = folderDialog.SelectedPath
    else:
        profileIds = []
        errors.append("Cancelled - no output folder selected; no reports written.")

for profileId in profileIds:
    profileName = None
    entitiesReportPath = None
    stationsReportPath = None
    errorMsg = None
    reportErrors = []
    with db.TransactionManager.StartTransaction() as tr:
        try:
            profileEntity = tr.GetObject(profileId, AcDb.OpenMode.ForRead)
            profileName = profileEntity.Name
    
            alignmentId = _safeProp(profileEntity, "AlignmentId")
            alignmentEntity = tr.GetObject(alignmentId, AcDb.OpenMode.ForRead)
            alignmentName = _safeProp(alignmentEntity, "Name")
    
            pointLocationMethod = None
            for m in alignmentEntity.GetType().GetMethods():
                if m.Name == "PointLocation":
                    ps = m.GetParameters()
                    if len(ps) == 4 and ps[0].ParameterType.Name == "Double" and ps[1].ParameterType.Name == "Double":
                        pointLocationMethod = m
                        break
    
            def _pointAt(station):
                plArgs = System.Array[object]([station, 0.0, 0.0, 0.0])
                try:
                    pointLocationMethod.Invoke(alignmentEntity, plArgs)
                except Exception as invokeEx:
                    # .NET reflection wraps the real error as TargetInvocationException -
                    # unwrap InnerException to get the actual Civil3D message (e.g. a
                    # station outside the alignment's range) instead of the generic
                    # "Exception has been thrown by the target of an invocation."
                    inner = getattr(invokeEx, "InnerException", None)
                    detail = inner.Message if inner is not None else str(invokeEx)
                    reportErrors.append("PointLocation failed at station {0}: {1}".format(station, detail))
                    return None, None
                return float(plArgs[2]), float(plArgs[3])
    
            alignSegments = []
            try:
                alignEntities = _safeProp(alignmentEntity, "Entities")
                alignEntityCount = _safeProp(alignEntities, "Count")
                for i in range(alignEntityCount):
                    aEnt = _safeCall(alignEntities, "GetEntityByOrder", [i])
                    aTypeName = str(_safeProp(aEnt, "EntityType"))
                    aStart = float(_safeProp(aEnt, "StartStation"))
                    aEnd = float(_safeProp(aEnt, "EndStation"))
                    aRadius = None
                    if aTypeName == "Arc":
                        aRadius = _arcPlanRadius(aEnt, _pointAt, aStart, aEnd)
                    elif aTypeName != "Line":
                        raise ValueError("Unsupported horizontal entity: " + aTypeName)
                    alignSegments.append((aStart, aEnd, aTypeName, aRadius))
            except Exception as ex:
                raise ValueError("Alignment entities read failed: {0}".format(ex))
            alignSegments.sort(key=lambda seg: seg[0])
            if not alignSegments:
                raise ValueError("No horizontal alignment entities found")
            # Horizontal alignment limits.  A Civil 3D profile can occasionally
            # report a solved entity endpoint a tiny distance beyond these limits.
            # Trim profile geometry to the actual alignment extents so PointLocation
            # is never asked for an invalid station.
            alignStart = float(alignSegments[0][0])
            alignEnd = float(alignSegments[-1][1])
    
            def _alignInfoAt(station):
                aStart, aEnd, aTypeName, aRadius = _segmentAt(station, alignSegments)
                if aTypeName == "Arc":
                    return "Curve", "Arc", aRadius
                return "Line", "Line", "Infinity"

            # Read actual solved entities, never connect PVIs as a substitute.
            profileEntities = list(_safeProp(profileEntity, "Entities"))
            profileEntities.sort(key=lambda e: float(_safeProp(e, "StartStation")))
            if not profileEntities:
                raise ValueError("The selected profile has no solved entities")
            def optional(e, name, default=""):
                try: return _safeProp(e, name)
                except Exception: return default
            def _elevationAt(station):
                return float(_safeCall(profileEntity, "ElevationAt", [float(station)]))
            profileSegments = []
            for entity in profileEntities:
                rawS = float(_safeProp(entity, "StartStation"))
                rawT = float(_safeProp(entity, "EndStation"))
                kind = str(_safeProp(entity, "EntityType"))
                label = {"Tangent":"Tangent", "Circular":"Circular Curve",
                         "ParabolaSymmetric":"Parabolic Curve",
                         "ParabolaAsymmetric":"Asymmetric Parabolic Curve"}.get(kind)
                if label is None:
                    raise ValueError("Unsupported profile entity: " + kind)
                # Use only the portion for which the parent alignment has XY geometry.
                s = max(rawS, alignStart)
                t = min(rawT, alignEnd)
                if s > rawS + 1e-8 or t < rawT - 1e-8:
                    reportErrors.append("Trimmed profile entity {0} from {1}-{2} to alignment range {3}-{4}".format(
                        kind, rawS, rawT, s, t))
                if t - s <= 1e-9:
                    reportErrors.append("Skipped profile entity {0} outside/at alignment limit: {1}-{2}".format(kind, rawS, rawT))
                    continue
                profileSegments.append((s,t,label,entity))
            if not profileSegments:
                raise ValueError("No profile entities overlap the horizontal alignment range")
            startStation=profileSegments[0][0]
            endStation=profileSegments[-1][1]
            def _gradientAt(station):
                h=1e-6
                a=max(startStation,station-h); b=min(endStation,station+h)
                return (_elevationAt(b)-_elevationAt(a))/(b-a) if b>a else 0.0
            def _profileInfoAt(station):
                return _segmentAt(station,profileSegments)
            # Compatibility with the shared critical-station collector.
            pviList=[]
            for s,t,label,entity in profileSegments:
                pviList.extend([(s,_elevationAt(s)),(t,_elevationAt(t))])
                if label != "Tangent":
                    mid=(s+t)*0.5
                    pviList.append((mid,_elevationAt(mid)))
            pviList.sort()

            drawingName = System.IO.Path.GetFileNameWithoutExtension(db.Filename)
            safeName = "".join(c if c.isalnum() or c in " _-" else "_" for c in profileName)
            safeAlignName = "".join(c if c.isalnum() or c in " _-" else "_" for c in alignmentName)
            if not System.IO.Directory.Exists(outDir):
                System.IO.Directory.CreateDirectory(outDir)
    
            entitiesReportPath = System.IO.Path.Combine(outDir, "{0} - {1} - {2}z.xlsx".format(drawingName, safeAlignName, safeName))
            stationsReportPath = System.IO.Path.Combine(outDir, "{0} - {1} - {2}xy.xlsx".format(drawingName, safeAlignName, safeName))
    
            entHeader = ["Entity Index", "Entity Type", "Tangency Constraint", "Parameter Constraint", "Length",
                         "Start Station", "End Station", "Start Easting", "Start Northing", "Start Elevation",
                         "End Easting", "End Northing", "End Elevation", "Gradient In", "Gradient Out",
                         "A (Gradient Change)", "Curve Type", "Curve Radius", "K Value", "M Value",
                         "PVI Station", "PVI Elevation", "PVI Tangent Offset", "High/Low Point Station",
                         "High/Low Point Elevation", "Asymmetric Length 1", "Asymmetric Length 2",
                         "Through Point 1 Station", "Through Point 1 Elevation", "Through Point 2 Station",
                         "Through Point 2 Elevation", "Through Point 3 Station", "Through Point 3 Elevation",
                         "Gradient At Through Point 1", "Gradient At Through Point 2", "Highest Design Speed",
                         "Violations", "Start Design Speed", "End Design Speed"]
    
            entRows = []
            for i,(s1,s2,label,entity) in enumerate(profileSegments):
                east1,north1=_pointAt(s1); east2,north2=_pointAt(s2)
                if None in (east1,north1,east2,north2):
                    raise ValueError("Cannot locate profile entity endpoints")
                # Evaluate elevations at the exported (possibly trimmed) stations.
                e1=_elevationAt(s1)
                e2=_elevationAt(s2)
                # Safe gradient calculation - protects against zero-length profile entities
                segLength=abs(s2-s1)
                gi=optional(entity,"GradeIn",None)
                go=optional(entity,"GradeOut",None)
                if segLength > 1e-9:
                    h=min(1e-6,segLength*0.01)
                    if gi is None: gi=(_elevationAt(s1+h)-e1)/h
                    if go is None: go=(e2-_elevationAt(s2-h))/h
                else:
                    # Degenerate/zero-length solved profile entity
                    if gi is None: gi=_gradientAt(s1)
                    if go is None: go=gi
                gi=float(gi); go=float(go)
                rawradius=optional(entity,"Radius",None)
                curveType=("Sag" if go>gi else "Crest") if label!="Tangent" else ""
                signedradius=(-abs(float(rawradius)) if curveType=="Sag" else abs(float(rawradius))) if rawradius is not None else ""
                constraint=str(optional(entity,"Constraint2"))
                if "radius" in constraint.lower(): constraint="Radius"
                row=[i+1,label,str(optional(entity,"Constraint1")),constraint,
                     float(_safeProp(entity,"Length")),s1,s2,east1,north1,e1,
                     east2,north2,e2,_formatGradient(gi),_formatGradient(go),
                     _formatGradient(go-gi),curveType,signedradius,
                     optional(entity,"K"),optional(entity,"M")]
                row += [""]*(len(entHeader)-len(row))
                entRows.append(row)

            stnHeader = ["Point Index", "Station", "Easting", "Northing", "Elevation", "Bearing", "Alignment Radius",
                         "Entity Type", "Sub-Entity Type", "Gradient", "Profile Radius", "Profile Entity",
                         "Alignment Point Code", "Profile Point Code", "Design Speed", "Compare to",
                         "Compared Station", "Compared Easting", "Compared Northing", "Compared Elevation",
                         "Compared Offset (XY)", "Compared Offset (Z)", "Compared Slope", "Rail Pivot Type",
                         "Applied Cant", "Left Rail Elevation Difference", "Right Rail Elevation Difference",
                         "Alignment Sub-Entity Length", "Profile Entity Length"]
    
            stations = _reportStations(startStation, endStation, stationInterval,
                                       alignSegments, pviList)

            stnRows = []
            idx = 1
            for st in stations:
                elev = _elevationAt(st)
                grad = _gradientAt(st)
                east, north = _pointAt(st)
                east2, north2 = _pointAt(min(st + 0.01, endStation))
                if east is not None and north is not None and east2 is not None and north2 is not None:
                    bearing = _bearingString(east2 - east, north2 - north)
                else:
                    bearing = ""
    
                entType, subEntType, alignRadius = _alignInfoAt(st)
                pCode = "Start Point" if idx == 1 else ("End Point" if st == endStation else None)
                ps,pe,profileLabel,profileObject = _profileInfoAt(st)
                profileRadius=optional(profileObject,"Radius","Infinity")
                row = [idx, float(st),
                       (round(east, 4) if east is not None else ""), (round(north, 4) if north is not None else ""), elev,
                       bearing, alignRadius, entType, subEntType,
                       _formatGradient(grad), profileRadius, profileLabel,
                       ("PC" if any(abs(st - a) <= 1e-8 and kind == "Arc" for a, b, kind, r in alignSegments)
                        else "PT" if any(abs(st - b) <= 1e-8 and kind == "Arc" for a, b, kind, r in alignSegments)
                        else pCode), ("PVC" if profileLabel!="Tangent" and abs(st-ps)<1e-8 else pCode)]
                row += [""] * (len(stnHeader) - len(row))
                stnRows.append(row)
                idx += 1
    
            styleNameVal = "MWP-Existing Ground"
            allElevs = [e for _, e in pviList]
            summaryHeader = ["Alignment/Profile Name", "Description", "Object Style", "Type", "Site",
                             "Start Station", "End Station", "Length", "Entities", "Minimum Elevation",
                             "Maximum Elevation", "Offset", "Design Check Set", "Property Sets"]
            summaryValues = ["{0} - {1}".format(alignmentName, profileName), "<None>", styleNameVal, "Layout Profile", "<None>",
                             float(startStation), float(endStation),
                             round(endStation - startStation, 4), len(profileSegments),
                             round(min(allElevs), 3), round(max(allElevs), 3), 0, "", 0]
    
            excelType = System.Type.GetTypeFromProgID("Excel.Application")
            excelApp = System.Activator.CreateInstance(excelType)
            excelApp.Visible = False
            excelApp.DisplayAlerts = False
            try:
                def _writeWorkbook(path, sheetName, header, rows):
                    wb = excelApp.Workbooks.Add()
                    while wb.Worksheets.Count > 2:
                        wb.Worksheets[wb.Worksheets.Count].Delete()
                    while wb.Worksheets.Count < 2:
                        wb.Worksheets.Add(System.Reflection.Missing.Value, wb.Worksheets[wb.Worksheets.Count])
    
                    headerSheet = wb.Worksheets[1]
                    headerSheet.Name = "Report Header"
                    headerInfoRows = [
                        ["Drawing:", System.IO.Path.GetFileName(db.Filename)],
                        ["Drawing Path:", db.Filename],
                        ["Parent Alignment:", alignmentName],
                        ["Report Date:", System.DateTime.Now.ToString("dd/MM/yyyy")],
                        ["Reported By:", System.Environment.UserName],
                        ["Report Version:", "1.0 (-)"],
                    ]
                    for r in range(len(headerInfoRows)):
                        headerSheet.Cells(r + 1, 1).Value2 = headerInfoRows[r][0]
                        headerSheet.Cells(r + 1, 2).Value2 = headerInfoRows[r][1]
                    headerSheet.Columns.AutoFit()
    
                    sheet = wb.Worksheets[2]
                    sheet.Name = sheetName[:31]
    
                    sheet.Cells(1, 1).Value2 = profileName
                    sheet.Cells(1, 1).Font.Bold = True
    
                    summaryLabelRange = sheet.Range(sheet.Cells(2, 1), sheet.Cells(2, len(summaryHeader)))
                    summaryLabelRange.Value2 = System.Array[object](summaryHeader)
                    summaryLabelRange.Font.Bold = True
    
                    summaryValueRange = sheet.Range(sheet.Cells(3, 1), sheet.Cells(3, len(summaryValues)))
                    summaryValueRange.Value2 = System.Array[object](summaryValues)
    
                    tableTopRow = 6
                    headerRange = sheet.Range(sheet.Cells(tableTopRow, 1), sheet.Cells(tableTopRow, len(header)))
                    headerRange.Value2 = System.Array[object](header)
                    headerRange.Font.Bold = True
    
                    if rows:
                        dataArr = System.Array.CreateInstance(object, len(rows), len(header))
                        for r in range(len(rows)):
                            for c in range(len(header)):
                                dataArr[r, c] = rows[r][c]
                        dataRange = sheet.Range(sheet.Cells(tableTopRow + 1, 1), sheet.Cells(tableTopRow + len(rows), len(header)))
                        dataRange.Value2 = dataArr
    
                    sheet.Columns.AutoFit()
                    if System.IO.File.Exists(path):
                        System.IO.File.Delete(path)
                    wb.SaveAs(path, 51)
                    wb.Close(False)
    
                _writeWorkbook(entitiesReportPath, profileName, entHeader, entRows)
                _writeWorkbook(stationsReportPath, profileName, stnHeader, stnRows)
            finally:
                excelApp.Quit()
    
            if reportErrors:
                errorMsg = "Completed with warnings: " + "; ".join(reportErrors)
    
            tr.Commit()
        except Exception as ex:
            excType, excValue, excTb = sys.exc_info()
            lineNo = excTb.tb_lineno if excTb is not None else -1
            # Unwrap .NET's InnerException chain - a bare reflection/COM wrapper
            # message ("Exception has been thrown by the target of an invocation")
            # hides the real cause, which lives one or more levels down.
            detailParts = [str(excValue)]
            innerEx = getattr(excValue, "InnerException", None)
            while innerEx is not None:
                detailParts.append("Inner: " + str(innerEx.Message))
                innerEx = getattr(innerEx, "InnerException", None)
            errorMsg = "Line {0}: {1}: {2}".format(lineNo, excType, " | ".join(detailParts))
            if reportErrors:
                errorMsg += " | Warnings: " + "; ".join(reportErrors)
            entitiesReportPath = None
            stationsReportPath = None
            tr.Abort()
    profileNames.append(profileName)
    entitiesReportPaths.append(entitiesReportPath)
    stationsReportPaths.append(stationsReportPath)
    errors.append("{} | {}".format(profileName, errorMsg or "SUCCESS: XY and Z reports saved"))

if not profileIds:
    errors.append("No profiles selected.")

OUT = profileNames, entitiesReportPaths, stationsReportPaths, errors + selectionNotes
# ----------------------------------------
watch = Watch(export_xy_z_single_or_multiple)
