# Dynamo graph C12.01_Civil3D_Add_Profile_SagCrest_Curves_TABLE_MANUAL_v7 .dyn "C12.01_Add_Profile_SagCrest_Curves_TABLE_MANUAL_v7 (1)" (Dynamo 3.7.0.11777)
# Select a Civil 3D Profile, choose duct/cable from embedded Profile Elements table, and add sag/crest curves using the selected table radius.
# packages: DynamoIronPython2.7 3.2.1

# note: Dynamo for Civil 3D - Python Script node (engine: IronPython2)
# NOTE: IronPython2, not CPython3 - touching Application.DocumentManager /
# Autodesk.Civil.DatabaseServices pulls in Autodesk.AutoCAD.Interop, which
# Dynamo's CPython3 (pythonnet) engine cannot load in this Civil3D build
# ("Could not load type ... AcWindowState ..."). IronPython2's native CLR
# hosting resolves it fine - same reason every other Civil3D-API script in
# this repo (Add_MWP-NEZ_ChainageLevel_Labels.py, Diagnose_Civil3D_Styles.py)
# uses IronPython2.
# Prompts you to select one or more Profile Views on screen. For every design
# (layout) profile plotted in each selected view, walks every PVI that is
# currently a plain tangent-tangent break (no curve yet) and inserts a
# symmetric parabolic vertical curve there - EditSagCurve() where the grade
# increases through the PVI (valley), EditCrestCurve() where it decreases
# (hilltop) - sized from a single curve radius R (m):
#     curve length L = R x |grade_out - grade_in|
# with grade_out/grade_in as decimal fractions (e.g. 0.03 for 3%). That is R
# as used for "VC RAD" on Irish/UK road longitudinal-section drawings, not an
# AASHTO K value expressed in percent (K = R / 100 in that convention).
# Confirmed against Civil3D's own native Insert PVI / Curve Settings dialog
# (entering a Radius and reading back the resulting Length/K value).
# If that ideal length won't fit between the PVI and its neighbour (i.e. the
# PVI's tangent on that side is shorter than L/2), the length is CLIPPED to
# 2 x the shorter available tangent, matching what Civil3D's own dialog does
# in the same situation (confirmed against a native example where Radius 3.4
# produced Length 3.310 - not R x delta - because the neighbouring PVI didn't
# leave enough room; Civil3D shows K Value 0.000 for a curve clipped like
# this, since it no longer corresponds to the requested radius). A clipped
# curve is still added and counted as a success, just flagged in the report
# with the ideal length it couldn't reach.
# PVIs where the grade doesn't actually break (|delta grade| below
# minGradeBreak) are left alone and reported as skipped. Every other interior
# PVI just gets Profile.Entities.AddFreeSymmetricParabolaByRadius called on it directly, inside its
# own try/except - a PVI that's already curved, or can't fit the requested
# radius (curve longer than the available tangent to its neighbour), throws
# from that call and is reported as a failure with Civil3D's own message,
# rather than pre-checked. (Deliberate: this OEM build's ProfilePVI.PVIType
# getter returns null for an ordinary uncurved PVI instead of throwing or
# returning TangentWithoutCurve, the same broken-managed-property pattern as
# the .Name getters documented in Add_MWP-NEZ_ChainageLevel_Labels_HELP.md -
# so pre-checking PVIType here misclassified every plain PVI as "already
# curved" and skipped the whole profile. Letting the Profile entity API itself
# decide sidesteps that.)

manual_curve_radius_r_m_used = DoubleInput(3.4)  # "Manual Curve Radius R (m) - used when True"; graph input
min_grade_break_decimal = DoubleInput(0)  # graph input
use_manual_radius_false_table = BoolSelector(false)  # "Use Manual Radius? False=Table / True=Manual"; graph input
add_profile_sag_crest_curves = Python(IN[0]=manual_curve_radius_r_m_used, IN[1]=min_grade_break_decimal, IN[2]=use_manual_radius_false_table)  # IronPython2
# ---------- add_profile_sag_crest_curves.python (316 lines) ----------
"""
Dynamo for Civil 3D - Python Script node (engine: IronPython2)

NOTE: IronPython2, not CPython3 - touching Application.DocumentManager /
Autodesk.Civil.DatabaseServices pulls in Autodesk.AutoCAD.Interop, which
Dynamo's CPython3 (pythonnet) engine cannot load in this Civil3D build
("Could not load type ... AcWindowState ..."). IronPython2's native CLR
hosting resolves it fine - same reason every other Civil3D-API script in
this repo (Add_MWP-NEZ_ChainageLevel_Labels.py, Diagnose_Civil3D_Styles.py)
uses IronPython2.

Prompts you to select one or more Profile Views on screen. For every design
(layout) profile plotted in each selected view, walks every PVI that is
currently a plain tangent-tangent break (no curve yet) and inserts a
symmetric parabolic vertical curve there - EditSagCurve() where the grade
increases through the PVI (valley), EditCrestCurve() where it decreases
(hilltop) - sized from a single curve radius R (m):

    curve length L = R x |grade_out - grade_in|

with grade_out/grade_in as decimal fractions (e.g. 0.03 for 3%). That is R
as used for "VC RAD" on Irish/UK road longitudinal-section drawings, not an
AASHTO K value expressed in percent (K = R / 100 in that convention).
Confirmed against Civil3D's own native Insert PVI / Curve Settings dialog
(entering a Radius and reading back the resulting Length/K value).

If that ideal length won't fit between the PVI and its neighbour (i.e. the
PVI's tangent on that side is shorter than L/2), the length is CLIPPED to
2 x the shorter available tangent, matching what Civil3D's own dialog does
in the same situation (confirmed against a native example where Radius 3.4
produced Length 3.310 - not R x delta - because the neighbouring PVI didn't
leave enough room; Civil3D shows K Value 0.000 for a curve clipped like
this, since it no longer corresponds to the requested radius). A clipped
curve is still added and counted as a success, just flagged in the report
with the ideal length it couldn't reach.

PVIs where the grade doesn't actually break (|delta grade| below
minGradeBreak) are left alone and reported as skipped. Every other interior
PVI just gets Profile.Entities.AddFreeSymmetricParabolaByRadius called on it directly, inside its
own try/except - a PVI that's already curved, or can't fit the requested
radius (curve longer than the available tangent to its neighbour), throws
from that call and is reported as a failure with Civil3D's own message,
rather than pre-checked. (Deliberate: this OEM build's ProfilePVI.PVIType
getter returns null for an ordinary uncurved PVI instead of throwing or
returning TangentWithoutCurve, the same broken-managed-property pattern as
the .Name getters documented in Add_MWP-NEZ_ChainageLevel_Labels_HELP.md -
so pre-checking PVIType here misclassified every plain PVI as "already
curved" and skipped the whole profile. Letting the Profile entity API itself
decide sidesteps that.)

Inputs:
  Runtime dropdown: duct/cable selection from P02_Detail Summary.xlsx Profile Elements Table; its Curve Radius is used.
  IN[0] : manual curve radius in metres (used when IN[2] = True)
  IN[1] : minimum grade break to treat as a real PVI, decimal fraction
          (number, default 0.0001 = 0.01%)
  IN[2] : manual radius override (Boolean): False = TABLE dropdown, True = IN[0]

Output:
  OUT   : list[str] run report - one line per PVI processed/skipped, plus
          per-profile and grand totals
"""
import clr
from System import Array

clr.AddReference('AcMgd')
clr.AddReference('AcCoreMgd')
clr.AddReference('AcDbMgd')
clr.AddReference('AeccDbMgd')
clr.AddReference('System.Windows.Forms')
clr.AddReference('System.Drawing')

from Autodesk.AutoCAD.ApplicationServices import Application
from Autodesk.AutoCAD.DatabaseServices import OpenMode
from Autodesk.AutoCAD.EditorInput import PromptSelectionOptions
from Autodesk.Civil.ApplicationServices import CivilDocument
from Autodesk.Civil.DatabaseServices import ProfileView, Profile, VerticalCurveType
from System.Windows.Forms import Form, Label, ComboBox, Button, DialogResult, FormStartPosition, ComboBoxStyle
from System.Drawing import Point, Size

# Embedded lookup updated from P02_Detail Summary.xlsx -> Profile Elements Table.
# Tuple: (No., Duct / Cable, PRACTICAL Curve Radius in metres).
#
# TABLE NOTE - Profile Elements recommended practical design radii:
#  01  40mm E-DUCT                                      R = 1.500 m
#  02  50mm E-DUCT / E-DUCT_EARTH                      R = 1.500 m
#  03  63mm E-DUCT_SDR17.6                              R = 2.000 m
#  04  110mm E-DUCT_SDR17.6 / COMMS_SDR17.6             R = 3.000 m
#  05  125mm E-DUCT_SDR17.6 / COMMS / ECC_SDR17.6       R = 3.500 m
#  06  125mm E-DUCT_HDD_SDR11                            R = 3.500 m
#  07  140mm E-DUCT_COMMS_HDD_SDR11                      R = 3.500 m
#  08  160mm E-DUCT_SDR21                                R = 4.500 m
#  09  180mm E-DUCT_HDD_SDR11                            R = 4.500 m
#  10  200mm E-DUCT_SDR21                                R = 5.500 m
#  11-14 Project direct-buried HV cable rows             R = 2.500 m
#  15-21 Generic direct-buried cable rows                R = NOT SET (0.000 m)
#
# Source notes carried into this script:
# - Use the PRACTICAL design radius; do not enter a smaller radius in Civil 3D.
# - K Value = Curve Radius / 100.
# - Profile Curve Length in the spreadsheet is only a representative placeholder;
#   Civil 3D derives the actual length from radius and the real PVI grade change.
# - Profile Curve Type and asymmetric lengths are per-PVI values.
# - Generic/reference rows with radius 0 must be confirmed before use.
PROFILE_RADIUS_TABLE = [
    (1,  '40mm E-DUCT', 1.500),
    (2,  '50mm E-DUCT / E-DUCT_EARTH', 1.500),
    (3,  '63mm E-DUCT_SDR17.6', 2.000),
    (4,  '110mm E-DUCT_SDR17.6 / COMMS_SDR17.6', 3.000),
    (5,  '125mm E-DUCT_SDR17.6 / COMMS / ECC_SDR17.6', 3.500),
    (6,  '125mm E-DUCT_HDD_SDR11', 3.500),
    (7,  '140mm E-DUCT_COMMS_HDD_SDR11', 3.500),
    (8,  '160mm E-DUCT_SDR21', 4.500),
    (9,  '180mm E-DUCT_HDD_SDR11', 4.500),
    (10, '200mm E-DUCT_SDR21', 5.500),
    (11, 'Direct buried HV cable - 1c x 2000mm2 Aluminium HV (Incoming feed, Energinet -> FRD2A/C (L1/L2/L3))', 2.500),
    (12, 'Direct buried HV cable - 1c x 2000mm2 Aluminium HV (Incoming feed, Energinet -> FRD2A/D (L1/L2/L3))', 2.500),
    (13, 'Direct buried HV cable - 1c x 800mm2 Aluminium HV (Outgoing feed, FRD2A/C -> FRD1A/B (L1/L2/L3))', 2.500),
    (14, 'Direct buried HV cable - 1c x 800mm2 Aluminium HV (Outgoing feed, FRD2A/D -> FRD1A/A (L1/L2/L3))', 2.500),
    (15, 'Direct buried cable (generic) - Unarmoured multicore cable, OD <= 25mm', 0.0),
    (16, 'Direct buried cable (generic) - Unarmoured multicore cable, 25mm < OD <= 50mm', 0.0),
    (17, 'Direct buried cable (generic) - Unarmoured multicore cable, OD > 50mm', 0.0),
    (18, 'Direct buried cable (generic) - Armoured (SWA) multicore cable', 0.0),
    (19, 'Direct buried cable (generic) - Single-core cable (armoured or unarmoured)', 0.0),
    (20, 'Direct buried cable (generic) - Individually shielded / overall-shielded cable', 0.0),
    (21, 'Direct buried cable (generic) - Lead-sheathed cable', 0.0)
]

def choose_radius_from_table():
    form = Form()
    form.Text = 'Select Duct / Cable - Vertical Curve Radius'
    form.Size = Size(900, 245)
    form.StartPosition = FormStartPosition.CenterScreen
    form.TopMost = True

    lbl = Label()
    lbl.Text = 'Select duct / cable from P02 Detail Summary - Profile Elements Table:'
    lbl.Location = Point(15, 15)
    lbl.Size = Size(840, 20)
    form.Controls.Add(lbl)

    combo = ComboBox()
    combo.Location = Point(15, 42)
    combo.Size = Size(850, 25)
    combo.DropDownStyle = ComboBoxStyle.DropDownList
    for no, name, r in PROFILE_RADIUS_TABLE:
        if r > 0:
            combo.Items.Add('{:02d} | {} | R = {:.3f} m'.format(no, name, r))
        else:
            combo.Items.Add('{:02d} | {} | R = NOT SET'.format(no, name))
    combo.SelectedIndex = 0
    form.Controls.Add(combo)

    note = Label()
    note.Text = 'NOTE: Radius values are PRACTICAL design radii from the table. Do not use a smaller radius. Rows showing NOT SET must be confirmed before use.'
    note.Location = Point(15, 76)
    note.Size = Size(850, 40)
    form.Controls.Add(note)

    ok = Button()
    ok.Text = 'Use selected radius'
    ok.Location = Point(570, 135)
    ok.Size = Size(145, 30)
    ok.DialogResult = DialogResult.OK
    form.AcceptButton = ok
    form.Controls.Add(ok)

    cancel = Button()
    cancel.Text = 'Cancel'
    cancel.Location = Point(725, 135)
    cancel.Size = Size(140, 30)
    cancel.DialogResult = DialogResult.Cancel
    form.CancelButton = cancel
    form.Controls.Add(cancel)

    result = form.ShowDialog()
    if result != DialogResult.OK or combo.SelectedIndex < 0:
        return None
    return PROFILE_RADIUS_TABLE[combo.SelectedIndex]

# Radius source control:
# IN[2] = False -> choose radius from embedded Profile Elements table.
# IN[2] = True  -> bypass dropdown and use manual radius from IN[0] (metres).
use_manual_radius = bool(IN[2]) if (len(IN) > 2 and IN[2] is not None) else False
manual_radius = float(IN[0]) if (len(IN) > 0 and IN[0] is not None) else None

selected_table_item = None if use_manual_radius else choose_radius_from_table()
if use_manual_radius:
    radius = manual_radius
    selected_description = 'Manual radius override'
    selected_no = None
else:
    radius = selected_table_item[2] if selected_table_item is not None else None
    selected_description = selected_table_item[1] if selected_table_item is not None else None
    selected_no = selected_table_item[0] if selected_table_item is not None else None

minGradeBreak = float(IN[1]) if (len(IN) > 1 and IN[1] is not None) else 0.0001

report = []

if use_manual_radius and (radius is None or radius <= 0):
    report.append('ERROR: MANUAL mode is TRUE but IN[0] manual radius must be greater than 0.000 m - nothing done.')
elif (not use_manual_radius) and selected_table_item is None:
    report.append('Cancelled - no duct/cable selected, nothing done.')
elif not radius or radius <= 0:
    report.append("ERROR: selected table row {} '{}' has no Curve Radius set - nothing done.".format(selected_no, selected_description))
else:
    if use_manual_radius:
        report.append("RADIUS SOURCE: MANUAL | IN[0] Curve Radius R={:.3f} m".format(radius))
    else:
        report.append("RADIUS SOURCE: TABLE | No. {} | {} | Curve Radius R={:.3f} m".format(selected_no, selected_description, radius))
    doc = Application.DocumentManager.MdiActiveDocument
    db = doc.Database
    ed = doc.Editor

    opts = PromptSelectionOptions()
    opts.MessageForAdding = "Select design Profile line(s) to add sag/crest curves to: "
    selResult = ed.GetSelection(opts)

    if str(selResult.Status) != "OK" or selResult.Value is None or selResult.Value.Count == 0:
        report.append("No profiles selected - nothing done.")
    else:
        grandCurves = 0
        grandSkipped = 0
        grandErrors = 0
        validProfiles = 0

        with doc.LockDocument():
            with db.TransactionManager.StartTransaction() as tr:
                for selObj in selResult.Value:
                    profId = selObj.ObjectId
                    try:
                        profile = tr.GetObject(profId, OpenMode.ForWrite)
                        if not isinstance(profile, Profile):
                            try: clsName = profile.GetType().FullName
                            except Exception: clsName = profile.GetRXClass().Name
                            report.append("Skipped selected object {} - API type is {} (not Profile).".format(profId.Handle.ToString(), clsName))
                            continue
                    except Exception as ex:
                        report.append("Could not open selected object {} as a Profile: {}".format(profId.Handle.ToString(), str(ex)))
                        continue

                    validProfiles += 1
                    try:
                        prof_name = profile.AcadObject.Name
                    except Exception:
                        prof_name = profId.Handle.ToString()
                    label = "'{}'".format(prof_name)

                    try:
                        pvis = profile.PVIs
                        count = pvis.Count
                    except Exception as ex:
                        report.append("{}: profile has no editable PVI collection - {}".format(label, str(ex)))
                        grandErrors += 1
                        continue
                    if count < 3:
                        report.append("{}: fewer than 3 PVIs - nothing to curve".format(label))
                        grandSkipped += 1
                        continue

                    # Snapshot the PVI data and the IDs of the profile entities on each side.
                    # Civil 3D 2027 creates vertical curves through Profile.Entities, not Profile.PVIs.
                    work = []
                    for i in range(1, count - 1):
                        pvi = pvis[i]
                        try:
                            sta = pvi.Station
                            elev = pvi.Elevation
                            gradeIn = pvi.GradeIn
                            gradeOut = pvi.GradeOut
                            beforeId = pvi.EntityBefore
                            afterId = pvi.EntityAfter
                            work.append((i, sta, elev, gradeIn, gradeOut, beforeId, afterId))
                        except Exception as ex:
                            report.append("  {} PVI {}: could not read PVI/entity links - {}".format(label, i+1, str(ex)))

                    madeHere = skippedHere = errorsHere = 0
                    entities = profile.Entities

                    # Work from the end of the profile backwards so adding a curve does not
                    # disturb entity relationships still to be processed upstream.
                    for item in reversed(work):
                        i, sta, elev, gradeIn, gradeOut, beforeId, afterId = item
                        delta = gradeOut - gradeIn
                        if abs(delta) < minGradeBreak:
                            skippedHere += 1
                            report.append("  {} sta {:.3f}: grade break {:+.3f}% below threshold - skipped".format(label, sta, delta*100.0))
                            continue

                        kind = "SAG" if delta > 0 else "CREST"
                        curveType = VerticalCurveType.Sag if delta > 0 else VerticalCurveType.Crest
                        try:
                            curve = entities.AddFreeSymmetricParabolaByRadius(
                                beforeId, afterId, curveType, radius)
                            madeHere += 1
                            try:
                                actualLen = curve.Length
                                report.append("  {} sta {:.3f}: {} added, R={:.3f} m, L={:.3f} m".format(label, sta, kind, radius, actualLen))
                            except Exception:
                                report.append("  {} sta {:.3f}: {} added, R={:.3f} m".format(label, sta, kind, radius))
                        except Exception as ex:
                            errorsHere += 1
                            report.append("  {} sta {:.3f}: could not add {} curve R={:.3f} m - {}".format(label, sta, kind, radius, str(ex)))

                    report.append("{}: {} curve(s) added, {} skipped, {} failed".format(label, madeHere, skippedHere, errorsHere))
                    grandCurves += madeHere
                    grandSkipped += skippedHere
                    grandErrors += errorsHere
                tr.Commit()

        ed.Regen()
        if validProfiles == 0:
            report.append("No valid Civil 3D Profiles were found in the selection.")
        report.append("TOTAL: {} curve(s) added, {} skipped, {} failed".format(grandCurves, grandSkipped, grandErrors))

OUT = report
# ----------------------------------------
# note: Duct / Cable	No.	Profile Curve Type	Profile Curve Length	K Value	Curve Radius
# 40mm E-DUCT	1		0.052	0.015	1.500
# 50mm E-DUCT / E-DUCT_EARTH	2		0.052	0.015	1.500
# 63mm E-DUCT_SDR17.6	3		0.070	0.020	2.000
# 110mm E-DUCT_SDR17.6 / COMMS_SDR17.6	4		0.105	0.030	3.000
# 125mm E-DUCT_SDR17.6 / COMMS / ECC_SDR17.6	5		0.122	0.035	3.500
# 125mm E-DUCT_HDD_SDR11	6		0.122	0.035	3.500
# 140mm E-DUCT_COMMS_HDD_SDR11	7		0.122	0.035	3.500
# 160mm E-DUCT_SDR21	8		0.157	0.045	4.500
# 180mm E-DUCT_HDD_SDR11	9		0.157	0.045	4.500
# 200mm E-DUCT_SDR21	10		0.192	0.055	5.500
# Direct buried HV cable — 1c x 2000mm² Aluminium HV (Incoming feed, Energinet → FRD2A/C (L1/L2/L3))	11		0.087	0.025	2.500
# Direct buried HV cable — 1c x 2000mm² Aluminium HV (Incoming feed, Energinet → FRD2A/D (L1/L2/L3))	12		0.087	0.025	2.500
# Direct buried HV cable — 1c x 800mm² Aluminium HV (Outgoing feed, FRD2A/C → FRD1A/B (L1/L2/L3))	13		0.087	0.025	2.500
# Direct buried HV cable — 1c x 800mm² Aluminium HV (Outgoing feed, FRD2A/D → FRD1A/A (L1/L2/L3))	14		0.087	0.025	2.500
# Direct buried cable (generic) — Unarmoured multicore cable, OD ≤ 25mm	15		0.000	0.000	0.000
# Direct buried cable (generic) — Unarmoured multicore cable, 25mm < OD ≤ 50mm	16		0.000	0.000	0.000
# Direct buried cable (generic) — Unarmoured multicore cable, OD > 50mm	17		0.000	0.000	0.000
# Direct buried cable (generic) — Armoured (SWA) multicore cable	18		0.000	0.000	0.000
# Direct buried cable (generic) — Single-core cable (armoured or unarmoured)	19		0.000	0.000	0.000
# Direct buried cable (generic) — Individually shielded / overall-shielded cable	20		0.000	0.000	0.000
# Direct buried cable (generic) — Lead-sheathed cable	21		0.000	0.000	0.000
watch = Watch(add_profile_sag_crest_curves)  # graph output
