# Dynamo graph C13.01 Civil3D_Duct_Profile_Avoidance_v31_PIPE_DIAMETER_INPUT.dyn (Dynamo 3.7.0.11777)
# author: OpenAI
# v13: physically edits Top of Profile; hard 1.000m flat each side; auto-extends for max 1:6; R5.5m minimum.
# packages: DynamoIronPython2.7 3.2.1

go_over = BoolSelector(false)
n200mm_e_duct_sdr21_profile = BoolSelector(true)  # "200mm E-DUCT SDR21 | PROFILE AVOIDANCE."
# note: 200mm E-DUCT SDR21 — 300mm MIN CLEARANCE FROM CROSSING. PROFILE TO BE HORIZONTAL FOR 1.0m
# EACH SIDE OF CROSSING (2.0m TOTAL). MAX GRADIENT 1:6. ASSUMED DUCT LENGTH 6.0m.
pipe_duct_diameter_mm = DoubleInput(200)
# note: 200mm E-DUCT SDR21 — 300mm MIN CLEARANCE FROM CROSSING — PROFILE HORIZONTAL 1.0m
# EACH SIDE (2.0m TOTAL) — MAX GRADIENT 1:6 — ASSUMED DUCT LENGTH 6.0m
python_script = Python(IN[0]=go_over, IN[1]=n200mm_e_duct_sdr21_profile, IN[2]=pipe_duct_diameter_mm)  # IronPython2
# ---------- python_script.python (306 lines) ----------
# Civil 3D Dynamo - Duct Profile Obstruction Avoidance v25 - SAFE PROFILE EDIT
# IN[0] GO OVER? Boolean - set BEFORE Run: True=OVER / False=UNDER
# IN[1] APPLY toggle: True=edit selected profile, False=calculate/report only
# No crossing object selection. User picks one crossing point directly in the Profile View.
# Fixed design rules: duct 0.200m, clearance 0.300m, max grade 1:6, min vertical radius 5.5m

import clr, math
clr.AddReference('AcCoreMgd')
clr.AddReference('AcMgd')
clr.AddReference('AcDbMgd')
clr.AddReference('AeccDbMgd')
from Autodesk.AutoCAD.ApplicationServices import Application
from Autodesk.AutoCAD.DatabaseServices import OpenMode, ObjectId, BlockReference
import Autodesk.AutoCAD.EditorInput as EditorInput
from Autodesk.Civil.DatabaseServices import Profile, ProfileView

over = bool(IN[0]) if len(IN)>0 else True
apply_changes = bool(IN[1]) if len(IN)>1 else False
# Pipe / duct outside diameter from Dynamo IN[2], entered in mm.
try:
    DUCT_DIAMETER_MM=float(IN[2]) if len(IN)>2 and IN[2] is not None else 200.0
except:
    DUCT_DIAMETER_MM=200.0
if DUCT_DIAMETER_MM<=0:
    DUCT_DIAMETER_MM=200.0
DUCT=DUCT_DIAMETER_MM/1000.0
CLEAR = 0.300
MAX_G = 1.0/6.0
MIN_R = 5.5
FLAT_EACH_SIDE = 1.000

doc = Application.DocumentManager.MdiActiveDocument
db = doc.Database
ed = doc.Editor

def show_selected(ids):
    try:
        import System
        ed.SetImpliedSelection(System.Array[ObjectId](ids))
        ed.Regen()
    except: pass

def pick_profile(msg):
    peo=EditorInput.PromptEntityOptions(msg)
    r=ed.GetEntity(peo)
    if r.Status != EditorInput.PromptStatus.OK:
        raise Exception('Top of Profile selection cancelled.')
    show_selected([r.ObjectId])
    return r.ObjectId

def pick_crossing_point(msg, selected_profile_id):
    ppo=EditorInput.PromptPointOptions(msg)
    r=ed.GetPoint(ppo)
    if r.Status != EditorInput.PromptStatus.OK:
        raise Exception('Crossing point pick cancelled.')
    # Keep Top of Profile visibly highlighted after the point pick.
    show_selected([selected_profile_id])
    return r.Value

def pv_xy(pv,x,y):
    import System
    sta=clr.Reference[System.Double](0.0)
    elev=clr.Reference[System.Double](0.0)
    try:
        ok=pv.FindStationAndElevationAtXY(float(x),float(y),sta,elev)
        if ok: return float(sta.Value),float(elev.Value)
    except: pass
    return None

def choose_profile_view(aln,tr,pickpt):
    candidates=[]
    try: ids=aln.GetProfileViewIds()
    except: ids=[]
    for pvid in ids:
        try:
            pv=tr.GetObject(pvid,OpenMode.ForRead)
            q=pv_xy(pv,pickpt.X,pickpt.Y)
            if q is not None: candidates.append((pv,q))
        except: pass
    if not candidates:
        raise Exception('The crossing object must be selected inside a Profile View belonging to this alignment.')
    # Usually only one profile view contains the picked XY. Use the first valid one.
    return candidates[0][0], candidates[0][1]

def safe_elevation(prof,station,label):
    lo=float(prof.StartingStation); hi=float(prof.EndingStation)
    st=max(lo,min(hi,float(station)))
    tries=[0.0,1e-6,-1e-6,1e-5,-1e-5,1e-4,-1e-4,1e-3,-1e-3,1e-2,-1e-2,5e-2,-5e-2,1e-1,-1e-1]
    last=None
    for off in tries:
        q=st+off
        if q<lo or q>hi: continue
        try: return q,float(prof.ElevationAt(q))
        except Exception as ex: last=ex
    raise Exception('%s station %.6f is not on a valid profile entity (%.6f to %.6f). %s'%(label,st,lo,hi,str(last)))

report=[]
report.append('NOTE: E-DUCT / PIPE - 300mm MIN CLEARANCE FROM CROSSING - PROFILE HORIZONTAL 1.0m EACH SIDE (2.0m TOTAL) - MAX GRADIENT 1:6 - ASSUMED DUCT LENGTH 6.0m')
# v21 input diagnostics - these values come directly from the two Dynamo Boolean ports.
report.append('GO OVER INPUT IN[0] = '+str(over))
report.append('APPLY INPUT IN[1] = '+str(apply_changes))
report.append('SAFE MODE: v21 edit method - AUTO-EXTEND DISABLED TO PREVENT CIVIL 3D CRASH')
report.append('RULE: PICKED POINT IS THE CLEARANCE REFERENCE')
report.append('RULE: UNDER TOP-OF-DUCT = POINT ELEV - 0.300m')
report.append('PIPE / DUCT DIAMETER INPUT = %.0f mm'%DUCT_DIAMETER_MM)
report.append('RULE: OVER TOP-OF-DUCT = POINT ELEV + 0.300m + DUCT DIAMETER')
report.append('RULE: EXACT HORIZONTAL FLAT = 1.000m EACH SIDE / 2.000m TOTAL')
try:
    pid=pick_profile('\\nSELECT TOP OF PROFILE: ')
    ppoint=pick_crossing_point('\\nPICK CROSSING POINT IN PROFILE VIEW: ',pid)
    with db.TransactionManager.StartTransaction() as tr:
        prof=tr.GetObject(pid,OpenMode.ForWrite if apply_changes else OpenMode.ForRead)
        if not isinstance(prof,Profile):
            raise Exception('Selected Top of Profile is not a Civil 3D Profile.')
        aln=tr.GetObject(prof.AlignmentId,OpenMode.ForRead)
        pv,(pick_sta,pick_elev)=choose_profile_view(aln,tr,ppoint)

        report.append('MODE SELECTED BEFORE RUN: '+('OVER / UP' if over else 'UNDER / DOWN'))
        report.append('TOP OF PROFILE: '+str(prof.Name))
        report.append('PROFILE VIEW: '+str(pv.Name))
        report.append('CROSSING INPUT: PICKED POINT ONLY - NO OBJECT SELECTED')
        report.append('PICKED CROSSING POINT: Sta %.3f  Elev %.3f'%(pick_sta,pick_elev))

        # With point-only input, the picked station is the crossing centre/reference.
        # The required level platform extends a minimum 1.000 m left and right of it.
        s0=pick_sta
        s1=pick_sta
        flat_left=pick_sta-FLAT_EACH_SIDE
        flat_right=pick_sta+FLAT_EACH_SIDE
        if flat_left <= prof.StartingStation or flat_right >= prof.EndingStation:
            raise Exception('Not enough profile length to provide 1.000m flat on each side of the picked crossing point.')

        sm=pick_sta
        sm_eval,em=safe_elevation(prof,sm,'Crossing station')
        # Pick the relevant obstruction boundary point directly in the Profile View.
        # Selected profile is TOP OF DUCT:
        # UNDER: top of duct is CLEAR below picked point.
        # OVER: bottom of duct is CLEAR above picked point, so top of duct adds DUCT.
        target=(pick_elev+CLEAR+DUCT) if over else (pick_elev-CLEAR)
        delta=target-em
        if over and delta<=0: delta=0.0
        if (not over) and delta>=0: delta=0.0

        # Extend approach/departure automatically until the tie-to-flat tangent
        # is 1:6 or flatter. Do NOT relax the 1:6 design limit.
        def find_left_tie(flat_sta,target_z):
            step=0.25
            st=flat_sta-step
            lo=float(prof.StartingStation)
            bad=flat_sta
            while st>lo+1e-6:
                q,z=safe_elevation(prof,st,'Left tie search')
                run=flat_sta-q
                if run>1e-9 and abs((target_z-z)/run)<=MAX_G+1e-9:
                    good=q
                    # Refine between last failing station and first passing station.
                    a=good; b=bad
                    for _ in range(30):
                        m=0.5*(a+b)
                        qm,zm=safe_elevation(prof,m,'Left shortest tie')
                        gm=abs((target_z-zm)/(flat_sta-qm))
                        if gm<=MAX_G+1e-9: a=qm
                        else: b=qm
                    q=a
                    q,z=safe_elevation(prof,q,'Left shortest tie final')
                    return q,z
                bad=q
                st-=step
            raise Exception('No left tie point can achieve 1:6 before profile start.')

        def find_right_tie(flat_sta,target_z):
            step=0.25
            st=flat_sta+step
            hi=float(prof.EndingStation)
            bad=flat_sta
            while st<hi-1e-6:
                q,z=safe_elevation(prof,st,'Right tie search')
                run=q-flat_sta
                if run>1e-9 and abs((z-target_z)/run)<=MAX_G+1e-9:
                    good=q
                    # Refine between last failing station and first passing station.
                    a=bad; b=good
                    for _ in range(30):
                        m=0.5*(a+b)
                        qm,zm=safe_elevation(prof,m,'Right shortest tie')
                        gm=abs((zm-target_z)/(qm-flat_sta))
                        if gm<=MAX_G+1e-9: b=qm
                        else: a=qm
                    q=b
                    q,z=safe_elevation(prof,q,'Right shortest tie final')
                    return q,z
                bad=q
                st+=step
            raise Exception('No right tie point can achieve 1:6 before profile end.')

        left,el_left=find_left_tie(flat_left,target)
        right,el_right=find_right_tie(flat_right,target)
        gL=(target-el_left)/(flat_left-left)
        gR=(el_right-target)/(right-flat_right)

        # Minimum vertical-curve length based on R=5.5m and the actual grade change
        # to the zero-grade crossing platform. Keep a practical minimum of 0.50m.
        # v26 hard geometry checks.
        if abs(flat_left-(pick_sta-1.000))>1e-6:
            raise Exception('Left flat must be exactly 1.000m from crossing.')
        if abs(flat_right-(pick_sta+1.000))>1e-6:
            raise Exception('Right flat must be exactly 1.000m from crossing.')
        expected_target=(pick_elev+0.300+DUCT) if over else (pick_elev-0.300)
        if abs(target-expected_target)>1e-6:
            raise Exception('Target clearance must be exactly 0.300m from picked point.')

        curveL=max(0.50,MIN_R*abs(gL))
        curveR=max(0.50,MIN_R*abs(gR))
        if curveL >= (flat_left-left) or curveR >= (right-flat_right):
            raise Exception('Insufficient transition length for R5.5m vertical curves; extend available profile length.')

        report += [
            'MODE: '+('OVER' if over else 'UNDER'),
            'CLEARANCE: %.3f m'%CLEAR,
            'DUCT SIZE: %.3f m'%DUCT,
            'MIN FLAT EACH SIDE: %.3f m'%FLAT_EACH_SIDE,
            'TARGET TOP-OF-DUCT ELEVATION: %.3f m'%target,
            'FLAT SECTION: Sta %.3f to %.3f (1.000m each side of picked point Sta %.3f)'%(flat_left,flat_right,pick_sta),
            'LEFT TIE: Sta %.3f Elev %.3f'%(left,el_left),
            'RIGHT TIE: Sta %.3f Elev %.3f'%(right,el_right),
            'SHORTEST COMPLIANT DIVERSION: YES',
            'TRANSITION GRADES: 1:%.2f / 1:%.2f'%(1.0/abs(gL) if gL else 9999,1.0/abs(gR) if gR else 9999),
            '1:6 LIMIT CHECK: '+('PASS' if abs(gL)<=MAX_G+1e-9 and abs(gR)<=MAX_G+1e-9 else 'FAIL'),
            'VERTICAL CURVES: L %.3fm / R %.3fm (minimum radius %.3fm)'%(curveL,curveR,MIN_R)]
        if apply_changes:
            # v19 - force a real edit of the selected Civil 3D layout profile.
            # Autodesk API:
            #   Profile.PVIs.AddPVI(station,elevation)
            #   Profile.PVIs.AddPVISymParabola(station,elevation,curveLength)
            try:
                try:
                    prof.UpgradeOpen()
                except:
                    pass

                pvicol=prof.PVIs
                before_count=int(pvicol.Count)

                # The parabolic PVI itself is the grade-intersection point.
                # Therefore do not also add a tangent PVI at the same station.
                pviCurveL=flat_left-(curveL*0.5)
                pviCurveR=flat_right+(curveR*0.5)
                elevCurveL=target-gL*(flat_left-pviCurveL)
                elevCurveR=target+gR*(pviCurveR-flat_right)

                created=[]

                # Tie PVI
                p1=pvicol.AddPVI(float(left),float(el_left))
                created.append(('PVI 1 - LEFT TIE',float(p1.Station),float(p1.Elevation)))

                # PVI-based symmetric parabola
                pcL=pvicol.AddPVISymParabola(float(pviCurveL),float(elevCurveL),float(curveL))
                created.append(('PVI 2 - LEFT VERTICAL CURVE',float(pcL.Station),float(pcL.Elevation)))

                # Flat control PVIs
                p3=pvicol.AddPVI(float(flat_left),float(target))
                created.append(('PVI 3 - START FLAT',float(p3.Station),float(p3.Elevation)))
                p4=pvicol.AddPVI(float(flat_right),float(target))
                created.append(('PVI 4 - END FLAT',float(p4.Station),float(p4.Elevation)))

                # Right PVI-based symmetric parabola
                pcR=pvicol.AddPVISymParabola(float(pviCurveR),float(elevCurveR),float(curveR))
                created.append(('PVI 5 - RIGHT VERTICAL CURVE',float(pcR.Station),float(pcR.Elevation)))

                # Tie PVI
                p6=pvicol.AddPVI(float(right),float(el_right))
                created.append(('PVI 6 - RIGHT TIE',float(p6.Station),float(p6.Elevation)))

                after_count=int(pvicol.Count)
                if after_count <= before_count:
                    raise Exception('Civil 3D PVI count did not increase. Profile was not modified.')

                tr.Commit()

                # Force graphics regeneration after database commit.
                try:
                    ed.Regen()
                except:
                    pass

                report.append('APPLY=True - EXACT 300mm CLEARANCE / 2.000m FLAT PROFILE EDIT COMMITTED')
                report.append('PVI COUNT: %d -> %d'%(before_count,after_count))
                for label,st,el in created:
                    report.append('%s: Sta %.3f  Elev %.3f'%(label,st,el))
                report.append('LEFT CURVE LENGTH: %.3f m'%curveL)
                report.append('RIGHT CURVE LENGTH: %.3f m'%curveR)
                report.append('FLAT PRESERVED: Sta %.3f to %.3f'%(flat_left,flat_right))
                report.append('REGEN CALLED - PROFILE SHOULD NOW SHOW NEW PROFILE LAYOUT PVIs/CURVES')
            except Exception as ae:
                try:
                    tr.Abort()
                except:
                    pass
                raise Exception('REAL PROFILE EDIT FAILED: '+str(ae))

        else:
            report.append('PREVIEW ONLY - APPLY=False. Set APPLY=True to modify the selected layout profile.')
except Exception as ex:
    report.append('ERROR: '+str(ex))
OUT=report
# ----------------------------------------
watch = Watch(python_script)
