# Dynamo graph C14.0 MultiShapefileDBF_to_Table.dyn "MultiShapefileDBF_to_Table" (Dynamo 3.7.0.11777)
# Point at a folder containing several shapefiles and get one combined table back (header row + one row per feature across all .shp layers, tagged by SOURCE_LAYER), plus a saved combined_shapefile_table.csv written into a separate folder you choose. No external libraries required.

source_folder_shapefiles = Directory("N:\24974\01 WIP\01 - Drawings and Models\01 - Civil\03 - Sketch SK\05 - Grid Team\01 - GIS SKETCH WORK\03 - SHPs\Water_Sewer_SHP")
output_folder_csv_destination = Directory("C:\Users\Conor.mcenery\Documents")
python_script = Python(IN[0]=source_folder_shapefiles, IN[1]=output_folder_csv_destination)  # CPython3
# ---------- python_script.python (78 lines) ----------
import struct
import os
import glob
import csv

folder = IN[0]
out_folder = IN[1] if IN[1] else folder

def read_dbf(path):
    with open(path, 'rb') as f:
        data = f.read()

    num_records = struct.unpack('<I', data[4:8])[0]
    header_size = struct.unpack('<H', data[8:10])[0]
    record_size = struct.unpack('<H', data[10:12])[0]

    fields = []
    pos = 32
    while data[pos:pos+1] != b'\r':
        name = data[pos:pos+11].split(b'\x00')[0].decode('latin-1')
        ftype = data[pos+11:pos+12].decode('latin-1')
        flen = data[pos+16]
        fields.append((name, ftype, flen))
        pos += 32

    records = []
    rec_start = header_size
    for _ in range(num_records):
        rec = data[rec_start:rec_start+record_size]
        rec_start += record_size
        if rec[0:1] == b'*':
            continue
        row = {}
        offset = 1
        for name, ftype, flen in fields:
            raw = rec[offset:offset+flen].decode('latin-1', errors='replace').strip()
            offset += flen
            if ftype in ('N', 'F'):
                try:
                    row[name] = float(raw) if raw not in ('', '.') else None
                except ValueError:
                    row[name] = raw
            else:
                row[name] = raw
        records.append(row)
    return [f[0] for f in fields], records

shp_paths = sorted(glob.glob(os.path.join(folder, '*.shp')))

all_headers = []
seen = set()
tagged_records = []

for shp_path in shp_paths:
    dbf_path = os.path.splitext(shp_path)[0] + '.dbf'
    layer_name = os.path.splitext(os.path.basename(shp_path))[0]
    if not os.path.exists(dbf_path):
        continue
    headers, records = read_dbf(dbf_path)
    for h in headers:
        if h not in seen:
            seen.add(h)
            all_headers.append(h)
    for r in records:
        tagged_records.append((layer_name, r))

final_headers = ['SOURCE_LAYER'] + all_headers
table = [final_headers]
for layer_name, r in tagged_records:
    table.append([layer_name] + [r.get(h) for h in all_headers])

csv_path = os.path.join(out_folder, 'combined_shapefile_table.csv')
with open(csv_path, 'w', newline='', encoding='utf-8-sig') as f:
    writer = csv.writer(f)
    for row in table:
        writer.writerow(['' if v is None else v for v in row])

OUT = table, csv_path
# ----------------------------------------
watch = Watch(python_script)
