# Dynamo graph 21.5 Civil3D_MWP_PullCal_Linked_Fill_Jamming_Newtons_Fixed_Parabolic_CORRECTED_HELP_V13.dyn (Dynamo 3.7.0.11777)
# author: MWP
# Main pulling calculation and live Excel export, with the existing route inspector and eight additional section-type example code blocks matching the Word diagrams. Example blocks are independent of the route solver. V21.5 adds an HV cable minimum bend radius check (installation and installed), set by two new inputs. V2 adds a grade break tolerance input (default 0.3 deg) so export arc approximations are not counted as kinks. V3 corrects the report title/version label (V21.5) and garbled dash and r-squared characters. V4 removes the word Dynamo from the exported Excel report. V5 adds optional ELEK-style high sidewall friction (friction, threshold) and a three-cable factor rule switch, both off by default. V6 adds an ELEK-style section list sheet (forward and reverse) for each route. V7 defaults follow ELEK: friction 0.45 dropping to 0.2 above 2185 N/m sidewall force, IEEE three-cable factor. V8 allowable tension is 80% of the 28 kN grip limit (22,400 N), the ELEK tension reduction.

# group: 1 | Route reports and Excel export
# Choose the XY and Z Civil 3D reports and where the Excel report is saved.
# - Select reports | True then Run: True opens the file browser for the XY and Z Civil 3D reports.
# - Browse | select XY and Z reports: File dialog. Pick one XY and one Z report per route (several routes = batch run).
# - Browse for Excel export folder: True opens the folder browser for the Excel output.
# - Browse | choose Excel export folder: Folder dialog. Returns the export folder path.
# - Write new Excel report: True writes a new Excel workbook for the run.
select_reports_true_then_run_one = BoolSelector(true)  # "Select reports | True then Run (one or more routes)"; graph input
browse_select_xy_and_z_reports = Python(Browse_for_both_reports=select_reports_true_then_run_one)  # "Browse | select XY and Z reports (one pair per route; several = batch)"; CPython3
# ---------- browse_select_xy_and_z_reports.python (39 lines) ----------
import builtins
import json
import clr
key = '_mwp_profile_selection_7fa3c8bb58de4a81ba6c217654ff0a12'
if bool(IN[0]):
    # Clear before browsing: cancel never silently exports the previous route.
    setattr(builtins, key, None)
    clr.AddReference('System.Windows.Forms')
    from System.Windows.Forms import OpenFileDialog, DialogResult
    from System.Threading import Thread, ThreadStart, ApartmentState
    response = {'files': None, 'error': None}
    def browse():
        dialog = OpenFileDialog()
        try:
            dialog.Title = 'Select the XY profile AND Z entity Excel report for each route (Ctrl-click; several routes = batch run, same cable inputs)'
            dialog.Filter = 'Excel reports (*.xlsx)|*.xlsx'
            dialog.Multiselect = True
            dialog.CheckFileExists = True
            dialog.RestoreDirectory = True
            if dialog.ShowDialog() == DialogResult.OK:
                response['files'] = [str(p) for p in dialog.FileNames]
        except Exception as error:
            response['error'] = str(error)
        finally:
            dialog.Dispose()
    worker = Thread(ThreadStart(browse))
    worker.SetApartmentState(ApartmentState.STA)
    worker.Start()
    worker.Join()
    if response['error']:
        raise ValueError(response['error'])
    files = response['files']
    if files is None:
        raise ValueError('Selection cancelled. No calculation/export was made.')
    if len(files) < 2 or len(files) % 2:
        raise ValueError('Select an XY report and a Z entity report for every route '
                         '(%d files selected). Several routes = batch run.' % len(files))
    setattr(builtins, key, json.dumps(files))
OUT = getattr(builtins, key, None)
# ----------------------------------------
write_new_excel_report = BoolSelector(true)  # graph input
browse_for_excel_export_folder = BoolSelector(true)  # graph input
browse_choose_excel_export = Python(Browse_for_export_folder=browse_for_excel_export_folder)  # "Browse | choose Excel export folder"; CPython3
# ---------- browse_choose_excel_export.python (32 lines) ----------
import builtins
import clr
key = '_mwp_excel_export_folder_4bc7b98a_7fee_45b1_96c4_d8bd4f74bc0b'
if bool(IN[0]):
    clr.AddReference('System.Windows.Forms')
    from System.Windows.Forms import FolderBrowserDialog, DialogResult
    from System.Threading import Thread, ThreadStart, ApartmentState
    response = {'folder': None, 'error': None}
    def browse():
        dialog = FolderBrowserDialog()
        try:
            dialog.Description = 'Select the folder for the new Excel pull calculation report'
            dialog.ShowNewFolderButton = True
            previous = getattr(builtins, key, '')
            if previous:
                dialog.SelectedPath = previous
            if dialog.ShowDialog() == DialogResult.OK:
                response['folder'] = str(dialog.SelectedPath)
        except Exception as error:
            response['error'] = str(error)
        finally:
            dialog.Dispose()
    worker = Thread(ThreadStart(browse))
    worker.SetApartmentState(ApartmentState.STA)
    worker.Start()
    worker.Join()
    if response['error']:
        raise ValueError(response['error'])
    if response['folder'] is None:
        raise ValueError('Export folder selection cancelled. No Excel report was exported.')
    setattr(builtins, key, response['folder'])
OUT = getattr(builtins, key, '')
# ----------------------------------------

# group: 2 | Cable, duct and limits
# HDL1A 132 kV cable in a 160 OD duct, and the pull limits.
# - Number of cables: Cables pulled together in one duct (1 for the HV cable).
# - Allowable pulling tension, total: Total tension limit in N. Used only when max tension per cable is 0.
# - Mass per cable: Cable mass in kg/m (10.3 for the HV cable).
# - Maximum tension per cable: Per-cable limit in N (28000 grip). Allowable = cables x this x reduction factor.
# - Cable outside diameter: Cable outside diameter in mm (96.9).
# - Tension reduction factor: Fraction of the max tension used as the limit (ELEK default 0.8).
# - Conduit inside diameter: Duct bore in mm (144.8 for 160 OD SDR21).
# - Allowable sidewall pressure: Maximum sidewall bearing pressure in N/m.
# - Friction coefficient: Normal friction between cable and duct.
# - Allowable conduit fill: Largest cable fill of the duct (0.53 for a single cable).
# - Gravity: Converts kg/m to N/m.
# - Cable formation: Single, Trefoil, Cradled, Diamond or more than four cables.
# - Starting pulling tension: Reel back tension at the start of the pull (N).
# - Project cable assumptions confirmed: Set True once the cable data is checked, otherwise the report flags REVIEW.
number_of_cables = DoubleInput(1)  # graph input
mass_per_cable = DoubleInput(10.3)  # graph input
cable_outside_diameter = DoubleInput(96.9)  # graph input
conduit_inside_diameter = DoubleInput(144.8)  # graph input
friction_coefficient = DoubleInput(0.2)  # graph input
gravity = DoubleInput(9.8)  # graph input
starting_pulling_tension = DoubleInput(1960)  # graph input
allowable_pulling_tension_total = DoubleInput(22400)  # "Allowable pulling tension, total (N) (used only when max tension per cable = 0)"; graph input
allowable_sidewall_pressure = DoubleInput(7500)  # graph input
allowable_conduit_fill = DoubleInput(0.53)  # graph input
cable_formation = CustomSelection("Single", items={Single: "Single", Trefoil: "Trefoil", Cradled: "Cradled", Diamond: "Diamond", More than four cables: "fourcables"}, IsVisibleDropDownTextBlock=true)  # graph input
project_cable_assumptions = BoolSelector(true)  # "Project cable assumptions confirmed"; graph input
maximum_tension_per_cable_n_0 = DoubleInput(28000)  # "Maximum tension per cable (N) (0 = use total allowable tension)"; graph input
tension_reduction_factor_0_to_1 = DoubleInput(0.8)  # graph input

# group: 3 | Solver settings and bend radius
# Step sizes, friction switch, bend radius limits and units.
# - Maximum integration step: Longest RK4 step along the route (m).
# - Maximum angle step: Largest angle change per integration step (deg).
# - Grade break tolerance: Profile angle changes at or below this (deg) are not treated as grade breaks.
# - Minimum bend radius during installation: Cable minimum bending radius while pulling (m). 0 switches the check off.
# - Minimum bend radius installed: Cable minimum bending radius once installed (m). 0 switches the check off.
# - High sidewall friction coefficient: Friction used where sidewall pressure is above the threshold (0 = off).
# - Sidewall pressure threshold: Sidewall pressure above which the high friction applies (N/m).
# - Three-cable factor rule: 0 = project ratio rule, 1 = selected formation (IEEE).
# - Manufacturer SWBP override: Manufacturer sidewall factor. 0 uses the MWP formation factor.
# - Report units: True = kg / kg per m; False = N / N per m: False = N and N/m. True = kg and kg/m.
maximum_integration_step = DoubleInput(0.05)  # graph input
maximum_angle_step = DoubleInput(0.25)  # graph input
manufacturer_swbp_override_0_mwp = DoubleInput(0)  # "Manufacturer SWBP override (0 = MWP formation factor)"; graph input
report_units_true_kg_kg_per_m = BoolSelector(false)  # "Report units: True = kg / kg per m; False = N / N per m"; graph input
minimum_bend_radius_during = DoubleInput(2.907)  # "Minimum bend radius during installation (m)"; graph input
minimum_bend_radius_installed_m = DoubleInput(1.938)  # graph input
grade_break_tolerance_deg = DoubleInput(0.3)  # graph input
high_sidewall_friction = DoubleInput(0.2)  # "High sidewall friction coefficient (0 = off)"; graph input
sidewall_pressure_threshold_n_m = DoubleInput(2185)  # graph input
three_cable_factor_rule_0 = DoubleInput(1)  # "Three-cable factor rule (0 = project ratio rule, 1 = selected formation, IEEE)"; graph input

# group: 6 | Formula inspector (step-by-step check)
# Pick a route, direction, section and step to see the formulas behind one integration step.
# - Inspect route: Route to inspect (1-based).
# - 01 - Selected calculation data: Cable and section values for the chosen step.
# - 02 - Cable weight, friction and fill: Cable weight W, effective friction f and fill.
# - 03 - Current integration step inputs: Tension, angle, curvature and weight entering the step.
# - 04.1 - RK4 stage k1: RK4 stage k1: rate of tension change (N/m).
# - 04.2 - RK4 stage k2: RK4 stage k2 (N/m).
# - 04.3 - RK4 stage k3: RK4 stage k3 (N/m).
# - 04.4 - RK4 stage k4: RK4 stage k4 (N/m).
# - 05 - Step exit tension and verification: Combines k1 to k4 into the step exit tension and checks it.
# - 06 - Step exit SWBP and verification: Sidewall pressure at the step exit, with check.
# - Inspect direction: Pull direction to inspect: 1 forward, 2 reverse.
# - Inspect section: Section to inspect, in pull order.
# - Inspect integration step: Integration step to inspect inside that section.
# - Code Block: Splits the solver output into data, cable, step, geometry and selection.
# - 07 - Whole section and unknown joint: Whole-section result and unknown joints (grade breaks).
# - 08 - Straight / slope closed-form check: Closed-form hand check for straight and sloped sections.
# - 09 - Level horizontal bend closed-form check: Closed-form hand check for level horizontal bends.
inspect_route_1_based = DoubleInput(1)  # graph input
inspect_direction_1_forward_2 = DoubleInput(1)  # "Inspect direction (1 forward, 2 reverse)"; graph input
inspect_section_1_based_in_pull = DoubleInput(1)  # "Inspect section (1-based in pull order)"; graph input
inspect_integration_step_1_based = DoubleInput(1)  # graph input
code_block = CodeBlock {  }

# group: 4 | Solver and Excel export
# The calculation. Everything on the left feeds this node.
# - V16: actual 3D geometry, converged tension and both direction checks: Main calculation: reads the XY and Z reports, builds the 3D route, integrates tension both ways, checks tension, sidewall pressure and bend radius, writes the Excel report.
v16_actual_3d_geometry_converged = Python(XY_profile_report=browse_select_xy_and_z_reports, Z_profile_entity_report=browse_select_xy_and_z_reports, Write_new_Excel_report=write_new_excel_report, Number_of_cables=number_of_cables, Mass_per_cable=mass_per_cable, Cable_outside_diameter=cable_outside_diameter, Conduit_inside_diameter=conduit_inside_diameter, Friction_coefficient=friction_coefficient, Gravity=gravity, Starting_pulling_tension=starting_pulling_tension, Allowable_pulling_tension=allowable_pulling_tension_total, Allowable_sidewall_pressure=allowable_sidewall_pressure, Allowable_conduit_fill=allowable_conduit_fill, Cable_formation=cable_formation, Project_cable_assumptions_confirmed=project_cable_assumptions, Maximum_integration_step=maximum_integration_step, Maximum_angle_step=maximum_angle_step, Manufacturer_SWBP_factor_0_unavailable=manufacturer_swbp_override_0_mwp, Excel_export_folder=browse_choose_excel_export, Inspect_route_1_based=inspect_route_1_based, Inspect_direction_1_forward_2_reverse=inspect_direction_1_forward_2, Inspect_section_1_based_in_pull_order=inspect_section_1_based_in_pull, Inspect_integration_step_1_based=inspect_integration_step_1_based, Report_in_kg_kg_per_m=report_units_true_kg_kg_per_m, Min_bend_radius_installation_m=minimum_bend_radius_during, Min_bend_radius_installed_m=minimum_bend_radius_installed_m, Grade_break_tolerance_deg=grade_break_tolerance_deg, High_sidewall_friction_0_off=high_sidewall_friction, Sidewall_pressure_threshold_N_m=sidewall_pressure_threshold_n_m, Three_cable_factor_rule=three_cable_factor_rule_0, Max_tension_per_cable_N=maximum_tension_per_cable_n_0, Tension_reduction_factor=tension_reduction_factor_0_to_1)  # "V16: actual 3D geometry, converged tension and both direction checks"; CPython3; unwired: Legacy_template_unused
# ---------- v16_actual_3d_geometry_converged.python (1678 lines) ----------
import bisect, math, os, posixpath, re, zipfile, json
import xml.etree.ElementTree as ET
from datetime import datetime


STATION_TOL = 1e-6

DUPLICATE_POINT_TOL = 0.001

PROFILE_JOIN_ELEV_TOL = 0.001

ENTITY_LENGTH_TOL = 0.001

PLAN_CHORD_TOL = 0.002

ELEVATION_MATCH_TOL = 0.002

FLAT_TOL = 1e-8

FLAT_ANGLE_TOL = 1e-8

LEVEL_POINT_MIN_GAP = 0.01

STATION_LOOKUP_NUDGE = 1e-8

GRADE_BREAK_MIN_DEG = 0.01

NS = 'http://schemas.openxmlformats.org/spreadsheetml/2006/main'

REL = 'http://schemas.openxmlformats.org/officeDocument/2006/relationships'

def tag(name):
    """Full XML tag name in the spreadsheet namespace, e.g. tag('row')."""
    return '{%s}%s' % (NS, name)

def col_number(label):
    """'A' -> 1, 'Z' -> 26, 'AA' -> 27."""
    value = 0
    for char in label:
        value = 26 * value + ord(char) - 64
    return value

def col_label(number):
    """1 -> 'A', 26 -> 'Z', 27 -> 'AA'."""
    text = ''
    while number:
        number, rem = divmod(number - 1, 26)
        text = chr(65 + rem) + text
    return text

def sheet_paths(archive):
    """Map sheet name -> XML file path inside the .xlsx."""
    relations = ET.fromstring(archive.read('xl/_rels/workbook.xml.rels'))
    links = {r.attrib['Id']: r.attrib['Target'] for r in relations}
    workbook = ET.fromstring(archive.read('xl/workbook.xml'))
    result = {}
    for sheet in workbook.find(tag('sheets')):
        target = links[sheet.attrib['{%s}id' % REL]]
        if target.startswith('/'):
            result[sheet.attrib['name']] = target.lstrip('/')
        else:
            result[sheet.attrib['name']] = posixpath.normpath('xl/' + target)
    return result

def read_xlsx(path):
    """Read literal/cached cell values.

    Returns {sheet name: list of rows}, each row a list of cell values.
    Formulas without a cached value and Excel error cells are rejected.
    """
    with zipfile.ZipFile(path) as archive:
        shared_strings = []
        if 'xl/sharedStrings.xml' in archive.namelist():
            for item in ET.fromstring(archive.read('xl/sharedStrings.xml')):
                shared_strings.append(''.join(n.text or '' for n in item.iter(tag('t'))))

        result = {}
        for name, target in sheet_paths(archive).items():
            grid = []
            for row in ET.fromstring(archive.read(target)).iter(tag('row')):
                row_index = int(row.attrib['r'])
                while len(grid) < row_index:
                    grid.append([])
                for cell in row:
                    address = cell.attrib.get('r', '')
                    if not address:
                        continue
                    col_index = col_number(re.match('[A-Z]+', address).group())
                    while len(grid[row_index - 1]) < col_index:
                        grid[row_index - 1].append(None)

                    kind = cell.attrib.get('t')
                    raw = cell.find(tag('v'))
                    value = raw.text if raw is not None else None
                    if cell.find(tag('f')) is not None and value is None:
                        raise ValueError('Source formula has no cached value: %s!%s' % (name, address))

                    if kind == 'inlineStr':
                        value = ''.join(n.text or '' for n in cell.iter(tag('t')))
                    elif kind == 's' and value is not None:
                        value = shared_strings[int(value)]
                    elif kind == 'b':
                        value = value == '1'
                    elif kind == 'e':
                        raise ValueError('Source Excel error at %s!%s: %s' % (name, address, value))
                    elif value is not None and kind not in ('str', 'd'):
                        value = float(value)
                    grid[row_index - 1][col_index - 1] = value
            result[name] = grid
        return result

def records(workbook, first_header):
    """Find the table whose first header cell is `first_header` and return its
    numeric rows as dicts keyed by header name (plus '_excel_row')."""
    for rows in workbook.values():
        for index, row in enumerate(rows):
            if row and row[0] == first_header:
                headers = row
                table = []
                for excel_index, data in enumerate(rows[index + 1:], index + 1):
                    if data and isinstance(data[0], (float, int)):
                        padded = data + [None] * (len(headers) - len(data))
                        table.append(dict(zip(headers, padded), _excel_row=excel_index + 1))
                return table
    raise ValueError('Missing report header: ' + first_header)

def finite(value, name):
    if isinstance(value, (bool, str)) or value is None or not math.isfinite(value):
        raise ValueError(name + ' must be a finite number.')
    return float(value)

def radius(value):
    """Curve radius as a positive number, or None for a straight (Infinity/blank)."""
    if value is None or str(value).lower() in ('infinity', 'inf', '-infinity'):
        return None
    value = finite(value, 'Curve radius')
    if value == 0:
        raise ValueError('Curve radius cannot be zero.')
    return abs(value)

def profile_at(profile, station):
    """Elevation and slope angle (rad) of one profile entity at a station."""
    ds = station - profile['s0']
    kv, a0 = profile['kv'], profile['a0']
    if kv == 0:
        return profile['z0'] + ds * math.tan(a0), a0
    sine = max(-1.0, min(1.0, math.sin(a0) + kv * ds))
    alpha = math.asin(sine)
    elevation = profile['z0'] + (math.cos(a0) - math.cos(alpha)) / kv
    return elevation, alpha

def read_plan_points(xy_rows, issues):
    """XY rows in station order; exact duplicates are merged."""
    points = []
    for row in xy_rows:
        station = finite(row['Station'], 'XY station')
        for key in ('Easting', 'Northing', 'Elevation'):
            finite(row[key], key)
        if points and station < points[-1]['Station'] - STATION_TOL:
            raise ValueError('XY stations are out of order.')
        if points and abs(station - points[-1]['Station']) <= STATION_TOL:
            old = points[-1]
            difference = max(abs(row[k] - old[k]) for k in ('Easting', 'Northing', 'Elevation'))
            if difference > DUPLICATE_POINT_TOL:
                raise ValueError('Conflicting duplicate XY station.')
            issues.append(['INFO', station, 'Duplicate XY station merged',
                           'Rows %d and %d agree within 1 mm.' % (old['_excel_row'], row['_excel_row'])])
            continue
        points.append(row)
    return points

def read_profile_entities(z_rows, issues):
    """Tangent / circular-curve profile entities with start/end angles."""
    profiles = []
    for row in z_rows:
        s0, s1 = row['Start Station'], row['End Station']
        z0, z1 = row['Start Elevation'], row['End Elevation']
        for value in (s0, s1, z0, z1):
            finite(value, 'Profile coordinate')
        if s1 <= s0:
            raise ValueError('Profile stations must increase.')
        if profiles:
            previous = profiles[-1]
            if abs(s0 - previous['s1']) > STATION_TOL or abs(z0 - previous['z1']) > PROFILE_JOIN_ELEV_TOL:
                raise ValueError('Gap or overlap between profile entities.')

        ds, dz = s1 - s0, z1 - z0
        profile = dict(s0=s0, s1=s1, z0=z0, z1=z1, entity=int(row['Entity Index']),
                       kind=row['Entity Type'], kv=0.0)

        if row['Entity Type'] == 'Tangent':
            profile['a0'] = profile['a1'] = math.atan2(dz, ds)

        elif row['Entity Type'] == 'Circular Curve':
            r = radius(row['Curve Radius'])
            if r is None or row['Curve Type'] not in ('Sag', 'Crest'):
                raise ValueError('Circular profile requires radius and Sag/Crest type.')
            chord = math.hypot(ds, dz)
            if chord > 2 * r:
                raise ValueError('Profile chord exceeds its circle diameter.')
            sign = 1 if row['Curve Type'] == 'Sag' else -1
            delta = sign * 2 * math.asin(chord / (2 * r))       # total turn of the arc
            chord_angle = math.atan2(dz, ds)
            profile.update(a0=chord_angle - delta / 2, a1=chord_angle + delta / 2, kv=sign / r)
            if max(abs(profile['a0']), abs(profile['a1'])) >= math.pi / 2:
                raise ValueError('Profile arc is not single-valued in station.')

        elif row['Entity Type'] == 'Parabolic Curve':
            # Approximate the parabola by the circular arc with the same end points
            # and the same total turn (from the gradients); sub-mm elevation difference.
            g_in, g_out = row.get('Gradient In'), row.get('Gradient Out')
            if g_in is None or g_out is None:
                raise ValueError('Parabolic profile requires Gradient In/Out.')
            delta = math.atan(finite(g_out, 'Gradient Out')) - math.atan(finite(g_in, 'Gradient In'))
            chord = math.hypot(ds, dz)
            chord_angle = math.atan2(dz, ds)
            if abs(delta) < 1e-12:
                profile['a0'] = profile['a1'] = chord_angle
            else:
                r = chord / (2 * math.sin(abs(delta) / 2))
                profile.update(a0=chord_angle - delta / 2, a1=chord_angle + delta / 2,
                               kv=(1 if delta > 0 else -1) / r)
                if max(abs(profile['a0']), abs(profile['a1'])) >= math.pi / 2:
                    raise ValueError('Profile arc is not single-valued in station.')
            issues.append(['INFO', s0, 'Parabolic curve approximated by circular arc',
                           'Entity %d: same end points and total turn (%.4f deg); equivalent R=%.2f m.'
                           % (profile['entity'], math.degrees(delta), chord / abs(delta) if delta else 0.0)])

        else:
            raise ValueError('Unsupported profile entity: ' + str(row['Entity Type']))

        profiles.append(profile)
        if row.get('Length') is not None and abs(row['Length'] - ds) > ENTITY_LENGTH_TOL:
            issues.append(['REVIEW', s0, 'Reported entity length differs from station span',
                           'Entity %d: use endpoint stations; reported %.6f m versus %.6f m.'
                           % (profile['entity'], row['Length'], ds)])
    return profiles

def check_plan_chords(points):
    """Chord between exported points must match the alignment radius (unit check)."""
    for first, last in zip(points, points[1:]):
        ds = last['Station'] - first['Station']
        rh = radius(first['Alignment Radius'])
        expected = 2 * rh * math.sin(ds / (2 * rh)) if rh else ds
        actual = math.hypot(last['Easting'] - first['Easting'], last['Northing'] - first['Northing'])
        if abs(actual - expected) > PLAN_CHORD_TOL:
            raise ValueError('Plan geometry/units mismatch near station %.6f.' % first['Station'])

def check_point_elevations(points, profiles, starts):
    """XY-report elevations must sit on the rebuilt profile."""
    for row in points:
        index = bisect.bisect_right(starts, row['Station'] + STATION_LOOKUP_NUDGE) - 1
        profile = profiles[min(len(profiles) - 1, max(0, index))]
        expected, _ = profile_at(profile, row['Station'])
        if abs(expected - row['Elevation']) > ELEVATION_MATCH_TOL:
            raise ValueError('XY/Z elevation mismatch at station %.6f.' % row['Station'])

def segment_kind(rh, kv, z0, z1):
    if rh and kv:
        return 'Compound curve'
    if rh:
        return 'Horizontal curve'
    if kv:
        return 'Vertical curve'
    if z1 > z0 + FLAT_TOL:
        return 'Slope up'
    if z1 < z0 - FLAT_TOL:
        return 'Slope down'
    return 'Straight'

def build_geometry(xy_book, z_book):
    xy = records(xy_book, 'Point Index')
    z = records(z_book, 'Entity Index')
    issues = []

    # Both reports must come from the same drawing and alignment.
    header_xy = dict(xy_book.get('Report Header', []))
    header_z = dict(z_book.get('Report Header', []))
    for key in ('Drawing:', 'Parent Alignment:'):
        if header_xy.get(key) != header_z.get(key):
            raise ValueError('XY and Z reports disagree on ' + key)

    points = read_plan_points(xy, issues)
    profiles = read_profile_entities(z, issues)
    if len(points) < 2 or not profiles:
        raise ValueError('Insufficient profile data.')

    check_plan_chords(points)
    if (abs(points[0]['Station'] - profiles[0]['s0']) > STATION_TOL
            or abs(points[-1]['Station'] - profiles[-1]['s1']) > STATION_TOL):
        raise ValueError('XY and Z reports cover different station ranges.')
    starts = [p['s0'] for p in profiles]
    check_point_elevations(points, profiles, starts)

    # Break the route at every XY point and every profile entity start/end.
    # Also break vertical curves at their low/high point (slope = 0), so each
    # piece is wholly Upward or Downward for the IEEE bend formulas.
    level_points = []
    for profile in profiles:
        if profile['kv']:
            s_level = profile['s0'] - math.sin(profile['a0']) / profile['kv']
            if profile['s0'] + LEVEL_POINT_MIN_GAP < s_level < profile['s1'] - LEVEL_POINT_MIN_GAP:
                level_points.append(s_level)
    # XY points are only a break where the plan radius changes (start/end of a
    # horizontal curve); points in the middle of a straight or curve are not.
    plan_breaks = [points[0]['Station'], points[-1]['Station']]
    for k in range(1, len(points) - 1):
        if radius(points[k]['Alignment Radius']) != radius(points[k - 1]['Alignment Radius']):
            plan_breaks.append(points[k]['Station'])
    all_stations = sorted(plan_breaks + starts + [profiles[-1]['s1']] + level_points)
    stations = []
    for station in all_stations:
        if not stations or station - stations[-1] > STATION_TOL:
            if station in level_points and (station - stations[-1] < LEVEL_POINT_MIN_GAP):
                continue                       # low/high point too close to another break
            stations.append(station)
    # drop a low/high point that sits just before the next real break
    stations = [s for k, s in enumerate(stations)
                if not (s in level_points and k + 1 < len(stations)
                        and stations[k + 1] - s < LEVEL_POINT_MIN_GAP)]

    # One segment between each pair of break stations.
    segments = []
    xstarts = [p['Station'] for p in points]
    for s0, s1 in zip(stations, stations[1:]):
        middle = (s0 + s1) / 2
        profile = profiles[bisect.bisect_right(starts, middle) - 1]
        xi = bisect.bisect_right(xstarts, middle) - 1
        point, end = points[xi:xi + 2]
        rh = radius(point['Alignment Radius'])
        z0, a0 = profile_at(profile, s0)
        z1, a1 = profile_at(profile, s1)
        if profile['kv'] == 0:
            length = (s1 - s0) / math.cos(a0)
        else:
            length = abs((a1 - a0) / profile['kv'])
        heading = math.atan2(end['Easting'] - point['Easting'], end['Northing'] - point['Northing'])
        segments.append(dict(id=len(segments) + 1, s0=s0, s1=s1, z0=z0, z1=z1, a0=a0, a1=a1,
                             kv=profile['kv'], rh=rh, length=length,
                             kind=segment_kind(rh, profile['kv'], z0, z1),
                             entity=profile['entity'], heading=heading, joint_angle=0.0))

    # Grade breaks: exported points split smooth circular entities. Only profile
    # angle discontinuities have no resolved radius in these reports; alignment
    # curves retain their radii.
    for previous, following in zip(segments, segments[1:]):
        angle = abs(following['a0'] - previous['a1'])
        if angle > math.radians(GRADE_BREAK_MIN_DEG):
            following['joint_angle'] = angle
            issues.append(['REVIEW', following['s0'], 'Grade break has no bend radius',
                           'Direction changes %.4f degrees. Tension uses a zero-length capstan '
                           'estimate; joint SWBP is unavailable.' % math.degrees(angle)])

    metadata = dict(header=header_xy, xy_rows=len(xy), unique_xy=len(points),
                    profile_entities=len(z), source_xy=xy, source_z=z)
    return segments, issues, metadata

def report_role(path):
    """'xy' or 'z' from the report contents, plus its header."""
    book = read_xlsx(path)
    headers = [row for rows in book.values() for row in rows if row]
    is_z = any(row[0] == 'Entity Index' for row in headers)
    is_xy = any('Station' in row and 'Entity Index' not in row for row in headers)
    if is_z == is_xy:
        raise ValueError('Cannot identify report as XY or Z: ' + path)
    return ('z' if is_z else 'xy'), dict(book.get('Report Header', []))

def _report_stem(path, role):
    """File name without the Civil 3D 'xy' / 'z' ending, used to pair reports."""
    stem = os.path.splitext(os.path.basename(path))[0]
    stem = re.sub(r'[ _\-]?%s$' % role, '', stem, flags=re.IGNORECASE)
    return stem.strip(' _-').lower()

def resolve_profile_pairs(selected):
    """All selected reports -> [(xy_path, z_path, route name)], one pair per route.
    Pairs by file name (Civil 3D '...xy.xlsx' / '...z.xlsx'); reports whose names
    do not pair are matched by drawing path + parent alignment in the header."""
    import json
    if not selected:
        raise ValueError('Set Select both reports to True and Run; select the XY and Z Excel reports.')
    text = str(selected)
    paths = json.loads(text) if text.lstrip().startswith('[') else [text]
    unique, seen = [], set()
    for path in paths:
        key = os.path.normcase(os.path.abspath(path))
        if key not in seen:
            seen.add(key)
            unique.append(path)
    if len(unique) < 2 or len(unique) % 2:
        raise ValueError('Select an XY report AND a Z entity report for every route (%d files selected).'
                         % len(unique))
    info = []
    for path in unique:
        role, header = report_role(path)
        info.append(dict(path=path, role=role, header=header, stem=_report_stem(path, role)))
    xys = [i for i in info if i['role'] == 'xy']
    zs = [i for i in info if i['role'] == 'z']
    if len(xys) != len(zs):
        raise ValueError('Select one XY and one Z report per route: %d XY and %d Z reports selected.'
                         % (len(xys), len(zs)))
    pairs = []
    for xy in xys:                                        # 1) same file name apart from xy / z
        match = [z for z in zs if z['stem'] == xy['stem']]
        if len(match) == 1:
            pairs.append((xy, match[0]))
            zs.remove(match[0])
            xy['paired'] = True
    for xy in [x for x in xys if not x.get('paired')]:    # 2) same drawing + alignment
        key = (xy['header'].get('Drawing Path:'), xy['header'].get('Parent Alignment:'))
        match = [z for z in zs
                 if (z['header'].get('Drawing Path:'), z['header'].get('Parent Alignment:')) == key]
        if len(match) != 1:
            raise ValueError('Cannot find the Z report for ' + os.path.basename(xy['path']))
        pairs.append((xy, match[0]))
        zs.remove(match[0])
    return [(xy['path'], z['path'], xy['header'].get('Parent Alignment:') or xy['stem']) for xy, z in pairs]

def same_file(a, b):
    return os.path.normcase(os.path.abspath(str(a))) == os.path.normcase(os.path.abspath(str(b)))

"""V16 numerical engine. SI units; circular vertical-profile geometry.

IEEE 1185-2019 supplies Wc and listed SWBP factors. General 3D integration
is an engineering extension, not a claim that IEEE supplies a 3D equation.
No third-party packages are needed inside Dynamo.
"""
DEFAULTS = dict(cable_count=17, cable_mass_kg_m=.95, cable_diameter_mm=23.,
    conduit_diameter_mm=160., friction=.2, gravity=9.8, initial_tension_N=1960.,
    allowable_tension_N=30000., allowable_swbp_N_m=7000., allowable_fill=.4,
    formation='fourcables', assumptions_confirmed=False, max_step_m=.05,
    max_angle_step_deg=.25, manufacturer_swbp_factor=0.,
    min_bend_install_m=2.907, min_bend_static_m=1.938, grade_break_tol_deg=0.3, friction_high=0., sidewall_threshold_N_m=2185., three_cable_formation_rule=0.)
SETTING_KEYS=list(DEFAULTS)[:14]
EXTRA_SETTINGS={}
METHOD=[
 ['Weight','W = n m g (N/m); effective friction f = mu Wc, no rounding.'],
 ['Cable factors','IEEE 1185-2019 clause 4.13, equations 14-18. Single Wc=1; two triangular; three project ratio rule; four diamond; >4 assumed 1.4.'],
 ['Three cables','Project three-cable Wc rule: D/d<=2.5 triangular; <=3 diamond expression; >3 cradled expression. Middle band is user supplied, not verified IEEE. SWBP follows selected maintained formation.'],
 ['SWBP','MWP PullCal_V9 reference: single c=1; trefoil c=Wc/2; cradled c=(3Wc-2)/3; diamond c=Wc-1; more than four cables c=1.0 (conservative, no IEEE factor). Positive manufacturer override takes priority. P=c*T*kappa, sampled along each bend.'],
 ['Force balance','dT/dl = f*sqrt((T*kh)^2 + (T*kv-W*cos(alpha))^2) + W*sin(alpha).'],
 ['Curvature','kh=cos(alpha)^2/Rplan; kv=dalpha/dl; kappa=sqrt(kh^2+kv^2).'],
 ['Integration','RK4, full and half step. Refine until exit and sampled peaks differ by <=0.01 N or N/m plus 1e-7 relative.'],
 ['Contact','Absolute resultant normal force handles floor/roof contact continuously. No slope substitution for sags.'],
 ['Unknown joint','Zero-length capstan tension estimate; SWBP unresolved without radius.'],
 ['Slack','If taut tension reaches zero and would become negative, stop that direction. Subsequent results unavailable; braking/contact model required.'],
 ['Scope','3D force balance is an engineering extension of the straight/level bend relationships, requiring project review.'],
 ['Reports','Live formulas on fixed exported mesh. Rerun Dynamo after input changes to recheck convergence.'],
 ['Allowable tension','Allowable pulling tension = number of cables x maximum tension per cable x tension reduction factor when a per-cable limit is entered (as ELEK Cable Pulling). With a per-cable limit of 0 the total allowable pulling tension input is used.'],
 ['Bend radius','Effective radius R = 1/sqrt((cos^2(a)/R_plan)^2 + kv^2) at the tightest point of each curved section, compared with the cable minimum bending radius during installation and installed (HV cable datasheet). Grade breaks with no radius cannot be verified and stay REVIEW.'],
 ['ELEK-style section list','Sheets "R1 F list" and "R1 R list" (and one pair per route) list every section in pull order with Type, Specification, Length, Tension at the end of the section, sidewall force and Pass/Fail, in the same layout as the ELEK Cable Pulling section list, for a line by line comparison.'],
 ['High sidewall friction','If a high sidewall friction coefficient is entered, a section uses it (instead of the normal friction) when the sidewall force at the start of that section exceeds the sidewall pressure threshold. 0 switches this off. This matches the way ELEK Cable Pulling applies its high sidewall pressure friction.'],
 ['Three-cable factor rule','0 keeps the project ratio rule for three cables (D/d up to 2.5 triangular, up to 3 middle band, above 3 cradled). 1 uses the standard factor for the selected formation: triangular 1/sqrt(1-r^2) for Trefoil, cradled 1+4r^2/3 for Cradled.'],
 ['Grade breaks','A profile angle change between two entities counts as a grade break with no radius only if it exceeds the grade break tolerance (default 0.3 deg). Smaller steps are the report writing a parabolic curve as a circular arc; a 0.3 deg step needs about 1.5 cm of curve at the 2.907 m cable minimum radius.'],
 ['Reference','https://standards.ieee.org/ieee/1185/6194/']]

def validate_settings(settings=None):
    p=dict(DEFAULTS,**(settings or {}));p.update(EXTRA_SETTINGS)
    for key in DEFAULTS:
        if key in ('formation','assumptions_confirmed'):continue
        p[key]=finite(p[key],key)
        if p[key]<0 or (p[key]==0 and key not in ('friction','initial_tension_N','manufacturer_swbp_factor','min_bend_install_m','min_bend_static_m','grade_break_tol_deg','friction_high','sidewall_threshold_N_m','three_cable_formation_rule')):
            raise ValueError(key+' is outside its valid range')
    n=p['cable_count'];d=p['cable_diameter_mm'];D=p['conduit_diameter_mm'];form=p['formation']
    if n!=int(n):raise ValueError('Cable count must be an integer')
    if not isinstance(p['assumptions_confirmed'],bool):raise ValueError('Assumptions confirmed must be true/false')
    if D<=d or p['allowable_fill']>1:raise ValueError('Invalid conduit diameter or fill fraction')
    allowed={'Single':n==1,'Trefoil':n in (2,3),'Cradled':n==3,'Diamond':n==4,'fourcables':n>4}
    if not allowed.get(form,False):raise ValueError('Cable formation does not match cable count')
    fill=n*(d/D)**2
    if fill>p['allowable_fill']:raise ValueError('Cable fill %.2f%% exceeds configured allowance %.2f%%'%(100*fill,100*p['allowable_fill']))
    minimum={1:1.,2:2.,3:1+2/math.sqrt(3),4:1+math.sqrt(2)}
    if D/d<minimum.get(n,1):raise ValueError('Cables cannot geometrically fit the conduit')
    r=d/(D-d)
    if n==1:wc=1.;config='Single'
    elif n==2:wc=1/math.sqrt(1-r*r);config='Two cables'
    elif n==3:
        # Project-supplied ratio rule; the middle band is not claimed as IEEE verified.
        wc=(1/math.sqrt(1-r*r) if form=='Trefoil' else 1+4*r*r/3) if p['three_cable_formation_rule']>=.5 else (1/math.sqrt(1-r*r) if D/d<=2.5 else (1+2*r*r if D/d<=3 else 1+4*r*r/3))
        config='Cradled' if form=='Cradled' else 'Triangular'
    elif n==4:wc=1+2*r*r;config='Diamond'
    else:wc=1.4;config='More than four (assumed Wc=1.4)'
    c=1. if (n==1 or n>4) else (wc/2 if n==2 or config=='Triangular' else ((3*wc-2)/3 if config=='Cradled' else wc-1))
    if p['manufacturer_swbp_factor']>0:c=p['manufacturer_swbp_factor']
    p.update(weight_correction=wc,effective_friction=p['friction']*wc,
             weight_N_m=n*p['cable_mass_kg_m']*p['gravity'],fill=fill,configuration=config,swbp_factor=c)
    return p

def contact_force(T,alpha,kv,rh,p):
    kh=math.cos(alpha)**2/rh if rh else 0.
    return math.hypot(T*kh,T*kv-p['weight_N_m']*math.cos(alpha))

def derivative(T,alpha,kv,rh,p):
    return p['effective_friction']*contact_force(T,alpha,kv,rh,p)+p['weight_N_m']*math.sin(alpha)

def pressure(T,alpha,kv,rh,p):
    if p['swbp_factor'] is None:return None
    k=math.hypot(math.cos(alpha)**2/rh if rh else 0.,kv)
    return p['swbp_factor']*T*k

def integrate(seg,T,alpha,p,steps):
    h=seg['length']/steps;kv=seg['kv'];rh=seg['rh']
    peak=T;peak_p=pressure(T,alpha,kv,rh,p);peak_at=0.
    for j in range(steps):
        a=alpha+kv*j*h
        k1=derivative(T,a,kv,rh,p)
        u=T+h*k1/2;k2=derivative(u,a+kv*h/2,kv,rh,p)
        v=T+h*k2/2;k3=derivative(v,a+kv*h/2,kv,rh,p)
        z=T+h*k3;k4=derivative(z,a+kv*h,kv,rh,p)
        out=T+h*(k1+2*k2+2*k3+k4)/6
        if not math.isfinite(out):raise ValueError('Tension overflow: review geometry/friction')
        if min(T,u,v,z,out)<-1e-8:
            return dict(final=None,peak=peak,swbp=peak_p,peak_at=peak_at,slack=True,steps=steps)
        T=max(0.,out);peak=max(peak,T)
        q=pressure(T,a+kv*h,kv,rh,p)
        if q is not None and (peak_p is None or q>peak_p):peak_p=q;peak_at=(j+1)*h
    return dict(final=T,peak=peak,swbp=peak_p,peak_at=peak_at,slack=False,steps=steps)

def integrate_checked(seg,T,alpha,p):
    n=max(1,int(math.ceil(seg['length']/p['max_step_m'])),
          int(math.ceil(abs(seg['kv']*seg['length'])/math.radians(p['max_angle_step_deg']))),
          int(math.ceil(seg['length']/(seg['rh'] or 1e100)/math.radians(p['max_angle_step_deg']))))
    coarse=integrate(seg,T,alpha,p,n)
    for _ in range(9):
        if n>500000:raise ValueError('Integration too large: review step size or split route')
        fine=integrate(seg,T,alpha,p,n*2)
        if fine['slack'] and coarse['slack']:
            fine['error']=None;return fine
        keys=('final','peak','swbp')
        if not fine['slack'] and not coarse['slack']:
            delta=[abs(fine[k]-coarse[k]) for k in keys if fine[k] is not None]
            if all(abs(fine[k]-coarse[k])<=.01+1e-7*abs(fine[k]) for k in keys if fine[k] is not None):
                fine['error']=max(delta,default=0.);return fine
        coarse=fine;n*=2
    raise ValueError('Integration did not converge; reduce step limits')

HEAD=['Section','Type','Station in (m)','Station out (m)','Length (m)','Angle in (deg)',
      'Angle out (deg)','Plan radius (m)','Profile radius (m)','T1 (N)','T2 (N)',
      'Peak T (N)','Peak SWBP (N/m)','SWBP station (m)','Step comparison max difference',
      'Tension check','SWBP check','Review']

def section_params(p,T,alpha,s):
    """High sidewall friction: the whole section uses it when the sidewall force at its entry exceeds the threshold."""
    if p['friction_high']>0 and T is not None and (s['kv'] or s['rh']):
        q=pressure(T,alpha,s['kv'],s['rh'],p)
        if q is not None and q>p['sidewall_threshold_N_m']:
            return dict(p,friction=p['friction_high'],effective_friction=p['friction_high']*p['weight_correction'])
    return p

def solve_direction(segments,p,reverse=False):
    order=list(reversed(segments)) if reverse else segments
    T=p['initial_tension_N'];rows=[];unresolved=0;slack=False;maxerr=0.;switched=0
    for i,s in enumerate(order):
        a,b=(-s['a1'],-s['a0']) if reverse else (s['a0'],s['a1'])
        si,so=(s['s1'],s['s0']) if reverse else (s['s0'],s['s1'])
        joint=(order[i-1]['joint_angle'] if i else 0.) if reverse else s['joint_angle']
        unresolved+=bool(joint)
        if slack:
            rows.append([s['id'],s['kind'],si,so,s['length'],math.degrees(a),math.degrees(b),s['rh'],
                         abs(1/s['kv']) if s['kv'] else None,None,None,None,None,None,None,
                         'UNAVAILABLE','UNAVAILABLE','Upstream loss of taut tension'])
            continue
        if joint:T*=math.exp(p['effective_friction']*joint)
        tin=T
        ps=section_params(p,T,a,s);switched+=(ps is not p)
        v=integrate_checked(s,T,a,ps);slack=v['slack'];T=v['final']
        maxerr=max(maxerr,v['error'] or 0.)
        distance=v['peak_at'];kv=s['kv']
        ds=(math.sin(a+kv*distance)-math.sin(a))/kv if kv else distance*math.cos(a)
        station=si-ds if reverse else si+ds
        curved=bool(s['rh'] or kv)
        swbp=v['swbp'] if curved else 0.
        note='Loss of taut tension; direction stopped' if slack else ('Joint radius missing' if joint else '')
        rows.append([s['id'],s['kind'],si,so,s['length'],math.degrees(a),math.degrees(b),s['rh'],
                     abs(1/kv) if kv else None,tin,T,v['peak'],swbp,station if curved and swbp is not None else None,
                     v['error'],'FAIL' if v['peak']>p['allowable_tension_N'] else ('REVIEW' if slack else 'WITHIN LIMIT'),
                     'UNAVAILABLE' if swbp is None else ('FAIL' if swbp>p['allowable_swbp_N_m'] else 'WITHIN LIMIT'),note])
    peak=max([p['initial_tension_N']]+[r[11] for r in rows if r[11] is not None])
    pp=[r[12] for r in rows if r[12] is not None];peakp=max(pp) if pp else None
    complete=not slack
    pressure_complete=complete and not unresolved and all(r[12] is not None for r in rows)
    tc='FAIL' if peak>p['allowable_tension_N'] else ('WITHIN LIMIT' if complete else 'UNAVAILABLE')
    pc='FAIL' if peakp is not None and peakp>p['allowable_swbp_N_m'] else ('WITHIN LIMIT' if pressure_complete else 'UNAVAILABLE')
    status='FAIL' if 'FAIL' in (tc,pc) else 'REVIEW REQUIRED'
    return dict(rows=rows,final=T,peak=peak,swbp=peakp if pressure_complete else None,
                known_swbp=peakp,joints=unresolved,slack=slack,error=maxerr,tension_check=tc,swbp_check=pc,status=status,switched=switched)

BEND_HEAD=['Section','Type','Station in (m)','Station out (m)','Plan radius (m)','Profile radius (m)',
           'Effective bend radius (m)','Min radius installation (m)','Margin installation (m)','Installation check',
           'Min radius installed (m)','Margin installed (m)','Installed check']

def bend_radius_check(segments,p):
    """HV cable minimum bending radius check.

    Effective radius is the reciprocal of the same curvature the force balance uses,
    kappa = sqrt((cos(a)^2/R_plan)^2 + kv^2), taken at the tightest point of each
    curved section. A limit of 0 switches that check off.
    """
    mbr=p['min_bend_install_m'];mbs=p['min_bend_static_m'];rows=[];issues=[];smallest=None;where=None
    for s in segments:
        rh=s['rh'];kv=s['kv']
        if not rh and not kv:continue
        c2=max(math.cos(s['a0'])**2,math.cos(s['a1'])**2)
        if s['a0']*s['a1']<0:c2=1.
        kappa=math.hypot(c2/rh if rh else 0.,kv)
        if not kappa:continue
        reff=1/kappa
        if smallest is None or reff<smallest:smallest=reff;where=s['s0']
        pull='NOT CHECKED' if mbr<=0 else ('FAIL' if reff<mbr else 'WITHIN LIMIT')
        inst='NOT CHECKED' if mbs<=0 else ('FAIL' if reff<mbs else 'WITHIN LIMIT')
        rows.append([s['id'],s['kind'],s['s0'],s['s1'],rh,abs(1/kv) if kv else None,reff,
                     mbr if mbr>0 else None,reff-mbr if mbr>0 else None,pull,
                     mbs if mbs>0 else None,reff-mbs if mbs>0 else None,inst])
        if pull=='FAIL':
            issues.append(['FAIL',s['s0'],'Bend radius below cable minimum (installation)',
                           'Section %d (%s): effective radius %.3f m is below the %.3f m minimum bending radius during installation.'%(s['id'],s['kind'],reff,mbr)])
        elif inst=='FAIL':
            issues.append(['FAIL',s['s0'],'Bend radius below cable minimum (installed)',
                           'Section %d (%s): effective radius %.3f m is below the %.3f m minimum installed bending radius.'%(s['id'],s['kind'],reff,mbs)])
    joints=len([s for s in segments if s['joint_angle']])
    def verdict(limit,key):
        if limit<=0:return 'NOT CHECKED'
        if any(r[key]=='FAIL' for r in rows):return 'FAIL'
        return 'REVIEW' if joints else 'WITHIN LIMIT'
    pull_check=verdict(mbr,9);static_check=verdict(mbs,12)
    if smallest is None:text='%s: no curved sections'%pull_check
    elif mbr<=0:text='NOT CHECKED (limit is 0); smallest radius %.3f m'%smallest
    else:text='%s: smallest %.3f m vs %.3f m minimum'%(pull_check,smallest,mbr)
    if joints and mbr>0:text+='; %d grade break(s) without radius cannot be verified'%joints
    return dict(rows=rows,issues=issues,min_radius=smallest,min_station=where,pull_check=pull_check,
                static_check=static_check,joints=joints,text=text)

def calculate(xy,z,settings=None):
    p=validate_settings(settings);globals()['GRADE_BREAK_MIN_DEG']=p['grade_break_tol_deg'];segments,issues,meta=build_geometry(read_xlsx(xy),read_xlsx(z))
    if not p['assumptions_confirmed']:issues.append(['REVIEW',None,'Cable assumptions','Confirm project values before use'])
    if p['cable_count']>4 and p['manufacturer_swbp_factor']<=0:issues.append(['REVIEW',None,'SWBP factor for more than four cables','IEEE gives no factor; conservative c=1.0 used. Enter a manufacturer factor to override.'])
    if p['cable_count']==2:issues.append(['REVIEW',None,'Two-cable SWBP factor','c=Wc/2 is not an IEEE case; confirm with manufacturer.'])
    if p['cable_count']==3 and 2.8<=p['conduit_diameter_mm']/p['cable_diameter_mm']<=3.2:
        issues.append(['REVIEW',None,'Three-cable jam ratio','D/d is within 2.8 to 3.2'])
    if p['cable_count']==3 and p['formation']=='Trefoil' and 2.5<p['conduit_diameter_mm']/p['cable_diameter_mm']<=3:
        issues.append(['REVIEW',None,'Three-cable arrangement','Project-supplied middle-band Wc=1+2r^2 used; differs from the verified IEEE 1185-2010 cradled rule'])
    f=solve_direction(segments,p);r=solve_direction(segments,p,True)
    bend=bend_radius_check(segments,p)
    for item in bend['issues']:issues.append(item)
    if f['switched'] or r['switched']:issues.append(['INFO',None,'High sidewall friction applied','%d section(s) forward and %d reverse used the high sidewall friction of %.3f because the sidewall force at section entry exceeded %.0f N/m.'%(f['switched'],r['switched'],p['friction_high'],p['sidewall_threshold_N_m'])])
    for name,run in [('Forward',f),('Reverse',r)]:
        if run['slack']:issues.append(['REVIEW',None,name+' lost taut tension','Direction stopped; subsequent values unavailable'])
    meta.update(xy_path=os.path.abspath(xy),z_path=os.path.abspath(z),generated=datetime.now().isoformat())
    return dict(settings=p,segments=segments,issues=issues,metadata=meta,forward=f,reverse=r,bend=bend)

def result_tables(r):
    p=r['settings'];b=r['bend'];summary=[['Cable pull V16 - corrected numerical calculation'],
      ['Snapshot: change inputs in Dynamo and rerun. General 3D engineering model; review required.'],[],
      ['Direction','Exit T (N)','Peak T (N)','Peak SWBP (N/m)','Tension check','SWBP check','Status','Convergence difference']]
    for key in ('forward','reverse'):
        v=r[key];summary.append([key,v['final'],v['peak'],v['swbp'],v['tension_check'],v['swbp_check'],v['status'],v['error']])
    summary.extend([[],['Allowable tension (N)',p['allowable_tension_N']],['Allowable SWBP (N/m)',p['allowable_swbp_N_m']],
                    ['Cable fill (%)',p['fill']*100],['Allowable fill (%)',p['allowable_fill']*100],
                    ['Minimum bend radius during installation (m)',p['min_bend_install_m']],
                    ['Minimum bend radius installed (m)',p['min_bend_static_m']],
                    ['Smallest effective bend radius on route (m)',b['min_radius']],
                    ['Bend radius check (installation)',b['pull_check']],['Bend radius check (installed)',b['static_check']]])
    return {'Summary':summary,'Inputs':[['Input / derived value','Value']]+[[k,v] for k,v in p.items()],
            'Bend Radius':[BEND_HEAD]+b['rows'],
            'Forward':[HEAD]+r['forward']['rows'],'Reverse':[HEAD]+r['reverse']['rows'],
            'Review':[['Level','Station (m)','Item','Detail']]+r['issues'],
            'Method':[['Item','Basis']]+METHOD,
            'Sources':[['Item','Value']]+[[k,r['metadata'][k]] for k in ('xy_path','z_path','generated')]}

def export_snapshot(path,tables):
    """Dynamo runtime XLSX export. Typed snapshots; never overwrite source files.

    Formula-leading source text is always inline text, never executable Excel.
    This deliberately does not retain V15's now-invalid live bend formulas.
    """
    from xml.sax.saxutils import escape,quoteattr
    content=['<Types xmlns="http://schemas.openxmlformats.org/package/2006/content-types"><Default Extension="rels" ContentType="application/vnd.openxmlformats-package.relationships+xml"/><Default Extension="xml" ContentType="application/xml"/><Override PartName="/xl/workbook.xml" ContentType="application/vnd.openxmlformats-officedocument.spreadsheetml.sheet.main+xml"/><Override PartName="/xl/styles.xml" ContentType="application/vnd.openxmlformats-officedocument.spreadsheetml.styles+xml"/>']
    wb=['<workbook xmlns="'+NS+'" xmlns:r="'+REL+'"><sheets>'];rels=['<Relationships xmlns="http://schemas.openxmlformats.org/package/2006/relationships">']
    parts={}
    for k,(name,rows) in enumerate(tables.items(),1):
        wb.append('<sheet name=%s sheetId="%d" r:id="r%d"/>'%(quoteattr(name),k,k))
        rels.append('<Relationship Id="r%d" Type="%s/worksheet" Target="worksheets/sheet%d.xml"/>'%(k,REL,k))
        content.append('<Override PartName="/xl/worksheets/sheet%d.xml" ContentType="application/vnd.openxmlformats-officedocument.spreadsheetml.worksheet+xml"/>'%k)
        freeze=4 if name=='Summary' else 1
        cols=max(map(len,rows),default=1)
        widths=[max(16,min(65,max((len(str(row[c])) for row in rows if c<len(row) and row[c] is not None),default=12)+2)) for c in range(cols)]
        xml=['<worksheet xmlns="'+NS+'"><sheetViews><sheetView workbookViewId="0" showGridLines="0"><pane ySplit="%d" topLeftCell="A%d" activePane="bottomLeft" state="frozen"/></sheetView></sheetViews><cols>'%(freeze,freeze+1)]
        xml.extend('<col min="%d" max="%d" width="%d" customWidth="1"/>'%(j,j,v) for j,v in enumerate(widths,1))
        xml.append('</cols><sheetData>')
        for ri,row in enumerate(rows,1):
            height=45 if name in ('Method','Review','Sources') else 30
            xml.append('<row r="%d" ht="%d" customHeight="1">'%(ri,height))
            for ci,v in enumerate(row,1):
                if v is None:continue
                a=col_label(ci)+str(ri);style=1 if ri==freeze else 0
                if isinstance(v,(int,float)) and not isinstance(v,bool):
                    if not math.isfinite(v):raise ValueError('Nonfinite report value')
                    xml.append('<c r="%s" s="%d"><v>%r</v></c>'%(a,2 if style==0 else style,v))
                else:xml.append('<c r="%s" s="%d" t="inlineStr"><is><t xml:space="preserve">%s</t></is></c>'%(a,style,escape(str(v))))
            xml.append('</row>')
        xml.append('</sheetData></worksheet>');parts['xl/worksheets/sheet%d.xml'%k]=''.join(xml)
    wb.append('</sheets></workbook>');rels.append('<Relationship Id="styles" Type="'+REL+'/styles" Target="styles.xml"/></Relationships>');content.append('</Types>')
    parts.update({'[Content_Types].xml':''.join(content),'xl/workbook.xml':''.join(wb),'xl/_rels/workbook.xml.rels':''.join(rels),
      '_rels/.rels':'<Relationships xmlns="http://schemas.openxmlformats.org/package/2006/relationships"><Relationship Id="r1" Type="'+REL+'/officeDocument" Target="xl/workbook.xml"/></Relationships>',
      'xl/styles.xml':'<styleSheet xmlns="'+NS+'"><fonts count="2"><font><sz val="11"/><name val="Arial"/></font><font><b/><sz val="11"/><color rgb="FFFFFFFF"/><name val="Arial"/></font></fonts><fills count="3"><fill><patternFill patternType="none"/></fill><fill><patternFill patternType="gray125"/></fill><fill><patternFill patternType="solid"><fgColor rgb="FF243B53"/></patternFill></fill></fills><borders count="1"><border/></borders><cellStyleXfs count="1"><xf numFmtId="0" fontId="0" fillId="0" borderId="0"/></cellStyleXfs><cellXfs count="3"><xf numFmtId="0" fontId="0" fillId="0" borderId="0" xfId="0" applyAlignment="1"><alignment vertical="center" wrapText="1"/></xf><xf numFmtId="0" fontId="1" fillId="2" borderId="0" xfId="0" applyAlignment="1"><alignment vertical="center" wrapText="1"/></xf><xf numFmtId="4" fontId="0" fillId="0" borderId="0" xfId="0"/></cellXfs><cellStyles count="1"><cellStyle name="Normal" xfId="0" builtinId="0"/></cellStyles></styleSheet>'})
    with zipfile.ZipFile(path,'x',zipfile.ZIP_DEFLATED) as z:
        for name,data in parts.items():z.writestr(name,'<?xml version="1.0" encoding="UTF-8" standalone="yes"?>'+data)

def run_from_dynamo(values):
    if len(values)!=20:raise ValueError('Expected 20 input ports')
    settings=dict(zip(SETTING_KEYS,values[4:18]))
    settings['manufacturer_swbp_factor']=values[18] or 0.
    # Validate before browsing reports or exporting anything.
    validate_settings(settings)
    pairs=resolve_profile_pairs(values[0]) if same_file(values[0],values[1]) else [(str(values[0]),str(values[1]),'Route')]
    folder=str(values[19] or '').strip()
    if values[3] and (not folder or not os.path.isdir(folder)):
        raise ValueError('Select an existing Excel export folder')
    runs=[];tables={};summary=[['Route','Forward peak T (N)','Reverse peak T (N)','Forward SWBP (N/m)','Reverse SWBP (N/m)','Forward status','Reverse status','Error']]
    for xy,z,name in pairs:
        try:
            result=calculate(xy,z,settings);f=result['forward'];r=result['reverse']
            runs.append(dict(route=name,result=result))
            summary.append([name,f['peak'],r['peak'],f['swbp'],r['swbp'],f['status'],r['status'],''])
        except Exception as error:
            if len(pairs)==1:raise
            runs.append(dict(route=name,error=str(error)))
            summary.append([name,None,None,None,None,'NOT CALCULATED','NOT CALCULATED',str(error)])
    if len(runs)==1:tables=result_tables(runs[0]['result'])
    else:
        tables={'Batch Summary':summary}
        for i,run in enumerate(runs,1):
            if 'result' in run:
                for key,data in result_tables(run['result']).items():tables['%d %s'%(i,key)]=data
    path='Preview only'
    if values[3]:
        path=os.path.join(folder,'Civil3D_PullCal_V16_'+datetime.now().strftime('%Y%m%d_%H%M%S_%f')+'.xlsx')
        export_snapshot(path,tables)
    return ['V16: corrected 3D numerical calculation',path,summary,
            ['Inputs',validate_settings(settings)],['Routes',runs],['Method',METHOD]]


def inspect_work(output,selectors):
    # One-based selection: route, direction (1 forward / 2 reverse), section, step.
    indices=[]
    for value in selectors:
        if isinstance(value,bool) or not isinstance(value,(int,float)) or not math.isfinite(value) or value<1 or value!=int(value):
            raise ValueError('Formula inspector selectors must be positive whole numbers')
        indices.append(int(value))
    route,direction,section,step=indices
    runs=output[4][1]
    if route>len(runs) or direction not in (1,2):raise ValueError('Formula inspector route/direction is outside the available range')
    run=runs[route-1]
    if 'result' not in run:raise ValueError('Selected route was not calculated')
    result=run['result'];p=result['settings'];reverse=direction==2
    order=list(reversed(result['segments'])) if reverse else result['segments']
    rows=result['reverse' if reverse else 'forward']['rows']
    if section>len(rows):raise ValueError('Formula inspector section exceeds %d'%len(rows))
    s=order[section-1];row=rows[section-1]
    if row[9] is None:raise ValueError('Selected section is unavailable after loss of taut tension')
    a=math.radians(row[5]);T=row[9];kv=s['kv'];rh=s['rh'];p=section_params(p,T,a,s)
    checked=integrate_checked(s,T,a,p);n=checked['steps']
    if step>n:raise ValueError('Formula inspector step exceeds %d'%n)
    h=s['length']/n
    for j in range(step):
        alpha=a+kv*j*h
        k1=derivative(T,alpha,kv,rh,p)
        u=T+h*k1/2;k2=derivative(u,alpha+kv*h/2,kv,rh,p)
        v=T+h*k2/2;k3=derivative(v,alpha+kv*h/2,kv,rh,p)
        z=T+h*k3;k4=derivative(z,alpha+kv*h,kv,rh,p)
        raw=T+h*(k1+2*k2+2*k3+k4)/6
        if min(T,u,v,z,raw)<-1e-8:
            raise ValueError('Selected step reaches loss of taut tension; inspect an earlier step')
        if j==step-1:break
        T=max(0.,raw)
    joint=(order[section-2]['joint_angle'] if section>1 else 0.) if reverse else s['joint_angle']
    previous=p['initial_tension_N'] if section==1 else rows[section-2][10]
    cable=[p[k] for k in ('cable_count','cable_mass_kg_m','gravity','cable_diameter_mm','conduit_diameter_mm','friction')]
    cable += [p['configuration']=='Triangular',p['weight_correction'],p['manufacturer_swbp_factor'],p['swbp_factor']]
    state=[T,math.degrees(alpha),kv,rh or 0.,h,p['effective_friction'],p['weight_N_m'],p['swbp_factor'],max(0.,raw),pressure(max(0.,raw),alpha+kv*h,kv,rh,p)]
    geometry=[row[9],s['length'],row[5],rh or 0.,abs(s['s1']-s['s0']),kv,row[10],previous,math.degrees(joint),row[11],row[12]]
    info=[['Route',run['route']],['Direction','Reverse' if reverse else 'Forward'],['Section',section],['Type',s['kind']],['Station in/out',row[2:4]],['Step',step],['Accepted steps in section',n],['Selected step exit N',max(0.,raw)],['Whole section exit N',row[10]],['Whole section peak N',row[11]],['Whole section peak SWBP N/m',row[12]],['Step size m',h],['Note','Step exit is not whole-section exit unless the last step is selected. All four vertical bend orientations and compound curves use the same force-balance steps.']]
    return [cable,state,geometry,info]


EMBEDDED_TEMPLATE = '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'
"""Dynamo's standard-library adapter: preserve the supplied XLSX package assets.

The host-authored template is embedded in the graph. Excel formulas are emitted
alongside independently computed caches; no Excel installation is needed to export.
"""
import base64, io, copy

_report_indices={}
class ExcelFormula:
    def __init__(self,text,value):self.text=text;self.value=value

def report_cell(root,address,value,style=None):
    data=root.find(tag('sheetData'))
    rn=int(re.search(r'\d+',address).group())
    if root not in _report_indices:
        _report_indices[root]=({int(r.get('r')):r for r in data},{c.get('r'):c for r in data for c in r})
    rows,cells=_report_indices[root]
    row=rows.get(rn)
    if row is None:
        row=ET.SubElement(data,tag('row'),{'r':str(rn)});rows[rn]=row
    cell=cells.get(address)
    if cell is None:cell=ET.SubElement(row,tag('c'),{'r':address});cells[address]=cell
    for child in list(cell):cell.remove(child)
    cell.attrib.pop('t',None)
    if style is not None:cell.set('s',str(style))
    if isinstance(value,ExcelFormula):
        ET.SubElement(cell,tag('f')).text=value.text.lstrip('=');value=value.value
        if isinstance(value,str):cell.set('t','str')
        if value is not None:ET.SubElement(cell,tag('v')).text=str(value)
    elif isinstance(value,(float,int)):
        ET.SubElement(cell,tag('v')).text=repr(value)
    elif value is not None:
        cell.set('t','inlineStr');ET.SubElement(ET.SubElement(cell,tag('is')),tag('t')).text=str(value)

def report_xml(root):
    root.attrib.pop('{http://schemas.openxmlformats.org/markup-compatibility/2006}Ignorable',None)
    data=root.find(tag('sheetData'))
    data[:]=sorted(data,key=lambda r:int(r.get('r')))
    for row in data:row[:]=sorted(row,key=lambda c:col_number(re.sub(r'\d','',c.get('r'))))
    addresses=[c.get('r') for row in data for c in row if len(c)]
    if addresses:
        endcol=max(col_number(re.sub(r'\d','',a)) for a in addresses);endrow=max(int(re.search(r'\d+',a).group()) for a in addresses)
        dimension=root.find(tag('dimension'))
        if dimension is None:dimension=ET.Element(tag('dimension'));root.insert(0,dimension)
        dimension.set('ref','A1:'+col_label(endcol)+str(endrow))
    return ET.tostring(root,encoding='utf-8',xml_declaration=True)

def clear_report(root):
    for cell in root.findall('.//'+tag('c')):
        for ch in list(cell):cell.remove(ch)
        cell.attrib.pop('t',None)
    for name in ('conditionalFormatting','dataValidations','hyperlinks'):
        for el in root.findall(tag(name)):root.remove(el)

def report_widths(root,changes):
    cols=root.find(tag('cols'));mapping={}
    if cols is None:
        cols=ET.Element(tag('cols'));root.insert(list(root).index(root.find(tag('sheetData'))),cols)
    for old in cols:
        for i in range(int(old.get('min')),int(old.get('max'))+1):mapping[i]=dict(old.attrib)
    for i,width in changes.items():mapping[i]=dict(mapping.get(i,{}),width=str(width),customWidth='1')
    cols.clear()
    for i,attrs in sorted(mapping.items()):ET.SubElement(cols,tag('col'),dict(attrs,min=str(i),max=str(i)))

def report_height(root,row,height):
    data=root.find(tag('sheetData'));r=next((x for x in data if int(x.get('r'))==row),None)
    if r is not None:r.set('ht',str(height));r.set('customHeight','1')

def report_merge(root,address):
    merges=root.find(tag('mergeCells'))
    if merges is None:
        merges=ET.Element(tag('mergeCells'));root.insert(list(root).index(root.find(tag('sheetData')))+1,merges)
    if not any(m.get('ref')==address for m in merges):ET.SubElement(merges,tag('mergeCell'),{'ref':address})
    merges.set('count',str(len(merges)))

def fresh_sheet():
    root=ET.Element(tag('worksheet'))
    views=ET.SubElement(root,tag('sheetViews'));view=ET.SubElement(views,tag('sheetView'),{'workbookViewId':'0','showGridLines':'0'})
    ET.SubElement(view,tag('pane'),{'xSplit':'2','ySplit':'3','topLeftCell':'C4','activePane':'bottomRight','state':'frozen'})
    cols=ET.SubElement(root,tag('cols'));ET.SubElement(cols,tag('col'),{'min':'1','max':'29','width':'17','customWidth':'1'})
    ET.SubElement(root,tag('sheetData'))
    return root

def live_steps(segments,p,reverse,name,style,headerstyle=None,integerstyle=None):
    """One visible row per accepted RK4 step; all calculations remain Excel formulas."""
    root=fresh_sheet();put=lambda a,v:report_cell(root,a,v,style)
    put('A1',name+' — RK4 working');put('A2','Fixed exported mesh. Change inputs in Dynamo and rerun to verify convergence. Negative taut tension stops the pull.')
    headers=['Section','Step','h (m)','alpha (rad)','kv (1/m)','Rplan (m; 0=none)','T in (N)','kh start','Normal 1 (N/m)','k1 (N/m)','Trial T mid 1','alpha mid','kh mid','Normal 2','k2','Trial T mid 2','Normal 3','k3','Trial T end','alpha end','kh end','Normal 4','k4','Delta T (N)','T out (N)','P in (N/m)','P out (N/m)','Peak T in section','Peak P in section','Friction used (eff.)']
    for c,v in enumerate(headers,1):report_cell(root,col_label(c)+'3',v,headerstyle or style)
    root.find(tag('sheetData'))[-1].set('ht','60');root.find(tag('sheetData'))[-1].set('customHeight','1')
    order=list(reversed(segments)) if reverse else segments
    result=[];r=4;T=p['initial_tension_N'];prev=None
    W="'IEEE Inputs'!$C$29";f="'IEEE Inputs'!$C$27";c="'IEEE Inputs'!$C$33"
    for i,s in enumerate(order):
        a=-s['a1'] if reverse else s['a0'];kv=s['kv'];rh=s['rh'] or 0
        joint=(order[i-1]['joint_angle'] if i else 0.) if reverse else s['joint_angle']
        tin=T*math.exp(p['effective_friction']*joint) if T is not None else None
        ps=section_params(p,tin,a,s)
        n=integrate_checked(s,tin,a,ps)['steps'] if tin is not None else 2*max(1,int(math.ceil(s['length']/p['max_step_m'])),int(math.ceil(abs(kv*s['length'])/math.radians(p['max_angle_step_deg']))),int(math.ceil(s['length']/(rh or 1e100)/math.radians(p['max_angle_step_deg']))))
        if r+n>1048576:raise ValueError('Excel step sheet exceeds row limit. Split this route.')
        h=s['length']/n;first=r;peak=tin;peakp=pressure(tin,a,kv,rh,p) if tin is not None else None
        if not (kv or rh) and tin is not None:peakp=0.
        T=tin
        for j in range(n):
            angle=a+kv*j*h
            vals={};forms={}
            def v(col,value):vals[col]=value
            def q(col,formula,value,guard=True):
                forms[col]=('IF(ISNUMBER(G%d),%s,"UNAVAILABLE")'%(r,formula)) if guard else formula
                vals[col]=value if value is not None else 'UNAVAILABLE'
            for col,value in zip('ABCDEF',[s['id'],j+1,h,angle,kv,rh]):v(col,value)
            start="'IEEE Inputs'!$C$12" if prev is None else 'Y%d'%prev
            q('G',('IF(ISNUMBER(%s),%s*EXP(%s*%.17g),"UNAVAILABLE")'%(start,start,f,joint)) if j==0 else 'Y%d'%(r-1),T,False)
            if T is not None:
                kh=math.cos(angle)**2/rh if rh else 0.;normal=contact_force(T,angle,kv,rh,p);k1=derivative(T,angle,kv,rh,ps)
                u=T+h*k1/2;am=angle+kv*h/2;km=math.cos(am)**2/rh if rh else 0.;nm=contact_force(u,am,kv,rh,p);k2=derivative(u,am,kv,rh,ps)
                tmid=T+h*k2/2;nn=contact_force(tmid,am,kv,rh,p);k3=derivative(tmid,am,kv,rh,ps)
                z=T+h*k3;ae=angle+kv*h;ke=math.cos(ae)**2/rh if rh else 0.;ne=contact_force(z,ae,kv,rh,p);k4=derivative(z,ae,kv,rh,ps)
                inc=h*(k1+2*k2+2*k3+k4)/6;out=max(0.,T+inc) if min(T,u,tmid,z,T+inc)>=-1e-8 else None
                pi=pressure(T,angle,kv,rh,p) if (kv or rh) else 0.
                po=(pressure(out,ae,kv,rh,p) if (kv or rh) else 0.) if out is not None else None
            else:kh=normal=k1=u=am=km=nm=k2=tmid=nn=k3=z=ae=ke=ne=k4=inc=out=pi=po=None
            def ref(col):return col+str(r)
            G,H,I,J,K,L,M,N,O,P,Q,R,S,U,V,Wk,X,Y=[ref(x) for x in ['G','H','I','J','K','L','M','N','O','P','Q','R','S','U','V','W','X','Y']]
            C,D,E,F,Te=[ref(x) for x in ['C','D','E','F','T']];AD=ref('AD')
            q('H',f'IF({F}=0,0,COS({D})^2/{F})',kh)
            q('I',f'SQRT(({G}*{H})^2+({G}*{E}-{W}*COS({D}))^2)',normal)
            q('J',f'{AD}*{I}+{W}*SIN({D})',k1);q('K',f'{G}+{C}*{J}/2',u)
            q('L',f'{D}+{E}*{C}/2',am);q('M',f'IF({F}=0,0,COS({L})^2/{F})',km)
            q('N',f'SQRT(({K}*{M})^2+({K}*{E}-{W}*COS({L}))^2)',nm)
            q('O',f'{AD}*{N}+{W}*SIN({L})',k2);q('P',f'{G}+{C}*{O}/2',tmid)
            q('Q',f'SQRT(({P}*{M})^2+({P}*{E}-{W}*COS({L}))^2)',nn)
            q('R',f'{AD}*{Q}+{W}*SIN({L})',k3);q('S',f'{G}+{C}*{R}',z)
            q('T',f'{D}+{E}*{C}',ae);q('U',f'IF({F}=0,0,COS({Te})^2/{F})',ke)
            q('V',f'SQRT(({S}*{U})^2+({S}*{E}-{W}*COS({Te}))^2)',ne)
            q('W',f'{AD}*{V}+{W}*SIN({Te})',k4);q('X',f'{C}*({J}+2*{O}+2*{R}+{Wk})/6',inc)
            q('Y',f'IF(MIN({G},{K},{P},{S},{G}+{X})<-0.00000001,"UNAVAILABLE",MAX(0,{G}+{X}))',out)
            q('Z',f'IF(AND({E}=0,{F}=0),0,IF(ISNUMBER({c}),{c}*{G}*SQRT({H}^2+{E}^2),"UNAVAILABLE"))',pi)
            q('AA',f'IF(ISNUMBER({Y}),IF(AND({E}=0,{F}=0),0,IF(ISNUMBER({c}),{c}*{Y}*SQRT({U}^2+{E}^2),"UNAVAILABLE")),"UNAVAILABLE")',po)
            peak=max(x for x in (peak,T,out) if x is not None) if any(x is not None for x in (peak,T,out)) else None
            if pi is not None:peakp=max(x for x in (peakp,pi,po) if x is not None)
            q('AB',f'IF(ISNUMBER({G}),MAX({G},{Y}),"UNAVAILABLE")' if j==0 else f'IF(ISNUMBER(AB{r-1}),MAX(AB{r-1},IF(ISNUMBER({Y}),{Y},0)),"UNAVAILABLE")',peak,False)
            if j==0 and T is None:forms['AB']='"UNAVAILABLE"'
            q('AC',f'IF(ISNUMBER(Z{r}),MAX(Z{r},AA{r}'+(')' if j==0 else f',AC{r-1})')+(',"UNAVAILABLE")' if j==0 else f',AC{r-1})'),peakp,False)
            q('AD',(("IF(AND('IEEE Inputs'!$C$46>0,ISNUMBER(Z%d),Z%d>'IEEE Inputs'!$C$47),'IEEE Inputs'!$C$46*'IEEE Inputs'!$C$26,'IEEE Inputs'!$C$27)"%(first,first)) if j==0 else 'AD%d'%first),ps['effective_friction'],False)
            for col,value in vals.items():
                if col in ('A','B'):report_cell(root,col+str(r),value,integerstyle or style)
                else:put(col+str(r),ExcelFormula(forms[col],value) if col in forms else value)
            T=out;prev=r;r+=1
        result.append(dict(first=first,last=r-1,segment=s,joint=joint,tin=tin,tout=T,peak=peak,pressure=peakp,steps=n))
    return root,result

"""Normalize non-calculation Office metadata after ElementTree serialization."""
def normalize_excel_metadata(parts):
    main='http://schemas.openxmlformats.org/spreadsheetml/2006/main'
    rel='http://schemas.openxmlformats.org/officeDocument/2006/relationships'
    mc='http://schemas.openxmlformats.org/markup-compatibility/2006'
    allowed={main,rel,'http://www.w3.org/XML/1998/namespace'}
    def namespace(name):return name[1:].split('}',1)[0] if name.startswith('{') else ''
    def clean(parent):
        for attr in list(parent.attrib):
            ns=namespace(attr)
            if ns and ns not in allowed:del parent.attrib[attr]
        for child in list(parent):
            ns=namespace(child.tag)
            if ns==mc and child.tag.endswith('AlternateContent'):
                fallback=child.find('{'+mc+'}Fallback');index=list(parent).index(child)
                parent.remove(child)
                if fallback is not None:
                    for element in list(fallback):clean(element);parent.insert(index,element);index+=1
            elif ns and ns!=main:parent.remove(child)
            elif child.tag=='{'+main+'}extLst':
                # Only vendor metadata extensions occur in these generated sheets.
                parent.remove(child)
            else:clean(child)
    for name in list(parts):
        if name in ('xl/workbook.xml','xl/styles.xml') or (name.startswith('xl/worksheets/report') and name.endswith('.xml')):
            root=ET.fromstring(parts[name]);clean(root)
            parts[name]=ET.tostring(root,encoding='utf-8',xml_declaration=True)
    return parts


REFERENCE_ROUTE_COLS = '<ns0:cols xmlns:ns0="http://schemas.openxmlformats.org/spreadsheetml/2006/main"><ns0:col min="2" max="4" width="4.85546875" customWidth="1" /><ns0:col min="8" max="8" width="9.42578125" bestFit="1" customWidth="1" /><ns0:col min="10" max="10" width="9.42578125" bestFit="1" customWidth="1" /><ns0:col min="12" max="12" width="9.7109375" customWidth="1" /><ns0:col min="13" max="13" width="11.140625" bestFit="1" customWidth="1" /><ns0:col min="14" max="16" width="10" customWidth="1" /><ns0:col min="17" max="17" width="2.85546875" customWidth="1" /><ns0:col min="18" max="19" width="11.140625" customWidth="1" /><ns0:col min="20" max="20" width="10.42578125" customWidth="1" /><ns0:col min="21" max="21" width="9.28515625" bestFit="1" customWidth="1" /><ns0:col min="22" max="22" width="11" customWidth="1" /><ns0:col min="23" max="23" width="9.7109375" bestFit="1" customWidth="1" /><ns0:col min="24" max="25" width="9.42578125" bestFit="1" customWidth="1" /><ns0:col min="26" max="27" width="10.140625" customWidth="1" /><ns0:col min="28" max="28" width="10.42578125" customWidth="1" /><ns0:col min="29" max="29" width="11.85546875" customWidth="1" /><ns0:col min="31" max="33" width="11.42578125" bestFit="1" customWidth="1" /></ns0:cols>'

def route_one_reference_layout(report,base,directions,page,p,run):
    """Reference presentation only; results remain linked to the V19 solver."""
    oldcols=report.find(tag('cols'))
    report.remove(oldcols)
    report.insert(list(report).index(report.find(tag('sheetData'))),ET.fromstring(REFERENCE_ROUTE_COLS))
    # Restore the symbol/input panel, without obsolete closed-form worked examples.
    for cell in base.findall('.//'+tag('c')):
        addr=cell.get('r');rn=int(re.search(r'\d+',addr).group())
        if col_number(re.sub(r'\d','',addr))<12 and 6<=rn<=14:
            target=_report_indices[report][1].get(addr)
            if target is not None:
                target.attrib.clear();target.attrib.update(cell.attrib)
                target[:]=[copy.deepcopy(x) for x in cell]
    # Refresh restored template caches from this run before applying display units.
    for addr,source,value in [('H8','C29',p['weight_N_m']),('H9','C27',p['effective_friction']),('H14','C33',p['swbp_factor'] if p['swbp_factor'] is not None else 'UNAVAILABLE')]:
        report_cell(report,addr,ExcelFormula("'IEEE Inputs'!"+source,value))
    report_cell(report,'D6','Tension at end of section (N)')
    report_cell(report,'D7','Tension at beginning of section (N)')
    report_cell(report,'D8','Cable weight per unit length (N/m)')
    report_cell(report,'A15','Calculation method')
    report_cell(report,'C16','See IEEE 1185-2019 Method and the forward/reverse step sheets.')
    report_merge(report,'C16:K18')
    report_cell(report,'AC1','Cable Pulling Force Calculations')
    report_cell(report,'L2','V19 reference layout. Forces in N; sidewall pressure in N/m. Detailed geometry is on the step sheets.')
    labels=['Cable Section','T1 (N)','Length (m)','Curve Length (m)','Vertical Curve (m)','','Cumulative length (m)','bend (deg)','Angle (included) rad','Radius (m)','Gradient rad','Straight Pull (N)','Uphill Pull (N)','Downhill Pull (N)','Bend Pull (N)','Vertical / 3D Pull (N)','T (N)','Side Wall Force (N/m)']
    for reverse,(stepname,records) in enumerate(directions):
        title,head,first,footer=(102,103,104,197) if reverse else (3,4,5,98)
        for col,label in enumerate(labels,12):report_cell(report,col_label(col)+str(head),label)
        report_height(report,head,66)
        report_cell(report,'L'+str(title),'No of conductors:')
        report_cell(report,'T'+str(title),'Pull direction')
        report_cell(report,'V'+str(title),'Reverse' if reverse else 'Forward')
        report_cell(report,'Z'+str(title),'True Duct Length (m)')
        report_cell(report,'AC'+str(title),sum(rec['segment']['length'] for rec in records))
        subset=records[page*93:(page+1)*93]
        cumulative=sum(rec['segment']['length'] for rec in records[:page*93])
        for offset,rec in enumerate(subset):
            row=first+offset;s=rec['segment'];a=-s['a1'] if reverse else s['a0']
            cumulative+=s['length']
            angle=abs(s['kv']*s['length']) if s['kv'] else (s['length']/s['rh'] if s['rh'] else 0.)
            values={'N':s['length'] if not(s['kv'] or s['rh']) else None,'O':s['length'] if s['rh'] and not s['kv'] else None,'P':s['length'] if s['kv'] else None,'Q':None,'R':cumulative,'S':math.degrees(angle) if angle else None,'T':angle if angle else None,'U':abs(1/s['kv']) if s['kv'] else s['rh'],'V':a}
            for col,value in values.items():
                addr=col+str(row)
                # Reference numeric formatting, avoiding six decimals in narrow columns.
                source=next((c for c in base.findall('.//'+tag('c')) if c.get('r')==col+'5'),None)
                report_cell(report,addr,value,source.get('s','0') if source is not None else None)
        # Joint geometry is still on the detailed calculation sheets, not in gradient V.
        cell=_report_indices[report][1]['W'+str(footer)];formula=cell.find(tag('f'))
        last=first+len(subset)-1
        formula.text=formula.text.replace('SUM(V%d:V%d)'%(first,last),repr(sum(rec['joint'] for rec in subset)))
    views=report.find(tag('sheetViews'))
    if views is not None:
        for view in views:
            view.set('topLeftCell','L1');view.set('zoomScale','85')
            for selection in view.findall(tag('selection')):
                selection.set('activeCell','L1');selection.set('sqref','L1')


def route_section_type(segment,reverse=False):
    # Curvature keeps its sign when reversing; slope changes sign.
    a=-segment['a1'] if reverse else segment['a0']
    b=-segment['a0'] if reverse else segment['a1']
    slope=(a+b)/2.0
    if segment['kv']:
        shape='Concave' if segment['kv']>0 else 'Convex'
        # For a symmetric crest/sag, use the entry slope to identify direction.
        direction=slope if abs(slope)>1e-7 else a
        return shape+(' Downward Bend' if direction<0 else ' Upward Bend')
    if segment['rh']:return 'Horizontal Bend'
    if slope>1e-7:return 'Slope Up'
    if slope<-1e-7:return 'Slope Down'
    return 'Straight or Horizontal'

def add_route_section_types(report,directions,page,wrap_style):
    cols=report.find(tag('cols'));cur={}
    for old in cols:
        for i in range(int(old.get('min')),int(old.get('max'))+1):cur[i]=float(old.get('width','0'))
    w={i:max(12.6,cur.get(i,0)) for i in range(12,34)};w[17]=28
    report_widths(report,w)
    for reverse,(stepname,records) in enumerate(directions):
        head,first=(103,104) if reverse else (4,5)
        report_cell(report,'Q'+str(head),'Section type')
        for offset,rec in enumerate(records[page*93:(page+1)*93]):
            row=first+offset
            report_cell(report,'Q'+str(row),route_section_type(rec['segment'],bool(reverse)),wrap_style)
            report_height(report,row,30)

def add_known_swbp_output(report,directions,page,wrap_style,numeric_style):
    """Expose calculated section peaks without asserting a complete joint check."""
    results=[]
    for reverse,(stepname,records) in enumerate(directions):
        first,footer=(104,197) if reverse else (5,98)
        subset=records[page*93:(page+1)*93];last=first+len(subset)-1
        values=[rec['pressure'] for rec in subset if rec['pressure'] is not None]
        known=max(values) if values else 'UNAVAILABLE'
        joints=sum(bool(rec['joint']) for rec in subset)
        note=('%d joints: radius missing' % joints) if joints else 'No unresolved joints on page'
        if any(rec['tout'] is None or rec['pressure'] is None for rec in subset):
            note+='; section results incomplete'
        row=footer+1
        report_merge(report,'R%d:AC%d'%(row,row))
        report_cell(report,'R'+str(row),'Peak covers calculated sections only. '+note,wrap_style)
        report_height(report,row,36)
        results.append((footer,row,known,joints,note))
    return results


def report_display_units(sheets,inputs,p,wrap_style):
    """Only route/Summary presentation converts; inputs and RK4 remain in SI."""
    usekg=bool(p.get('report_kg_units',False));divisor=p['gravity'] if usekg else 1.
    report_cell(inputs,'B40','Report units',wrap_style)
    report_cell(inputs,'C40','kg' if usekg else 'N',wrap_style)
    report_cell(inputs,'E40','Select N or kg. kg / kg/m mean force equivalents: N divided by configured gravity. Inputs and step sheets stay in SI.',wrap_style)
    validation=inputs.find(tag('dataValidations'))
    if validation is None:
        validation=ET.Element(tag('dataValidations'))
        # SpreadsheetML requires dataValidations before hyperlinks/print/page elements.
        after={'hyperlinks','printOptions','pageMargins','pageSetup','headerFooter','rowBreaks','colBreaks','customProperties','cellWatches','ignoredErrors','smartTags','drawing','legacyDrawing','legacyDrawingHF','picture','oleObjects','controls','webPublishItems','tableParts','extLst'}
        index=next((i for i,child in enumerate(inputs) if child.tag.rsplit('}',1)[-1] in after),len(inputs))
        inputs.insert(index,validation)
    dv=ET.SubElement(validation,tag('dataValidation'),{'type':'list','allowBlank':'0','showErrorMessage':'1','errorTitle':'Report units','error':'Choose N or kg','sqref':'C40'})
    ET.SubElement(dv,tag('formula1')).text='"N,kg"'
    validation.set('count',str(len(validation)))
    divisorref="IF('IEEE Inputs'!$C$40=\"kg\",'IEEE Inputs'!$C$8,1)"
    def convert(root,address):
        cell=_report_indices[root][1].get(address)
        if cell is None:return
        f=cell.find(tag('f'));v=cell.find(tag('v'))
        if f is None or v is None:return
        expression=f.text
        value=v.text if cell.get('t')=='str' else float(v.text)
        formula='IF(ISNUMBER(%s),(%s)/(%s),%s)'%(expression,expression,divisorref,expression)
        report_cell(root,address,ExcelFormula(formula,value/divisor if isinstance(value,(int,float)) else value))
    def convert_cache(root,address):
        cell=_report_indices[root][1].get(address)
        if cell is None or cell.get('t')=='str':return
        value=cell.find(tag('v'))
        if value is not None:value.text=repr(float(value.text)/divisor)
    def labels(root):
        for address,cell in list(_report_indices[root][1].items()):
            s=cell.find(tag('is'))
            if s is None:continue
            text=''.join(s.itertext())
            if '(N)' in text or '(N/m)' in text:
                alternate=text.replace('(N/m)','(kg/m)').replace('(N)','(kg)')
                formula='IF(\'IEEE Inputs\'!$C$40="kg",%s,%s)'%(json.dumps(alternate),json.dumps(text))
                report_cell(root,address,ExcelFormula(formula,alternate if usekg else text))
    for name,root,_ in sheets:
        if name.startswith('Route '):
            # Route 1 restores a symbol panel; cable weight is a displayed force.
            if re.match(r'^Route 1(?: p\d+)?$',name):convert(root,'H8')
            for reverse in (False,True):
                first,footer=(104,197) if reverse else (5,98)
                # Snapshot SI expressions so each category switches independently
                # and every force is divided only once.
                for row in range(first,first+93):
                    exitcell=_report_indices[root][1].get('AB'+str(row))
                    exitformula=exitcell.find(tag('f')) if exitcell is not None else None
                    if exitformula is not None:
                        for col in ('W','X','Y','Z','AA'):
                            categorycell=_report_indices[root][1].get(col+str(row))
                            categoryformula=categorycell.find(tag('f')) if categorycell is not None else None
                            if categoryformula is not None and categoryformula.text=='AB'+str(row):
                                categoryformula.text=exitformula.text
                for row in range(first,first+93):
                    for col in ('M','AB','AC','W','X','Y','Z','AA'):convert(root,col+str(row))
                for col in ('M','S','AC'):convert(root,col+str(footer))
                convert_cache(root,'W'+str(footer))
                report_cell(root,'V'+str(footer),'MAX Peak Sidewall (N/m)',wrap_style)
            labels(root)
            report_cell(root,'L2','Sidewall force is shown on bends; straight rows are blank. Page result is MAX of bend values; missing joint radii remain flagged.',wrap_style)
        elif name=='Summary':
            for address in list(_report_indices[root][1]):
                if address[0] in ('E','F') and address[1:].isdigit() and int(address[1:])>=7:convert(root,address)
            for address in list(_report_indices[root][1]):
                if address[0] in ('G','H') and address[1:].isdigit() and int(address[1:])>=7:convert_cache(root,address)
            labels(root)
            report_cell(root,'H6',ExcelFormula('IF(\'IEEE Inputs\'!$C$40="kg","MAX Peak Sidewall (kg/m)","MAX Peak Sidewall (N/m)")','MAX Peak Sidewall (kg/m)' if usekg else 'MAX Peak Sidewall (N/m)'),wrap_style)


def import_separate_calculations(parts,sheets,embedded):
    """Copy the supplied calculation sheets, formulas, styles and artwork."""
    styles=ET.fromstring(parts['xl/styles.xml'])
    ct='{http://schemas.openxmlformats.org/package/2006/content-types}'
    types=ET.fromstring(parts['[Content_Types].xml'])
    imported_names={}
    def section(name):
        el=styles.find(tag(name))
        if el is None:
            el=ET.Element(tag(name));order=['numFmts','fonts','fills','borders','cellStyleXfs','cellXfs','cellStyles','dxfs','tableStyles','colors','extLst'];rank=order.index(name)
            pos=next((i for i,x in enumerate(styles) if x.tag.rsplit('}',1)[-1] in order and order.index(x.tag.rsplit('}',1)[-1])>rank),len(styles));styles.insert(pos,el)
        return el
    for index,(title,payload) in enumerate(embedded,1):
        with zipfile.ZipFile(io.BytesIO(base64.b64decode(payload))) as z:source={name:z.read(name) for name in z.namelist()}
        srcstyles=ET.fromstring(source['xl/styles.xml']);offsets={}
        numformats=section('numFmts');nummap={}
        existing={x.get('formatCode'):int(x.get('numFmtId')) for x in numformats}
        nextid=max([163]+[int(x.get('numFmtId')) for x in numformats])+1
        srcnum=srcstyles.find(tag('numFmts'))
        for old in srcnum if srcnum is not None else []:
            fmt=old.get('formatCode');fid=existing.get(fmt)
            if fid is None:fid=nextid;nextid+=1;existing[fmt]=fid;x=copy.deepcopy(old);x.set('numFmtId',str(fid));numformats.append(x)
            nummap[int(old.get('numFmtId'))]=fid
        numformats.set('count',str(len(numformats)))
        for kind in ['fonts','fills','borders','cellStyleXfs','cellXfs','dxfs']:
            dest=section(kind);offsets[kind]=len(dest);src=srcstyles.find(tag(kind))
            for item in src if src is not None else []:
                item=copy.deepcopy(item)
                if kind in ('cellStyleXfs','cellXfs','dxfs'):
                    for key,bucket in [('fontId','fonts'),('fillId','fills'),('borderId','borders')]:
                        if item.get(key) is not None:item.set(key,str(int(item.get(key))+offsets[bucket]))
                    if item.get('numFmtId') is not None:item.set('numFmtId',str(nummap.get(int(item.get('numFmtId')),int(item.get('numFmtId')))))
                    if kind=='cellXfs' and item.get('xfId') is not None:item.set('xfId',str(int(item.get('xfId'))+offsets['cellStyleXfs']))
                dest.append(item)
            dest.set('count',str(len(dest)))
        archive=zipfile.ZipFile(io.BytesIO(base64.b64decode(payload)));srcname,srcpath=next(iter(sheet_paths(archive).items()));archive.close()
        root=ET.fromstring(source[srcpath]);strings=[]
        if 'xl/sharedStrings.xml' in source:strings=list(ET.fromstring(source['xl/sharedStrings.xml']))
        for cell in root.findall('.//'+tag('c')):
            if cell.get('s') is not None:cell.set('s',str(int(cell.get('s'))+offsets['cellXfs']))
            if cell.get('t')=='s':
                value=cell.find(tag('v'));item=strings[int(value.text)];cell.remove(value);cell.set('t','inlineStr');inline=ET.SubElement(cell,tag('is'))
                for child in item:inline.append(copy.deepcopy(child))
        for col in root.findall('.//'+tag('col')):
            if col.get('style') is not None:col.set('style',str(int(col.get('style'))+offsets['cellXfs']))
        for row in root.findall('.//'+tag('row')):
            if row.get('s') is not None:row.set('s',str(int(row.get('s'))+offsets['cellXfs']))
        for rule in root.findall('.//'+tag('cfRule')):
            if rule.get('dxfId') is not None:rule.set('dxfId',str(int(rule.get('dxfId'))+offsets['dxfs']))
        prefix='xl/separate%d/'%index
        mapped=lambda path:prefix+path[3:] if path.startswith('xl/') else prefix+path
        sheetrel=posixpath.dirname(srcpath)+'/_rels/'+posixpath.basename(srcpath)+'.rels'
        for name,blob in source.items():
            if not (name==sheetrel or name.startswith(('xl/drawings/','xl/media/','xl/printerSettings/'))):continue
            if name.endswith('.rels'):
                relroot=ET.fromstring(blob)
                owner=posixpath.join(posixpath.dirname(posixpath.dirname(name)),posixpath.basename(name)[:-5])
                for rel in relroot:
                    if rel.get('TargetMode')=='External':continue
                    target=rel.get('Target');absolute=target.lstrip('/') if target.startswith('/') else posixpath.normpath(posixpath.join(posixpath.dirname(owner),target))
                    rel.set('Target','/'+mapped(absolute))
                blob=ET.tostring(relroot,encoding='utf-8',xml_declaration=True)
            parts[mapped(name)]=blob
        sourcetypes=ET.fromstring(source['[Content_Types].xml'])
        for item in sourcetypes:
            if item.tag==ct+'Default':
                if not any(x.tag==ct+'Default' and x.get('Extension')==item.get('Extension') for x in types):types.append(copy.deepcopy(item))
            elif item.tag==ct+'Override':
                old=item.get('PartName').lstrip('/')
                if old.startswith(('xl/drawings/','xl/media/','xl/printerSettings/')):
                    el=copy.deepcopy(item);el.set('PartName','/'+mapped(old));types.append(el)
        workbook=ET.fromstring(source['xl/workbook.xml']);names=workbook.find(tag('definedNames'))
        for item in names if names is not None else []:
            if item.get('name') in ('_xlnm.Print_Area','_xlnm.Print_Titles'):
                imported_names.setdefault(title,[]).append((item.get('name'),item.text.replace("'"+srcname+"'!","'"+title+"'!")))
        sheets.append((title,root,mapped(srcpath)))
    parts['xl/styles.xml']=ET.tostring(styles,encoding='utf-8',xml_declaration=True)
    parts['[Content_Types].xml']=ET.tostring(types,encoding='utf-8',xml_declaration=True)
    return imported_names


SEPARATE_CALCULATIONS = [('Duct Fill Calculation', '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'), ('Cable Jamming Calculation', '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')]

def link_duct_calculations(sheets,p):
    """Use authoritative Dynamo/IEEE Inputs for both calculation panels."""
    for title,root,_ in sheets:
        if title not in ('Duct Fill Calculation','Cable Jamming Calculation'):continue
        existing={c.get('r'):c for c in root.findall('.//'+tag('c'))}
        def put(addr,value,stylefrom=None):
            source=existing.get(stylefrom or addr)
            report_cell(root,addr,value,source.get('s') if source is not None else None)
        put('S1','Dynamo cable pulling calculation')
        put('AJ1','-')
        put('K11','Dynamo cable settings')
        put('AD11','Dynamo duct settings')
        # Cross-sectional conductor size, material and nominal duct size/type
        # are absent from the existing graph, so never reuse template values.
        put('K12','Not supplied')
        put('D13','Arrangement')
        put('K13',ExcelFormula("'IEEE Inputs'!C36",p['formation']))
        put('AD12','Not supplied')
        put('AD13','Not supplied')
        put('K14',ExcelFormula("'IEEE Inputs'!C9",p['cable_diameter_mm']))
        put('K15',ExcelFormula("'IEEE Inputs'!C6",p['cable_count']))
        put('AD14',ExcelFormula("'IEEE Inputs'!C10",p['conduit_diameter_mm']))
        descriptor='Duct fill calculation' if title=='Duct Fill Calculation' else 'Cable jam ratio calculation'
        put('S2',ExcelFormula('"%s - "&K15&" cables"'%descriptor,descriptor+' - %g cables'%p['cable_count']))
        if title=='Duct Fill Calculation':
            put('W15','Fill limit (%)','W14')
            put('S3','CME');put('Z3','NA');put('AG3',datetime.now().strftime('%d/%m/%Y'))
            put('AD15',ExcelFormula("'IEEE Inputs'!C15*100",p['allowable_fill']*100),'AD14')
            report_merge(root,'AD15:AG15')
            put('D17','Reference fill limits (%)')
            put('G35',ExcelFormula('K14',p['cable_diameter_mm']))
            put('L35',ExcelFormula('K15',p['cable_count']))
            put('G36',ExcelFormula('AD14',p['conduit_diameter_mm']))
            cablearea=math.pi*(p['cable_diameter_mm']/2)**2*p['cable_count']
            ductarea=math.pi*(p['conduit_diameter_mm']/2)**2
            put('R35',ExcelFormula('IF(AND(ISNUMBER(K14),K14>0,ISNUMBER(K15),K15=INT(K15),K15>=1),PI()*(K14/2)^2*K15,"UNAVAILABLE")',cablearea))
            put('R36',ExcelFormula('IF(AND(ISNUMBER(AD14),AD14>0),PI()*(AD14/2)^2,"UNAVAILABLE")',ductarea))
            fill=cablearea/ductarea*100
            put('K40',ExcelFormula('IF(AND(ISNUMBER(R35),ISNUMBER(R36),R36>0),R35/R36*100,"UNAVAILABLE")',fill))
            put('D43','Check against Dynamo fill limit')
            put('D45',ExcelFormula('IF(AND(ISNUMBER(K40),ISNUMBER(AD15),AD15>0,AD15<=100),IF(K40<=AD15,"PASS","FAIL"),"UNAVAILABLE")','PASS' if fill<=p['allowable_fill']*100 else 'FAIL'))
        else:
            put('S3','CME');put('Z3','NA');put('AG3',datetime.now().strftime('%d/%m/%Y'))
            put('D19','Jamming check applies to three equal-size single cables.')
            put('D20','Uses adjusted JR = 1.05 x duct ID / cable OD.')
            put('D21','Critical adjusted JR range: 2.8 to 3.2 (inclusive).')
            put('G37',ExcelFormula('AD14',p['conduit_diameter_mm']))
            put('G38',ExcelFormula('K14',p['cable_diameter_mm']))
            ratio=1.05*p['conduit_diameter_mm']/p['cable_diameter_mm']
            put('K42',ExcelFormula('IF(AND(ISNUMBER(G37),G37>0,ISNUMBER(G38),G38>0),1.05*G37/G38,"UNAVAILABLE")',ratio))
            put('D45','Check for three equal cables')
            status='N/A' if p['cable_count']!=3 else ('PASS' if ratio<2.8 or ratio>3.2 else 'FAIL')
            put('D47',ExcelFormula('IF(AND(ISNUMBER(K15),K15=INT(K15),K15>=1,ISNUMBER(K42)),IF(K15<>3,"N/A",IF(OR(K42<2.8,K42>3.2),"PASS","FAIL")),"UNAVAILABLE")',status))
            put('D49','N/A: three-cable criterion does not apply to this count.','D21')
            report_cell(root,'D49',ExcelFormula('IF(AND(ISNUMBER(K15),K15>=1,K15<>3),"N/A: three-cable criterion does not apply to this count.","")','N/A: three-cable criterion does not apply to this count.' if p['cable_count']!=3 else ''),existing['D21'].get('s'))
HELP_ROWS = [('H', 'A. Inputs and cable factors', '', '', ''), ('R', 'Cable weight per metre', 'W = n x m x g', 'W [N/m]; n = number of cables; m = cable mass [kg/m]; g = gravity [m/s2] (9.8). Gravity is applied once.', 'IEEE Inputs C29; Dynamo engine weight_N_m'), ('R', 'Duct / cable ratio', 'r = d / (D - d)    ;    D/d', 'd = cable outside diameter [mm]; D = duct inside diameter [mm]. Cables must fit: D/d >= 1 (1 cable), 2 (2), 1+2/sqrt(3) (3), 1+sqrt(2) (4).', 'IEEE Inputs C18:C20'), ('R', 'Weight correction factor Wc - single cable', 'Wc = 1', 'IEEE 1185-2019 clause 4.13 (workbook eq. 16-18).', 'IEEE Inputs C26'), ('R', 'Wc - two cables (three cables follow the project rule below)', 'Wc = 1 / sqrt(1 - r^2)', 'Triangular arrangement; requires r < 1. Three cables use the D/d rule in the next row.', 'IEEE Inputs C26; Dynamo validate_settings'), ('R', 'Wc - three cables, cradled', 'Wc = 1 + (4/3) x r^2', 'Cradled arrangement.', 'IEEE Inputs C26'), ('R', 'Wc - four cables, diamond', 'Wc = 1 + 2 x r^2', 'Diamond arrangement.', 'IEEE Inputs C26'), ('R', 'Wc - three-cable project rule', 'D/d <= 2.5: 1/sqrt(1-r^2);   2.5 < D/d <= 3.0: 1 + 2 r^2;   D/d > 3.0: 1 + (4/3) r^2', 'The middle band (2.5 to 3.0) is a project-supplied rule and is NOT verified against IEEE 1185. Review before use.', 'Dynamo validate_settings (3 cables, trefoil)'), ('R', 'Wc - more than four cables', 'Wc = 1.4 (assumed)', 'Project assumption, not an IEEE value. Confirm for the project.', 'Dynamo validate_settings'), ('R', 'Effective friction coefficient', "f' = f x Wc", "f = coefficient of friction (cable to duct). f' replaces f in every tension equation below.", 'IEEE Inputs C27'), ('R', 'Conduit fill', 'fill = n x (d / D)^2', 'Compared with the allowable fill (for example 0.40 for three or more cables).', 'Duct Fill Calculation sheet; Dynamo validate_settings'), ('R', 'Jamming check (three equal cables)', 'Jam ratio JR = D / d ;  jam factor = 1.05 x D / d', 'A D/d between 2.8 and 3.2 is flagged for review (jamming likely). Applies to three equal cables only.', 'Cable Jamming Calculation sheet; Dynamo calculate()'), ('H', 'B. Closed-form section equations (IEEE 1185-2019, as transcribed in the IEEE-1185-2019 Method workbook)', '', '', ''), ('R', 'Straight horizontal pull (eq. 5)', "T2 = T1 + W x f' x L", 'T1 = tension at start of section [N]; T2 = tension at end [N]; L = length of section [m].', 'Dynamo test node: straight; Method sheet'), ('R', 'Straight inclined pull - uphill (eq. 6a)', "T2 = T1 + W x L x ( f' x cos(a) + sin(a) )", 'a = slope angle [deg]; L = length along the duct [m]. Friction f appears once.', 'Dynamo test node: slope up'), ('R', 'Straight inclined pull - downhill (eq. 6b)', "T2 = T1 + W x L x ( f' x cos(a) - sin(a) )", 'Tension can fall to zero on a steep downhill; if it would go negative the pull is slack (see section D).', 'Dynamo test node: slope down'), ('R', 'Horizontal bend, level (eq. 6 / 8)', "T2 = T1 x cosh(f' x th) + sinh(f' x th) x sqrt( T1^2 + (W x R)^2 )", "th = bend angle [rad]; R = bend radius [m]. Friction does not appear inside the square root. For large T1 this tends to T1 x e^(f' x th).", 'Dynamo test node: level bend; engine contact_force()'), ('R', 'Vertical bends - common terms (eq. 9 to 12)', "E = e^(f' x th) ;   B = W x R / (1 + f'^2)", 'th in radians (converted once: th = degrees x pi / 180). e = exp(1) exactly.', 'Method sheet; Dynamo test nodes'), ('R', 'Convex (crest) bend, pulling upward (eq. 9)', "T2 = T1 x E + B x [ 2 f' E sin(th) + (1 - f'^2) (1 - E cos(th)) ]", 'Inclination falls from +th to 0 (pull up a slope and over the crest).', 'Dynamo test node 1ffa5d'), ('R', 'Concave (sag) bend, pulling upward (eq. 10)', "T2 = T1 x E - B x [ 2 f' sin(th) - (1 - f'^2) (E - cos(th)) ]", 'Inclination rises from 0 to +th. Valid while T/R >= W cos(a) (cable stays on the roof).', 'Dynamo test node 56865c'), ('R', 'Convex (crest) bend, pulling downward (eq. 11)', "T2 = T1 x E + B x [ 2 f' sin(th) - (1 - f'^2) (E - cos(th)) ]", 'Inclination falls from 0 to -th.', 'Dynamo test node 00c6a3'), ('R', 'Concave (sag) bend, pulling downward (eq. 12)', "T2 = T1 x E - B x [ 2 f' E sin(th) + (1 - f'^2) (1 - E cos(th)) ]", 'Inclination rises from -th to 0. Valid while T/R >= W cos(a).', 'Dynamo test node 3a4384'), ('H', 'C. General 3D solver used for the route (Dynamo engine, RK4)', '', '', ''), ('R', 'Force balance along the duct', "dT/dl = f' x N + W x sin(a)", 'l = distance along the duct [m]; a = inclination of the duct [rad]; N = contact force per metre [N/m]. +sin(a) when pulling uphill.', 'Engine derivative() ; step sheets column J'), ('R', 'Contact force per metre', 'N = sqrt( (T x kh)^2 + (T x kv - W x cos(a))^2 )', 'Absolute resultant handles floor and roof contact continuously. Same balance for straights, horizontal, vertical and compound curves.', 'Engine contact_force() ; step sheets column I'), ('R', 'Curvatures', 'kh = cos(a)^2 / R_plan ;   kv = da/dl', 'R_plan = plan radius [m] (kh = 0 on a straight). kv > 0 sag (concave), kv < 0 crest (convex); |kv| = 1 / R_profile.', 'Engine; step sheets columns E, F, H'), ('R', 'Total curvature of the cable path (kappa)', 'kappa = sqrt( kh^2 + kv^2 )   [1/m]', 'kappa = 1 / (radius the cable is actually bending around). 0 on a straight; 0.5 for a 2 m radius bend. Plain horizontal or vertical bend: kappa = 1/R. Compound bend: both kh and kv contribute.', 'Sidewall pressure; step sheets columns Z, AA'), ('R', 'Runge-Kutta 4 step', 'k1 = f(T, a);  k2 = f(T + h k1/2, a + kv h/2);  k3 = f(T + h k2/2, a + kv h/2);  k4 = f(T + h k3, a + kv h);   T_next = T + h (k1 + 2 k2 + 2 k3 + k4) / 6', 'h = step length [m]; a advances by kv x h. One visible row per step on the R# F/R steps sheets.', 'Step sheets columns J to Y'), ('R', 'Step refinement', 'Halve h until exit tension, peak tension and peak SWBP change by <= 0.01 + 1e-7 x value', 'Limits: maximum integration step [m] and maximum angle step [deg] are Dynamo inputs.', 'Engine integrate_checked()'), ('R', 'Profile geometry (vertical circular arc)', 'sin(a) = sin(a0) + kv x ds ;   z = z0 + ( cos(a0) - cos(a) ) / kv', 'ds = horizontal (station) distance. Arc from chord c and radius R: total turn = 2 x asin( c / (2 R) ). Section length = ds / cos(a) for a tangent, |a1 - a0| / |kv| for an arc.', 'Engine read_profile_entities(), build_geometry()'), ('R', 'Parabolic profile curves', 'Replaced by the circular arc with the same end points and total turn', 'Elevation difference is sub-millimetre. Equivalent R = chord / total turn is reported in the Review sheet.', 'Engine read_profile_entities()'), ('R', 'Grade break with no radius (zero-length joint)', "T1(next) = T_prev x e^( f' x delta )", 'delta = change of direction [rad]. Joint SWBP is unavailable without a radius; a REVIEW line is raised.', 'Engine solve_direction()'), ('R', 'Reverse pull', 'Sections taken in reverse order; inclination a becomes -a; curvature sign is kept', 'Reverse results are a separate calculation, not a reversal of the forward numbers.', 'Engine solve_direction(reverse=True)'), ('H', 'D. Limits and checks', '', '', ''), ('R', 'Slack (loss of taut tension)', 'If T would become < 0 the direction stops', 'Later sections show UNAVAILABLE. A braking / contact model is then required.', 'Engine integrate()'), ('R', 'Sidewall bearing pressure (SWBP), general', 'P = c x T x kappa ;   kappa = sqrt( kh^2 + kv^2 )', 'P [N/m]. For a single cable on a bend of radius R this reduces to P = T2 / R (eq. 19).', 'Step sheets columns Z, AA; route sheets'), ('R', 'SWBP factor c', 'single: c = 1;  two cables or trefoil: c = Wc / 2;  cradled: c = (3 Wc - 2) / 3;  diamond (four): c = Wc - 1;  more than four: c = 1.0', 'Eq. 19 to 21. More than four cables has no IEEE factor, so the conservative value 1.0 is used and a REVIEW line is raised. A positive manufacturer factor overrides all of these.', 'IEEE Inputs C33; Dynamo validate_settings'), ('R', 'Pass / fail', 'Peak T <= allowable tension ;   Peak P <= allowable SWBP', 'Typical SWBP guidelines (IEEE Table 7): 7300 N/m for 600 V multi-conductor and 5 to 15 kV shielded power cable; 4380 N/m for 25 to 35 kV or armoured. Manufacturer values take precedence.', 'Summary and route sheets'), ('R', 'Maximum allowable pulling tension', 'three or fewer conductors: Tm = K x n x CMA ;   four or more: Tm = 0.8 x K x n x CMA', 'K = 0.008 lbf per circular mil (copper) or 0.006 (aluminium); n = number of conductors; CMA = conductor area in circular mils. Convert: 1 lbf = 4.4482216 N. Manufacturer limits take precedence.', 'IEEE 1185-2019 Method workbook, rows 287-305'), ('H', 'E. Units and conventions', '', '', ''), ('R', 'Angles', 'radians = degrees x pi / 180 (applied once)', 'Dynamo Math.Sin / Math.Cos take DEGREES; Python and Excel SIN / COS take radians.', 'All'), ('R', 'Force units', 'N; weight in N/m; SWBP in N/m. kg force = N / g', 'Display option on the report converts N to kg using the configured gravity; calculations stay in SI.', 'Summary; IEEE Inputs'), ('R', 'Verification', 'Closed forms (eq. 9 to 12) agree with the RK4 solution to 0.0000 N for constant-radius bends with cable in contact', 'The RK4 solver is the reference; the closed forms are checks. Where the cable lifts off the duct wall the closed forms do not apply.', 'Dynamo inspector panel'), ('H', 'F. Symbols and abbreviations', '', '', ''), ('S', 'Symbol / abbreviation', 'Meaning', 'Units / notes', 'Appears in'), ('R', 'T, T1, T2', 'Cable pulling tension; T1 = at the start of a section, T2 = at its end', 'N (1 kg force = g newtons)', 'All tension equations'), ('R', 'Peak T', 'Highest tension reached anywhere in a section or route', 'N; compared with the allowable tension', 'Summary, route sheets'), ('R', 'W', 'Total cable weight per metre of duct', 'N/m', 'Sections A to C'), ('R', 'n', 'Number of cables pulled together in the duct', 'whole number', 'Weight, Wc, fill, SWBP factor'), ('R', 'm', 'Cable mass per metre (one cable)', 'kg/m', 'Weight'), ('R', 'g', 'Gravity constant', 'm/s2 (9.8)', 'Weight'), ('R', 'd, D', 'd = cable outside diameter (OD); D = duct inside diameter (ID)', 'mm', 'Wc, fill, jamming'), ('R', 'r', 'Clearance ratio d / (D - d)', 'no units', 'Wc equations'), ('R', 'D/d', 'Duct to cable diameter ratio', 'no units', 'Wc bands, jam ratio'), ('R', 'JR', 'Jam ratio (D/d); jam factor = 1.05 x D/d', 'no units; 2.8 to 3.2 is flagged', 'Jamming check'), ('R', 'Wc', 'Weight correction factor for cable formation (single, triangular/trefoil, cradled, diamond)', 'no units', 'Section A'), ('R', 'f', 'Coefficient of friction between cable and duct', 'no units (for example 0.2 lubricated)', 'All tension equations'), ('R', "f'", 'Effective friction coefficient = f x Wc', 'no units', 'All tension equations'), ('R', 'L, l, ds', 'L = length of a section; l = distance along the duct; ds = horizontal (station) distance', 'm', 'Section B and C'), ('R', 'h', 'Integration step length', 'm', 'RK4'), ('R', 'R, R_plan, R_profile', 'Bend radius; R_plan = radius in plan (horizontal curve); R_profile = radius of a vertical curve (sag or crest)', 'm', 'Bend equations, curvature'), ('R', 'th (theta)', 'Bend angle', 'radians inside formulas; degrees as inputs', 'Bend equations'), ('R', 'a (alpha), a0, a1', 'Inclination of the duct from horizontal; a0 = at start, a1 = at end. Positive = rising in the pull direction', 'radians (degrees in Dynamo)', 'Slopes, vertical bends, solver'), ('R', 'delta', 'Change of direction at a grade break (joint with no radius)', 'radians', 'Joint capstan'), ('R', 'E', "e^(f' x th), the capstan factor", 'no units', 'Eq. 9 to 12'), ('R', 'e', 'Base of natural logarithms, exp(1) = 2.718281828...', 'no units', 'Capstan factor'), ('R', 'B', "W x R / (1 + f'^2)", 'N', 'Eq. 9 to 12'), ('R', 'N', 'Contact force per metre between cable and duct wall', 'N/m', 'Section C'), ('R', 'kh', 'Plan curvature = cos(a)^2 / R_plan', '1/m', 'Section C'), ('R', 'kv', 'Profile curvature = da/dl; positive sag, negative crest', '1/m', 'Section C'), ('R', 'kappa', 'Total curvature = sqrt(kh^2 + kv^2), the reciprocal of the effective bend radius', '1/m', 'Sidewall pressure'), ('R', 'k1, k2, k3, k4', 'The four slope estimates (dT/dl) used in one RK4 step', 'N/m', 'Step sheets'), ('R', 'SWBP (P)', 'Sidewall bearing pressure: force per metre of bend radius pressing the cable on the duct wall', 'N/m', 'Sidewall checks'), ('R', 'c', 'SWBP factor for the cable formation (single 1, trefoil Wc/2, cradled (3Wc-2)/3, diamond Wc-1)', 'no units', 'Sidewall pressure'), ('R', 'MAPT / Tm', 'Maximum allowable pulling tension of the cable', 'N', 'Limits'), ('R', 'K, n, CMA', 'K = pulling constant (0.008 lbf per circular mil copper, 0.006 aluminium); CMA = conductor area in circular mils', 'lbf per cmil; cmil', 'MAPT'), ('R', 'RK4', 'Fourth-order Runge-Kutta numerical integration', '-', 'Solver'), ('R', 'IEEE 1185', 'IEEE Std 1185-2019, Recommended Practice for Cable Installation in Generating Stations and Industrial Facilities', '-', 'Equation source'), ('R', 'XY / Z report', 'Civil 3D (or Revit-extracted) plan-point report (station, easting, northing, elevation, plan radius) and profile-entity report (tangents, sag and crest curves)', '-', 'Dynamo inputs'), ('R', 'Sag / Crest', 'Sag = vertical curve that is concave up (kv > 0); Crest = convex up (kv < 0). Concave / Convex bend uses the same meaning', '-', 'Vertical bends'), ('R', 'Forward / Reverse', 'Pull from the first section to the last, or from the last to the first', '-', 'Route sheets'), ('R', 'Taut / Slack', 'Taut: tension stays above zero. Slack: tension would go below zero, so the cable is not under tension and the pull needs a different model', '-', 'Solver'), ('R', 'WITHIN LIMIT / FAIL / REVIEW REQUIRED / UNAVAILABLE', 'Check results: inside the allowable value; over it; needs engineer review (assumptions not confirmed or review items raised); not calculated (for example after slack)', '-', 'Summary, route sheets')]

def help_equations_sheet(wrap_style, headerstyle):
    """Plain-text help sheet listing every equation used in the calculation."""
    root = fresh_sheet()
    view = root.find(tag('sheetViews'))[0]
    pane = view.find(tag('pane'))
    for key in ('xSplit',):
        pane.attrib.pop(key, None)
    pane.set('ySplit', '3'); pane.set('topLeftCell', 'A4'); pane.set('activePane', 'bottomLeft')
    widths = {1: 6, 2: 34, 3: 72, 4: 62, 5: 38}
    report_widths(root, widths)
    put = lambda a, v, s=None: report_cell(root, a, v, s if s is not None else wrap_style)
    put('A1', 'Help - equations used in this calculation', headerstyle)
    put('A2', 'Units: N, N/m, m, kg/m, degrees for inputs, radians inside formulas. Equation numbers refer to the IEEE-1185-2019 Method workbook. th = bend angle in radians.', wrap_style)
    report_merge(root, 'A1:E1'); report_merge(root, 'A2:E2'); report_height(root, 2, 32)
    for c, h in enumerate(['No.', 'Topic', 'Equation', 'Symbols, limits and notes', 'Used in'], 1):
        put(col_label(c) + '3', h, headerstyle)
    row = 4; number = 0
    for kind, topic, eq, notes, used in HELP_ROWS:
        if kind == 'H':
            put('A%d' % row, topic, headerstyle); report_merge(root, 'A%d:E%d' % (row, row)); report_height(root, row, 22)
        elif kind == 'S':
            number = 0
            for c, h in enumerate(['No.', topic, eq, notes, used], 1):
                put(col_label(c) + str(row), h, headerstyle)
            report_height(root, row, 20)
        else:
            number += 1
            put('A%d' % row, number); put('B%d' % row, topic); put('C%d' % row, eq); put('D%d' % row, notes); put('E%d' % row, used)
            lines = max(int(math.ceil(len(topic) / 32.0)), int(math.ceil(len(eq) / 68.0)), int(math.ceil(len(notes) / 58.0)), int(math.ceil(len(used) / 34.0)), 1)
            report_height(root, row, 15 * lines + 4)
        row += 1
    return root

DYNAMO_TEXT=[
 ('Rerun Dynamo after input changes to recheck convergence','Rerun the calculation after input changes to recheck convergence'),
 ('Rerun Dynamo after input changes to check convergence','Rerun the calculation after input changes to check convergence'),
 ('Rerun Dynamo after route input changes','Rerun the calculation after route input changes'),
 ('rerun Dynamo to verify changed inputs','rerun the calculation to verify changed inputs'),
 ('INVALID - rerun Dynamo','INVALID - rerun the calculation'),
 ('Change inputs in Dynamo and rerun to verify convergence','Change the inputs and rerun to verify convergence'),
 ('Dynamo cable settings; confirm for this project','Cable settings; confirm for this project'),
 ('Dynamo cable settings and Civil 3D route reports','Cable settings and Civil 3D route reports'),
 ('Dynamo cable settings','Cable settings'),
 ('Dynamo duct settings','Duct settings'),
 ('Dynamo cable pulling calculation','Cable pulling calculation'),
 ('Fill and jamming tabs use Dynamo cable/duct inputs','Fill and jamming tabs use the cable/duct inputs'),
 ('Dynamo inputs. Formulas update','Inputs. Formulas update'),
 ('replaced by Dynamo inputs','replaced by the calculation inputs'),
 ('are Dynamo inputs','are calculation inputs'),
 ('-Dynamo inputs','-calculation inputs'),
 ('Check against Dynamo fill limit','Check against the fill limit'),
 ('(as FRD2A Civil 3D PullCal Dynamo graph)','(as FRD2A Civil 3D PullCal graph)'),
 ('(as the Dynamo graph)','(as the calculation graph)'),
 ('As Dynamo graph','As calculation graph'),
 ('PullCal Dynamo graph','PullCal graph'),
 ('Same steps as the Dynamo','Same steps as the'),
 ('(Dynamo engine, RK4)','(calculation engine, RK4)'),
 ('Dynamo engine ','calculation engine '),
 ('Dynamo test nodes','Test nodes'),
 ('Dynamo test node','Test node'),
 ('Dynamo inspector panel','Inspector panel'),
 ('Dynamo Math.Sin / Math.Cos','Math.Sin / Math.Cos'),
 ('(degrees in Dynamo)','(degrees in the graph)'),
 ('Dynamo validate_settings','validate_settings'),
 ('Dynamo calculate()','calculate()')]

def scrub_dynamo(parts):
    """Remove the word Dynamo from every text part of the exported workbook."""
    for name,content in list(parts.items()):
        if not name.endswith('.xml') or b'Dynamo' not in content:continue
        text=content.decode('utf-8')
        for old,new in DYNAMO_TEXT:text=text.replace(old,new)
        text=re.sub(r'\bDynamo\b','calculation',text)
        parts[name]=text.encode('utf-8')

HMV_LOGO_SHA256={'3290bd1f502b27d0653f06752af9929dd33002d3cca4cbdbfba8a1a6a3c3e0e2'}

def remove_logo(parts):
    """Remove the H&MV Engineering logo from the workbook: the picture, its relationship and the image file itself.
    The picture is found by the SHA-256 of its image data, so the MWP logo, the method diagrams and the jamming chart
    are never touched. Drawings are searched both at xl/drawings and in the imported xl/separateN/drawings folders."""
    import hashlib
    anchors=re.compile(r'<((?:\w+:)?)(twoCellAnchor|oneCellAnchor|absoluteAnchor)\b.*?</\1\2>',re.S)
    relitem=re.compile(r'<Relationship\b[^>]*?/>')
    dropped=set()
    for name,content in list(parts.items()):
        m=re.match(r'(xl/(?:separate\d+/)?drawings)/(drawing\d+)\.xml$',name)
        if not m:continue
        relname=m.group(1)+'/_rels/'+m.group(2)+'.xml.rels'
        if relname not in parts:continue
        relxml=parts[relname].decode('utf-8');ids=set()
        for item in relitem.findall(relxml):
            rid=re.search(r'\bId="([^"]+)"',item);tgt=re.search(r'\bTarget="([^"]+)"',item)
            if not rid or not tgt:continue
            target=tgt.group(1)
            media=target.lstrip('/') if target.startswith('/') else posixpath.normpath(posixpath.join(m.group(1),target))
            data=parts.get(media)
            if data is not None and hashlib.sha256(data).hexdigest() in HMV_LOGO_SHA256:ids.add(rid.group(1));dropped.add(media)
        if not ids:continue
        text=content.decode('utf-8')
        parts[name]=anchors.sub(lambda mm:'' if any('"%s"'%i in mm.group(0) for i in ids) else mm.group(0),text).encode('utf-8')
        parts[relname]=relitem.sub(lambda mm:'' if re.search(r'\bId="([^"]+)"',mm.group(0)).group(1) in ids else mm.group(0),relxml).encode('utf-8')
    for media in dropped:
        base=posixpath.basename(media).encode('utf-8')
        if not any(n.endswith('.rels') and base in c for n,c in parts.items()):parts.pop(media,None)

def elek_style_sheet(res,reverse,p):
    """Section list laid out like the ELEK Cable Pulling section list (No., Type, Specification, Length, Tension, SWBP, Result)."""
    def fmt(x):return ('%.2f'%x).rstrip('0').rstrip('.')
    root=fresh_sheet();put=lambda a,v:report_cell(root,a,v)
    run=res['reverse' if reverse else 'forward'];order=list(reversed(res['segments'])) if reverse else res['segments']
    put('A1','Section list, '+('reverse' if reverse else 'forward')+' pull, same columns as the ELEK Cable Pulling section list')
    put('A2','Values at export. Pass = peak tension within the allowable pulling tension and peak sidewall force within the allowable sidewall pressure (IEEE Inputs). Tension is at the end of the section. Rerun the calculation after input changes.')
    for c,h in enumerate(['No.','Type','Specification','Length (m)','Tension (N)','SWBP (N/m)','Result'],1):report_cell(root,col_label(c)+'3',h)
    for i,(s,row) in enumerate(zip(order,run['rows']),1):
        r=3+i;kind=route_section_type(s,reverse);length=s['length']
        a0=-s['a1'] if reverse else s['a0'];a1=-s['a0'] if reverse else s['a1']
        if s['kv']:spec='Radius = %s m, Angle = %s deg'%(fmt(abs(1/s['kv'])),fmt(math.degrees(abs(a1-a0))))
        elif s['rh']:spec='Radius = %s m, Angle = %s deg'%(fmt(s['rh']),fmt(math.degrees(length/s['rh'])))
        elif kind in ('Slope Up','Slope Down'):spec='Length = %s m, Angle = %s deg'%(fmt(length),fmt(math.degrees(abs((a0+a1)/2))))
        else:spec='Length = %s m'%fmt(length)
        t_end=row[10];peak=row[11];swbp=row[12]
        curved=bool(s['kv'] or s['rh'])
        if t_end is None:result='n/a'
        elif peak>p['allowable_tension_N'] or (swbp is not None and swbp>p['allowable_swbp_N_m']):result='Fail'
        elif swbp is None and curved:result='Review'
        else:result='Pass'
        report_cell(root,'A'+str(r),i);report_cell(root,'B'+str(r),kind);report_cell(root,'C'+str(r),spec);report_cell(root,'D'+str(r),round(length,2))
        report_cell(root,'E'+str(r),None if t_end is None else round(t_end));report_cell(root,'F'+str(r),0 if not curved else (None if swbp is None else round(swbp)));report_cell(root,'G'+str(r),result)
    report_widths(root,{1:7,2:28,3:44,4:12,5:14,6:14,7:10})
    return root

def cable_data_sheet(p):
    """HV cable datasheet (Prysmian 76/132 kV 1C 1200 mm2 Al, submittal 9800-E-0021-PD) beside the values this calculation used."""
    root=fresh_sheet();put=lambda a,v:report_cell(root,a,v)
    put('A1','Cable data');put('A2','Datasheet: HDL1A 9800-E-0021-PD, Prysmian 76/132 (145) kV, 1 core 1200 mm2 Al Milliken, XLPE, HDPE sheath, IEC 60840. Used = value in this calculation.')
    for c,h in enumerate(['Item','Datasheet','Used','Unit','Check'],1):report_cell(root,col_label(c)+'3',h)
    rows=[('Overall diameter',96.9,p['cable_diameter_mm'],'mm','eq'),('Weight per metre',10.3,p['cable_mass_kg_m'],'kg/m','eq'),
          ('Minimum bending radius, installation',2.907,p.get('min_bend_install_m'),'m','eq'),('Minimum bending radius, installed',1.938,p.get('min_bend_static_m'),'m','eq'),
          ('Maximum pulling tension, grip on sheath',28000.,p['allowable_tension_N'],'N','le'),('Maximum pulling tension, eye on conductor',36000.,p['allowable_tension_N'],'N','le'),
          ('Maximum sidewall pressure',7500.,p['allowable_swbp_N_m'],'N/m','le')]
    for i,(name,ds,used,unit,mode) in enumerate(rows,4):
        ok='n/a' if used is None else (('Matches' if abs(used-ds)<1e-6 else 'Differs') if mode=='eq' else ('Within datasheet' if used<=ds+1e-6 else 'Exceeds datasheet'))
        for col,v in zip('ABCDE',(name,ds,used,unit,ok)):report_cell(root,col+str(i),v)
    for i,(name,v) in enumerate([('Conductor diameter (mm)',42.0),('Insulation diameter (mm)',78.6),('Screen diameter (mm)',86.2),('Sheath thickness (mm)','4.0 + 0.3'),
        ('Rated temperature normal / emergency / short circuit (C)','90 / 105 / 250'),('Short circuit rating','40 kA, 0.5 s'),('Drum length (m)','800 or 1100')],12):
        report_cell(root,'A'+str(i),name);report_cell(root,'B'+str(i),v)
    report_cell(root,'A11','Allowable tension used as a fraction of the 28 kN grip limit (ELEK tension reduction factor)');report_cell(root,'C11',round(p['allowable_tension_N']/(28000.*p['cable_count']),4))
    report_widths(root,{1:52,2:16,3:14,4:8,5:20})
    return root

def export_live_template(path,runs,p):
    raw=base64.b64decode(EMBEDDED_TEMPLATE)
    with zipfile.ZipFile(io.BytesIO(raw)) as archive:parts={n:archive.read(n) for n in archive.namelist()}
    workbook=ET.fromstring(parts['xl/workbook.xml']);rels=ET.fromstring(parts['xl/_rels/workbook.xml.rels'])
    sheetels=workbook.find(tag('sheets'));source_paths=sheet_paths(zipfile.ZipFile(io.BytesIO(raw)))
    # sheet_paths is a list of (name, path) in the parser.
    source_paths=dict(source_paths)
    inputs=ET.fromstring(parts[source_paths['IEEE Inputs']]);method=ET.fromstring(parts[source_paths['IEEE 1185-2019 Method']])
    base=ET.fromstring(parts[source_paths['SS JB1']]);summary=ET.fromstring(parts[source_paths['Summary']])
    clear_report(summary)
    style=next(c.get('s','0') for c in base.findall('.//'+tag('c')) if c.get('r')=='M5')
    styles=ET.fromstring(parts['xl/styles.xml']);xfs=styles.find(tag('cellXfs'));formats=styles.find(tag('numFmts'))
    if formats is None:formats=ET.Element(tag('numFmts'));styles.insert(0,formats)
    fmtid=max([163]+[int(x.get('numFmtId')) for x in formats])+1
    ET.SubElement(formats,tag('numFmt'),{'numFmtId':str(fmtid),'formatCode':'0.000000'});formats.set('count',str(len(formats)))
    precise=copy.deepcopy(xfs[int(style)]);precise.set('numFmtId',str(fmtid));precise.set('applyNumberFormat','1');precision_style=len(xfs);xfs.append(precise)
    wrapped=copy.deepcopy(xfs[int(style)]);wrapped.set('numFmtId','0');alignment=wrapped.find(tag('alignment'))
    if alignment is None:alignment=ET.SubElement(wrapped,tag('alignment'))
    alignment.set('wrapText','1');alignment.set('vertical','center');wrapped.set('applyAlignment','1');wrap_style=len(xfs);xfs.append(wrapped)
    xfs.set('count',str(len(xfs)));parts['xl/styles.xml']=ET.tostring(styles)
    def ip(a,x):report_cell(inputs,a,x)
    inputkeys={6:'cable_count',7:'cable_mass_kg_m',8:'gravity',9:'cable_diameter_mm',10:'conduit_diameter_mm',11:'friction',12:'initial_tension_N',13:'allowable_tension_N',14:'allowable_swbp_N_m',15:'allowable_fill',36:'formation',37:'manufacturer_swbp_factor'}
    for row,key in inputkeys.items():ip('C'+str(row),p[key])
    for row in range(6,16):ip('E'+str(row),'Dynamo cable settings; confirm for this project')
    for a,v in {'A24':'Wc_diamond','B23':'Triangular candidate: 1 / sqrt(1 - r²)','B24':'Four cables in diamond: 1 + 2 r²','B25':'Cradled candidate: 1 + 4 r² / 3','B26':'Wc: cable count and project D/d rule','B33':'SWBP c: MWP formation factor; positive manufacturer override','A36':'formation','B36':'Cable arrangement','A37':'c_mfr','B37':'Manufacturer SWBP override (0 = MWP formation factor)','A38':'valid','B38':'Input validity'}.items():ip(a,v)
    ratio=p['cable_diameter_mm']/(p['conduit_diameter_mm']-p['cable_diameter_mm'])
    data={18:('C10-C9',p['conduit_diameter_mm']-p['cable_diameter_mm']),19:('C10/C9',p['conduit_diameter_mm']/p['cable_diameter_mm']),20:('C9/C18',ratio),21:('C20^2',ratio**2),22:('1-C21',1-ratio**2),23:('IF(C22>0,1/SQRT(C22),"UNAVAILABLE")',1/math.sqrt(1-ratio**2) if ratio<1 else 'UNAVAILABLE'),24:('1+2*C21',1+2*ratio**2),25:('1+4*C21/3',1+4*ratio**2/3),26:('IF(C6=1,1,IF(C6=2,C23,IF(C6=3,IF(C48>=0.5,IF(C36="Cradled",C25,C23),IF(C19<=2.5,C23,IF(C19<=3,C24,C25))),IF(C6=4,C24,1.4))))',p['weight_correction']),27:('C11*C26',p['effective_friction']),28:('C6*C7',p['cable_count']*p['cable_mass_kg_m']),29:('C28*C8',p['weight_N_m']),30:('C9/C10',p['cable_diameter_mm']/p['conduit_diameter_mm']),31:('C30^2',(p['cable_diameter_mm']/p['conduit_diameter_mm'])**2),32:('C6*C31',p['fill']),33:('IF(C37>0,C37,IF(C6=1,1,IF(C6=2,C26/2,IF(C6=3,IF(C36="Cradled",(3*C26-2)/3,C26/2),C26-1))))',p['swbp_factor'] if p['swbp_factor'] is not None else 'UNAVAILABLE'),34:('IF(C32<=C15,"WITHIN LIMIT","FAIL")','WITHIN LIMIT')}
    for row,(formula,value) in data.items():ip('C'+str(row),ExcelFormula(formula,value));ip('E'+str(row),'='+formula)
    validity='IF(AND(C6=INT(C6),C6>=1,C7>0,C8>0,C9>0,C10>C9,C11>=0,C12>=0,C13>0,C14>0,C15>0,C15<=1,C32<=C15,C37>=0,OR(AND(C6=1,C36="Single"),AND(OR(C6=2,C6=3),C36="Trefoil"),AND(C6=3,C36="Cradled"),AND(C6=4,C36="Diamond"),AND(C6>4,C36="fourcables")),ISNUMBER(C26)),"VALID","INVALID - rerun Dynamo")'
    validity=validity.replace('ISNUMBER(C26))','ISNUMBER(C26),C19>=IF(C6=2,2,IF(C6=3,1+2/SQRT(3),IF(C6=4,1+SQRT(2),1))))')
    ip('C38',ExcelFormula(validity,'VALID'))
    report_cell(inputs,'B43','Minimum bend radius during installation (m)');ip('C43',p['min_bend_install_m']);ip('E43','HV cable datasheet. 0 switches the bend radius check off.')
    report_cell(inputs,'B44','Minimum bend radius installed (m)');ip('C44',p['min_bend_static_m']);ip('E44','HV cable datasheet. 0 switches the bend radius check off.')
    report_cell(inputs,'B45','Grade break tolerance (deg)');ip('C45',p['grade_break_tol_deg']);ip('E45','Profile angle changes at or below this are treated as export approximation (parabola written as an arc), not a kink. 0 counts every break.')
    report_cell(inputs,'B46','High sidewall friction coefficient (0 = off)');ip('C46',p['friction_high']);ip('E46','Applied to a whole section when the sidewall force at the start of that section exceeds the threshold below.')
    report_cell(inputs,'B47','Sidewall pressure threshold (N/m)');ip('C47',p['sidewall_threshold_N_m']);ip('E47','Above this the high sidewall friction replaces the normal friction for that section.')
    report_cell(inputs,'B50','Maximum tension per cable (N)');ip('C50',p.get('tension_per_cable_N',0.));ip('E50','HV cable datasheet: 28 kN pulling grip, 36 kN pulling eye. 0 = use the total allowable pulling tension input instead.')
    report_cell(inputs,'B51','Tension reduction factor');ip('C51',p.get('tension_reduction',1.));ip('E51','Allowable pulling tension (C13) = number of cables x maximum tension per cable x this factor, as in ELEK Cable Pulling.')
    report_cell(inputs,'B48','Three-cable factor rule (0 = project ratio rule, 1 = selected formation, IEEE)');ip('C48',p['three_cable_formation_rule']);ip('E48','1 uses the standard triangular factor for Trefoil and the cradled factor for Cradled, whatever the duct to cable ratio.')
    report_cell(inputs,'B39','Wc rule source',wrap_style)
    report_cell(inputs,'E39','Project-supplied three-cable D/d bands. Middle band 1+2r^2 is not the verified IEEE 1185-2010 rule. SWBP follows selected formation.',wrap_style)
    report_height(inputs,39,70)
    report_cell(inputs,'E26','Project three-cable ratio rule: <=2.5 triangular; 2.5<D/d<=3 uses 1+2r^2; >3 uses 1+4r^2/3. Middle band differs from verified IEEE 1185-2010.',wrap_style)
    ip('E37','MWP PullCal_V9: Single=1; Trefoil=Wc/2; Cradled=(3Wc-2)/3; Diamond=Wc-1; fourcables=1.0 (conservative). Positive override takes priority.')
    report_cell(inputs,'E37','MWP PullCal_V9: Single=1; Trefoil=Wc/2; Cradled=(3Wc-2)/3; Diamond=Wc-1; fourcables=1.0 (conservative). Positive override takes priority.',wrap_style)
    report_height(inputs,37,60)
    for row in (26,33,34):
        report_cell(inputs,'E'+str(row),'='+data[row][0],wrap_style);report_height(inputs,row,55)
    report_height(inputs,3,36);report_merge(inputs,'A3:E3')
    report_cell(inputs,'A3','Live Excel formulas use a fixed exported mesh. Rerun Dynamo after input changes to check convergence.',wrap_style)
    # Remove obsolete worked examples outside the method's print area. Retain diagrams.
    for cell in method.findall('.//'+tag('c')):
        addr=cell.get('r');row=int(re.search(r'\d+',addr).group());col=col_number(re.sub(r'\d','',addr))
        if (col>11 or row>=60) and addr not in ('A77','A79','A81'):report_cell(method,addr,None)
    for addr,formula,value in [('H8',"'IEEE Inputs'!C7",p['cable_mass_kg_m']),('H9',"'IEEE Inputs'!C26",p['weight_correction']),('H10',"'IEEE Inputs'!C29",p['weight_N_m']),('H11',"'IEEE Inputs'!C11",p['friction']),('H12',"'IEEE Inputs'!C27",p['effective_friction']),('H16',"'IEEE Inputs'!C8",p['gravity']),('H41',"'IEEE Inputs'!C13",p['allowable_tension_N']),('H47',"'IEEE Inputs'!C14",p['allowable_swbp_N_m']),('H51',"'IEEE Inputs'!C12",p['initial_tension_N'])]:report_cell(method,addr,ExcelFormula(formula,value))
    for addr,formula,value in [('H42','H41/1000',p['allowable_tension_N']/1000),('H43','H41/H16',p['allowable_tension_N']/p['gravity']),('H48','H47/1000',p['allowable_swbp_N_m']/1000),('H49','H47/H16',p['allowable_swbp_N_m']/p['gravity'])]:report_cell(method,addr,ExcelFormula(formula,value))
    for a,v in {'B18':'IEEE cable factors with general 3D force-balance integration. Units: N and N/m.','B20':'Straight','B21':'Level bend','B22':'Curved pull','B23':'Curvature','B24':'Contact force','B25':'Force balance','B26':'RK4 step','B27':'Joint','C30':'Î±'}.items():report_cell(method,a,v,wrap_style)
    report_merge(method,'B18:K18');report_height(method,18,32)
    report_cell(method,'K1','V21.5')
    for row in range(20,28):report_merge(method,'B%d:D%d'%(row,row));report_merge(method,'E%d:K%d'%(row,row));report_height(method,row,42)
    for row in (32,34):report_merge(method,'F%d:K%d'%(row,row));report_height(method,row,40)
    for row in (36,37,38,39):report_merge(method,'B%d:K%d'%(row,row));report_height(method,row,32)
    for row in (53,55,57,59):report_merge(method,'A%d:K%d'%(row,row));report_height(method,row,32)
    for cell in method.findall('.//'+tag('c')):
        if cell.find(tag('is')) is not None and int(re.search(r'\d+',cell.get('r')).group())>=20:cell.set('s',str(wrap_style))
    report_cell(summary,'A2','Cable pulling calculations — V21.5')
    report_cell(summary,'A3','Template report with live formula working. Fixed mesh; rerun Dynamo after changing inputs.')
    headings=['Route','Report page','Direction','Duct length (m)','Allowable T (N)','Allowable P (N/m)','Peak T (N)','Peak P (N/m)','Status']
    for c,v in enumerate(headings,1):report_cell(summary,col_label(c)+'6',v)
    report_widths(summary,{1:31,2:18,3:16,4:20,5:20,6:21,7:20,8:22,9:26})
    for address,label in [('J6','Joints without radius'),('K6','SWBP coverage'),('L6','Smallest bend radius (m)'),('M6','Bend radius check')]:report_cell(summary,address,label,wrap_style)
    report_widths(summary,{10:22,11:45,12:20,13:40});report_height(summary,6,36)
    report_merge(summary,'A2:I2');report_merge(summary,'A3:I3');report_height(summary,3,36)
    sheets=[('Summary',summary,source_paths['Summary']),('IEEE Inputs',inputs,source_paths['IEEE Inputs']),('IEEE 1185-2019 Method',method,source_paths['IEEE 1185-2019 Method'])];sr=7
    for ri,run in enumerate(runs,1):
        if 'result' not in run:
            report_cell(summary,'A'+str(sr),run['route']);report_cell(summary,'I'+str(sr),'NOT CALCULATED: '+run['error']);sr+=1;continue
        res=run['result'];directions=[]
        for rev in (False,True):
            headerstyle=next(c.get('s','0') for c in base.findall('.//'+tag('c')) if c.get('r')=='M4')
            name='R%d %s steps'%(ri,'R' if rev else 'F');root,records=live_steps(res['segments'],p,rev,name,precision_style,headerstyle,wrap_style)
            directions.append((name,records));sheets.append((name,root,None))
        for rev in (False,True):sheets.append(('R%d %s list'%(ri,'R' if rev else 'F'),elek_style_sheet(res,rev,p),None))
        if ri==1:sheets.append(('Cable data',cable_data_sheet(p),None))
        pages=int(math.ceil(len(res['segments'])/93.))
        for page in range(pages):
            report=copy.deepcopy(base);clear_report(report);name='Route %d'%ri+(' p%d'%(page+1) if pages>1 else '')
            put=lambda a,v:report_cell(report,a,v)
            put('L1',run['route']);put('AC1','V21.5')
            report_merge(report,'L2:AC2');report_merge(report,'M99:Q99');report_merge(report,'M198:Q198')
            merges=report.find(tag('mergeCells'))
            for m in list(merges):
                if m.get('ref')=='X197:AB197':merges.remove(m)
            merges.set('count',str(len(merges)))
            cols=report.find(tag('cols'))
            # Q was a two-character dropdown column in the source template.
            for col in list(cols):
                if int(col.get('min'))<=17<=int(col.get('max')):
                    lo,hi=int(col.get('min')),int(col.get('max'));cols.remove(col)
                    if lo<17:before=copy.deepcopy(col);before.set('max','16');cols.append(before)
                    if hi>17:after=copy.deepcopy(col);after.set('min','18');cols.append(after)
            ET.SubElement(cols,tag('col'),{'min':'17','max':'17','width':'22','customWidth':'1'})
            cols[:]=sorted(cols,key=lambda col:int(col.get('min')))
            put('L2','Working: use R%d F steps and R%d R steps. Angles signed in pulling direction.'%(ri,ri))
            for reverse,(stepname,records) in enumerate(directions):
                title,head,first,footer=(102,103,104,197) if reverse else (3,4,5,98)
                put('L'+str(title),'Reverse' if reverse else 'Forward');put('N'+str(title),ExcelFormula("'IEEE Inputs'!C6",p['cable_count']))
                put('O'+str(title),run['route']);put('Z'+str(title),'Page %d/%d'%(page+1,pages))
                labels=['Section','T1 (N)','Length (m)','R plan (m)','R profile (m)','Type','Station out (m)','Angle in (deg)','Angle out (deg)','kv (1/m)','Joint (rad)','Straight T2','Uphill T2','Downhill T2','Horizontal T2','Vertical/3D T2','T2 (N)','Side Wall Force (N/m)']
                for col,label in enumerate(labels,12):put(col_label(col)+str(head),label)
                subset=records[page*93:(page+1)*93];peakrefs=[];pref=[];jointcount=0
                for offset,rec in enumerate(subset):
                    row=first+offset;s=rec['segment'];a=-s['a1'] if reverse else s['a0'];b=-s['a0'] if reverse else s['a1'];jointcount+=bool(rec['joint']);q="'%s'!"%stepname
                    vals={'L':s['id'],'M':ExcelFormula(q+'G'+str(rec['first']),rec['tin'] if rec['tin'] is not None else 'UNAVAILABLE'),'N':s['length'],'O':s['rh'],'P':abs(1/s['kv']) if s['kv'] else None,'Q':s['kind'],'R':s['s0'] if reverse else s['s1'],'S':math.degrees(a),'T':math.degrees(b),'U':s['kv'],'V':rec['joint'],'AB':ExcelFormula(q+'Y'+str(rec['last']),rec['tout'] if rec['tout'] is not None else 'UNAVAILABLE'),'AC':ExcelFormula(q+'AC'+str(rec['last']),rec['pressure'] if rec['pressure'] is not None else 'UNAVAILABLE')}
                    if not (s['kv'] or s['rh']):vals['AC']=ExcelFormula('""','')
                    category='AA' if s['kv'] else ('Z' if s['rh'] else ('X' if a>1e-7 else ('Y' if a<-1e-7 else 'W')))
                    vals[category]=ExcelFormula('AB'+str(row),rec['tout'] if rec['tout'] is not None else 'UNAVAILABLE')
                    for col,v in vals.items():put(col+str(row),v)
                    for col in ('S','T','U','V'):report_cell(report,col+str(row),vals[col],precision_style)
                    peakrefs.append(q+'AB'+str(rec['last']));pref.append(q+'AC'+str(rec['last']))
                last=first+len(subset)-1;peak=max([r['peak'] for r in subset if r['peak'] is not None],default='UNAVAILABLE');pressure_complete=any(r['pressure'] is not None for r in subset)
                pv=max((r['pressure'] for r in subset if r['pressure'] is not None),default=0.) if pressure_complete else 'UNAVAILABLE'
                put('L'+str(footer),'Peak T (page)');put('M'+str(footer),ExcelFormula('IF(COUNT('+','.join(peakrefs)+')=0,"UNAVAILABLE",MAX('+','.join(peakrefs)+'))',peak))
                put('R'+str(footer),'Allowable T');put('S'+str(footer),ExcelFormula("'IEEE Inputs'!C13",p['allowable_tension_N']))
                put('V'+str(footer),'Peak SWBP (page)');put('W'+str(footer),ExcelFormula('IF(COUNT(AC%d:AC%d)>0,MAX(AC%d:AC%d),"UNAVAILABLE")'%(first,last,first,last),pv))
                put('AB'+str(footer),'Allowable SWBP');put('AC'+str(footer),ExcelFormula("'IEEE Inputs'!C14",p['allowable_swbp_N_m']))
                knownp=max((r['pressure'] for r in subset if r['pressure'] is not None),default=0.)
                status='FAIL' if isinstance(peak,(float,int)) and peak>p['allowable_tension_N'] or knownp>p['allowable_swbp_N_m'] else 'REVIEW REQUIRED'
                sf='IF(\'IEEE Inputs\'!C38<>"VALID","INVALID INPUT",IF(OR(IF(ISNUMBER(M%d),M%d>S%d,FALSE),MAX(AC%d:AC%d)>AC%d),"FAIL","REVIEW REQUIRED"))'%(footer,footer,footer,first,last,footer)
                put('L'+str(footer+1),'Check');put('M'+str(footer+1),ExcelFormula(sf,status))
                summaryvals=[run['route'],name,'Reverse' if reverse else 'Forward',sum(x['segment']['length'] for x in subset),ExcelFormula("'IEEE Inputs'!C13",p['allowable_tension_N']),ExcelFormula("'IEEE Inputs'!C14",p['allowable_swbp_N_m']),ExcelFormula("'%s'!M%d"%(name,footer),peak),ExcelFormula("'%s'!W%d"%(name,footer),pv),ExcelFormula("'%s'!M%d"%(name,footer+1),status)]
                for c,v in enumerate(summaryvals,1):report_cell(summary,col_label(c)+str(sr),v)
                sr+=1
            if ri == 1:route_one_reference_layout(report,base,directions,page,p,run)
            add_route_section_types(report,directions,page,wrap_style)
            for footer,row,known,joints,note in add_known_swbp_output(report,directions,page,wrap_style,style):
                summaryrow=sr-2+(footer==197)
                report_cell(summary,'J'+str(summaryrow),joints,wrap_style)
                report_cell(summary,'K'+str(summaryrow),note,wrap_style)
                report_cell(summary,'L'+str(summaryrow),res['bend']['min_radius'],wrap_style)
                report_cell(summary,'M'+str(summaryrow),res['bend']['text'],wrap_style)
                report_height(summary,summaryrow,36)
            for _d in report.findall(tag('drawing')):report.remove(_d)
            sheets.insert(3,(name,report,source_paths['SS JB1']))
    hstyle=next((x.get('s','0') for x in base.findall('.//'+tag('c')) if x.get('r')=='M4'),'0')
    sheets.insert(3,('Help - Equations',help_equations_sheet(wrap_style,hstyle),None))
    report_display_units(sheets,inputs,p,wrap_style)
    imported_names=import_separate_calculations(parts,sheets,SEPARATE_CALCULATIONS)
    link_duct_calculations(sheets,p)
    report_cell(summary,'A3','Fill and jamming tabs use Dynamo cable/duct inputs. Jamming criterion applies to three equal cables. Rerun Dynamo after route input changes.',wrap_style)
    report_height(summary,3,54)
    try:
        _mu=float(p['friction'])
    except Exception:
        _mu=None
    if _mu is None:
        _fnote='Friction basis: confirm the friction coefficient used for this run.'
    elif _mu<=0.3:
        _fnote=('FRICTION NOTE: friction coefficient %.2f used for this run. This is a LUBRICATED pull value. '
                'Cable outer sheath is HDPE (cable data sheet 9800-E-0021-PD); published lubricated polyethylene-jacket/duct values are about 0.05 to 0.15. '
                'Pulling lubricant is REQUIRED: without lubricant friction is typically 0.35 to 0.5 and the pull exceeds the cable limits. '
                'Confirm the friction value and lubricant compatibility with the cable and lubricant suppliers.') % _mu
    else:
        _fnote=('FRICTION NOTE: friction coefficient %.2f used for this run. This is an UNLUBRICATED or conservative value. '
                'Lubricated pulls typically use about 0.2 or lower; compare with the lubricated case and confirm with the cable and lubricant suppliers.') % _mu
    report_cell(summary,'A4',_fnote,wrap_style)
    report_merge(summary,'A4:M4')
    report_height(summary,4,66)
    report_cell(method,'E21','Level horizontal reference: T2=T1*cosh(f_eff*theta)+sqrt(T1^2+(f_eff*W*g*R)^2)*sinh(f_eff*theta)',wrap_style)
    report_cell(method,'E24','Level horizontal uses reference Eq.8; other 3D sections use resultant contact force.',wrap_style)
    report_cell(method,'B59','Angles converted once; exact EXP; slope friction once; sidewall divides by radius. Fill and jamming sheets use the same cable count and diameters as the route.',wrap_style)
    # Rebuild the workbook's sheet registry; preserve styles, drawings and media bytes.
    sheetels.clear()
    for relationship in list(rels):
        if relationship.get('Type','').endswith(('/worksheet','/calcChain')):rels.remove(relationship)
    for item in list(workbook):
        if item.tag in (tag('definedNames'),tag('calcPr')):workbook.remove(item)
    ET.SubElement(workbook,tag('calcPr'),{'calcId':'191029','fullCalcOnLoad':'1','forceFullCalc':'1','calcMode':'auto'})
    types=ET.fromstring(parts['[Content_Types].xml']);ct='{http://schemas.openxmlformats.org/package/2006/content-types}'
    for item in list(types):
        if item.get('ContentType','').endswith(('worksheet+xml','calcChain+xml')):types.remove(item)
    names=ET.SubElement(workbook,tag('definedNames'))
    for index,(name,root,oldpath) in enumerate(sheets,1):
        part='xl/worksheets/report%d.xml'%index;rid='report%d'%index
        ET.SubElement(sheetels,tag('sheet'),{'name':name,'sheetId':str(index),'{'+REL+'}id':rid})
        ET.SubElement(rels,'{http://schemas.openxmlformats.org/package/2006/relationships}Relationship',{'Id':rid,'Type':REL+'/worksheet','Target':'worksheets/report%d.xml'%index})
        ET.SubElement(types,ct+'Override',{'PartName':'/'+part,'ContentType':'application/vnd.openxmlformats-officedocument.spreadsheetml.worksheet+xml'})
        if oldpath:
            oldrel=posixpath.dirname(oldpath)+'/_rels/'+posixpath.basename(oldpath)+'.rels'
            if oldrel in parts:parts['xl/worksheets/_rels/report%d.xml.rels'%index]=parts[oldrel]
        parts[part]=report_xml(root)
        if name.startswith('Route '):ET.SubElement(names,tag('definedName'),{'name':'_xlnm.Print_Area','localSheetId':str(index-1)}).text="'%s'!$L$1:$AC$198"%name
        for key,value in imported_names.get(name,[]):ET.SubElement(names,tag('definedName'),{'name':key,'localSheetId':str(index-1)}).text=value
    # Defined names precede calcPr in SpreadsheetML.
    workbook.remove(names);workbook.insert(list(workbook).index(workbook.find(tag('calcPr'))),names)
    workbook.attrib.pop('{http://schemas.openxmlformats.org/markup-compatibility/2006}Ignorable',None)
    ET.register_namespace('',NS);ET.register_namespace('r',REL)
    parts['xl/workbook.xml']=ET.tostring(workbook)
    ET.register_namespace('','http://schemas.openxmlformats.org/package/2006/relationships')
    parts['xl/_rels/workbook.xml.rels']=ET.tostring(rels)
    ET.register_namespace('','http://schemas.openxmlformats.org/package/2006/content-types')
    parts['[Content_Types].xml']=ET.tostring(types)
    ET.register_namespace('',NS)
    parts.pop('xl/calcChain.xml',None)
    normalize_excel_metadata(parts)
    remove_logo(parts)
    scrub_dynamo(parts)
    with zipfile.ZipFile(path,'x',zipfile.ZIP_DEFLATED) as archive:
        for name,content in parts.items():archive.writestr(name,content)
    _report_indices.clear()

_snapshot_runner=run_from_dynamo
def run_from_dynamo(values):
    EXTRA_SETTINGS.clear()
    for k,v in zip(('min_bend_install_m','min_bend_static_m','grade_break_tol_deg','friction_high','sidewall_threshold_N_m','three_cable_formation_rule'),values[21:27]):
        if isinstance(v,(int,float)) and not isinstance(v,bool):EXTRA_SETTINGS[k]=float(v)
    preview=list(values[:20]);preview[3]=False
    _per=values[27] if len(values)>27 else 0.;_fac=values[28] if len(values)>28 else 1.
    _num=lambda x:isinstance(x,(int,float)) and not isinstance(x,bool)
    if not _num(_per) or _per<0:raise ValueError('Maximum tension per cable must be zero or positive')
    if not _num(_fac) or not 0<_fac<=1:raise ValueError('Tension reduction factor must be above 0 and at most 1')
    EXTRA_SETTINGS['tension_per_cable_N']=float(_per);EXTRA_SETTINGS['tension_reduction']=float(_fac)
    if _per>0:preview[11]=float(preview[4])*float(_per)*float(_fac)
    out=_snapshot_runner(preview)
    out[0]='V21.5: audited formulas; HV cable bend radius check added'
    if values[3]:
        folder=str(values[19] or '').strip()
        if not os.path.isdir(folder):raise ValueError('Select an existing Excel export folder')
        path=os.path.join(folder,'Civil3D_PullCal_V21_5_'+datetime.now().strftime('%Y%m%d_%H%M%S_%f')+'.xlsx')
        reportsettings=dict(out[3][1]);reportsettings['report_kg_units']=bool(values[20]) if len(values)>20 else False
        export_live_template(path,out[4][1],reportsettings);out[1]=path
    return out

if 'IN' in globals():
    OUT=run_from_dynamo(IN[:20]+[IN[24] if len(IN)>24 else False]+[IN[25] if len(IN)>25 else 2.907,IN[26] if len(IN)>26 else 1.938,IN[27] if len(IN)>27 else 0.3,IN[28] if len(IN)>28 else 0.,IN[29] if len(IN)>29 else 2185.,IN[30] if len(IN)>30 else 0.,IN[31] if len(IN)>31 else 0.,IN[32] if len(IN)>32 else 1.])
    OUT.append(inspect_work(OUT,IN[20:24]))
# ----------------------------------------

# group: 5 | Results
# Output of the solver.
# - Results and review items: Shows the results and review items returned by the solver.
results_and_review_items = Watch(v16_actual_3d_geometry_converged)

# group (continued): 6 | Formula inspector (step-by-step check)
n01_selected_calculation_data = CodeBlock(result=v16_actual_3d_geometry_converged)  # "01 - Selected calculation data"
# ---------- n01_selected_calculation_data.designscript (6 lines) ----------
// Change the four Inspect inputs then Run.
data = result[6];
cable = data[0];
step = data[1];
geometry = data[2];
selection = data[3];
# ----------------------------------------
n03_current_integration_step = CodeBlock(s=n01_selected_calculation_data.step)  # "03 - Current integration step inputs"
# ---------- n03_current_integration_step.designscript (11 lines) ----------
// Angles in degrees for Dynamo Math.Sin/Cos.
T = s[0];
alpha = s[1];
kv = s[2];
Rh = s[3];
h = s[4];
f = s[5];
W = s[6];
c = s[7];
expectedT = s[8];
expectedP = s[9];
# ----------------------------------------
n04_1_rk4_stage_k1_n_m = CodeBlock(T=n03_current_integration_step.T, alpha=n03_current_integration_step.alpha, Rh=n03_current_integration_step.Rh, kv=n03_current_integration_step.kv, W=n03_current_integration_step.W, f=n03_current_integration_step.f)  # "04.1 - RK4 stage k1 (N/m)"
# ---------- n04_1_rk4_stage_k1_n_m.designscript (11 lines) ----------
// dT/dl: same balance for straight, vertical and compound bends.
stageT = T;
stageAngle = alpha;
safeRadius = Rh == 0 ? 1 : Rh;
kh = Rh == 0 ? 0 : Math.Cos(stageAngle)*Math.Cos(stageAngle)/safeRadius;
horizontalContact = stageT * kh;
verticalContact = stageT * kv - W * Math.Cos(stageAngle);
normalForce = Math.Sqrt(horizontalContact*horizontalContact + verticalContact*verticalContact);
frictionForce = f * normalForce;
gravityForce = W * Math.Sin(stageAngle);
rate = frictionForce + gravityForce;
# ----------------------------------------
n04_2_rk4_stage_k2_n_m = CodeBlock(T=n03_current_integration_step.T, h=n03_current_integration_step.h, k=n04_1_rk4_stage_k1_n_m.rate, alpha=n03_current_integration_step.alpha, kv=n03_current_integration_step.kv, Rh=n03_current_integration_step.Rh, W=n03_current_integration_step.W, f=n03_current_integration_step.f)  # "04.2 - RK4 stage k2 (N/m)"
# ---------- n04_2_rk4_stage_k2_n_m.designscript (11 lines) ----------
// dT/dl: same balance for straight, vertical and compound bends.
stageT = T + h*k/2;
stageAngle = alpha + Math.RadiansToDegrees(kv*h/2);
safeRadius = Rh == 0 ? 1 : Rh;
kh = Rh == 0 ? 0 : Math.Cos(stageAngle)*Math.Cos(stageAngle)/safeRadius;
horizontalContact = stageT * kh;
verticalContact = stageT * kv - W * Math.Cos(stageAngle);
normalForce = Math.Sqrt(horizontalContact*horizontalContact + verticalContact*verticalContact);
frictionForce = f * normalForce;
gravityForce = W * Math.Sin(stageAngle);
rate = frictionForce + gravityForce;
# ----------------------------------------
n04_3_rk4_stage_k3_n_m = CodeBlock(T=n03_current_integration_step.T, h=n03_current_integration_step.h, k=n04_2_rk4_stage_k2_n_m.rate, alpha=n03_current_integration_step.alpha, kv=n03_current_integration_step.kv, Rh=n03_current_integration_step.Rh, W=n03_current_integration_step.W, f=n03_current_integration_step.f)  # "04.3 - RK4 stage k3 (N/m)"; same code as n04_2_rk4_stage_k2_n_m
n04_4_rk4_stage_k4_n_m = CodeBlock(T=n03_current_integration_step.T, h=n03_current_integration_step.h, k=n04_3_rk4_stage_k3_n_m.rate, alpha=n03_current_integration_step.alpha, kv=n03_current_integration_step.kv, Rh=n03_current_integration_step.Rh, W=n03_current_integration_step.W, f=n03_current_integration_step.f)  # "04.4 - RK4 stage k4 (N/m)"
# ---------- n04_4_rk4_stage_k4_n_m.designscript (11 lines) ----------
// dT/dl: same balance for straight, vertical and compound bends.
stageT = T + h*k;
stageAngle = alpha + Math.RadiansToDegrees(kv*h);
safeRadius = Rh == 0 ? 1 : Rh;
kh = Rh == 0 ? 0 : Math.Cos(stageAngle)*Math.Cos(stageAngle)/safeRadius;
horizontalContact = stageT * kh;
verticalContact = stageT * kv - W * Math.Cos(stageAngle);
normalForce = Math.Sqrt(horizontalContact*horizontalContact + verticalContact*verticalContact);
frictionForce = f * normalForce;
gravityForce = W * Math.Sin(stageAngle);
rate = frictionForce + gravityForce;
# ----------------------------------------
n05_step_exit_tension_and = CodeBlock(k1=n04_1_rk4_stage_k1_n_m.rate, k2=n04_2_rk4_stage_k2_n_m.rate, k3=n04_3_rk4_stage_k3_n_m.rate, k4=n04_4_rk4_stage_k4_n_m.rate, h=n03_current_integration_step.h, T=n03_current_integration_step.T, expectedT=n03_current_integration_step.expectedT)  # "05 - Step exit tension and verification"
# ---------- n05_step_exit_tension_and.designscript (8 lines) ----------
// Weighted RK4 increment. This is ONE selected step.
weightedRate = k1 + 2*k2 + 2*k3 + k4;
increment = h * weightedRate / 6;
rawT2 = T + increment;
T2 = rawT2 < 0 ? 0 : rawT2;
differenceN = T2 - expectedT;
// Bounds avoid Dynamo's ambiguous Abs(int)/Abs(double) overload.
stepMatches = differenceN > -0.000001 && differenceN < 0.000001;
# ----------------------------------------
n06_step_exit_swbp_and = CodeBlock(alpha=n03_current_integration_step.alpha, kv=n03_current_integration_step.kv, h=n03_current_integration_step.h, Rh=n03_current_integration_step.Rh, c=n03_current_integration_step.c, T2=n05_step_exit_tension_and.T2, expectedP=n03_current_integration_step.expectedP)  # "06 - Step exit SWBP and verification"
# ---------- n06_step_exit_swbp_and.designscript (9 lines) ----------
// P = c T kappa. Null c means manufacturer factor required.
exitAngle = alpha + Math.RadiansToDegrees(kv*h);
safeRadius = Rh == 0 ? 1 : Rh;
kh = Rh == 0 ? 0 : Math.Cos(exitAngle)*Math.Cos(exitAngle)/safeRadius;
kappa = Math.Sqrt(kh*kh + kv*kv);
P = c == null ? null : c*T2*kappa;
differenceP = c == null ? null : P-expectedP;
pressureMatches = c == null ? null : (differenceP > -0.000001 && differenceP < 0.000001);
// Whole-section peak is in Selected calculation / selection.
# ----------------------------------------
n02_cable_weight_friction_and = CodeBlock(x=n01_selected_calculation_data.cable)  # "02 - Cable weight, friction and fill"
# ---------- n02_cable_weight_friction_and.designscript (21 lines) ----------
// kg/m -> N/m: gravity is included ONCE.
n = x[0];
m = x[1];
g = x[2];
d = x[3];
D = x[4];
mu = x[5];
triangular = x[6];
r = d / (D - d);
safeRoot = Math.Sqrt(n == 1 ? 1 : 1-r*r);
WcTriangle = 1 / safeRoot;
WcCradle = 1 + (4.0/3.0)*r*r;
WcDiamond = 1 + 2*r*r;
Wc = n == 1 ? 1 : (n == 2 ? WcTriangle : (n == 3 ? (D/d <= 2.5 ? WcTriangle : (D/d <= 3 ? WcDiamond : WcCradle)) : (n == 4 ? WcDiamond : 1.4)));
W = n * m * g;
f = mu * Wc;
fill = n * (d/D) * (d/D);
WcDifference = Wc - x[7];
manufacturerC = x[8];
ieeeC = n == 1 ? 1 : (n == 2 ? Wc/2 : (n == 3 ? (triangular ? Wc/2 : (3*Wc-2)/3) : (n == 4 ? Wc-1 : 1)));
c = manufacturerC > 0 ? manufacturerC : ieeeC;
# ----------------------------------------
n07_whole_section_and_unknown = CodeBlock(q=n01_selected_calculation_data.geometry, f=n02_cable_weight_friction_and.f)  # "07 - Whole section and unknown joint"
# ---------- n07_whole_section_and_unknown.designscript (14 lines) ----------
T1 = q[0];
L = q[1];
angle = q[2];
Rh = q[3];
planLength = q[4];
kv = q[5];
sectionExit = q[6];
previousT = q[7];
jointDegrees = q[8];
peakT = q[9];
peakP = q[10];
jointRadians = Math.DegreesToRadians(jointDegrees);
jointT1 = previousT*Math.Exp(f*jointRadians);
jointDifference = jointT1-T1;
# ----------------------------------------
n08_straight_slope_closed_form = CodeBlock(Rh=n07_whole_section_and_unknown.Rh, kv=n07_whole_section_and_unknown.kv, W=n02_cable_weight_friction_and.W, L=n07_whole_section_and_unknown.L, f=n02_cable_weight_friction_and.f, angle=n07_whole_section_and_unknown.angle, T1=n07_whole_section_and_unknown.T1, sectionExit=n07_whole_section_and_unknown.sectionExit)  # "08 - Straight / slope closed-form check"
# ---------- n08_straight_slope_closed_form.designscript (6 lines) ----------
// Applicable only if BOTH curvatures are zero.
applicable = Rh == 0 && kv == 0;
frictionTerm = W * L * f * Math.Cos(angle);
gravityTerm = W * L * Math.Sin(angle);
T2check = applicable ? T1 + frictionTerm + gravityTerm : null;
sectionDifference = applicable ? T2check-sectionExit : null;
# ----------------------------------------
n09_level_horizontal_bend_closed = CodeBlock(Rh=n07_whole_section_and_unknown.Rh, kv=n07_whole_section_and_unknown.kv, angle=n07_whole_section_and_unknown.angle, planLength=n07_whole_section_and_unknown.planLength, f=n02_cable_weight_friction_and.f, T1=n07_whole_section_and_unknown.T1, W=n02_cable_weight_friction_and.W, sectionExit=n07_whole_section_and_unknown.sectionExit)  # "09 - Level horizontal bend closed-form check"
# ---------- n09_level_horizontal_bend_closed.designscript (11 lines) ----------
// Applicable only to a LEVEL plan bend, not inclined/compound curves.
applicable = Rh > 0 && kv == 0 && angle > -0.0000001 && angle < 0.0000001;
safeRadius = Rh == 0 ? 1 : Rh;
thetaRadians = planLength/safeRadius;
ePlus = Math.Exp(f*thetaRadians);
eMinus = Math.Exp(0-f*thetaRadians);
coshValue = (ePlus+eMinus)/2;
sinhValue = (ePlus-eMinus)/2;
root = Math.Sqrt(T1*T1 + (W*Rh)*(W*Rh));
T2check = applicable ? T1*coshValue+sinhValue*root : null;
sectionDifference = applicable ? T2check-sectionExit : null;
# ----------------------------------------

# group: 7 | Section type examples
# Worked examples of each section type. Independent of the route solver.
# - Entry tension T1 [N]: Example input value.
# - 00 - Common quantities: W and f shared by all the worked examples.
# - 01 - Straight or Horizontal: Worked example of this section type, from T1 to T2.
# - 02 - Slope Up: Worked example of this section type, from T1 to T2.
# - Cable count: Example input value.
# - Mass per cable [kg/m]: Example input value.
# - Gravity [m/s2]: Example input value.
# - Friction coefficient: Example input value.
# - Weight correction â€” selected separately: Example input value.
# - Straight or slope length [m]: Example input value.
# - Bend radius [m]: Example input value.
# - Positive slope or bend angle [degrees]: Example input value.
# - 03 - Slope Down: Worked example of this section type, from T1 to T2.
# - 04 - Concave Downward Bend: Worked example of this section type, from T1 to T2.
# - 05 - Concave Upward Bend: Worked example of this section type, from T1 to T2.
# - 06 - Convex Downward Bend: Worked example of this section type, from T1 to T2.
# - 07 - Convex Upward Bend: Worked example of this section type, from T1 to T2.
# - 08 - Horizontal Bend: Worked example of this section type, from T1 to T2.
section_examples_entry_tension = DoubleInput(10000)  # "Section examples - Entry tension T1 [N]"
section_examples_cable_count = DoubleInput(17)
section_examples_mass_per_cable = DoubleInput(0.95)  # "Section examples - Mass per cable [kg/m]"
section_examples_gravity_m_s2 = DoubleInput(9.8)
section_examples_friction = DoubleInput(0.2)  # "Section examples - Friction coefficient"
section_examples_weight = DoubleInput(1.4)  # "Section examples - Weight correction â€” selected separately"
section_examples_00_common = CodeBlock(n=section_examples_cable_count, m=section_examples_mass_per_cable, g=section_examples_gravity_m_s2, mu=section_examples_friction, Wc=section_examples_weight)  # "Section examples - 00 - Common quantities"
# ---------- section_examples_00_common.designscript (4 lines) ----------
// Total cable weight per metre, not mass.
W = n * m * g;
// Effective friction. Wc must suit the cable arrangement.
f = mu * Wc;
# ----------------------------------------
section_examples_straight_or = DoubleInput(200)  # "Section examples - Straight or slope length [m]"
section_examples_01_straight_or = CodeBlock(T1=section_examples_entry_tension, W=section_examples_00_common.W, f=section_examples_00_common.f, L=section_examples_straight_or)  # "Section examples - 01 - Straight or Horizontal"
# ---------- section_examples_01_straight_or.designscript (6 lines) ----------
// L is actual cable length along the section.
valid = T1 >= 0 && W >= 0 && f >= 0 && L >= 0;
increment = W * f * L;
rawT2 = T1 + increment;
T2 = valid && rawT2 >= 0 ? rawT2 : null;
status = valid ? (rawT2 >= 0 ? "Taut solution" : "Loss of taut tension - use general solver") : "Invalid input";
# ----------------------------------------
section_examples_positive_slope = DoubleInput(30)  # "Section examples - Positive slope or bend angle [degrees]"
section_examples_02_slope_up = CodeBlock(T1=section_examples_entry_tension, W=section_examples_00_common.W, f=section_examples_00_common.f, L=section_examples_straight_or, angleDeg=section_examples_positive_slope)
# ---------- section_examples_02_slope_up.designscript (10 lines) ----------
// L is actual cable length along the section.
valid = T1 >= 0 && W >= 0 && f >= 0 && L >= 0 && angleDeg >= 0 && angleDeg <= 90;
cosAngle = Math.Cos(angleDeg);
sinAngle = Math.Sin(angleDeg);
frictionTerm = f * cosAngle;
gravityTerm = sinAngle;
increment = W * L * (frictionTerm + gravityTerm);
rawT2 = T1 + increment;
T2 = valid && rawT2 >= 0 ? rawT2 : null;
status = valid ? (rawT2 >= 0 ? "Taut solution" : "Loss of taut tension - use general solver") : "Invalid input";
# ----------------------------------------
section_examples_03_slope_down = CodeBlock(T1=section_examples_entry_tension, W=section_examples_00_common.W, f=section_examples_00_common.f, L=section_examples_straight_or, angleDeg=section_examples_positive_slope)
# ---------- section_examples_03_slope_down.designscript (10 lines) ----------
// L is actual cable length along the section.
valid = T1 >= 0 && W >= 0 && f >= 0 && L >= 0 && angleDeg >= 0 && angleDeg <= 90;
cosAngle = Math.Cos(angleDeg);
sinAngle = Math.Sin(angleDeg);
frictionTerm = f * cosAngle;
gravityTerm = -sinAngle;
increment = W * L * (frictionTerm + gravityTerm);
rawT2 = T1 + increment;
T2 = valid && rawT2 >= 0 ? rawT2 : null;
status = valid ? (rawT2 >= 0 ? "Taut solution" : "Loss of taut tension - use general solver") : "Invalid input";
# ----------------------------------------
section_examples_bend_radius_m = DoubleInput(3)
section_examples_04_concave = CodeBlock(angleDeg=section_examples_positive_slope, T1=section_examples_entry_tension, W=section_examples_00_common.W, f=section_examples_00_common.f, R=section_examples_bend_radius_m)  # "Section examples - 04 - Concave Downward Bend"
# ---------- section_examples_04_concave.designscript (19 lines) ----------
// Inclination: -angleDeg to 0 degrees.
// Circular bend in a vertical plane, constant R.
theta = Math.DegreesToRadians(angleDeg);
valid = T1 >= 0 && W >= 0 && f >= 0 && R > 0 && angleDeg >= 0 && angleDeg <= 90;
E = Math.Exp(f * theta);
s = Math.Sin(angleDeg);
c = Math.Cos(angleDeg);
B = W * R / (1 + f*f);
term1 = 2 * f * E * s;
term2 = (1 - f*f) * (1 - E*c);
C = term1 + term2;
rawT2 = T1 * E - B * C;
// Sufficient condition for T/R >= W*cos(alpha) throughout.
// If false, this simplified branch is not established. Use V18.
contactBound = W * R * (2 - c);
contactConfirmed = T1 >= contactBound;
formulaApplicable = valid && contactConfirmed;
T2 = formulaApplicable && rawT2 >= 0 ? rawT2 : null;
status = valid ? (formulaApplicable ? (rawT2 >= 0 ? "Taut solution" : "Loss of taut tension - use general solver") : "Contact branch not established - use V18") : "Invalid input";
# ----------------------------------------
section_examples_05_concave = CodeBlock(angleDeg=section_examples_positive_slope, T1=section_examples_entry_tension, W=section_examples_00_common.W, f=section_examples_00_common.f, R=section_examples_bend_radius_m)  # "Section examples - 05 - Concave Upward Bend"
# ---------- section_examples_05_concave.designscript (19 lines) ----------
// Inclination: 0 to +angleDeg degrees.
// Circular bend in a vertical plane, constant R.
theta = Math.DegreesToRadians(angleDeg);
valid = T1 >= 0 && W >= 0 && f >= 0 && R > 0 && angleDeg >= 0 && angleDeg <= 90;
E = Math.Exp(f * theta);
s = Math.Sin(angleDeg);
c = Math.Cos(angleDeg);
B = W * R / (1 + f*f);
term1 = 2 * f * s;
term2 = (1 - f*f) * (E - c);
D = term1 - term2;
rawT2 = T1 * E - B * D;
// Sufficient condition for T/R >= W*cos(alpha) throughout.
// If false, this simplified branch is not established. Use V18.
contactBound = W * R;
contactConfirmed = T1 >= contactBound;
formulaApplicable = valid && contactConfirmed;
T2 = formulaApplicable && rawT2 >= 0 ? rawT2 : null;
status = valid ? (formulaApplicable ? (rawT2 >= 0 ? "Taut solution" : "Loss of taut tension - use general solver") : "Contact branch not established - use V18") : "Invalid input";
# ----------------------------------------
section_examples_06_convex = CodeBlock(angleDeg=section_examples_positive_slope, T1=section_examples_entry_tension, W=section_examples_00_common.W, f=section_examples_00_common.f, R=section_examples_bend_radius_m)  # "Section examples - 06 - Convex Downward Bend"
# ---------- section_examples_06_convex.designscript (15 lines) ----------
// Inclination: 0 to -angleDeg degrees.
// Circular bend in a vertical plane, constant R.
theta = Math.DegreesToRadians(angleDeg);
valid = T1 >= 0 && W >= 0 && f >= 0 && R > 0 && angleDeg >= 0 && angleDeg <= 90;
E = Math.Exp(f * theta);
s = Math.Sin(angleDeg);
c = Math.Cos(angleDeg);
B = W * R / (1 + f*f);
term1 = 2 * f * s;
term2 = (1 - f*f) * (E - c);
D = term1 - term2;
rawT2 = T1 * E + B * D;
formulaApplicable = valid;
T2 = formulaApplicable && rawT2 >= 0 ? rawT2 : null;
status = valid ? (formulaApplicable ? (rawT2 >= 0 ? "Taut solution" : "Loss of taut tension - use general solver") : "Contact branch not established - use V18") : "Invalid input";
# ----------------------------------------
section_examples_07_convex = CodeBlock(angleDeg=section_examples_positive_slope, T1=section_examples_entry_tension, W=section_examples_00_common.W, f=section_examples_00_common.f, R=section_examples_bend_radius_m)  # "Section examples - 07 - Convex Upward Bend"
# ---------- section_examples_07_convex.designscript (15 lines) ----------
// Inclination: +angleDeg to 0 degrees.
// Circular bend in a vertical plane, constant R.
theta = Math.DegreesToRadians(angleDeg);
valid = T1 >= 0 && W >= 0 && f >= 0 && R > 0 && angleDeg >= 0 && angleDeg <= 90;
E = Math.Exp(f * theta);
s = Math.Sin(angleDeg);
c = Math.Cos(angleDeg);
B = W * R / (1 + f*f);
term1 = 2 * f * E * s;
term2 = (1 - f*f) * (1 - E*c);
C = term1 + term2;
rawT2 = T1 * E + B * C;
formulaApplicable = valid;
T2 = formulaApplicable && rawT2 >= 0 ? rawT2 : null;
status = valid ? (formulaApplicable ? (rawT2 >= 0 ? "Taut solution" : "Loss of taut tension - use general solver") : "Contact branch not established - use V18") : "Invalid input";
# ----------------------------------------
section_examples_08_horizontal = CodeBlock(angleDeg=section_examples_positive_slope, T1=section_examples_entry_tension, W=section_examples_00_common.W, f=section_examples_00_common.f, R=section_examples_bend_radius_m)  # "Section examples - 08 - Horizontal Bend"
# ---------- section_examples_08_horizontal.designscript (13 lines) ----------
// Level circular bend in plan. No vertical rise or fall.
theta = Math.DegreesToRadians(angleDeg);
valid = T1 >= 0 && W >= 0 && f >= 0 && R > 0 && angleDeg >= 0 && angleDeg <= 360;
x = f * theta;
ePlus = Math.Exp(x);
eMinus = Math.Exp(-x);
coshValue = (ePlus + eMinus) / 2;
sinhValue = (ePlus - eMinus) / 2;
WR = W * R;
root = Math.Sqrt(T1*T1 + WR*WR);
rawT2 = T1*coshValue + sinhValue*root;
T2 = valid ? rawT2 : null;
status = valid ? "Taut solution" : "Invalid input";
# ----------------------------------------

# group: 4.7 Weight correction factor - IEEE standard (Wc)
# Project equations and pulling conditions; middle-band IEEE discrepancy is explicitly identified.
n4_7_wc_formulas_and_live_project = Python(Cable_count=number_of_cables, Cable_diameter_d=cable_outside_diameter, Conduit_diameter_D=conduit_inside_diameter, Friction_f=friction_coefficient)  # "4.7 - Wc formulas and live project values"; CPython3
# ---------- n4_7_wc_formulas_and_live_project.python (12 lines) ----------
import math
n,d,D,f=map(float,IN)
if n<1 or n!=int(n) or d<=0 or D<=d or f<0:
    raise ValueError('Use positive cable count and diameters, D>d, and nonnegative friction.')
ratio=D/d
r=d/(D-d)
tri=1/math.sqrt(1-r*r) if r<1 else None
diamond=1+2*r*r
cradle=1+4*r*r/3
project_three=tri if ratio<=2.5 else (diamond if ratio<=3 else cradle)
selected=1 if n==1 else (tri if n==2 else (project_three if n==3 else (diamond if n==4 else 1.4)))
OUT=[['D/d',ratio],['d/(D-d)',r],['Triangular Wc = 1/sqrt(1-r^2)',tri],['Diamond Wc = 1+2r^2',diamond],['Cradled Wc = 1+(4/3)r^2',cradle],['Project three-cable ratio Wc',project_three],['Selected Wc',selected],["Effective friction f prime = Wc*f",selected*f if selected is not None else None],['Conduit fill n*(d/D)^2',n*(d/D)**2]]
# ----------------------------------------
# note: Wc and effective friction
# D = conduit inside diameter; d = cable outside diameter; r=d/(D-d).
# Project rule for THREE cables:
# D/d <= 2.5: Wc=1/sqrt(1-r^2) (Equation 7b reference supplied).
# 2.5 < D/d <= 3.0: Wc=1+2r^2 (project-supplied rule).
# D/d > 3.0: Wc=1+(4/3)r^2.
# Single: Wc=1; two: triangular; four: diamond; more than four: Wc=1.4.
# f prime = Wc*f. The 1.0/2.0/3.0 in the supplied notes are case numbers.
# Mixed cable sizes: 1.4 assumption noted, but this graph accepts one cable diameter/mass
# only.
# note: Expected sidewall pressure
# Single: P=T1/R.
# Three cables maintained in triangular formation: P=(Wc*T1)/(2*R).
# Cradled: P=((3*Wc-2)*T1)/(3*R).
# Diamond / fourcables: P=(Wc-1)*T1/R, per supplied MWP graph.
# T1 is local tension at the point assessed. Route Peak SWBP samples tension and curvature
# along the bend.
# Units: tension N, radius m, pressure N/m. Positive manufacturer override takes priority.
# note: Three-core pulling method - project supplied
# Use only a Triple Stocking for Pulling Three Cable Cores, type K50/3, as specified by the
# project notes referencing ESBN's MV/LV Installations Standards and Practice Manual.
# Do not use a single stocking encompassing all three cables; the supplied notes warn of
# irreparable cable damage.
# Use tie wraps every 5 m to maintain trefoil throughout the section.
# Use approved lubricant in the quantities specified in manual section 2.7.10.
# These conditions apply to the three-core case; they do not confirm a 17-cable arrangement.
# note: Source distinction and fill caution
# The project-supplied 2.5<D/d<=3 Wc rule is not verified as IEEE 1185-2019. Verified IEEE
# 1185-2010 text uses the cradled expression for three cables in this band and reserves
# 1+2r^2 for four cables in diamond.
# Reference:
# https://ptacts.uspto.gov/ptacts/public-informations/petitions/1554880/download-documents?artifactId=oWdBe7rMg5XtUz8CBriLLzex-cH5o1pjEcuhqW9sE64JX9LEnkXJkHQ
# Project caution: approaching 40% conduit fill increases jamming and damage risk; a
# fill-limit check alone does not establish pull suitability.
# The 40% NEC statement and ESBN method are supplied project notes, not independently
# verified here.
n4_7_weight_correction_results = Watch(Wc_working=n4_7_wc_formulas_and_live_project)  # "4.7 - Weight correction results"
