# Dynamo graph C16.0 GPS_Photos_ITM_V2.dyn "GPS_Photos_ITM 2" (Dynamo 3.7.0.11777)
# Pick JPGs, read EXIF GPS, convert to ITM, then draw points, embedded photos in a grid and leader lines in the active drawing via AutoLISP.

trigger_toggle_to_run_again = BoolSelector(false)  # "Trigger (toggle to run again; picker opens each run)"; graph input
photo_width_m = DoubleInput(20)  # graph input
grid_columns = DoubleInput(4)  # graph input
gap_between_photos_m = DoubleInput(2)  # graph input
grid_offset_above_northernmost = DoubleInput(20)  # "Grid offset above northernmost point (m)"; graph input
send_to_civil_3d_false_dry_run = BoolSelector(true)  # "Send to Civil 3D (False = dry run only)"; graph input
gps_photos_to_itm = Python(Trigger=trigger_toggle_to_run_again, Photo_width_m=photo_width_m, Grid_columns=grid_columns, Gap_m=gap_between_photos_m, Grid_offset_m=grid_offset_above_northernmost, Send_to_Civil3D=send_to_civil_3d_false_dry_run)  # CPython3
# ---------- gps_photos_to_itm.python (366 lines) ----------
"""Civil 3D Dynamo CPython3 (v2). Picks JPGs, reads EXIF GPS, converts WGS84 -> ITM (EPSG:2157), then
writes an AutoLISP file and sends (load ...) to Civil 3D. LISP draws, in the ACTIVE drawing, a point + 1 m ring
at each photo location, the photo (embedded as an OLE picture) in a grid, a leader line and a label.
No AutoCAD .NET objects are touched from Python (they fail to load in this Dynamo).
IN[0] trigger (value ignored; toggle to run again), IN[1] photo width (m), IN[2] grid columns,
IN[3] gap between photos (m), IN[4] grid offset above northernmost point (m),
IN[5] send to Civil 3D (False = dry run: pick photos, read GPS, convert only)."""
import os, math, struct

# ---------- JPEG / EXIF (pure python) ----------
def read_meta(path):
    """Return dict(lat, lon, w, h) (w,h after EXIF rotation) or None if there is no GPS."""
    with open(path, 'rb') as fh:
        data = fh.read(4 * 1024 * 1024)
    if data[:2] != b'\xff\xd8':
        return None
    pos, tiff, size_px = 2, None, None
    while pos + 4 <= len(data):
        if data[pos] != 0xFF:
            break
        marker = data[pos + 1]
        if marker == 0xDA:
            break
        seg = struct.unpack('>H', data[pos + 2:pos + 4])[0]
        if marker == 0xE1 and data[pos + 4:pos + 10] == b'Exif\x00\x00' and tiff is None:
            tiff = data[pos + 10:pos + 2 + seg]
        if 0xC0 <= marker <= 0xCF and marker not in (0xC4, 0xC8, 0xCC) and size_px is None:
            size_px = struct.unpack('>HH', data[pos + 5:pos + 9])[::-1]   # (width, height)
        pos += 2 + seg
    if tiff is None or size_px is None:
        return None
    e = '<' if tiff[:2] == b'II' else '>'
    def u16(o): return struct.unpack(e + 'H', tiff[o:o + 2])[0]
    def u32(o): return struct.unpack(e + 'I', tiff[o:o + 4])[0]
    def ifd(off):
        out = {}
        for i in range(u16(off)):
            b = off + 2 + i * 12
            out[u16(b)] = (u16(b + 2), u32(b + 4), b + 8)
        return out
    def rationals(entry):
        typ, cnt, vo = entry
        o = u32(vo)
        return [u32(o + 8 * i) / float(u32(o + 8 * i + 4) or 1) for i in range(cnt)]
    def ascii_(entry):
        typ, cnt, vo = entry
        o = vo if cnt <= 4 else u32(vo)
        return tiff[o:o + cnt].split(b'\x00')[0].decode('ascii', 'ignore')
    root = ifd(u32(4))
    if 0x8825 not in root:
        return None
    gps = ifd(u32(root[0x8825][2]))
    if not all(k in gps for k in (1, 2, 3, 4)):
        return None
    def dms(v): return v[0] + v[1] / 60.0 + v[2] / 3600.0
    lat, lon = dms(rationals(gps[2])), dms(rationals(gps[4]))
    if ascii_(gps[1]).upper().startswith('S'): lat = -lat
    if ascii_(gps[3]).upper().startswith('W'): lon = -lon
    w, h = size_px
    if 0x0112 in root and u16(root[0x0112][2]) in (5, 6, 7, 8):
        w, h = h, w
    return {'lat': lat, 'lon': lon, 'w': w, 'h': h}

# ---------- WGS84 / ETRS89 -> ITM (EPSG:2157), transverse Mercator on GRS80 ----------
def to_itm(lat_deg, lon_deg):
    a = 6378137.0; f = 1 / 298.257222101; e2 = 2 * f - f * f
    lat0 = math.radians(53.5); lon0 = math.radians(-8.0); k0 = 0.99982; fe = 600000.0; fn = 750000.0
    def meridian(p):
        e4 = e2 * e2; e6 = e4 * e2
        return a * ((1 - e2 / 4 - 3 * e4 / 64 - 5 * e6 / 256) * p
                    - (3 * e2 / 8 + 3 * e4 / 32 + 45 * e6 / 1024) * math.sin(2 * p)
                    + (15 * e4 / 256 + 45 * e6 / 1024) * math.sin(4 * p)
                    - (35 * e6 / 3072) * math.sin(6 * p))
    p = math.radians(lat_deg); l = math.radians(lon_deg)
    n = a / math.sqrt(1 - e2 * math.sin(p) ** 2)
    t = math.tan(p) ** 2; c = e2 / (1 - e2) * math.cos(p) ** 2; ep2 = e2 / (1 - e2)
    aa = (l - lon0) * math.cos(p)
    x = fe + k0 * n * (aa + (1 - t + c) * aa ** 3 / 6 + (5 - 18 * t + t * t + 72 * c - 58 * ep2) * aa ** 5 / 120)
    y = fn + k0 * (meridian(p) - meridian(lat0) + n * math.tan(p) * (aa * aa / 2
        + (5 - t + 9 * c + 4 * c * c) * aa ** 4 / 24 + (61 - 58 * t + t * t + 600 * c - 330 * ep2) * aa ** 6 / 720))
    return x, y

CLIP_PS1 = """param([string]$Path,[int]$MaxW=1600)
Add-Type -AssemblyName System.Windows.Forms, System.Drawing
$src=[System.Drawing.Image]::FromFile($Path)
foreach($p in $src.PropertyItems){ if($p.Id -eq 0x0112){ $o=[BitConverter]::ToUInt16($p.Value,0); if($o -eq 6){$src.RotateFlip('Rotate90FlipNone')} elseif($o -eq 8){$src.RotateFlip('Rotate270FlipNone')} elseif($o -eq 3){$src.RotateFlip('Rotate180FlipNone')} } }
$w=[Math]::Min($MaxW,$src.Width); $h=[int]($src.Height*$w/$src.Width)
$bmp=New-Object System.Drawing.Bitmap($w,$h)
$g=[System.Drawing.Graphics]::FromImage($bmp); $g.InterpolationMode='HighQualityBicubic'; $g.DrawImage($src,0,0,$w,$h); $g.Dispose(); $src.Dispose()
$tmp=Join-Path $env:TEMP 'gps_paint_photo.png'
$bmp.Save($tmp,[System.Drawing.Imaging.ImageFormat]::Png); $bmp.Dispose()
Get-Process mspaint -ErrorAction SilentlyContinue | Stop-Process -Force
Start-Sleep -Milliseconds 500
Start-Process mspaint -ArgumentList ('"'+$tmp+'"')
Start-Sleep -Seconds 4
$sh=New-Object -ComObject WScript.Shell
$null=$sh.AppActivate('Paint')
Start-Sleep -Milliseconds 600
$sh.SendKeys('^a')
Start-Sleep -Milliseconds 400
$sh.SendKeys('^c')
Start-Sleep -Milliseconds 800
"""

BMP_PS1 = """$MaxW=1600; $Path=(Get-Content (Join-Path $env:TEMP 'gps_clip_path.txt') -Raw).Trim()
Add-Type -AssemblyName System.Windows.Forms, System.Drawing
$src=[System.Drawing.Image]::FromFile($Path)
foreach($p in $src.PropertyItems){ if($p.Id -eq 0x0112){ $o=[BitConverter]::ToUInt16($p.Value,0); if($o -eq 6){$src.RotateFlip('Rotate90FlipNone')} elseif($o -eq 8){$src.RotateFlip('Rotate270FlipNone')} elseif($o -eq 3){$src.RotateFlip('Rotate180FlipNone')} } }
$w=[Math]::Min($MaxW,$src.Width); $h=[int]($src.Height*$w/$src.Width)
$bmp=New-Object System.Drawing.Bitmap($w,$h)
$g=[System.Drawing.Graphics]::FromImage($bmp); $g.InterpolationMode='HighQualityBicubic'; $g.DrawImage($src,0,0,$w,$h); $g.Dispose(); $src.Dispose()
[System.Windows.Forms.Clipboard]::SetImage($bmp)
if ([System.Windows.Forms.Clipboard]::ContainsImage()) { Set-Content (Join-Path $env:TEMP 'gps_clip_ok.flag') 'ok' }
"""

WATCH_PS1 = """$Flag='@@FLAG@@'
Add-Type -TypeDefinition @'
using System; using System.Text; using System.Runtime.InteropServices;
public class GpsWin {
  public delegate bool EnumProc(IntPtr h, IntPtr l);
  [DllImport("user32.dll")] public static extern bool EnumWindows(EnumProc cb, IntPtr l);
  [DllImport("user32.dll", CharSet=CharSet.Unicode)] public static extern int GetWindowText(IntPtr h, StringBuilder s, int n);
  [DllImport("user32.dll")] public static extern bool IsWindowVisible(IntPtr h);
  [DllImport("user32.dll")] public static extern bool SetForegroundWindow(IntPtr h);
  public static IntPtr Find(string part) {
    IntPtr found = IntPtr.Zero;
    EnumWindows(delegate(IntPtr h, IntPtr l) {
      if (!IsWindowVisible(h)) return true;
      StringBuilder sb = new StringBuilder(256); GetWindowText(h, sb, 256);
      if (sb.ToString().IndexOf(part, StringComparison.OrdinalIgnoreCase) >= 0) { found = h; return false; }
      return true; }, IntPtr.Zero);
    return found; } }
'@
$sh = New-Object -ComObject WScript.Shell
$t0 = Get-Date
while (((Get-Date) - $t0).TotalMinutes -lt 15 -and -not (Test-Path $Flag)) {
  $h = [GpsWin]::Find('OLE Text')
  if ($h -ne [IntPtr]::Zero) {
    [void][GpsWin]::SetForegroundWindow($h)
    Start-Sleep -Milliseconds 300
    $sh.SendKeys('{ENTER}')
    Start-Sleep -Milliseconds 900
  } else { Start-Sleep -Milliseconds 250 }
}
"""

def enc_cmd(script):
    import base64
    b64 = base64.b64encode(script.encode('utf-16-le')).decode('ascii')
    return 'powershell -STA -NoProfile -ExecutionPolicy Bypass -WindowStyle Hidden -EncodedCommand ' + b64

def lisp_str(text):
    return str(text).replace('\\', '\\\\').replace('"', '\\"')

def fwd(path):
    return str(path).replace('\\', '/')

def build_lisp(items, ps1_path, bmp_path, watch_path='', flag_path=''):
    """items: list of dicts(path,label,e,n,llx,lly,w,h) in metres. Returns AutoLISP source."""
    out = []
    add = out.append
    add('(vl-load-com)')
    add('(setq *gp-k* (if (= (getvar "INSUNITS") 4) 1000.0 1.0))')
    add('(setq *gp-ps1* "%s")' % lisp_str(fwd(ps1_path)))
    add('(setq *gp-bmp* "%s")' % lisp_str(fwd(bmp_path)))
    add('(setq *gp-bmpcmd* "%s")' % enc_cmd(BMP_PS1))
    add('(setq *gp-pathfile* "%s")' % lisp_str(fwd(os.path.join(os.path.dirname(bmp_path), 'gps_clip_path.txt'))))
    add('(setq *gp-okflag* "%s")' % lisp_str(fwd(os.path.join(os.path.dirname(bmp_path), 'gps_clip_ok.flag'))))
    add('(setq *gp-sh* (vlax-create-object "WScript.Shell"))')
    if watch_path:
        add('(if (findfile "%s") (vl-file-delete "%s"))' % (lisp_str(fwd(flag_path)), lisp_str(fwd(flag_path))))
        add('(vlax-invoke-method *gp-sh* "Run" "%s" 0 :vlax-false)' % enc_cmd(WATCH_PS1.replace('@@FLAG@@', fwd(flag_path))))
    add('(setq *gp-ok* 0 *gp-emb* 0 *gp-static* 0 *gp-fail* nil)')
    add('(if (not (tblsearch "LAYER" "PHOTO-LOC")) (entmake (list (cons 0 "LAYER") (cons 100 "AcDbSymbolTableRecord") (cons 100 "AcDbLayerTableRecord") (cons 2 "PHOTO-LOC") (cons 70 0) (cons 62 3) (cons 6 "Continuous"))))')
    add("""(defun gp-new-ole (prev / e)
  (setq e (entlast))
  (if (and e (not (equal e prev)) (= "OLE2FRAME" (cdr (assoc 0 (entget e))))) e nil))
(defun gp-embed (path ll w h / prev ent obj mn mx pf)
  (setq prev (entlast))
  (command "_.ZOOM" "_C" ll (* 40.0 *gp-k*))
  (if (findfile *gp-okflag*) (vl-file-delete *gp-okflag*))
  (setq pf (open *gp-pathfile* "w"))
  (if pf (progn (write-line path pf) (close pf)))
  (vlax-invoke-method *gp-sh* "Run" *gp-bmpcmd* 0 :vlax-true)
  (if (findfile *gp-okflag*)
    (progn
      (command "_.PASTECLIP" ll)
      (setq ent (gp-new-ole prev))))
  (if ent
    (progn
      (setq obj (vlax-ename->vla-object ent))
      (vla-put-LockAspectRatio obj :vlax-false)
      (vla-put-Width obj (* w *gp-k*))
      (vla-put-Height obj (* h *gp-k*))
      (vla-put-Layer obj "PHOTO-LOC")
      (vla-getboundingbox obj (quote mn) (quote mx))
      (setq mn (vlax-safearray->list mn))
      (vla-move obj (vlax-3d-point mn) (vlax-3d-point ll))
      T)
    nil))""")
    add("""(defun gp-photo (path label e n llx lly w h / loc ll r)
  (setq loc (list (* e *gp-k*) (* n *gp-k*) 0.0)
        ll  (list (* llx *gp-k*) (* lly *gp-k*) 0.0))
  (entmake (list (cons 0 "POINT") (cons 8 "PHOTO-LOC") (cons 10 loc)))
  (entmake (list (cons 0 "CIRCLE") (cons 8 "PHOTO-LOC") (cons 10 loc) (cons 40 *gp-k*)))
  (entmake (list (cons 0 "LINE") (cons 8 "PHOTO-LOC") (cons 10 loc)
                 (cons 11 (list (+ (car ll) (* 0.5 w *gp-k*)) (cadr ll) 0.0))))
  (entmake (list (cons 0 "MTEXT") (cons 100 "AcDbEntity") (cons 8 "PHOTO-LOC") (cons 100 "AcDbMText")
                 (cons 10 (list (car ll) (- (cadr ll) (* 0.4 *gp-k*)) 0.0))
                 (cons 40 (* 0.8 *gp-k*)) (cons 71 1) (cons 1 label)))
  (setq r (vl-catch-all-apply (quote gp-embed) (list path ll w h)))
  (if (and (not (vl-catch-all-error-p r)) r)
    (setq *gp-ok* (1+ *gp-ok*))
    (setq *gp-fail* (cons path *gp-fail*))))""")
    add('(setq *gp-os* (getvar "OSMODE") *gp-ce* (getvar "CMDECHO"))')
    add('(setvar "OSMODE" 0)(setvar "CMDECHO" 0)(setvar "PDMODE" 34)(setvar "PDSIZE" (* 0.5 *gp-k*))')
    for it in items:
        add('(gp-photo "%s" "%s" %.3f %.3f %.3f %.3f %.3f %.3f)' % (
            lisp_str(fwd(it['path'])), lisp_str(it['label']), it['e'], it['n'], it['llx'], it['lly'], it['w'], it['h']))
    add('(command "_.ZOOM" "_E")')
    add('(setvar "OSMODE" *gp-os*)(setvar "CMDECHO" *gp-ce*)')
    if watch_path:
        add('(setq *gp-f* (open "%s" "w"))(if *gp-f* (close *gp-f*))' % lisp_str(fwd(flag_path)))
    add('(princ (strcat "\\nGPS photos: " (itoa *gp-ok*) " of %d pasted as static pictures." (if *gp-fail* (strcat " Failed: " (vl-princ-to-string *gp-fail*)) "")))' % len(items))
    add('(princ)')
    return '\n'.join(out) + '\n'

def send_to_acad(command_text):
    """Send text to Civil 3D's command line via WM_COPYDATA (no AutoCAD .NET objects needed)."""
    import ctypes
    from ctypes import wintypes
    import System
    try:
        # In-process: queue the text on the command line exactly as if it were typed.
        post = ctypes.WinDLL('accore.dll')['?acedPostCommand@@YA_NPEB_W@Z']
        post.argtypes = [ctypes.c_wchar_p]
        post.restype = ctypes.c_bool
        if post(command_text + '\n'):
            return 'acedPostCommand'
    except Exception:
        pass
    hwnd =int(System.Diagnostics.Process.GetCurrentProcess().MainWindowHandle.ToInt64())
    if not hwnd:
        raise ValueError('Could not find the Civil 3D main window.')
    class COPYDATASTRUCT(ctypes.Structure):
        _fields_ = [('dwData', ctypes.c_size_t), ('cbData', wintypes.DWORD), ('lpData', ctypes.c_void_p)]
    raw = (command_text + '\n').encode('mbcs') + b'\x00'
    buf = ctypes.create_string_buffer(raw)
    cds = COPYDATASTRUCT(1, len(raw), ctypes.cast(buf, ctypes.c_void_p))
    user32 = ctypes.windll.user32
    user32.SendMessageW.argtypes = [wintypes.HWND, wintypes.UINT, wintypes.WPARAM, ctypes.c_void_p]
    user32.SendMessageW.restype = ctypes.c_ssize_t
    user32.SendMessageW(hwnd, 0x004A, 0, ctypes.byref(cds))   # WM_COPYDATA
    return 'WM_COPYDATA'

def pick_photos(start_folder):
    """Multi-select file dialog; returns the chosen paths."""
    import System
    from System.Threading import Thread, ThreadStart, ApartmentState
    import clr
    clr.AddReference('System.Windows.Forms')
    from System.Windows.Forms import OpenFileDialog, DialogResult
    picked = []
    def show():
        dlg = OpenFileDialog()
        dlg.Title = 'Select photos with GPS'
        dlg.Filter = 'JPEG photos (*.jpg;*.jpeg)|*.jpg;*.jpeg|All files (*.*)|*.*'
        dlg.Multiselect = True
        if start_folder and os.path.isdir(start_folder):
            dlg.InitialDirectory = start_folder
        if dlg.ShowDialog() == DialogResult.OK:
            for f in dlg.FileNames:
                picked.append(str(f))
    if Thread.CurrentThread.GetApartmentState() == ApartmentState.STA:
        show()
    else:
        t = Thread(ThreadStart(show))
        t.SetApartmentState(ApartmentState.STA)
        t.Start()
        t.Join()
    return picked

def run():
    stage = 'Starting'
    try:
        width_m = float(IN[1]); cols = max(1, int(float(IN[2])))
        gap_m = float(IN[3]); offset_m = float(IN[4])
        send = bool(IN[5])
        if width_m <= 0:
            raise ValueError('Photo width must be greater than zero.')
        memo = os.path.join(os.environ.get('APPDATA', ''), 'gps_photos_last_folder.txt')
        folder = ''
        try:
            folder = open(memo).read().strip()
        except Exception:
            pass
        if not folder:
            folder = os.path.join(os.path.expanduser('~'), 'Pictures')

        stage = 'Selecting photos'
        chosen = pick_photos(folder)
        if not chosen:
            return ['CANCELLED', 'No photos selected.', None]
        try:
            open(memo, 'w').write(os.path.dirname(chosen[0]))
        except Exception:
            pass

        stage = 'Reading GPS from photos'
        photos, skipped = [], []
        for full in sorted(chosen, key=lambda s: os.path.basename(s).lower()):
            fn_ = os.path.basename(full)
            try:
                meta = read_meta(full)
            except Exception:
                meta = None
            if meta is None:
                skipped.append(fn_)
                continue
            e, n = to_itm(meta['lat'], meta['lon'])
            photos.append({'path': full, 'label': '%s\\P' % fn_, 'name': fn_, 'e': e, 'n': n, 'pw': meta['w'], 'ph': meta['h']})
        if not photos:
            return ['ERROR', 'None of the selected photos has GPS' + (' (no GPS: %s)' % ', '.join(skipped) if skipped else ''), None]
        summary = '; '.join('%s E %.3f N %.3f' % (p['name'], p['e'], p['n']) for p in photos)
        if skipped:
            summary += ' | no GPS: ' + ', '.join(skipped)
        if not send:
            return ['DRY RUN - drawing untouched', summary + '. Set "Send to Civil 3D" to True to draw.', len(photos)]

        stage = 'Laying out grid'
        grid_e = min(p['e'] for p in photos)
        grid_n = max(p['n'] for p in photos) + offset_m
        rows = [photos[i:i + cols] for i in range(0, len(photos), cols)]
        y = grid_n
        for row in rows:
            heights = [width_m * p['ph'] / float(p['pw']) for p in row]
            for c, (p, h) in enumerate(zip(row, heights)):
                p['llx'] = grid_e + c * (width_m + gap_m)
                p['lly'] = y
                p['w'] = width_m
                p['h'] = h
                p['label'] = '%s\\PE %.3f  N %.3f (ITM)' % (p['name'], p['e'], p['n'])
            y += max(heights) + gap_m + 3.0

        stage = 'Writing LISP'
        tmp = os.environ.get('TEMP', '.')
        ps1 = os.path.join(tmp, 'gps_clip.ps1')
        lsp = os.path.join(tmp, 'gps_photos.lsp')
        bmp = os.path.join(tmp, 'gps_clip_bmp.ps1')
        open(ps1, 'w').write(CLIP_PS1)
        open(bmp, 'w').write(BMP_PS1)
        wat = os.path.join(tmp, 'gps_watch.ps1')
        flag = os.path.join(tmp, 'gps_done.flag')
        open(wat, 'w').write(WATCH_PS1)
        open(lsp, 'w').write(build_lisp(photos, ps1, bmp, wat, flag))
        load = '(load "%s")' % lisp_str(fwd(lsp))
        stage = 'Sending to Civil 3D'
        try:
            via = send_to_acad(load)
        except Exception as ex:
            return ['LISP WRITTEN - send failed', 'Type this in the Civil 3D command line: ' + load + '   (send error: %s)' % ex, len(photos)]
        return ['SENT via ' + via, 'Civil 3D is drawing %d photo(s) into the ACTIVE drawing, pasting each one from the clipboard (a few seconds each; watch the command line; zooms to extents when done, then QSAVE). ITM: %s. If nothing happens, type: %s' % (len(photos), summary, load), len(photos)]
    except Exception as ex:
        return ['ERROR', stage + ': ' + str(ex), None]

OUT = run()
# ----------------------------------------
result_status_message_count = Watch(gps_photos_to_itm)  # graph output
