# Dynamo graph C17.0 Surface_Tubes_To_Solids.dyn (Dynamo 3.7.0.11777)
# Converts open-tube AutoCAD SURFACE objects (e.g. duct surfaces) into closed 3D solids. Needs Civil3DExecPlugin.dll NETLOADed. Set Run to True.

run = BoolSelector(true)  # graph input
layer_contains = StringInput("Ele Duct")  # graph input
erase_source_surfaces = BoolSelector(true)  # graph input
surface_tubes_to_solids = Python(Run=run, Layer_contains=layer_contains, Erase_sources=erase_source_surfaces)  # CPython3
# ---------- surface_tubes_to_solids.python (75 lines) ----------
"""Civil 3D Dynamo CPython3 - no AutoCAD API is loaded in Python (that crashed Civil 3D).
The geometry work runs as C# inside Civil 3D through the civil3d-exec plugin (NETLOAD Civil3DExecPlugin.dll, port 8081).
IN[0] Run (bool) | IN[1] layer name contains (text) | IN[2] erase source surfaces (bool) | IN[3] port (optional, default 8081)"""
import json
import socket

CSHARP = r'''
string filter = __FILTER__.ToLower();
bool erase = __ERASE__;
var ms = (BlockTableRecord)Transaction.GetObject(SymbolUtilityServices.GetBlockModelSpaceId(Database), OpenMode.ForWrite);
var srfs = new List<Autodesk.AutoCAD.DatabaseServices.Surface>();
foreach (ObjectId id in ms) { var o = Transaction.GetObject(id, OpenMode.ForRead) as Autodesk.AutoCAD.DatabaseServices.Surface; if (o != null && o.Layer.ToLower().Contains(filter)) srfs.Add(o); }
var res = new List<string>(); int made = 0;
foreach (var srf in srfs) {
  var ex = new Autodesk.AutoCAD.DatabaseServices.DBObjectCollection(); srf.Explode(ex);
  bool lines = false; var ells = new List<Autodesk.AutoCAD.DatabaseServices.Ellipse>();
  foreach (Autodesk.AutoCAD.DatabaseServices.DBObject d in ex) { if (d is Autodesk.AutoCAD.DatabaseServices.Line) lines = true; if (d is Autodesk.AutoCAD.DatabaseServices.Ellipse e) ells.Add(e); }
  if (lines || ells.Count == 0) { res.Add(srf.Handle+" skipped (ring face)"); continue; }
  var groups = new List<Autodesk.AutoCAD.DatabaseServices.DBObjectCollection>(); var centres = new List<Autodesk.AutoCAD.Geometry.Point3d>();
  foreach (var e in ells) {
    int gi = centres.FindIndex(c => c.DistanceTo(e.Center) <= e.MajorRadius*0.01);
    if (gi < 0) { centres.Add(e.Center); groups.Add(new Autodesk.AutoCAD.DatabaseServices.DBObjectCollection()); gi = groups.Count-1; }
    groups[gi].Add(e);
  }
  var ents = new List<Autodesk.AutoCAD.DatabaseServices.Entity>(); ents.Add((Autodesk.AutoCAD.DatabaseServices.Entity)srf.Clone());
  foreach (var g in groups) foreach (Autodesk.AutoCAD.DatabaseServices.Region r in Autodesk.AutoCAD.DatabaseServices.Region.CreateFromCurves(g)) ents.Add(Autodesk.AutoCAD.DatabaseServices.Surface.CreateFrom(r));
  if (groups.Count != 2 || ents.Count != 3) { res.Add(srf.Handle+" skipped (rings="+groups.Count+", pieces="+ents.Count+")"); continue; }
  var sol = new Autodesk.AutoCAD.DatabaseServices.Solid3d();
  try { sol.CreateSculptedSolid(ents.ToArray(), new Autodesk.AutoCAD.Geometry.IntegerCollection()); }
  catch (System.Exception e) { res.Add(srf.Handle+" failed "+e.Message); continue; }
  sol.Layer = srf.Layer; sol.Color = srf.Color;
  ms.AppendEntity(sol); Transaction.AddNewlyCreatedDBObject(sol, true); made++;
  res.Add(srf.Handle+" -> "+sol.Handle+" vol "+sol.MassProperties.Volume.ToString("F4"));
  if (erase) { srf.UpgradeOpen(); srf.Erase(); }
}
return new { surfacesFound = srfs.Count, made, erased = erase, res };
'''


def send(code, port):
    request = {'jsonrpc': '2.0', 'method': 'executeCode', 'id': 'dyn1',
               'params': {'code': code, 'readOnly': False, 'description': 'Dynamo: surface tubes to solids'}}
    sock = socket.create_connection(('127.0.0.1', port), timeout=10)
    try:
        sock.settimeout(120)
        sock.sendall(json.dumps(request).encode('utf-8'))
        buffer = b''
        while True:
            chunk = sock.recv(65536)
            if not chunk:
                raise ValueError('Plugin closed the connection before replying.')
            buffer += chunk
            try:
                return json.loads(buffer.decode('utf-8'))
            except ValueError:
                continue
    finally:
        sock.close()


def run():
    if not bool(IN[0]):
        return ['READY', 'Set Run to True. Civil 3D must have Civil3DExecPlugin.dll loaded (NETLOAD).', None]
    port = int(IN[3]) if len(IN) > 3 and IN[3] else 8081
    code = CSHARP.replace('__FILTER__', json.dumps(str(IN[1]).strip())).replace('__ERASE__', 'true' if bool(IN[2]) else 'false')
    try:
        reply = send(code, port)
    except (OSError, ValueError) as ex:
        return ['ERROR', 'Cannot reach the civil3d-exec plugin on port %d (%s). In Civil 3D run NETLOAD on Civil3DExecPlugin.dll first.' % (port, ex), None]
    if reply.get('error'):
        return ['ERROR', str(reply['error'].get('message', reply['error'])), None]
    result = reply.get('result')
    return ['SUCCESS', json.dumps(result), result]

OUT = run()
# ----------------------------------------
