# Dynamo graph R18 - Sections_Along_Path_V1.dyn "Sections_Along_Path_V1" (Dynamo 2.19.3.6394)
# Places Revit sections perpendicular to a connected chain of model lines/arcs at a set spacing (m). Select the curves, set Spacing and Create=True, Run.

select_path_curves = DSModelElementsSelection()  # 4 picked in the model
spacing_m = DoubleInput(5)  # graph input
section_width_m = DoubleInput(6)  # graph input
half_height_up_down_m = DoubleInput(3)  # graph input
section_depth_m = DoubleInput(1)  # graph input
create_sections = BoolSelector(true)  # graph input
sections_along_path = Python(Curves=select_path_curves, Spacing_m=spacing_m, Width_m=section_width_m, HalfHeight_m=half_height_up_down_m, Depth_m=section_depth_m, Create=create_sections)  # CPython3
# ---------- sections_along_path.python (86 lines) ----------
"""Revit Dynamo CPython3. IN: curves (model lines/arcs, one connected path), spacing m, width m, half height m, section depth m, create."""
import clr
clr.AddReference('RevitAPI')
clr.AddReference('RevitServices')
clr.AddReference('RevitNodes')
import Revit
clr.ImportExtensions(Revit.Elements)
from Autodesk.Revit.DB import *
from RevitServices.Persistence import DocumentManager
from RevitServices.Transactions import TransactionManager

M = 1.0 / 0.3048  # metres -> feet

def raw(e):
    return e.InternalElement if hasattr(e, 'InternalElement') else e

def run():
    items = IN[0] if isinstance(IN[0], list) else [IN[0]]
    spacing, width, half_h, depth, create = IN[1], IN[2], IN[3], IN[4], IN[5]
    if not create:
        return 'READY - set Create to True and Run'
    doc = DocumentManager.Instance.CurrentDBDocument
    curves = [raw(e).GeometryCurve for e in items]
    # order the curves end-to-start into one chain
    tol = 0.01
    def same(a, b):
        return a.DistanceTo(b) < tol
    chain = [curves.pop(0)]
    while curves:
        hit = False
        for c in list(curves):
            if same(chain[-1].GetEndPoint(1), c.GetEndPoint(0)):
                chain.append(c); curves.remove(c); hit = True; break
            if same(chain[-1].GetEndPoint(1), c.GetEndPoint(1)):
                chain.append(c.CreateReversed()); curves.remove(c); hit = True; break
            if same(chain[0].GetEndPoint(0), c.GetEndPoint(1)):
                chain.insert(0, c); curves.remove(c); hit = True; break
            if same(chain[0].GetEndPoint(0), c.GetEndPoint(0)):
                chain.insert(0, c.CreateReversed()); curves.remove(c); hit = True; break
        if not hit:
            return 'ERROR - curves are not one connected path'
    lens = [c.Length for c in chain]
    total = sum(lens)
    step = spacing * M
    stations = []
    s = 0.0
    while s < total - 1e-6:
        stations.append(s)
        s += step
    stations.append(total)
    vft = [v for v in FilteredElementCollector(doc).OfClass(ViewFamilyType) if v.ViewFamily == ViewFamily.Section][0]
    existing = set(v.Name for v in FilteredElementCollector(doc).OfClass(View))
    made = []
    TransactionManager.Instance.EnsureInTransaction(doc)
    for st in stations:
        acc = 0.0
        u = 1.0
        c = chain[-1]
        for cc, l in zip(chain, lens):
            if st <= acc + l + 1e-9:
                c = cc
                u = min(max((st - acc) / l, 0.0), 1.0)
                break
            acc += l
        d = c.ComputeDerivatives(u, True)
        tg = XYZ(d.BasisX.X, d.BasisX.Y, 0).Normalize()
        tr = Transform.Identity
        tr.Origin = d.Origin
        tr.BasisZ = tg.Negate()
        tr.BasisY = XYZ.BasisZ
        tr.BasisX = XYZ.BasisZ.CrossProduct(tg.Negate())
        bb = BoundingBoxXYZ()
        bb.Transform = tr
        bb.Min = XYZ(-width * M / 2.0, -half_h * M, 0)
        bb.Max = XYZ(width * M / 2.0, half_h * M, depth * M)
        v = ViewSection.CreateSection(doc, vft.Id, bb)
        nm = 'PATH SEC %05.1f m' % (st / M)
        while nm in existing:
            nm += ' (2)'
        v.Name = nm
        existing.add(nm)
        made.append(nm)
    TransactionManager.Instance.TransactionTaskDone()
    return made

OUT = run()
# ----------------------------------------
watch = Watch(sections_along_path)
