# Dynamo graph 2.0_Revit_family_sweep_V2.83_GRIDLINE_SWEEPS.dyn (Dynamo 3.7.0.11777)
# V2.82: restores valid embedded profile; 4-value origin now E,N,Z,rotation. V2.82: restores the valid embedded circular profile family (V2.81 payload was corrupted and failed its checksum). V2.81: Imported profiles without a Length type Diameter parameter retain authored dimensions with explicit reporting. Built-in circle and parameterized imported profiles follow the diameter input. True = imported; False = built-in.

# group: Profile From Civil 3D - Project Explorer - create two report Excel-"Calculated Stations - XY" "Layout Profile Entities Z"
# note: Profile - Right Click on profile in civil3D and open project explore , export report in excel
# "Calculated Stations - XY"
# "Layout Profile Entities Z"
select_multiple_xy_z_report = Python()  # "SELECT MULTIPLE XY + Z REPORT PAIRS"; CPython3; graph input
# ---------- select_multiple_xy_z_report.python (119 lines) ----------
# V2.59 - ONE CLICK: select XY + Z reports and return the ACTUAL TABLE DATA
# Dynamo CPython3
import os
import io
import zipfile
import clr
clr.AddReference("System.Windows.Forms")
from System.Windows.Forms import OpenFileDialog, DialogResult


def _readable_xlsx(path):
    try:
        with open(path, 'rb') as fh:
            raw = fh.read()
    except Exception:
        return path
    try:
        z = zipfile.ZipFile(io.BytesIO(raw)); z.close()
        return path
    except zipfile.BadZipFile:
        pass
    sig = b'PK\x05\x06'
    pos = 0
    while True:
        idx = raw.find(sig, pos)
        if idx < 0 or idx + 22 > len(raw):
            return path
        comment_len = int.from_bytes(raw[idx+20:idx+22], 'little')
        end = idx + 22 + comment_len
        if end <= len(raw):
            candidate = raw[:end]
            try:
                z = zipfile.ZipFile(io.BytesIO(candidate)); z.close()
                return io.BytesIO(candidate)
            except zipfile.BadZipFile:
                pass
        pos = idx + 4


def clean(v):
    if v is None: return ''
    return ' '.join(str(v).replace('\xa0',' ').strip().lower().split())


def read_and_classify(path):
    import openpyxl
    src = _readable_xlsx(path)
    wb = openpyxl.load_workbook(src, read_only=True, data_only=True)
    best_xy = None
    best_z = None
    for ws in wb.worksheets:
        rows = [list(r) for r in ws.iter_rows(values_only=True)]
        for i, row in enumerate(rows[:60]):
            h = [clean(x) for x in row]
            hs = set(h)
            # Project Explorer Calculated Stations
            xy_score = 0
            if 'point index' in hs: xy_score += 5
            if 'station' in hs: xy_score += 3
            if 'easting' in hs and 'northing' in hs: xy_score += 5
            if 'alignment radius' in hs: xy_score += 3
            if 'entity type' in hs: xy_score += 2
            # Project Explorer Layout Profile Entities
            z_score = 0
            if 'entity index' in hs: z_score += 5
            if 'start station' in hs and 'end station' in hs: z_score += 5
            if 'start elevation' in hs and 'end elevation' in hs: z_score += 6
            if 'entity type' in hs: z_score += 2
            if 'curve radius' in hs: z_score += 2
            if xy_score >= 13 and (best_xy is None or xy_score > best_xy[0]):
                best_xy = (xy_score, rows)
            if z_score >= 16 and (best_z is None or z_score > best_z[0]):
                best_z = (z_score, rows)
    wb.close()
    return (best_xy[1] if best_xy else None, best_z[1] if best_z else None)



import json

def pair_files(files):
    pairs = {}
    for path in files:
        stem = os.path.splitext(os.path.basename(path))[0]
        low = stem.lower()
        role = 'xy' if low.endswith('xy') else 'z' if low.endswith('z') else None
        if role is None:
            raise ValueError('Report filename must end in xy.xlsx or z.xlsx: ' + os.path.basename(path))
        base = stem[:-len(role)]
        key = (os.path.normcase(os.path.abspath(os.path.dirname(path))), base.lower())
        pair = pairs.setdefault(key, {'name':base, 'folder':os.path.dirname(path)})
        if role in pair:
            raise ValueError('Duplicate ' + role.upper() + ' report for ' + base)
        pair[role] = path
    if not pairs:
        raise ValueError('No report pairs selected')
    for pair in pairs.values():
        if 'xy' not in pair or 'z' not in pair:
            raise ValueError('Select both XY and Z reports for ' + pair['name'])
    return [pairs[key] for key in sorted(pairs)]

dlg = OpenFileDialog()
dlg.Title = 'Select ALL XY and Z reports - one matching pair per route'
dlg.Filter = 'Excel workbooks (*.xlsx)|*.xlsx'
dlg.Multiselect = True
packet = {'batch_version':1, 'pairs':[]}
try:
    if dlg.ShowDialog() != DialogResult.OK:
        raise ValueError('File selection cancelled; no sweeps created')
    for pair in pair_files(list(dlg.FileNames)):
        xy, unused = read_and_classify(pair['xy'])
        unused, z = read_and_classify(pair['z'])
        if xy is None or z is None:
            raise ValueError('Required XY/Z headers not found for ' + pair['name'])
        packet['pairs'].append({'name':pair['name'], 'folder':pair['folder'], 'xy':xy, 'z':z})
except Exception as ex:
    packet = {'batch_version':1, 'error':str(ex), 'pairs':[]}
# JSON protects nested rows from Dynamo list marshalling/stringification.
OUT = (json.dumps(packet, ensure_ascii=True, default=str), None)
# ----------------------------------------

# group: Use custom profile T/F TOP_OF_DUCT SWEEP
# Use custom profile: True uses this category's Browse profile family node; False uses the embedded circular family. Diameter follows the corresponding duct input.
standard_duct_diameter_mm = DoubleInput(200)  # graph input
duct_use_custom_profile_true = BoolSelector(false)  # "DUCT - Use custom profile: True = selected RFA / False = built-in"; graph input
built_in_circular_profile_no = StringInput("BUILT_IN_CIRCULAR_PROFILE")  # "Built-in circular profile (no file needed)"

# group: Add a Cross at the cenetr of Centre 0,0,0 in the Family
# note: IF ture_
# Use the Starting point of the center duct from civil3D, you get by useing a labe in the main gridline profile
# IF False
# USe the below to family to find the  Project Base Point in this fromant N/S,E/W,Elev, Angle To True North. you see this by highlighting the bsee point in the Project Folder
set_it_to_false_for_origin = BoolSelector(false)  # "Set it to False for origin-relative (0,0,0)"; graph input
# note: Create by Conor McEnery
# test on version 2024 to 2027
# No add -On  need
show_origin_marker_0_0_0 = BoolSelector(true)  # graph input
create_update_plan_origin_marker = Python(Show_Origin_Marker=show_origin_marker_0_0_0)  # CPython3
# ---------- create_update_plan_origin_marker.python (86 lines) ----------
import clr
clr.AddReference('RevitAPI')
clr.AddReference('RevitServices')
from Autodesk.Revit.DB import *
from RevitServices.Persistence import DocumentManager
from RevitServices.Transactions import TransactionManager
import math

doc = DocumentManager.Instance.CurrentDBDocument
show_marker = bool(IN[0]) if IN else True

def update_origin_marker(family_doc, visible):
    manager = family_doc.FamilyManager
    parameter_name = 'Show Origin Marker'
    parameter = next((p for p in manager.Parameters if p.Definition.Name == parameter_name), None)
    if parameter is None:
        parameter = manager.AddParameter(parameter_name, GroupTypeId.Visibility, SpecTypeId.Boolean.YesNo, True)
    elif parameter.Definition.GetDataType() != SpecTypeId.Boolean.YesNo:
        raise ValueError('Show Origin Marker already exists but is not a Yes/No parameter.')
    category = family_doc.OwnerFamily.FamilyCategory
    category_name = 'MWP Origin Marker 0-0-0'
    subcategory = next((c for c in category.SubCategories if c.Name == category_name), None)
    if subcategory is None:
        subcategory = family_doc.Settings.Categories.NewSubcategory(category, category_name)
        subcategory.SetLineWeight(3, GraphicsStyleType.Projection)
    style = subcategory.GetGraphicsStyle(GraphicsStyleType.Projection)
    existing = []
    for curve in FilteredElementCollector(family_doc).OfClass(CurveElement):
        if isinstance(curve, SymbolicCurve) and curve.LineStyle is not None and curve.LineStyle.Id == style.Id:
            existing.append(curve)
    if not existing:
        sketch = SketchPlane.Create(family_doc, Plane.CreateByNormalAndOrigin(XYZ.BasisZ, XYZ.Zero))
        half = 500.0 / 304.8
        radius = 200.0 / 304.8
        geometry = [
            Line.CreateBound(XYZ(-half,0,0), XYZ(half,0,0)),
            Line.CreateBound(XYZ(0,-half,0), XYZ(0,half,0)),
            Arc.Create(XYZ.Zero,radius,0.0,math.pi,XYZ.BasisX,XYZ.BasisY),
            Arc.Create(XYZ.Zero,radius,math.pi,2*math.pi,XYZ.BasisX,XYZ.BasisY)
        ]
        for shape in geometry:
            curve = family_doc.FamilyCreate.NewSymbolicCurve(shape, sketch)
            curve.LineStyle = style
            visibility = curve.GetVisibility()
            visibility.IsShownInCoarse = True
            visibility.IsShownInMedium = True
            visibility.IsShownInFine = True
            curve.SetVisibility(visibility)
            existing.append(curve)
    for curve in existing:
        element_parameter = curve.get_Parameter(BuiltInParameter.IS_VISIBLE_PARAM)
        if element_parameter is None or not manager.CanElementParameterBeAssociated(element_parameter):
            raise ValueError('The origin marker visibility cannot be associated in this family.')
        manager.AssociateElementParameterToFamilyParameter(element_parameter, parameter)
    original_type = manager.CurrentType
    if original_type is None:
        original_type = manager.NewType('Default')
    try:
        for family_type in manager.Types:
            manager.CurrentType = family_type
            manager.Set(parameter, 1 if visible else 0)
    finally:
        manager.CurrentType = original_type
    family_doc.Regenerate()
    return 'Origin marker at (0,0,0): {}. Cross centre is the alignment point. Visibility: Show Origin Marker.'.format('ON' if visible else 'OFF')

def run_marker():
    if doc is None or not doc.IsFamilyDocument:
        return 'ERROR: Open the sweep family in Family Editor to create the origin marker.'
    sub = None
    try:
        TransactionManager.Instance.EnsureInTransaction(doc)
        sub = SubTransaction(doc)
        sub.Start()
        result = update_origin_marker(doc, show_marker)
        if sub.Commit() != TransactionStatus.Committed:
            raise RuntimeError('Marker changes were not committed.')
        return result
    except Exception as ex:
        if sub is not None and sub.GetStatus() == TransactionStatus.Started:
            sub.RollBack()
        return 'ERROR: Origin marker was not updated: ' + str(ex)
    finally:
        TransactionManager.Instance.TransactionTaskDone()

OUT = run_marker()
# ----------------------------------------
origin_marker_status = Watch(create_update_plan_origin_marker)

# group: To Revit - Family- if the PROJECT BASE POINTS IS MOVE
horizontal_origin_rotation_z = StringInput("144958.950, 6688894.884,38.000,0°")  # "Horizontal origin / rotation - Z ignored; keep imported elevations"
# note: Ailgment
unit_mm_or_m_for = StringInput("M")  # "Unit (mm or M) for GlobalOriginPoint"

# group: Excel name contains Com (case-insensitive)
# Use custom profile: True uses this category's Browse profile family node; False uses the embedded circular family. Diameter follows the corresponding duct input.
com_duct_diameter_mm = DoubleInput(125)  # graph input
com_use_custom_profile_true = BoolSelector(false)  # "COM - Use custom profile: True = selected RFA / False = built-in"; graph input
built_in_circular_profile_no_2 = StringInput("BUILT_IN_CIRCULAR_PROFILE")  # "Built-in circular profile (no file needed)"

# group: DUCT - add your own profile family (when True)
# Use custom profile True: browse to an RFA here. False: use the built-in circular family and ignore this file. Imported profiles with a Length type Diameter parameter follow the size input; otherwise authored size is retained and reported.
duct_browse_profile_family_rfa = Filename("No file selected.")  # "DUCT - Browse profile family .rfa (used when True)"

# group: COM - add your own profile family (when True)
# Use custom profile True: browse to an RFA here. False: use the built-in circular family and ignore this file. Imported profiles with a Length type Diameter parameter follow the size input; otherwise authored size is retained and reported.
com_browse_profile_family_rfa = Filename("No file selected.")  # "COM - Browse profile family .rfa (used when True)"

# group: Single, 3 Flat, Trefoil
duct_formation_0_single_1_three = IntegerSlider(0, range=0..2 step 1)  # "Duct formation: 0 = Single, 1 = Three, 2 = Trefoil"
three_flat_c_c_spacing_mm_0 = DoubleInput(235)  # "Three (flat) c/c spacing (mm) - 0 = diameter + 75"
trefoil_c_c_spacing_mm_0 = DoubleInput(160)  # "Trefoil c/c spacing (mm) - 0 = diameter (touching)"
# group: Outputs
create_sweeps_for_every_xy_z = Python(XY_Calculated=select_multiple_xy_z_report.XY_Data, DuctSize=standard_duct_diameter_mm, PickFalse_UnlessIts_0_0_0=set_it_to_false_for_origin, Z_Calculated=select_multiple_xy_z_report.Z_Data, UseCustomProfileBoolean=duct_use_custom_profile_true, CustomProfileCurves=built_in_circular_profile_no, GlobalOriginPoint_E_N_Z=horizontal_origin_rotation_z, OriginUnit_mm_or_M=unit_mm_or_m_for, Com_duct_diameter_mm_SET_SIZE=com_duct_diameter_mm, Com_use_custom_profile=com_use_custom_profile_true, Com_custom_profile_select_rfa=built_in_circular_profile_no_2, DUCT_OptionalFamily=duct_browse_profile_family_rfa, COM_OptionalFamily=com_browse_profile_family_rfa, GridlineOffsets_mm=duct_formation_0_single_1_three, ThreeFlat_cc_mm=three_flat_c_c_spacing_mm_0, Trefoil_cc_mm=trefoil_c_c_spacing_mm_0)  # "Create sweeps for every XY/Z pair"; CPython3; graph output
# ---------- create_sweeps_for_every_xy_z.python (2021 lines) ----------
import clr
clr.AddReference('RevitAPI')
clr.AddReference('RevitServices')
from RevitServices.Persistence import DocumentManager
from RevitServices.Transactions import TransactionManager
from Autodesk.Revit.DB import *
import math
import os

doc = DocumentManager.Instance.CurrentDBDocument

# V2.57: Civil 3D Project Explorer PC/PT exact horizontal-curve transition fix.

# INPUTS
data = IN[0] if len(IN) > 0 else None
diameter_mm = IN[1] if len(IN) > 1 else 100.0
use_true_coords = IN[2] if len(IN) > 2 else False
data2 = IN[3] if len(IN) > 3 else None
use_custom_profile_in = IN[4] if len(IN) > 4 else False
profile_rfa_path_in = IN[5] if len(IN) > 5 else None
global_origin_in = IN[6] if len(IN) > 6 else None
origin_unit_in = IN[7] if len(IN) > 7 and IN[7] else "M"

# Independent settings for Excel route names containing Com (case-insensitive).
com_diameter_mm = IN[8] if len(IN) > 8 else 0.0
com_use_custom_profile = bool(IN[9]) if len(IN) > 9 else False
com_profile_path = IN[10] if len(IN) > 10 else None

def optional_profile_path(value):
    """Treat empty Dynamo File Path outputs as absent, not as filenames."""
    while isinstance(value, (list, tuple)):
        if not value:
            return ''
        if len(value) != 1:
            raise ValueError('Select one profile family per optional family node.')
        value = value[0]
    if value is None:
        return ''
    path = str(value).strip().strip('"').strip("'").strip()
    empty_labels = ('', 'none', 'null', 'no file selected', 'no file selected.',
                    'no file selected...', 'no file selected…', '<none>', '<null>')
    if path.lower() in empty_labels:
        return ''
    return path

# True selects the browsed RFA; False always selects the embedded family.
duct_use_imported = bool(IN[4]) if len(IN) > 4 else False
com_use_imported = bool(IN[9]) if len(IN) > 9 else False
profile_rfa_path_in = optional_profile_path(IN[11] if len(IN) > 11 else None) if duct_use_imported else 'BUILT_IN_CIRCULAR_PROFILE'
com_profile_path = optional_profile_path(IN[12] if len(IN) > 12 else None) if com_use_imported else 'BUILT_IN_CIRCULAR_PROFILE'
# Both choices use a family profile, including the embedded circular family.
use_custom_profile_in = True
com_use_custom_profile = True

# V2.83: one sweep per duct gridline.  IN[13] = formation:
#   0 Single  - one duct on the path (old behaviour; blank also means this)
#   1 Three   - three ducts in a flat row, pitch = duct diameter + 75 mm clear
#             (160 mm ducts -> 235 c/c, i.e. -235 / 0 / +235 about the path)
#   2 Trefoil - three ducts at an equilateral triangle: two side by side, one centred
#             above them (path = top of the lower pair; apex raised by pitch x sqrt(3)/2)
#   IN[14] = Three (flat) c/c mm (blank/0 = diameter + 75), IN[15] = Trefoil c/c mm (blank/0 = diameter).
#   or a custom list of lateral offsets in mm, e.g. "-300,0,300" (left of travel +).
def parse_grid_offsets(value):
    while isinstance(value, (list, tuple)):
        if not value:
            return [0.0]
        if len(value) == 1:
            value = value[0]
        else:
            value = ",".join(str(v) for v in value)
    if value is None:
        return [0.0]
    items = str(value).replace(';', ',').replace(' ', ',').split(',')
    offsets = []
    for item in items:
        item = item.strip()
        if not item:
            continue
        number = float(item)
        if not (abs(number) < 1.0e6):
            raise ValueError('Gridline offset is not a finite number: ' + item)
        if not [o for o in offsets if abs(o - number) < 1e-6]:
            offsets.append(number)
    return offsets if offsets else [0.0]

def _pitch_mm(value):
    while isinstance(value, (list, tuple)) and len(value) == 1:
        value = value[0]
    try:
        number = float(value)
    except (TypeError, ValueError):
        return None
    return number if (number == number and abs(number) < 1.0e6 and number > 0.0) else None

def resolve_grid_layout(value, duct_diameter_mm, flat_pitch_in=None, trefoil_pitch_in=None):
    """Return [(lateral_mm, rise_mm), ...] for the chosen formation.
    flat_pitch_in / trefoil_pitch_in are centre-to-centre distances in mm; blank or
    zero falls back to diameter + 75 (flat) and diameter (trefoil, touching)."""
    while isinstance(value, (list, tuple)) and len(value) == 1:
        value = value[0]
    text = '' if value is None else str(value).strip().lower()
    try:
        # Selector index from the slider: 0 = Single, 1 = Three, 2 = Trefoil.
        text = {0: 'single', 1: 'three', 2: 'trefoil'}.get(int(round(float(text))), text) \
            if abs(float(text) - round(float(text))) < 1e-9 and 0 <= round(float(text)) <= 2 else text
    except ValueError:
        pass
    dia = float(duct_diameter_mm)
    if text in ('', 'single', 'one'):
        return [(0.0, 0.0)]
    if text in ('three', 'flat', 'three flat', 'flat three'):
        pitch = _pitch_mm(flat_pitch_in) or (dia + 75.0)
        if pitch < dia - 1e-6:
            raise ValueError('Three (flat) spacing {:.1f} mm is smaller than the {:.1f} mm duct diameter - ducts would overlap.'.format(pitch, dia))
        return [(-pitch, 0.0), (0.0, 0.0), (pitch, 0.0)]
    if text.startswith('tref'):
        pitch = _pitch_mm(trefoil_pitch_in) or dia
        if pitch < dia - 1e-6:
            raise ValueError('Trefoil spacing {:.1f} mm is smaller than the {:.1f} mm duct diameter - ducts would overlap.'.format(pitch, dia))
        return [(-pitch / 2.0, 0.0), (pitch / 2.0, 0.0), (0.0, pitch * math.sqrt(3.0) / 2.0)]
    return [(o, 0.0) for o in parse_grid_offsets(value)]

grid_mode_in = IN[13] if len(IN) > 13 else None
grid_flat_pitch_in = IN[14] if len(IN) > 14 else None      # Three (flat) c/c, mm
grid_trefoil_pitch_in = IN[15] if len(IN) > 15 else None   # Trefoil c/c, mm
current_route_is_com = False   # Com routes stay a single sweep on the centreline

result = None

# V2.61 ROBUST INPUT NORMALIZER
# The one-click selector can arrive through Dynamo as either genuine nested
# lists or as rows stringified like "['point index', ...]". It can also hand
# both XY and Z tables to one input. Normalize all of those cases before the
# proven V2.57 geometry parser runs.
import ast

class _NoneNameToConstant(ast.NodeTransformer):
    def visit_Name(self, node):
        if str(node.id).lower() == "none":
            return ast.copy_location(ast.Constant(value=None), node)
        return node

def _parse_row_string(value):
    if not isinstance(value, str):
        return value
    s = value.strip()
    if not (s.startswith('[') and s.endswith(']')):
        return value
    try:
        tree = ast.parse(s, mode='eval')
        tree = _NoneNameToConstant().visit(tree)
        ast.fix_missing_locations(tree)
        return ast.literal_eval(tree)
    except Exception:
        return value

def _normalize_table(obj):
    if obj is None:
        return None
    if isinstance(obj, tuple):
        obj = list(obj)
    if not isinstance(obj, list):
        return obj
    result_rows = []
    for item in obj:
        item = _parse_row_string(item)
        if isinstance(item, tuple):
            item = list(item)
        result_rows.append(item)
    return result_rows

def _header_kind(table):
    if not isinstance(table, list):
        return None
    for row in table:
        row = _parse_row_string(row)
        if not isinstance(row, (list, tuple)):
            continue
        vals = [str(x).strip().lower() if x is not None else '' for x in row]
        if 'point index' in vals and 'easting' in vals and 'northing' in vals:
            return 'xy'
        if ('entity index' in vals and 'start easting' in vals and
                'start northing' in vals and 'end easting' in vals and
                'end northing' in vals):
            return 'z'
    return None

def _collect_candidate_tables(obj):
    """Return likely worksheet tables without flattening their row structure."""
    obj = _normalize_table(obj)
    candidates = []
    if not isinstance(obj, list):
        return candidates
    if _header_kind(obj):
        candidates.append(obj)
        return candidates
    # One-click output may be [XY_table, Z_table].
    for child in obj:
        child = _normalize_table(child)
        if isinstance(child, list) and _header_kind(child):
            candidates.append(child)
    return candidates

# Prefer explicitly wired IN[0]/IN[3], but recover automatically if the
# one-click node supplies both worksheets on either input.
_candidates = []
_candidates.extend(_collect_candidate_tables(data))
_candidates.extend(_collect_candidate_tables(data2))

_xy = None
_z = None
for _tbl in _candidates:
    _kind = _header_kind(_tbl)
    if _kind == 'xy' and _xy is None:
        _xy = _tbl
    elif _kind == 'z' and _z is None:
        _z = _tbl

# Also normalize a normal, correctly wired table.
if _xy is None:
    _tmp = _normalize_table(data)
    if _header_kind(_tmp) == 'xy':
        _xy = _tmp
if _z is None:
    _tmp = _normalize_table(data2)
    if _header_kind(_tmp) == 'z':
        _z = _tmp

if _xy is not None:
    data = _xy
if _z is not None:
    data2 = _z


def to_float(v):
    if v is None:
        return None
    if isinstance(v, str):
        v = v.strip()
        # Civil 3D / Excel exports can contain Unicode minus signs or
        # non-breaking spaces.  Normalise them so negative Alignment Radius
        # values (for example -8.9956) are never discarded as text.
        v = (v.replace(u'\u2212', '-')
               .replace(u'\u2013', '-')
               .replace(u'\u2014', '-')
               .replace(u'\xa0', '')
               .replace(',', ''))
        if v.endswith(u'°'):
            v = v[:-1].strip()
        # Allow a harmless trailing metre marker from some report formats.
        if v.lower().endswith(' m'):
            v = v[:-2].strip()
        if v == '':
            return None
    try:
        return float(v)
    except:
        return None


def is_finite_number(v):
    try:
        return v is not None and not math.isnan(v) and not math.isinf(v)
    except Exception:
        return False


def parse_station(v):
    """Parse Civil 3D station values such as 0+002.19 or 1+234.56."""
    if v is None:
        return None
    try:
        s = str(v).strip().replace('\xa0', '').replace(' ', '')
    except:
        return None
    if not s:
        return None
    # Civil 3D chainage: kilometres/hundreds prefix + remainder.
    if '+' in s:
        try:
            left, right = s.split('+', 1)
            left = left.replace(',', '')
            right = right.replace(',', '')
            sign = -1.0 if left.startswith('-') else 1.0
            return sign * (abs(float(left)) * 1000.0 + abs(float(right)))
        except:
            return None
    try:
        return float(s.replace(',', ''))
    except:
        return None


def origin_unit_to_meters_factor(unit_str):
    key = str(unit_str).strip().lower()

    if key in (
        "mm",
        "millimeter",
        "millimetre",
        "millimeters",
        "millimetres"
    ):
        return 0.001

    if key in (
        "m",
        "meter",
        "metre",
        "meters",
        "metres"
    ):
        return 1.0

    return None


def parse_global_origin(v):
    if v is None:
        return None

    if isinstance(v, str):
        parts = [p.strip() for p in v.split(',')]
    else:
        parts = list(v)

    if len(parts) == 4:
        # E, N, Z, rotation - same order as the 3-value form.
        e = to_float(parts[0])
        nn = to_float(parts[1])
        z = to_float(parts[2])
        angle_deg = to_float(parts[3])

    elif len(parts) == 3:
        e = to_float(parts[0])
        nn = to_float(parts[1])
        z = to_float(parts[2])
        angle_deg = None

    else:
        return None

    if e is None or nn is None or z is None:
        return None

    return e, nn, z, angle_deg


def find_vcurve(s0, s1, vcurves):
    mid = (s0 + s1) / 2.0

    for vc in vcurves:
        lo = min(vc['start'], vc['end'])
        hi = max(vc['start'], vc['end'])

        if lo - 1e-6 <= mid <= hi + 1e-6:
            return vc

    return None


def merge_collinear_lines(curves, dot_tol=1e-6):
    if not curves:
        return curves

    merged = [curves[0]]

    for c in curves[1:]:
        prev = merged[-1]
        combined = None

        if isinstance(prev, Line) and isinstance(c, Line):
            p0 = prev.GetEndPoint(0)
            p1 = prev.GetEndPoint(1)
            q0 = c.GetEndPoint(0)
            q1 = c.GetEndPoint(1)

            if p1.DistanceTo(q0) < 1e-6:
                try:
                    d1 = p1.Subtract(p0).Normalize()
                    d2 = q1.Subtract(q0).Normalize()

                    if d1.DotProduct(d2) > 1.0 - dot_tol:
                        combined = Line.CreateBound(p0, q1)
                except Exception:
                    combined = None

        if combined is not None:
            merged[-1] = combined
        else:
            merged.append(c)

    return merged


BUILT_IN_PROFILE = 'BUILT_IN_CIRCULAR_PROFILE'

def resolve_builtin_profile(path):
    if str(path) != BUILT_IN_PROFILE:
        return path
    if int(doc.Application.VersionNumber) < 2026:
        raise ValueError('The built-in circular family requires Revit 2026 or newer.')
    import base64
    import hashlib
    import tempfile
    payload = base64.b64decode('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')
    expected = '19b1a0298b802ed8074973d6cb9519c857f1296966219296b367ed265fdd1a99'
    if hashlib.sha256(payload).hexdigest() != expected:
        raise ValueError('The embedded circular family is damaged.')
    folder = os.path.join(tempfile.gettempdir(), 'MWP_Dynamo_Profiles', expected)
    if not os.path.isdir(folder):
        os.makedirs(folder)
    target = os.path.join(folder, 'MWP_Circular_Profile_Parameterized_RV2026.rfa')
    valid = False
    if os.path.isfile(target):
        with open(target, 'rb') as stream:
            valid = hashlib.sha256(stream.read()).hexdigest() == expected
    if not valid:
        handle, staging = tempfile.mkstemp(suffix='.rfa', dir=folder)
        try:
            with os.fdopen(handle, 'wb') as stream:
                stream.write(payload)
            os.replace(staging, target)
        finally:
            if os.path.isfile(staging):
                os.remove(staging)
    return target


def get_or_load_profile_symbol(path):
    try:
        path = resolve_builtin_profile(path)
    except Exception as ex:
        return None, str(ex)

    if path is None:
        return None, "no .rfa path was supplied"

    path = str(path).strip()

    if not path:
        return None, "the .rfa path was empty"

    if not path.lower().endswith('.rfa'):
        return None, "path does not end in .rfa: '{}'".format(path)

    if not os.path.isfile(path):
        return None, "file does not exist: '{}'".format(path)

    family_name = os.path.splitext(os.path.basename(path))[0]
    existing_family = None

    for fam in FilteredElementCollector(doc).OfClass(Family):
        if fam.Name == family_name:
            existing_family = fam
            break

    family = existing_family

    if family is None:
        try:
            raw_result = doc.LoadFamily(path)
            loaded_ok = bool(raw_result[0]) if isinstance(raw_result, tuple) else bool(raw_result)
            loaded_family = raw_result[1] if isinstance(raw_result, tuple) and len(raw_result) > 1 else None

            if loaded_ok:
                loaded_name = os.path.splitext(
                    os.path.basename(str(path))
                )[0]

                for loaded_fam in FilteredElementCollector(doc).OfClass(Family):
                    if loaded_fam.Name == loaded_name:
                        loaded_family = loaded_fam
                        break

        except Exception as ex:
            return None, "could not load '{}': {}".format(path, str(ex))

        if not loaded_ok or loaded_family is None:
            return None, "LoadFamily returned false for '{}'".format(path)

        family = loaded_family

    symbol_ids = list(family.GetFamilySymbolIds())

    if not symbol_ids:
        return None, (
            "family '{}' has no types (FamilySymbols)"
            .format(family_name)
        )

    symbol = doc.GetElement(symbol_ids[0])

    if not isinstance(symbol, FamilySymbol):
        return None, (
            "element resolved from '{}' is not a FamilySymbol"
            .format(family_name)
        )

    if not symbol.IsActive:
        symbol.Activate()
        doc.Regenerate()

    return symbol, None


def sized_profile_symbol(symbol, diameter):
    """Use a dedicated type for each diameter; never resize an existing sweep type."""
    mm = to_float(diameter)
    if not is_finite_number(mm) or mm <= 0:
        raise ValueError("Duct diameter must be a positive number in mm.")
    target_ft = mm / 304.8
    parameter = symbol.LookupParameter('Diameter')
    if parameter is None or parameter.StorageType != StorageType.Double or parameter.Definition.GetDataType() != SpecTypeId.Length:
        if str(profile_rfa_path_in) == BUILT_IN_PROFILE:
            raise ValueError("Built-in circular profile is missing its Length type Diameter parameter.")
        # Imported profiles may be rectangular or fixed-size; preserve their geometry.
        return symbol
    # Reuse only a type whose actual parameter value already matches.
    for sid in symbol.Family.GetFamilySymbolIds():
        candidate = doc.GetElement(sid)
        p = candidate.LookupParameter('Diameter')
        if p is not None and abs(p.AsDouble() - target_ft) < 1e-9:
            if not candidate.IsActive:
                candidate.Activate()
            doc.Regenerate()
            return candidate
    import uuid
    candidate = symbol.Duplicate('Duct_{:.6g}mm_{}'.format(mm, uuid.uuid4().hex[:8]))
    p = candidate.LookupParameter('Diameter')
    if p is None or p.IsReadOnly:
        raise ValueError("Profile Diameter must be writable.")
    p.Set(target_ft)
    if not candidate.IsActive:
        candidate.Activate()
    doc.Regenerate()
    if abs(p.AsDouble() - target_ft) > 1e-9:
        raise ValueError("Profile Diameter did not accept the duct input.")
    return candidate


def custom_profile_top_offset(symbol):
    """Measure the selected type in a temporary straight sweep, then discard it.

    Local profile Y maps to world Z on this horizontal X-directed probe.
    Measuring actual solids respects profiles whose origin is not centred.
    """
    # This supplied family is a circle centred on the origin. Use its exact
    # radius: a solid bounding box may conservatively overestimate the top.
    if symbol.Family.Name == 'MWP_Circular_Profile_Parameterized_RV2026':
        return -symbol.LookupParameter('Diameter').AsDouble() / 2.0
    probe = SubTransaction(doc)
    probe.Start()
    try:
        profile = doc.Application.Create.NewFamilySymbolProfile(symbol)
        path = CurveArray()
        path.Append(Line.CreateBound(XYZ.Zero, XYZ(10.0, 0.0, 0.0)))
        plane = SketchPlane.Create(doc, Plane.CreateByNormalAndOrigin(XYZ.BasisZ, XYZ.Zero))
        sweep = doc.FamilyCreate.NewSweep(True, path, plane, profile, 0, ProfilePlaneLocation.Start)
        doc.Regenerate()
        tops = []
        for item in sweep.get_Geometry(Options()):
            if isinstance(item, Solid) and item.Volume > 0:
                bounds = item.GetBoundingBox()
                for x in (bounds.Min.X, bounds.Max.X):
                    for y in (bounds.Min.Y, bounds.Max.Y):
                        for z in (bounds.Min.Z, bounds.Max.Z):
                            tops.append(bounds.Transform.OfPoint(XYZ(x, y, z)).Z)
        if not tops:
            raise RuntimeError("Cannot measure the top of the selected custom profile.")
        return -max(tops)
    finally:
        probe.RollBack()


def top_profile_frame(refs, curves, radius):
    """Resolve Revit's actual section frame at the flattest path start.

    Near-vertical route starts do not define a reliable top direction.
    Never assume that local profile +Y equals world up.
    """
    index = min(range(len(curves)), key=lambda i:
                abs(curves[i].ComputeDerivatives(0.0, True).BasisX.Normalize().Z))
    probe_tx = SubTransaction(doc)
    probe_tx.Start()
    try:
        arcs = CurveArray()
        for a, b in ((0.0, math.pi), (math.pi, 2.0 * math.pi)):
            arcs.Append(Arc.Create(XYZ.Zero, radius, a, b, XYZ.BasisX, XYZ.BasisY))
        loops = CurveArrArray()
        loops.Append(arcs)
        profile = doc.Application.Create.NewCurveLoopsProfile(loops)
        probe = doc.FamilyCreate.NewSweep(True, refs, profile, index, ProfilePlaneLocation.Start)
        doc.Regenerate()
        plane = probe.ProfileSketch.SketchPlane.GetPlane()
        up = XYZ.BasisZ.Subtract(plane.Normal.Multiply(plane.Normal.Z))
        if up.GetLength() < 1e-8:
            raise RuntimeError("A fully vertical route has no unique top-of-duct section direction.")
        up = up.Normalize()
        return index, up.DotProduct(plane.XVec), up.DotProduct(plane.YVec)
    finally:
        probe_tx.RollBack()


def run_sweeps():
    global _created_sweep_ids
    _created_sweep_ids = []
    result = None
    if not doc.IsFamilyDocument:
        result = "ERROR: Open a Family Editor document before running this script."
    
    elif not data:
        result = "ERROR: Input Data (IN[0]) is empty."
    
    else:
        # Detect either the original point-table format or a Civil 3D
        # profile entity table (Entity Index / Start Easting / End Easting...).
        def clean_header(value):
            if value is None:
                return ''
            try:
                txt = str(value)
            except:
                return ''
            txt = txt.replace('\xa0', ' ').replace('_', ' ').strip().lower()
            return ' '.join(txt.split())

        header_idx = None
        header = None
        header_map = None
        input_mode = None

        for i, row in enumerate(data):
            if not row:
                continue
            cleaned = [clean_header(x) for x in row]
            if 'point index' in cleaned:
                input_mode = 'point'
            elif 'entity index' in cleaned and 'start easting' in cleaned and 'end easting' in cleaned:
                input_mode = 'entity'
            else:
                continue

            header_idx = i
            header = row
            header_map = {}
            for j, name in enumerate(cleaned):
                if name and name not in header_map:
                    header_map[name] = j
            break

        if header_idx is None:
            preview = []
            try:
                for r in data[:10]:
                    preview.append([clean_header(x) for x in r] if r else [])
            except:
                pass
            return (
                "ERROR: Could not find a supported geometry header row. "
                "Expected either 'Point Index' or a Civil 3D 'Entity Index' row "
                "with Start/End Easting and Northing. First rows received: {}"
            ).format(preview)

        if input_mode == 'point':
            required = ['easting', 'northing', 'entity type', 'station']
        else:
            required = [
                'entity index', 'entity type', 'start station', 'end station',
                'start easting', 'start northing', 'start elevation',
                'end easting', 'end northing', 'end elevation'
            ]

        missing = [name for name in required if name not in header_map]
        if missing:
            return (
                "ERROR: {} table found, but required columns are missing. "
                "Missing: {}. Headers found: {}"
            ).format(
                input_mode, ', '.join(missing),
                ', '.join([clean_header(x) for x in header if clean_header(x)])
            )

        # V2.52: Build a station -> elevation table from IN[3] (Z_Calculated).
        # Supports either a point report (Station/Elevation) or a profile entity
        # report (Start/End Station + Start/End Elevation).  This lets IN[0]
        # remain the Civil 3D XY report even when its Elevation cells are blank.
        z_by_station = {}
        z_source_note = ""

        if data2:
            z_header_idx = None
            z_header_map = None
            for zi, zrow in enumerate(data2):
                if not zrow:
                    continue
                zclean = [clean_header(x) for x in zrow]
                if ('station' in zclean and 'elevation' in zclean) or (
                    'start station' in zclean and 'end station' in zclean and
                    'start elevation' in zclean and 'end elevation' in zclean
                ):
                    z_header_idx = zi
                    z_header_map = {}
                    for zj, zname in enumerate(zclean):
                        if zname and zname not in z_header_map:
                            z_header_map[zname] = zj
                    break

            if z_header_idx is not None:
                if 'station' in z_header_map and 'elevation' in z_header_map:
                    for zrow in data2[z_header_idx + 1:]:
                        if not zrow:
                            continue
                        zs = parse_station(zrow[z_header_map['station']] if z_header_map['station'] < len(zrow) else None)
                        zz = to_float(zrow[z_header_map['elevation']] if z_header_map['elevation'] < len(zrow) else None)
                        if zs is not None and zz is not None:
                            z_by_station[round(zs, 6)] = zz
                    z_source_note = "point Station/Elevation table"
                else:
                    for zrow in data2[z_header_idx + 1:]:
                        if not zrow:
                            continue
                        for skey, zkey in (('start station','start elevation'), ('end station','end elevation')):
                            zs = parse_station(zrow[z_header_map[skey]] if z_header_map[skey] < len(zrow) else None)
                            zz = to_float(zrow[z_header_map[zkey]] if z_header_map[zkey] < len(zrow) else None)
                            if zs is not None and zz is not None:
                                z_by_station[round(zs, 6)] = zz
                    z_source_note = "profile Start/End Station/Elevation table"

        def elevation_at_station(station):
            if station is None or not z_by_station:
                return None
            key = round(station, 6)
            if key in z_by_station:
                return z_by_station[key]
            # Linear interpolation between profile stations for XY sample points
            keys = sorted(z_by_station.keys())
            if station < keys[0] - 1e-6 or station > keys[-1] + 1e-6:
                return None
            for ai in range(len(keys) - 1):
                s0, s1 = keys[ai], keys[ai + 1]
                if s0 - 1e-6 <= station <= s1 + 1e-6:
                    z0, z1 = z_by_station[s0], z_by_station[s1]
                    if abs(s1 - s0) < 1e-12:
                        return z0
                    f = (station - s0) / (s1 - s0)
                    return z0 + (z1 - z0) * f
            return None

        vcurves = []

        if data2:
            header2_idx = None
            header2_map = None
            for vi, vrow in enumerate(data2):
                if not vrow:
                    continue
                vclean = [clean_header(x) for x in vrow]
                # Vertical-curve metadata is optional. Only parse it when the
                # necessary fields actually exist; an alignment entity report
                # must not crash the node.
                if 'start station' in vclean and 'end station' in vclean:
                    header2_idx = vi
                    header2_map = {name: j for j, name in enumerate(vclean) if name}
                    if ('curve radius' in header2_map or 'profile radius' in header2_map or 'radius' in header2_map):
                        break

            if header2_idx is not None and header2_map:
                radius_key = ('curve radius' if 'curve radius' in header2_map else
                              'profile radius' if 'profile radius' in header2_map else
                              'radius' if 'radius' in header2_map else None)
                pc_key = 'parameter constraint' if 'parameter constraint' in header2_map else None
                ct_key = 'curve type' if 'curve type' in header2_map else ('entity type' if 'entity type' in header2_map else None)
                if radius_key:
                    for vrow in data2[header2_idx + 1:]:
                        if not vrow:
                            continue
                        ss = parse_station(vrow[header2_map['start station']] if header2_map['start station'] < len(vrow) else None)
                        es = parse_station(vrow[header2_map['end station']] if header2_map['end station'] < len(vrow) else None)
                        radius = to_float(vrow[header2_map[radius_key]] if header2_map[radius_key] < len(vrow) else None)
                        curve_type = vrow[header2_map[ct_key]] if ct_key and header2_map[ct_key] < len(vrow) else None
                        pc_ok = True
                        if pc_key:
                            pc = vrow[header2_map[pc_key]] if header2_map[pc_key] < len(vrow) else None
                            pc_ok = pc is not None and str(pc).strip().lower() == 'radius'
                        entity_col = header2_map.get('entity type')
                        entity_label = str(vrow[entity_col]).lower() if entity_col is not None and entity_col < len(vrow) else ''
                        circular = 'circular' in entity_label
                        if (circular or (pc_ok and 'parab' not in entity_label and 'tangent' not in entity_label)) and ss is not None and es is not None and is_finite_number(radius) and radius != 0.0:
                            vcurves.append({'start': ss, 'end': es, 'radius': radius, 'curve_type': curve_type})

        raw_pts = []

        if input_mode == 'point':
            col_e = header_map['easting']
            col_n = header_map['northing']
            col_z = header_map.get('elevation')
            col_t = header_map['entity type']
            col_station = header_map['station']
            # Optional Civil 3D XY report column.  For Entity Type = Curve,
            # this signed value controls the horizontal curve radius/direction.
            col_align_radius = header_map.get('alignment radius')

            for row in data[header_idx + 1:]:
                if not row or row[0] is None or str(row[0]).strip() == '':
                    continue
                if to_float(row[0]) is None:
                    break
                e_val = to_float(row[col_e])
                n_val = to_float(row[col_n])
                z_val = to_float(row[col_z]) if col_z is not None and col_z < len(row) else None
                type_val = row[col_t]
                station_val = parse_station(row[col_station])
                # V2.52: if XY report has a blank Elevation, obtain Z from
                # IN[3] by station (exact match or linear interpolation).
                if z_val is None:
                    z_val = elevation_at_station(station_val)
                alignment_radius = (
                    to_float(row[col_align_radius])
                    if col_align_radius is not None and col_align_radius < len(row)
                    else None
                )
                # Ignore any point row that has no usable Elevation value.
                if e_val is None or n_val is None or z_val is None:
                    continue
                raw_pts.append([
                    e_val, n_val, z_val, type_val, station_val, alignment_radius
                ])

        else:
            # Civil 3D profile entity table.  Store the segment type on the
            # END point; later seg_types[k] uses point k+1, so transitions
            # Tangent -> Curve -> Tangent remain unambiguous at shared PVIs.
            ci = header_map
            first_entity = True
            for row in data[header_idx + 1:]:
                if not row or row[ci['entity index']] is None or str(row[ci['entity index']]).strip() == '':
                    continue
                if to_float(row[ci['entity index']]) is None:
                    break

                se = to_float(row[ci['start easting']])
                sn = to_float(row[ci['start northing']])
                sz = to_float(row[ci['start elevation']])
                ee = to_float(row[ci['end easting']])
                en = to_float(row[ci['end northing']])
                ez = to_float(row[ci['end elevation']])
                ss = parse_station(row[ci['start station']])
                es = parse_station(row[ci['end station']])
                et = clean_header(row[ci['entity type']])
                seg_type = 'Curve' if 'curve' in et else 'Line'

                # Ignore any Civil 3D entity row when either end has no Elevation.
                if (
                    se is None or sn is None or sz is None or
                    ee is None or en is None or ez is None
                ):
                    continue

                if first_entity:
                    raw_pts.append([se, sn, sz, None, ss, None])
                    first_entity = False
                else:
                    # Add a start point only when the report has a real gap.
                    pe, pn = raw_pts[-1][0], raw_pts[-1][1]
                    if abs(pe - se) > 1e-6 or abs(pn - sn) > 1e-6:
                        raw_pts.append([se, sn, sz, 'Line', ss, None])

                raw_pts.append([ee, en, ez, seg_type, es, None])

        # Blank/invalid Elevation rows are intentionally ignored above.
        # Do not copy elevations from neighbouring points and do not substitute 0.0.

        if len(raw_pts) < 2:
            if input_mode == 'point' and not z_by_station:
                result = (
                    "ERROR: XY points were found, but no usable elevations were found. "
                    "IN[0] may contain blank Elevation cells, so IN[3] (Z_Calculated) "
                    "must be a Civil 3D PROFILE report containing Station/Elevation or "
                    "Start/End Station + Start/End Elevation. The current Z input appears "
                    "to be an alignment/XY report rather than a profile report."
                )
            else:
                result = (
                    "ERROR: Fewer than 2 valid XYZ points found after matching XY and Z by station."
                )

        else:
            M_TO_FT = 1.0 / 0.3048
            profile_fallback_note = ""

            profile_symbol = None

            if bool(use_custom_profile_in):
                profile_symbol, load_error = (
                    get_or_load_profile_symbol(profile_rfa_path_in)
                )

                if profile_symbol is None:
                    detail = (
                        load_error if load_error
                        else "unknown error loading profile family"
                    )

                    return "ERROR: Custom profile could not be loaded: " + str(detail)
                    profile_fallback_note = (
                        " (custom profile failed - {} - "
                        "used duct diameter instead)"
                    ).format(detail)

            if profile_symbol is not None:
                profile_symbol = sized_profile_symbol(profile_symbol, diameter_mm)
            use_custom_profile = profile_symbol is not None

            diam_ft_raw = to_float(diameter_mm) or 100.0
            radius_ft = (diam_ft_raw / 2.0) / 304.8
            # V2.70: keep the path on the imported top-of-duct alignment.
            # Offset the section instead of lowering the path to its centre.
            z_shift_ft = 0.0
            custom_y_offset = custom_profile_top_offset(profile_symbol) if use_custom_profile else 0.0

            angle_deg = None
            origin_unit_note = ""

            if use_true_coords:
                ox = 0.0
                oy = 0.0
                oz = 0.0

            elif parse_global_origin(global_origin_in) is not None:
                ox, oy, oz, angle_deg = parse_global_origin(
                    global_origin_in
                )

                origin_unit_factor = origin_unit_to_meters_factor(
                    origin_unit_in
                )

                if origin_unit_factor is None:
                    origin_unit_note = (
                        " (WARNING: unit '{}' not recognized - "
                        "use 'mm' or 'M'; treated origin as meters)"
                    ).format(origin_unit_in)

                    origin_unit_factor = 1.0

                ox *= origin_unit_factor
                oy *= origin_unit_factor
                oz *= origin_unit_factor

            else:
                ox = raw_pts[0][0]
                oy = raw_pts[0][1]
                oz = raw_pts[0][2]

            # V2.67: preserve imported elevation against family Z=0 (Ref. Level).
            # The supplied/automatic origin only translates the horizontal XY.
            oz = 0.0

            if angle_deg is not None and angle_deg != 0.0:
                normalized_angle = angle_deg % 360.0

                revit_angle_deg = (
                    360.0 - normalized_angle
                    if normalized_angle != 0.0
                    else 0.0
                )

                angle_rad = math.radians(revit_angle_deg)
                cos_a = math.cos(angle_rad)
                sin_a = math.sin(angle_rad)

                def rotate_offset(de, dn):
                    return (
                        de * cos_a + dn * sin_a,
                        -de * sin_a + dn * cos_a
                    )
            else:
                def rotate_offset(de, dn):
                    return de, dn

            def to_internal_xy(e, n):
                if use_true_coords:
                    return e * M_TO_FT, n * M_TO_FT

                dx, dy = rotate_offset(e - ox, n - oy)
                return dx * M_TO_FT, dy * M_TO_FT

            all_pts = []

            for e, n, z, entity_type, station, alignment_radius in raw_pts:
                x_ft, y_ft = to_internal_xy(e, n)

                all_pts.append((
                    XYZ(
                        x_ft,
                        y_ft,
                        (z - oz) * M_TO_FT - z_shift_ft
                    ),
                    entity_type,
                    station,
                    alignment_radius
                ))

            tol_ft = 0.01 * M_TO_FT
            clean = [all_pts[0]]

            for point, entity_type, station, alignment_radius in all_pts[1:]:
                if point.DistanceTo(clean[-1][0]) > tol_ft:
                    clean.append((
                        point,
                        entity_type,
                        station,
                        alignment_radius
                    ))
                else:
                    # Keep geometry de-duplicated, but do not lose horizontal-curve
                    # metadata merely because two exported points are almost coincident.
                    prev_point, prev_type, prev_station, prev_radius = clean[-1]
                    this_is_curve = ('curve' in str(entity_type).strip().lower()) if entity_type is not None else False
                    prev_is_curve = ('curve' in str(prev_type).strip().lower()) if prev_type is not None else False
                    if this_is_curve and not prev_is_curve:
                        clean[-1] = (prev_point, entity_type, station, alignment_radius)
                    elif this_is_curve and prev_is_curve and is_finite_number(alignment_radius):
                        clean[-1] = (prev_point, prev_type, prev_station, alignment_radius)

            clean_pts = [item[0] for item in clean]
            clean_types = [item[1] for item in clean]
            clean_stations = [item[2] for item in clean]
            clean_alignment_radii = [item[3] for item in clean]

            farthest_pt = max(
                clean_pts,
                key=lambda point: point.DistanceTo(XYZ.Zero)
            )

            max_dist_ft = farthest_pt.DistanceTo(XYZ.Zero)
            REVIT_LIMIT_FT = 105600.0

            if len(clean_pts) < 2:
                result = (
                    "ERROR: Not enough distinct points to build a path."
                )

            elif max_dist_ft > REVIT_LIMIT_FT:
                result = (
                    "ERROR: after applying the origin/rotation, "
                    "the farthest point is {:.1f} m ({:.0f} ft) "
                    "from the internal origin - Revit's limit is "
                    "about 20 miles (~32,000 m)."
                ).format(
                    max_dist_ft * 0.3048,
                    max_dist_ft
                )

            else:
                if input_mode == 'entity':
                    # Entity-table convention: each point stores the type of
                    # the segment that ENDS at that point.
                    seg_types = [
                        'Curve' if clean_types[i + 1] == 'Curve' else 'Line'
                        for i in range(len(clean_pts) - 1)
                    ]
                else:
                    # XY point-table convention: honour the Entity Type text
                    # from Excel.  Any value containing the word "curve"
                    # (for example "Curve", "Circular Curve",
                    # "Horizontal Curve") marks the adjacent XY segment as
                    # curved.  This is deliberately a contains check rather
                    # than requiring the cell to equal exactly "Curve".
                    def xy_entity_is_curve(value):
                        if value is None:
                            return False
                        try:
                            return 'curve' in str(value).strip().lower()
                        except Exception:
                            return False

                    # V2.57 CIVIL 3D PC/PT FIX
                    # Project Explorer marks the PC row as Curve, while the PT
                    # row is already reported as Line. Classify each segment from
                    # its START point so the last curve segment reaches the true PT.
                    # tangent->PC = Line, PC->...->PT = Curve, PT->onward = Line.
                    seg_types = [
                        'Curve' if xy_entity_is_curve(clean_types[i]) else 'Line'
                        for i in range(len(clean_pts) - 1)
                    ]

                def build_xy_alignment_radius_arc(start, end, signed_radius_m, sample_points):
                    """Build a 3D Revit Arc whose PLAN geometry uses Alignment Radius.

                    The signed radius magnitude is the horizontal radius.  When
                    intermediate XY points are available, they decide which of the
                    two possible circle centres matches the Excel geometry; the sign
                    is used as the tie-breaker/direction hint.  Z comes from the
                    middle sample so the sweep still follows the imported elevation.
                    """
                    if signed_radius_m is None or abs(signed_radius_m) < 1e-12:
                        return None, "blank/zero Alignment Radius"

                    radius_ft_plan = abs(signed_radius_m) * M_TO_FT
                    dx = end.X - start.X
                    dy = end.Y - start.Y
                    chord_xy = math.sqrt(dx * dx + dy * dy)
                    if chord_xy < 1e-9:
                        return None, "zero XY chord"
                    if radius_ft_plan + 1e-8 < chord_xy / 2.0:
                        return None, (
                            "Alignment Radius {:.6g} m is smaller than half the "
                            "XY chord {:.6g} m"
                        ).format(signed_radius_m, chord_xy * 0.3048)

                    mx = (start.X + end.X) * 0.5
                    my = (start.Y + end.Y) * 0.5
                    h_sq = max(0.0, radius_ft_plan * radius_ft_plan - (chord_xy * chord_xy) / 4.0)
                    h = math.sqrt(h_sq)
                    left_x = -dy / chord_xy
                    left_y = dx / chord_xy
                    centres = [
                        (mx + left_x * h, my + left_y * h),
                        (mx - left_x * h, my - left_y * h)
                    ]

                    samples = sample_points if sample_points else []
                    def centre_score(c):
                        cx, cy = c
                        if not samples:
                            return 0.0
                        total = 0.0
                        for sp in samples:
                            rr = math.sqrt((sp.X - cx) ** 2 + (sp.Y - cy) ** 2)
                            total += abs(rr - radius_ft_plan)
                        return total

                    scores = [centre_score(c) for c in centres]

                    # V2.56 EXACT XY ARC FIX
                    # Civil 3D Calculated Stations are authoritative for the PLAN
                    # geometry.  There are two possible circle centres for a given
                    # PC/PT chord and radius.  Previous versions selected the centre
                    # from the radius sign alone; that can choose the opposite circle
                    # after coordinate rotation and creates a visible kink at PC/PT.
                    # When Civil 3D intermediate calculated stations exist, choose the
                    # centre whose circle best fits those exported XY points.  Use the
                    # signed radius only as a fallback when there are no samples.
                    if samples:
                        chosen_index = 0 if scores[0] <= scores[1] else 1
                    else:
                        # Fallback only.  centres[0] is left of start->end and
                        # centres[1] is right of start->end in the current XY frame.
                        chosen_index = 0 if signed_radius_m > 0.0 else 1
                    chosen = centres[chosen_index]

                    cx, cy = chosen
                    if samples:
                        mid_sample = samples[len(samples) // 2]
                        vx = mid_sample.X - cx
                        vy = mid_sample.Y - cy
                        vl = math.sqrt(vx * vx + vy * vy)
                        if vl < 1e-9:
                            mid_sample = None
                    else:
                        mid_sample = None

                    if mid_sample is not None:
                        mid = XYZ(
                            cx + (vx / vl) * radius_ft_plan,
                            cy + (vy / vl) * radius_ft_plan,
                            mid_sample.Z
                        )
                    else:
                        # No useful intermediate point: use the midpoint of the
                        # minor circular arc in plan and average the elevation.
                        ux0 = (start.X - cx) / radius_ft_plan
                        uy0 = (start.Y - cy) / radius_ft_plan
                        ux1 = (end.X - cx) / radius_ft_plan
                        uy1 = (end.Y - cy) / radius_ft_plan
                        sx = ux0 + ux1
                        sy = uy0 + uy1
                        sl = math.sqrt(sx * sx + sy * sy)
                        if sl < 1e-9:
                            # Semicircle: choose a perpendicular direction using sign.
                            direction = 1.0 if signed_radius_m >= 0.0 else -1.0
                            sx = -uy0 * direction
                            sy = ux0 * direction
                            sl = math.sqrt(sx * sx + sy * sy)
                        mid = XYZ(
                            cx + (sx / sl) * radius_ft_plan,
                            cy + (sy / sl) * radius_ft_plan,
                            (start.Z + end.Z) * 0.5
                        )

                    try:
                        arc = Arc.Create(start, end, mid)
                        # V2.73: Revit can regenerate but reject a shallow arc at
                        # final commit when its defining sample is off-centre.
                        # Rebuild the SAME circle using its own parametric midpoint.
                        # Do not resample the route or alter the imported elevations.
                        stable = Arc.Create(arc.GetEndPoint(0), arc.GetEndPoint(1),
                                            arc.Evaluate(0.5, True))
                        deviation = max(arc.Evaluate(t, True).DistanceTo(
                            stable.Evaluate(t, True)) for t in (0.0, 0.25, 0.5, 0.75, 1.0))
                        if deviation > 1e-7:
                            return None, "Arc normalization exceeded the geometry tolerance."
                        return stable, None
                    except Exception as ex:
                        return None, "Revit Arc.Create failed: {}".format(str(ex))

                def build_vertical_arc_or_line(k):
                    start = clean_pts[k]
                    end = clean_pts[k + 1]

                    if (
                        clean_stations[k] is not None and
                        clean_stations[k + 1] is not None
                    ):
                        vertical_curve = find_vcurve(
                            clean_stations[k],
                            clean_stations[k + 1],
                            vcurves
                        )
                    else:
                        vertical_curve = None

                    if vertical_curve is not None:
                        arc_radius_ft = (
                            abs(vertical_curve['radius']) * M_TO_FT
                        )

                        chord_len = start.DistanceTo(end)

                        if arc_radius_ft > chord_len / 2.0:
                            chord_dir = (
                                end.Subtract(start).Normalize()
                            )

                            ratio = min(
                                1.0,
                                (chord_len / 2.0) / arc_radius_ft
                            )

                            half_angle = math.asin(ratio)

                            sagitta = (
                                arc_radius_ft -
                                arc_radius_ft * math.cos(half_angle)
                            )

                            z_axis = XYZ.BasisZ

                            vert_perp = z_axis.Subtract(
                                chord_dir.Multiply(
                                    z_axis.DotProduct(chord_dir)
                                )
                            )

                            if vert_perp.GetLength() < 1e-6:
                                vert_perp = XYZ.BasisX.Subtract(
                                    chord_dir.Multiply(
                                        XYZ.BasisX.DotProduct(chord_dir)
                                    )
                                )

                            vert_perp = vert_perp.Normalize()

                            sign = (
                                -1.0
                                if str(vertical_curve['curve_type']).strip().lower() == 'sag'
                                else 1.0
                            )

                            mid_chord = start.Add(end).Multiply(0.5)

                            mid_point = mid_chord.Add(
                                vert_perp.Multiply(sign * sagitta)
                            )

                            try:
                                return Arc.Create(
                                    start,
                                    end,
                                    mid_point
                                )
                            except Exception:
                                return Line.CreateBound(start, end)

                    return Line.CreateBound(start, end)

                xy_curve_block_notes = []
                if input_mode == 'point':
                    bi = 0
                    while bi < len(clean_pts):
                        if not xy_entity_is_curve(clean_types[bi]):
                            bi += 1
                            continue
                        bj = bi
                        while bj + 1 < len(clean_pts) and xy_entity_is_curve(clean_types[bj + 1]):
                            bj += 1
                        block_radii = [
                            rr for rr in clean_alignment_radii[bi:bj + 1]
                            if is_finite_number(rr)
                        ]
                        radius_label = (
                            "{:.6g}".format(block_radii[0])
                            if block_radii else "NO VALID RADIUS"
                        )
                        xy_curve_block_notes.append(
                            "stations {} to {} | points {} | signed radius {}".format(
                                clean_stations[bi], clean_stations[bj],
                                (bj - bi + 1), radius_label
                            )
                        )
                        bi = bj + 1

                sweep_groups = []
                i = 0
                number_of_segments = len(seg_types)

                while i < number_of_segments:
                    run_type = seg_types[i]
                    j = i

                    while (
                        j < number_of_segments and
                        seg_types[j] == run_type
                    ):
                        # The outgoing radius at a shared PC belongs to the NEXT arc.
                        if run_type == 'Curve' and input_mode == 'point' and j > i:
                            first_radius = clean_alignment_radii[i]
                            next_radius = clean_alignment_radii[j]
                            if (not is_finite_number(first_radius) or
                                not is_finite_number(next_radius) or
                                abs(next_radius-first_radius) > max(1e-6,abs(first_radius)*1e-6)):
                                break
                        j += 1

                    group_curves = []
                    run_point_count = (j - i) + 1

                    if run_type == 'Curve' and input_mode == 'point':
                        # A continuous Excel block of Entity Type = Curve is one
                        # horizontal curve.  Use Alignment Radius rather than
                        # merely fitting an arbitrary arc through the XY samples.
                        radius_values = []
                        for rr in clean_alignment_radii[i:j]:
                            if is_finite_number(rr):
                                radius_values.append(rr)

                        if not radius_values:
                            return (
                                "ERROR: Curve block at station {} to {} has no valid "
                                "Alignment Radius. The curve was not guessed."
                            ).format(clean_stations[i], clean_stations[j])

                        signed_alignment_radius = radius_values[0]
                        # A single curve block should carry one radius.  Allow only
                        # tiny spreadsheet rounding differences.
                        for rr in radius_values[1:]:
                            if abs(rr - signed_alignment_radius) > max(1e-6, abs(signed_alignment_radius) * 1e-6):
                                return (
                                    "ERROR: Curve block at station {} to {} contains "
                                    "multiple Alignment Radius values: {}"
                                ).format(clean_stations[i], clean_stations[j], radius_values)

                        sample_points = clean_pts[i + 1:j]
                        fitted_arc, radius_error = build_xy_alignment_radius_arc(
                            clean_pts[i], clean_pts[j], signed_alignment_radius, sample_points
                        )
                        if fitted_arc is None:
                            return (
                                "ERROR: Could not build XY curve at station {} to {} "
                                "from Alignment Radius {}: {}"
                            ).format(
                                clean_stations[i], clean_stations[j],
                                signed_alignment_radius, radius_error
                            )
                        group_curves.append(fitted_arc)

                    elif run_type == 'Curve' and run_point_count >= 3:
                        # Civil 3D entity-table fallback: retain the existing
                        # 3-point fit when no XY Alignment Radius column is involved.
                        start_point = clean_pts[i]
                        end_point = clean_pts[j]
                        mid_index = i + (j - i) // 2
                        middle_point = clean_pts[mid_index]
                        fitted_arc = None

                        try:
                            if (
                                middle_point.DistanceTo(start_point) < 1e-7 or
                                middle_point.DistanceTo(end_point) < 1e-7
                            ):
                                raise Exception("No distinct intermediate point for arc")
                            fitted_arc = Arc.Create(start_point, end_point, middle_point)
                        except Exception:
                            fitted_arc = None

                        if fitted_arc is not None:
                            group_curves.append(fitted_arc)
                        else:
                            for k in range(i, j):
                                group_curves.append(build_vertical_arc_or_line(k))

                    else:
                        for k in range(i, j):
                            group_curves.append(
                                build_vertical_arc_or_line(k)
                            )

                    group_station_start = clean_stations[i]
                    group_station_end = clean_stations[j]

                    sweep_groups.append((
                        run_type,
                        merge_collinear_lines(group_curves),
                        group_station_start,
                        group_station_end
                    ))

                    i = j

                # V2.71: use one continuous sweep for circular AND custom profiles.
                # Independent sweeps choose different section frames at bends;
                # an off-centre (top-aligned) section then leaves offset end faces.
                # Preserve the V2.69 curve/radius boundaries within the one path.
                if sweep_groups:
                    continuous_curves = [c for sg in sweep_groups for c in sg[1]]
                    for ci in range(len(continuous_curves) - 1):
                        gap = continuous_curves[ci].GetEndPoint(1).DistanceTo(
                            continuous_curves[ci + 1].GetEndPoint(0))
                        if gap > 1e-6:
                            raise RuntimeError(
                                "Cannot connect top-aligned duct: path gap after segment {} = {:.6f} mm."
                                .format(ci + 1, gap * 304.8))
                    if continuous_curves:
                        def _plan_normal(tangent):
                            length = math.hypot(tangent.X, tangent.Y)
                            if length < 1e-9:
                                return None
                            return (-tangent.Y / length, tangent.X / length)

                        def _tangent_at(curve, normalized_param):
                            return curve.ComputeDerivatives(normalized_param, True).BasisX

                        def offset_path_curves(curves, offset_ft, rise_ft=0.0):
                            """Offset a connected path sideways in plan; Z is kept.
                            Shared joints use one common point so the offset path stays
                            gap-free, and arcs are rebuilt through offset start/mid/end."""
                            joint_normals = []
                            for idx in range(len(curves) + 1):
                                normals = []
                                if idx > 0:
                                    nrm = _plan_normal(_tangent_at(curves[idx - 1], 1.0))
                                    if nrm is not None:
                                        normals.append(nrm)
                                if idx < len(curves):
                                    nrm = _plan_normal(_tangent_at(curves[idx], 0.0))
                                    if nrm is not None:
                                        normals.append(nrm)
                                if not normals:
                                    raise RuntimeError('Cannot offset a vertical path segment sideways.')
                                sx = sum(v[0] for v in normals)
                                sy = sum(v[1] for v in normals)
                                sl = math.hypot(sx, sy)
                                if sl < 1e-9:
                                    raise RuntimeError('Path reverses direction; cannot offset it.')
                                joint_normals.append((sx / sl, sy / sl))
                            joints = []
                            for idx in range(len(curves) + 1):
                                base = (curves[idx].GetEndPoint(0) if idx < len(curves)
                                        else curves[-1].GetEndPoint(1))
                                joints.append(XYZ(base.X + joint_normals[idx][0] * offset_ft,
                                                  base.Y + joint_normals[idx][1] * offset_ft,
                                                  base.Z + rise_ft))
                            result_curves = []
                            for idx, curve in enumerate(curves):
                                if isinstance(curve, Arc):
                                    mid_nrm = _plan_normal(_tangent_at(curve, 0.5))
                                    if mid_nrm is None:
                                        raise RuntimeError('Cannot offset a vertical arc sideways.')
                                    mid = curve.Evaluate(0.5, True)
                                    result_curves.append(Arc.Create(
                                        joints[idx], joints[idx + 1],
                                        XYZ(mid.X + mid_nrm[0] * offset_ft,
                                            mid.Y + mid_nrm[1] * offset_ft, mid.Z + rise_ft)))
                                else:
                                    result_curves.append(Line.CreateBound(joints[idx], joints[idx + 1]))
                            return result_curves

                        grid_list = ([(0.0, 0.0)] if current_route_is_com
                                     else resolve_grid_layout(grid_mode_in, diam_ft_raw,
                                                         grid_flat_pitch_in, grid_trefoil_pitch_in))
                        expanded_groups = []
                        for offset_mm, rise_mm in grid_list:
                            if abs(offset_mm) < 1e-9 and abs(rise_mm) < 1e-9:
                                path_curves = continuous_curves
                            else:
                                path_curves = offset_path_curves(
                                    continuous_curves, offset_mm / 304.8, rise_mm / 304.8)
                            expanded_groups.append((
                                'Continuous 3D Path (gridline {:+.0f} mm lateral, {:+.0f} mm up)'.format(offset_mm, rise_mm),
                                path_curves, sweep_groups[0][2], sweep_groups[-1][3]))
                        sweep_groups = expanded_groups

                tight_curve_warnings = []

                if not use_custom_profile:
                    for group_index, group_data in enumerate(sweep_groups):
                        segment_kind = group_data[0]
                        group_curves = group_data[1]
                        group_station_start = group_data[2]
                        group_station_end = group_data[3]

                        for curve in group_curves:
                            if (
                                isinstance(curve, Arc) and
                                curve.Radius <= radius_ft * 1.01
                            ):
                                tight_curve_warnings.append(
                                    (
                                        "group {} ({}, station {} to {}): "
                                        "arc radius {:.1f} mm is too tight "
                                        "for the {:.0f} mm duct diameter "
                                        "(needs to exceed {:.1f} mm)"
                                    ).format(
                                        group_index,
                                        segment_kind,
                                        group_station_start,
                                        group_station_end,
                                        curve.Radius * 304.8,
                                        diam_ft_raw,
                                        radius_ft * 304.8
                                    )
                                )

                if tight_curve_warnings:
                    result = (
                        "ERROR: path curve radius too tight "
                        "for the sweep profile:\n" +
                        "\n".join(tight_curve_warnings)
                    )

                else:
                    # The caller owns one atomic transaction for this run.

                    created_sweeps = []
                    sweep_failures = []

                    try:
                        for group_data in sweep_groups:
                            segment_kind = group_data[0]
                            curves_in_group = group_data[1]
                            group_station_start = group_data[2]
                            group_station_end = group_data[3]

                            ref_array = ReferenceArray()

                            for curve in curves_in_group:
                                curve_start = curve.GetEndPoint(0)

                                # The sketch plane must contain the curve.
                                if isinstance(curve, Arc):
                                    curve_plane = (
                                        Plane.CreateByNormalAndOrigin(
                                            curve.Normal,
                                            curve.Center
                                        )
                                    )

                                else:
                                    curve_end = curve.GetEndPoint(1)

                                    tangent = (
                                        curve_end
                                        .Subtract(curve_start)
                                        .Normalize()
                                    )

                                    helper = XYZ.BasisZ

                                    if abs(
                                        tangent.DotProduct(helper)
                                    ) > 0.99:
                                        helper = XYZ.BasisY

                                    plane_normal = (
                                        tangent
                                        .CrossProduct(helper)
                                        .Normalize()
                                    )

                                    curve_plane = (
                                        Plane.CreateByNormalAndOrigin(
                                            plane_normal,
                                            curve_start
                                        )
                                    )

                                sketch_plane = SketchPlane.Create(
                                    doc,
                                    curve_plane
                                )

                                model_curve = (
                                    doc.FamilyCreate.NewModelCurve(
                                        curve,
                                        sketch_plane
                                    )
                                )

                                ref_array.Append(
                                    model_curve.GeometryCurve.Reference
                                )

                            doc.Regenerate()

                            profile_index, up_x, up_y = top_profile_frame(
                                ref_array, curves_in_group, radius_ft)

                            if use_custom_profile:
                                sweep_profile = (
                                    doc.Application.Create
                                    .NewFamilySymbolProfile(profile_symbol)
                                )
                                sweep_profile.Angle = math.atan2(up_y, up_x) - math.pi / 2.0
                                sweep_profile.XOffset = custom_y_offset * up_x
                                sweep_profile.YOffset = custom_y_offset * up_y

                            else:
                                first_curve = curves_in_group[0]

                                # Project world-down into Revit's measured section frame.
                                profile_origin = XYZ(-radius_ft * up_x, -radius_ft * up_y, 0.0)

                                # NewSweep's SweepProfile must be built flat in the
                                # world XY-plane using the global X/Y axes - Revit
                                # transforms it onto the path automatically (via
                                # IndexOfPathReference and ProfilePlaneLocation).
                                # Building it pre-rotated to the group's own curve
                                # tangent (as before) double-applies that transform
                                # and throws "One of the conditions for the inputs
                                # was not satisfied." from FamilyItemFactory.NewSweep.
                                profile_x = XYZ.BasisX
                                profile_y = XYZ.BasisY

                                profile_curves = CurveArray()

                                profile_curves.Append(
                                    Arc.Create(
                                        profile_origin,
                                        radius_ft,
                                        0.0,
                                        math.pi,
                                        profile_x,
                                        profile_y
                                    )
                                )

                                profile_curves.Append(
                                    Arc.Create(
                                        profile_origin,
                                        radius_ft,
                                        math.pi,
                                        2.0 * math.pi,
                                        profile_x,
                                        profile_y
                                    )
                                )

                                profile_curve_arrays = CurveArrArray()
                                profile_curve_arrays.Append(
                                    profile_curves
                                )

                                sweep_profile = (
                                    doc.Application.Create
                                    .NewCurveLoopsProfile(
                                        profile_curve_arrays
                                    )
                                )

                            sweep = doc.FamilyCreate.NewSweep(
                                True,
                                ref_array,
                                sweep_profile,
                                profile_index,
                                ProfilePlaneLocation.Start
                            )

                            _created_sweep_ids.append(sweep.Id)
                            doc.Regenerate()
                            # Verify actual geometry, not only matching path endpoints.
                            solids = [g for g in sweep.get_Geometry(Options())
                                      if isinstance(g, Solid) and g.Volume > 0.0]
                            if len(solids) != 1:
                                raise RuntimeError(
                                    "The continuous duct did not produce one connected solid.")
                            created_sweeps.append((
                                segment_kind,
                                sweep,
                                group_station_start,
                                group_station_end
                            ))

                        if use_custom_profile:
                            size_parameter = profile_symbol.LookupParameter('Diameter')
                            has_diameter = (size_parameter is not None and
                                size_parameter.StorageType == StorageType.Double and
                                size_parameter.Definition.GetDataType() == SpecTypeId.Length)
                            if has_diameter:
                                mode_label = "profile family '{}', Diameter {:.6g}mm".format(
                                    profile_symbol.Family.Name, size_parameter.AsDouble() * 304.8)
                            else:
                                mode_label = ("profile family '{}', authored size retained "
                                    "(no Length type Diameter parameter; duct size input not applied)").format(
                                        profile_symbol.Family.Name)
                        else:
                            mode_label = (
                                "{:.0f}mm circular duct"
                                .format(diam_ft_raw)
                            )

                        # Revit-family verification report.  Check that every
                        # created Sweep still resolves in the active Family document,
                        # report ElementIds, segment counts and path continuity.
                        sweep_ids = []
                        missing_sweep_ids = []
                        line_count = 0
                        curve_count = 0
                        for created_data in created_sweeps:
                            kind = created_data[0]
                            sw = created_data[1]
                            sid = sw.Id
                            try:
                                sid_value = sid.Value
                            except Exception:
                                sid_value = sid.IntegerValue
                            sweep_ids.append(str(sid_value))
                            if doc.GetElement(sid) is None:
                                missing_sweep_ids.append(str(sid_value))

                        continuity_issues = []
                        path_curves_flat = []
                        group_boundaries = set()
                        for sg in sweep_groups:
                            for cc in sg[1]:
                                path_curves_flat.append(cc)
                                if isinstance(cc, Line):
                                    line_count += 1
                                else:
                                    curve_count += 1
                            group_boundaries.add(len(path_curves_flat) - 1)
                        for ci in range(len(path_curves_flat) - 1):
                            if ci in group_boundaries:
                                continue
                            gap_ft = path_curves_flat[ci].GetEndPoint(1).DistanceTo(
                                path_curves_flat[ci + 1].GetEndPoint(0)
                            )
                            if gap_ft > tol_ft:
                                continuity_issues.append(
                                    "gap after path segment {} = {:.3f} mm".format(
                                        ci + 1, gap_ft * 304.8
                                    )
                                )

                        xy_radius_notes = []
                        if input_mode == 'point':
                            seen = []
                            for rr in clean_alignment_radii:
                                if is_finite_number(rr):
                                    if not [x for x in seen if abs(rr - x) <= max(1e-6, abs(x) * 1e-6)]:
                                        seen.append(rr)
                            if seen:
                                xy_radius_notes.append(
                                    "Alignment Radius values used/detected: {}".format(
                                        ", ".join(["{:.6g}".format(x) for x in seen])
                                    )
                                )
                            if xy_curve_block_notes:
                                xy_radius_notes.append(
                                    "XY source blocks (may contain multiple bends): " +
                                    " ; ".join(xy_curve_block_notes)
                                )

                        check_status = "PASS"
                        check_details = []
                        if missing_sweep_ids:
                            check_status = "FAIL"
                            check_details.append(
                                "missing Revit sweep element(s): {}".format(
                                    ", ".join(missing_sweep_ids)
                                )
                            )
                        if continuity_issues:
                            check_status = "WARNING" if check_status == "PASS" else check_status
                            check_details.extend(continuity_issues)

                        result = (
                            "Successfully created {} continuous sweeps using {}. Top of profile aligned to sweep path.\n"
                            "Revit family check: {}. Lines: {}, Curves: {}.\n"
                            "Sweep Element IDs: {}{}{}{}{}"
                        ).format(
                            len(created_sweeps),
                            mode_label,
                            check_status,
                            line_count,
                            curve_count,
                            ", ".join(sweep_ids) if sweep_ids else "none",
                            ("\n" + "\n".join(xy_radius_notes)) if xy_radius_notes else "",
                            ("\nCheck details: " + "; ".join(check_details)) if check_details else "",
                            profile_fallback_note,
                            origin_unit_note
                        )

                    except Exception as ex:
                        raise RuntimeError("Sweep failed at station {} to {} ({}): {}".format(
                            group_station_start, group_station_end, segment_kind, str(ex)))

                    finally:
                        pass  # Commit only after all groups regenerate successfully.

                    if created_sweeps:
                        try:
                            for warning in doc.GetWarnings():
                                failing_ids = list(
                                    warning.GetFailingElements()
                                )

                                for created_data in created_sweeps:
                                    segment_kind = created_data[0]
                                    sweep = created_data[1]
                                    station_start = created_data[2]
                                    station_end = created_data[3]

                                    if sweep.Id in failing_ids:
                                        sweep_failures.append(
                                            (
                                                "station {} to {} "
                                                "({}, element id {}): {}"
                                            ).format(
                                                station_start,
                                                station_end,
                                                segment_kind,
                                                sweep.Id.Value,
                                                warning.GetDescriptionText()
                                            )
                                        )

                        except Exception as warning_exception:
                            sweep_failures.append(
                                (
                                    "Could not check post-commit "
                                    "warnings: {}"
                                ).format(str(warning_exception))
                            )

                        if sweep_failures:
                            result = (
                                "Created {} sweep(s), but {} failed "
                                "Revit's regeneration check:\n{}"
                            ).format(
                                len(created_sweeps),
                                len(sweep_failures),
                                "\n".join(sweep_failures)
                            )
    return result

def execute_atomic():
    if doc is None or not doc.IsFamilyDocument:
        return "ERROR: Open a 3D family supporting sweeps (for example Generic Model) in Family Editor."
    sub = None
    try:
        TransactionManager.Instance.EnsureInTransaction(doc)
        sub = SubTransaction(doc)
        sub.Start()
        message = run_sweeps()
        if str(message).startswith("ERROR:"):
            sub.RollBack()
            return message
        doc.Regenerate()
        if sub.Commit() != TransactionStatus.Committed:
            raise RuntimeError("Revit did not commit the sweep changes.")
        # A SubTransaction commit does not run Revit's final sweep validation.
        # Finish the owning Dynamo transaction for THIS route before reporting
        # success or starting the next batch route.
        TransactionManager.Instance.ForceCloseTransaction()
        if not _created_sweep_ids:
            return "ERROR: No sweep was retained for this route."
        for sweep_id in _created_sweep_ids:
            retained = doc.GetElement(sweep_id)
            if retained is None or not isinstance(retained, Sweep):
                return "ERROR: Revit rejected the sweep at final commit; no sweep retained for this route."
        return message + "\nFinal Revit transaction committed; sweep elements verified."
    except Exception as ex:
        if sub is not None and sub.GetStatus() == TransactionStatus.Started:
            sub.RollBack()
        return "ERROR: Sweep run rolled back; no new sweep geometry retained. {}".format(ex)
    finally:
        TransactionManager.Instance.TransactionTaskDone()


def _decode_batch_packet(value, depth=0):
    import json
    if depth > 8:
        return None
    if isinstance(value, dict):
        return value if 'batch_version' in value else None
    if isinstance(value, str):
        text = value.strip()
        if not text.startswith(('{', '[')):
            return None
        try:
            decoded = json.loads(text)
        except Exception:
            # A Dynamo wrapper can be a Python-list representation with None.
            try:
                decoded = ast.literal_eval(text)
            except Exception:
                if 'batch_version' in text:
                    raise ValueError('The report batch is damaged; reselect the report files.')
                return None
        return _decode_batch_packet(decoded, depth+1)
    if isinstance(value, (list, tuple)):
        packets = []
        for child in value:
            packet = _decode_batch_packet(child, depth+1)
            if packet is not None:
                packets.append(packet)
        if len(packets) > 1:
            raise ValueError('More than one batch packet reached the sweep node.')
        return packets[0] if packets else None
    return None


def execute_batch_or_single():
    global data, data2, global_origin_in, origin_unit_in
    global diameter_mm, use_custom_profile_in, profile_rfa_path_in
    import json
    try:
        packet = _decode_batch_packet(data)
        if packet is None:
            packet = _decode_batch_packet(data2)
    except ValueError as ex:
        return "ERROR: " + str(ex)
    if packet is None:
        return execute_atomic()
    if not isinstance(packet, dict) or packet.get('batch_version') != 1:
        return "ERROR: Unrecognised report selection."
    if packet.get('error'):
        return "ERROR: " + packet['error']
    pairs = packet.get('pairs', [])
    if not pairs:
        return "ERROR: No XY/Z report pairs selected."
    # Check every table before starting any Revit transaction.
    for pair in pairs:
        if _header_kind(pair.get('xy')) != 'xy' or _header_kind(pair.get('z')) != 'z':
            return "ERROR: Missing XY/Z table for " + pair.get('name', 'unknown route')
    # Reject a selected invalid file before creating any route.
    for pair in pairs:
        is_com = 'com' in str(pair.get('name', '')).lower()
        selected = com_profile_path if is_com else profile_rfa_path_in
        enabled = com_use_custom_profile if is_com else use_custom_profile_in
        if enabled and str(selected) != BUILT_IN_PROFILE:
            if not selected or not str(selected).lower().endswith('.rfa') or not os.path.isfile(str(selected)):
                return ('ERROR: {} optional family node contains an invalid file: {!r}. '
                        'Browse to an existing .rfa, or set Use custom profile to False for the built-in circle. Route: {}').format(
                            'COM' if is_com else 'DUCT', selected, pair.get('name', 'route'))
    # Both custom profiles and generated circles follow the diameter inputs.
    if any('com' not in str(pair.get('name', '')).lower() for pair in pairs):
        if not is_finite_number(to_float(diameter_mm)) or to_float(diameter_mm) <= 0:
            return 'ERROR: Set standard duct diameter (mm) to a positive size.'
    # Validate the alternate settings before creating any routes.
    if any('com' in str(pair.get('name', '')).lower() for pair in pairs):
        if com_use_custom_profile:
            if str(com_profile_path) != BUILT_IN_PROFILE and (not com_profile_path or not os.path.isfile(str(com_profile_path)) or not str(com_profile_path).lower().endswith('.rfa')):
                return 'ERROR: Select an existing Com custom profile .rfa file.'
        if not is_finite_number(to_float(com_diameter_mm)) or to_float(com_diameter_mm) <= 0:
            return 'ERROR: Set Com duct diameter (mm) to a positive size, including when using a Com custom profile.'
    saved = data, data2, global_origin_in, origin_unit_in
    saved_profile = diameter_mm, use_custom_profile_in, profile_rfa_path_in
    origin_note = 'Using the supplied horizontal origin; imported elevations retained relative to family Z=0 (Ref. Level).' 
    try:
        if not use_true_coords and parse_global_origin(global_origin_in) is None:
            # All routes must share one origin, not each move to its own zero.
            table = pairs[0]['xy']
            header_index = next(i for i,row in enumerate(table) if isinstance(row,list) and 'point index' in [str(x).strip().lower() for x in row])
            headers = [str(x).strip().lower() for x in table[header_index]]
            indices = [headers.index(k) for k in ('easting','northing','elevation')]
            common = None
            for row in table[header_index+1:]:
                if len(row) <= max(indices):
                    continue
                values = [to_float(row[i]) for i in indices]
                if all(is_finite_number(v) for v in values):
                    common = [values[0], values[1], 0.0]
                    break
            if common is None:
                return 'ERROR: Supply a common origin or include numeric XY elevations in the first report.'
            global_origin_in = common
            origin_unit_in = 'M'
            origin_note = 'Shared horizontal origin (E,N metres): ' + str(common[:2]) + '; imported elevations retained relative to family Z=0 (Ref. Level).' 
        elif use_true_coords:
            origin_note = 'Using true coordinates for all routes.'
        results = []
        for pair in pairs:
            data, data2 = pair['xy'], pair['z']
            is_com = 'com' in str(pair.get('name', '')).lower()
            diameter_mm, use_custom_profile_in, profile_rfa_path_in = (
                (com_diameter_mm, com_use_custom_profile, com_profile_path)
                if is_com else saved_profile)
            global current_route_is_com
            current_route_is_com = is_com
            message = execute_atomic()
            message = ('[Com profile] ' if is_com else '[Standard profile] ') + str(message)
            results.append({'route':pair['name'], 'folder':pair['folder'], 'result':message})
        return [origin_note, results]
    finally:
        data, data2, global_origin_in, origin_unit_in = saved
        diameter_mm, use_custom_profile_in, profile_rfa_path_in = saved_profile

OUT = execute_batch_or_single()
# ----------------------------------------

watch = Watch(create_sweeps_for_every_xy_z)
python_script = Python(IN[0]=built_in_circular_profile_no, Use_custom_profile=duct_use_custom_profile_true)  # CPython3
# ---------- python_script.python (1 lines) ----------
OUT = 'Use custom profile is True: choose the DUCT Browse profile family node.' if len(IN) > 1 and bool(IN[1]) else 'Use custom profile is False: built-in circular family selected.'
# ----------------------------------------
watch_2 = Watch(python_script)

# group: Option Here_BATCH LOAD PROFILES FROM FOLDER
paste_family_here_check_their = StringInput("C:\Users\Conor.mcenery\Documents\15.0 DYN\Profile_1")  # "Paste Family here_Check their correct Version"
leave_false_to_skip_families = BoolSelector(false)  # "Leave False to skip families already loaded by name;"
python_script_2 = Python(IN[0]=paste_family_here_check_their, IN[1]=leave_false_to_skip_families)  # CPython3
# ---------- python_script_2.python (85 lines) ----------
import clr
clr.AddReference('RevitAPI')
clr.AddReference('RevitServices')
from RevitServices.Persistence import DocumentManager
from RevitServices.Transactions import TransactionManager
from Autodesk.Revit.DB import *
import os

doc = DocumentManager.Instance.CurrentDBDocument

# --- Inputs ---
folder_path = IN[0] if len(IN) > 0 else None      # Folder containing .rfa profile families
overwrite_existing = IN[1] if len(IN) > 1 else False  # Reload+overwrite if a family with the same name already exists

results = []  # one status string per file, in the order processed
loaded_names = []
failed_names = []


if not doc.IsFamilyDocument:
    OUT = "ERROR: Open a Family Editor document before running this script."
elif not folder_path:
    OUT = "ERROR: No folder path supplied in IN[0]."
elif not os.path.isdir(str(folder_path)):
    OUT = "ERROR: '{}' is not a valid folder.".format(folder_path)
else:
    folder_path = str(folder_path)
    rfa_files = sorted(
        f for f in os.listdir(folder_path)
        if f.lower().endswith('.rfa') and not f.startswith('~')
    )

    if not rfa_files:
        OUT = "No .rfa files found in '{}'.".format(folder_path)
    else:
        TransactionManager.Instance.EnsureInTransaction(doc)
        try:
            for fname in rfa_files:
                full_path = os.path.join(folder_path, fname)
                family_name = os.path.splitext(fname)[0]

                already_loaded = any(
                    fam.Name == family_name
                    for fam in FilteredElementCollector(doc).OfClass(Family)
                )
                if already_loaded and not overwrite_existing:
                    results.append("{} - skipped (already loaded)".format(fname))
                    loaded_names.append(family_name)
                    continue

                try:
                    raw_result = doc.LoadFamily(full_path)
                    if isinstance(raw_result, tuple):
                        loaded_ok = raw_result[0]
                        loaded_family = raw_result[1] if len(raw_result) > 1 else None
                    else:
                        loaded_ok = bool(raw_result)
                        loaded_family = None
                    if loaded_ok and loaded_family is None:
                        # CPython3's LoadFamily(path) overload only returns the bool, not
                        # the Family object, so look up the family Revit just loaded by name.
                        _fam_name = os.path.splitext(os.path.basename(str(full_path)))[0]
                        for _fam in FilteredElementCollector(doc).OfClass(Family):
                            if _fam.Name == _fam_name:
                                loaded_family = _fam
                                break
                    if loaded_ok and loaded_family is not None:
                        results.append("{} - loaded OK".format(fname))
                        loaded_names.append(loaded_family.Name)
                    else:
                        results.append("{} - LoadFamily returned false".format(fname))
                        failed_names.append(fname)
                except Exception as ex:
                    results.append("{} - FAILED: {}".format(fname, str(ex)))
                    failed_names.append(fname)
        finally:
            TransactionManager.Instance.TransactionTaskDone()

        summary = "Loaded {}/{} profile families from '{}'.".format(
            len(loaded_names), len(rfa_files), folder_path
        )
        if failed_names:
            summary += " Failed: {}".format(", ".join(failed_names))

        OUT = [summary, results, loaded_names]
# ----------------------------------------
