# Dynamo graph 3.1 Export_Sheets_to_PDF_V6_With_Help_Note.dyn "Export_Sheets_to_PDF" (Dynamo 2.19.3.6394)
# HELP - EXPORT SELECTED SHEETS TO PDF
# 1. Click RUN.
# 2. Select the Revit sheets you want to export.
# 3. Click Continue.
# 4. Choose the folder where the PDF files will be saved.
# 5. The selected sheets will export automatically.
# If you cancel the sheet selection or folder selection, no PDFs will be exported.

filename_pattern = StringInput("{SheetNumber}_{SheetName}_{Revision}")
select_sheets = Python()  # CPython3
# ---------- select_sheets.python (97 lines) ----------
import clr
clr.AddReference('RevitAPI')
clr.AddReference('RevitServices')
clr.AddReference('System.Windows.Forms')
clr.AddReference('System.Drawing')

from Autodesk.Revit.DB import *
from RevitServices.Persistence import DocumentManager
import System.Windows.Forms as WinForms

doc = DocumentManager.Instance.CurrentDBDocument

collector = FilteredElementCollector(doc).OfClass(ViewSheet)
sheets = sorted([s for s in collector if not s.IsPlaceholder], key=lambda s: s.SheetNumber)

form = WinForms.Form()
form.Text = "Select Sheets to Export"
form.Width = 560
form.Height = 640
form.StartPosition = WinForms.FormStartPosition.CenterScreen
form.TopMost = True

label = WinForms.Label()
label.Text = "Tick the sheets to export, then click Continue."
label.Left = 10
label.Top = 10
label.Width = 510
form.Controls.Add(label)

checklist = WinForms.CheckedListBox()
checklist.Left = 10
checklist.Top = 35
checklist.Width = 520
checklist.Height = 500
checklist.CheckOnClick = True
for s in sheets:
    checklist.Items.Add("{0} - {1}".format(s.SheetNumber, s.Name), True)
form.Controls.Add(checklist)

btn_ok = WinForms.Button()
btn_ok.Text = "Continue"
btn_ok.Left = 340
btn_ok.Top = 545
btn_ok.Width = 90
btn_ok.DialogResult = WinForms.DialogResult.OK
form.Controls.Add(btn_ok)

btn_cancel = WinForms.Button()
btn_cancel.Text = "Cancel"
btn_cancel.Left = 440
btn_cancel.Top = 545
btn_cancel.Width = 90
btn_cancel.DialogResult = WinForms.DialogResult.Cancel
form.Controls.Add(btn_cancel)

# Native dialog results avoid Python click-handler delegates in CPython3.
btn_uncheck = WinForms.Button()
btn_uncheck.Text = "Uncheck All"
btn_uncheck.Left = 10
btn_uncheck.Top = 545
btn_uncheck.Width = 100
btn_uncheck.DialogResult = WinForms.DialogResult.Retry
form.Controls.Add(btn_uncheck)

btn_check = WinForms.Button()
btn_check.Text = "Check All"
btn_check.Left = 120
btn_check.Top = 545
btn_check.Width = 100
btn_check.DialogResult = WinForms.DialogResult.Ignore
form.Controls.Add(btn_check)

form.AcceptButton = btn_ok
form.CancelButton = btn_cancel
# Redisplay the same form after bulk selection, retaining all sheet states.
while True:
    form.DialogResult = getattr(WinForms.DialogResult, "None")
    result = form.ShowDialog()
    if result == WinForms.DialogResult.Retry or result == WinForms.DialogResult.Ignore:
        checked = result == WinForms.DialogResult.Ignore
        checklist.BeginUpdate()
        try:
            for i in range(checklist.Items.Count):
                checklist.SetItemChecked(i, checked)
        finally:
            checklist.EndUpdate()
    else:
        break

selected_sheets = []

if result == WinForms.DialogResult.OK:
    for i in range(checklist.Items.Count):
        if checklist.GetItemChecked(i):
            selected_sheets.append(sheets[i])

OUT = selected_sheets
# ----------------------------------------
export_sheets_to_pdf = Python(IN[1]=filename_pattern, IN[2]=select_sheets)  # CPython3; unwired: IN[0]
# ---------- export_sheets_to_pdf.python (102 lines) ----------
import clr
clr.AddReference('RevitAPI')
clr.AddReference('RevitServices')
clr.AddReference('System.Windows.Forms')

from Autodesk.Revit.DB import *
from RevitServices.Persistence import DocumentManager
from System.Collections.Generic import List
import System.Windows.Forms as WinForms
import re

doc = DocumentManager.Instance.CurrentDBDocument

export_folder = None
name_pattern  = IN[1]      # e.g. "{SheetNumber}_{SheetName}_{Revision}"

import System

def sanitize(text):
    return re.sub(r'[\\/:*?"<>|]', '-', text)

def clean_separators(text):
    # collapse runs of separator-like characters (space, underscore, hyphen)
    # left behind by empty tokens (e.g. blank Revision) into a single one
    text = re.sub(r'[ _\\-]{2,}', lambda m: m.group(0)[0], text)
    # trim leading/trailing separators
    return text.strip(' _-')

# Sheets to export come from IN[2] (output of the sheet-selection node)
sheets = IN[2]

results = []
errors = []

# Ask for destination only after sheets have been selected.
if sheets:
    folder_dialog = WinForms.FolderBrowserDialog()
    folder_dialog.Description = "Select folder to save exported PDF sheets"
    folder_dialog.ShowNewFolderButton = True
    folder_result = folder_dialog.ShowDialog()
    if folder_result == WinForms.DialogResult.OK and folder_dialog.SelectedPath:
        export_folder = folder_dialog.SelectedPath
        if not System.IO.Directory.Exists(export_folder):
            System.IO.Directory.CreateDirectory(export_folder)
    else:
        errors.append("Export cancelled - no save folder selected.")

if not sheets:
    errors.append("No sheets selected (dialog cancelled or nothing checked).")
elif not export_folder:
    pass
else:
    options = PDFExportOptions()
    options.Combine = True  # required so FileName is actually used per sheet

    for sheet in sheets:
        try:
            # Dynamo may wrap ViewSheet objects when passing between Python nodes.
            # Convert the selected item back to the native Autodesk.Revit.DB.ViewSheet.
            native_sheet = sheet
            try:
                native_sheet = UnwrapElement(sheet)
            except:
                pass

            # Extra fallback for wrappers that UnwrapElement does not resolve.
            if not isinstance(native_sheet, ViewSheet):
                try:
                    sid = sheet.Id
                    if isinstance(sid, ElementId):
                        native_sheet = doc.GetElement(sid)
                    else:
                        native_sheet = doc.GetElement(ElementId(int(sid)))
                except:
                    native_sheet = None

            if native_sheet is None or not isinstance(native_sheet, ViewSheet):
                raise Exception("Selected sheet could not be converted to a native Revit ViewSheet")

            number = native_sheet.SheetNumber
            name = native_sheet.Name
            rev_param = native_sheet.get_Parameter(BuiltInParameter.SHEET_CURRENT_REVISION)
            revision = rev_param.AsString() if rev_param else ""
            revision = revision or ""

            filename = name_pattern
            filename = filename.replace("{SheetNumber}", number)
            filename = filename.replace("{SheetName}", name)
            filename = filename.replace("{Revision}", revision)
            filename = clean_separators(filename)
            filename = sanitize(filename)

            options.FileName = filename
            view_ids = List[ElementId]()
            view_ids.Add(native_sheet.Id)

            doc.Export(export_folder, view_ids, options)
            results.append(filename + ".pdf")
        except Exception as e:
            errors.append("{0}: {1}".format(getattr(sheet, "SheetNumber", "Sheet"), str(e)))

OUT = results, errors
# ----------------------------------------
results_errors = Watch(export_sheets_to_pdf)
help_instructions = NoteModel(Text="""HELP - EXPORT SELECTED SHEETS TO PDF

1. Click RUN.
2. Select the Revit sheets you want to export.
3. Click Continue.
4. Choose the folder where the PDF files will be saved.
5. The selected sheets will export automatically.

If you cancel the sheet selection or folder selection, no PDFs will be exported.""", X=50, Y=650, FontSize=18)
