# Dynamo graph 4.0 Export_Sheets_to_DWG.dyn (Dynamo 2.19.3.6394)

# note: By Conor McEnery - 2026-08-14
# Just Run, Select the Sheet, then select folder. all view are bind in the one DWG file and are in model/page Space.
select_export_sheets_to_dwg = Python()  # CPython3
# ---------- select_export_sheets_to_dwg.python (135 lines) ----------
import clr
clr.AddReference('RevitAPI')
clr.AddReference('RevitServices')
clr.AddReference('System.Windows.Forms')
clr.AddReference('System.Drawing')

import os
import Autodesk.Revit.DB as DB
from RevitServices.Persistence import DocumentManager
from System.Collections.Generic import List
from System.Windows.Forms import Form, CheckedListBox, Button, FormStartPosition, DockStyle, DialogResult, FolderBrowserDialog, FlowLayoutPanel

doc = DocumentManager.Instance.CurrentDBDocument

all_sheets = list(DB.FilteredElementCollector(doc).OfClass(DB.ViewSheet).ToElements())
all_sheets.sort(key=lambda s: s.SheetNumber)
labels = ["%s - %s" % (s.SheetNumber, s.Name) for s in all_sheets]

# --- Window 1: pick sheets ---
sheet_form = Form()
sheet_form.Text = "Select sheets to export to DWG"
sheet_form.Width = 480
sheet_form.Height = 560
sheet_form.StartPosition = FormStartPosition.CenterScreen
sheet_form.TopMost = True

clb = CheckedListBox()
clb.Dock = DockStyle.Top
clb.Height = 420
clb.CheckOnClick = True
for lbl in labels:
    clb.Items.Add(lbl)
sheet_form.Controls.Add(clb)

# DialogResult on the button closes the form without needing a Python
# event-handler delegate (Dynamo's CPython3/pythonnet engine cannot build
# one at runtime - it throws "Constructor on type 'TypeBuilder' not found").
next_btn = Button()
next_btn.Text = "Next: Choose Save Folder"
next_btn.Dock = DockStyle.Bottom
next_btn.Height = 40
next_btn.DialogResult = DialogResult.OK
sheet_form.Controls.Add(next_btn)
sheet_form.AcceptButton = next_btn

# Native dialog results avoid Python event delegates in CPython3/pythonnet.
# Bulk actions return to this loop and redisplay the same form and checklist.
selection_buttons = FlowLayoutPanel()
selection_buttons.Dock = DockStyle.Bottom
selection_buttons.Height = 36

uncheck_btn = Button()
uncheck_btn.Text = "Uncheck All"
uncheck_btn.Width = 110
uncheck_btn.DialogResult = DialogResult.Retry
selection_buttons.Controls.Add(uncheck_btn)

check_btn = Button()
check_btn.Text = "Check All"
check_btn.Width = 110
check_btn.DialogResult = DialogResult.Ignore
selection_buttons.Controls.Add(check_btn)

cancel_btn = Button()
cancel_btn.Text = "Cancel"
cancel_btn.Width = 110
cancel_btn.DialogResult = DialogResult.Cancel
selection_buttons.Controls.Add(cancel_btn)
sheet_form.Controls.Add(selection_buttons)
sheet_form.CancelButton = cancel_btn

while True:
    sheet_form.DialogResult = getattr(DialogResult, "None")
    sheet_dialog_result = sheet_form.ShowDialog()
    if sheet_dialog_result == DialogResult.Retry or sheet_dialog_result == DialogResult.Ignore:
        checked = sheet_dialog_result == DialogResult.Ignore
        clb.BeginUpdate()
        try:
            for i in range(clb.Items.Count):
                clb.SetItemChecked(i, checked)
        finally:
            clb.EndUpdate()
    else:
        break

results = []
if sheet_dialog_result != DialogResult.OK:
    results = ["Cancelled - no sheets exported"]
else:
    chosen_sheets = [all_sheets[i] for i in list(clb.CheckedIndices)]

    if len(chosen_sheets) == 0:
        results = ["No sheets checked - nothing exported"]
    else:
        # --- Window 2: pick save folder ---
        folder_dialog = FolderBrowserDialog()
        folder_dialog.Description = "Choose folder to save the DWG files"
        folder_dialog.ShowNewFolderButton = True

        folder_dialog_result = folder_dialog.ShowDialog()
        folder = folder_dialog.SelectedPath

        # FolderBrowserDialog can return DialogResult.OK with an empty
        # SelectedPath if OK is clicked without ever highlighting a folder
        # node in the tree - guard against that and against a folder that
        # no longer exists (create it) before handing the path to Export.
        folder_ok = False
        if folder_dialog_result != DialogResult.OK or not folder:
            results = ["Cancelled - no folder chosen, no sheets exported"]
        elif os.path.isdir(folder):
            folder_ok = True
        else:
            try:
                os.makedirs(folder)
                folder_ok = True
            except Exception as e:
                results = ["Could not use folder '%s': %s" % (folder, e)]

        if folder_ok:
            opts = DB.DWGExportOptions()
            opts.TargetUnit = DB.ExportUnit.Millimeter
            opts.SharedCoords = False
            opts.MergedViews = True
            opts.FileVersion = DB.ACADVersion.Default

            invalid_chars = '\\/:*?"<>|'

            for s in chosen_sheets:
                ids = List[DB.ElementId]([s.Id])
                safe_name = "".join(c for c in s.Name if c not in invalid_chars)
                fname = "%s - %s" % (s.SheetNumber, safe_name)
                ok = doc.Export(folder, fname, ids, opts)
                results.append("%s -> %s" % (fname, ok))

OUT = results
# ----------------------------------------
watch = Watch(select_export_sheets_to_dwg)
