# Dynamo graph C1.0 PolylineToAlignment_V1.8.dyn "C1.0 PolylineToAlignment V1.8 MAJOR7 MINOR1 SAFE" (Dynamo 3.7.0.11777)
# Cleaned Polyline-to-Alignment Dynamo graph for Civil 3D.
# packages: DynamoIronPython2.7 3.2.1

alignment_Style = StringInput("MWP GRID ALIGNMENT")
major_Chainage_Style = StringInput("MWP - Perpendicular with Tick")  # graph input
minor_Chainage_Style = StringInput("Tick")  # graph input
curve_Radius = DoubleInput(12)  # graph input
polyline_to_alignment = Python(IN[0]=alignment_Style, IN[1]=major_Chainage_Style, IN[2]=minor_Chainage_Style, IN[3]=curve_Radius)  # IronPython2
# ---------- polyline_to_alignment.python (364 lines) ----------
# PolylineToAlignment V1.8 SAFE - Major tick 7mm / Minor tick style 1mm
# Dynamo for Civil 3D | IronPython 2

import sys
import clr

clr.AddReference('AcMgd')
clr.AddReference('AcDbMgd')
clr.AddReference('AcCoreMgd')
clr.AddReference('AeccDbMgd')

import Autodesk.AutoCAD.ApplicationServices as AcAppServ
import Autodesk.AutoCAD.DatabaseServices as AcDb
import Autodesk.AutoCAD.EditorInput as AcEd
import Autodesk.Civil.ApplicationServices as CivAppServ
import Autodesk.Civil.DatabaseServices as CivDb
import Autodesk.Civil.DatabaseServices.Styles as CivStyles

# -----------------------------------------------------------------------------
# INPUTS
# -----------------------------------------------------------------------------
alignmentStyleName = IN[0] if len(IN) > 0 else None
majorLabelStyleName = IN[1] if len(IN) > 1 else None
minorLabelStyleName = IN[2] if len(IN) > 2 else None
curveRadius = IN[3] if len(IN) > 3 else 0.0

# Settings
ERASE_SOURCE_POLYLINE = False
ADD_CURVES_DURING_CONVERSION = False
MAJOR_STATION_INCREMENT = 10.0
MINOR_STATION_INCREMENT = 1.0
DEFAULT_ALIGNMENT_NAME = 'Alignment-1'


def get_or_create_alignment_style_id(style_collection, requested_name):
    # Alignment styles can be created normally if missing.
    if requested_name:
        name = str(requested_name).strip()
        if name:
            try:
                return style_collection[name], 'existing'
            except:
                pass
            try:
                return style_collection.Add(name), 'created'
            except:
                pass
    return (style_collection[0], 'fallback') if style_collection.Count else (AcDb.ObjectId.Null, 'fallback')


def clone_label_style_safely(style_collection, requested_name, transaction):
    """Use an existing native label style or clone a native sibling.
    Never creates a blank LabelStyle. This avoids unstable/incomplete styles.
    """
    name = str(requested_name).strip() if requested_name else 'MWP - Perpendicular with Tick'
    safe_name = name + '_SAFE'

    # Always prefer our known-safe cloned style on repeat runs.
    try:
        sid = style_collection[safe_name]
        if not sid.IsNull:
            return sid, 'existing-safe'
    except:
        pass

    if style_collection.Count == 0:
        return AcDb.ObjectId.Null, 'no-base-style'

    # Pick a native existing style as the template. Avoid the style created by older scripts.
    base_id = AcDb.ObjectId.Null
    for i in range(style_collection.Count):
        sid = style_collection[i]
        try:
            st = transaction.GetObject(sid, AcDb.OpenMode.ForRead)
            nm = st.Name
            if nm != name and not nm.endswith('_SAFE'):
                base_id = sid
                break
        except:
            pass
    if base_id.IsNull:
        base_id = style_collection[0]

    base_style = transaction.GetObject(base_id, AcDb.OpenMode.ForRead)
    new_id = base_style.CopyAsSibling(safe_name)
    return new_id, 'cloned-native'


def configure_major_station_style_safe(style_id, transaction):
    """Modify only a native cloned Major Station label style.
    Existing component objects are reused where possible.
    """
    notes = []
    if style_id.IsNull:
        return notes
    style = transaction.GetObject(style_id, AcDb.OpenMode.ForWrite)
    try: style.Description = 'MWP safe major station style - cloned from native Civil 3D style.'
    except: pass

    # Text: reuse first native text component; add only if the native style has none.
    try:
        ids = style.GetComponents(CivStyles.LabelStyleComponentType.Text)
        if ids.Count == 0:
            style.AddComponent('Major Station', CivStyles.LabelStyleComponentType.Text)
            ids = style.GetComponents(CivStyles.LabelStyleComponentType.Text)
        txt = transaction.GetObject(ids[0], AcDb.OpenMode.ForWrite)
        try: txt.General.Name.Value = 'Major Station'
        except: pass
        try: txt.General.Visible.Value = True
        except: pass
        try: txt.Text.Contents.Value = '<[Chainage Value(Um|FS|P0|RN|AP|Sn|TN|B1|EN|W0|OF)]>'
        except Exception as ex: notes.append('contents: ' + str(ex))
        try: txt.Text.Height.Value = 0.0025
        except Exception as ex: notes.append('height: ' + str(ex))
        try: txt.Text.Angle.Value = 4.71238898038469
        except Exception as ex: notes.append('angle: ' + str(ex))
        try: txt.Text.XOffset.Value = 0.0
        except: pass
        try: txt.Text.YOffset.Value = -0.005
        except Exception as ex: notes.append('Y offset: ' + str(ex))
    except Exception as ex:
        notes.append('text component: ' + str(ex))

    # Tick: reuse native tick component if present.
    try:
        ids = style.GetComponents(CivStyles.LabelStyleComponentType.Tick)
        if ids.Count == 0:
            style.AddComponent('MWP_Tick', CivStyles.LabelStyleComponentType.Tick)
            ids = style.GetComponents(CivStyles.LabelStyleComponentType.Tick)
        tick = transaction.GetObject(ids[0], AcDb.OpenMode.ForWrite)
        try: tick.General.Name.Value = 'MWP_Tick'
        except: pass
        try: tick.General.Visible.Value = True
        except: pass
        try: tick.Tick.BlockName.Value = 'AeccTickLine'
        except Exception as ex: notes.append('tick block: ' + str(ex))
        try: tick.Tick.BlockHeight.Value = 0.007
        except Exception as ex: notes.append('major tick height: ' + str(ex))
        try: tick.Tick.RotationAngle.Value = 0.0
        except: pass
        try: tick.Tick.AlignWithObject.Value = True
        except Exception as ex: notes.append('tick align: ' + str(ex))
    except Exception as ex:
        notes.append('tick component: ' + str(ex))
    return notes

def remove_station_label_groups(alignment, transaction):
    """Remove existing major/minor station groups inherited from label set."""
    ids_to_erase = []

    for group_id in alignment.GetLabelGroupIds():
        group = transaction.GetObject(group_id, AcDb.OpenMode.ForRead)
        if (isinstance(group, CivDb.AlignmentStationLabelGroup) or
                isinstance(group, CivDb.AlignmentMinorStationLabelGroup)):
            ids_to_erase.append(group_id)

    for group_id in ids_to_erase:
        transaction.GetObject(group_id, AcDb.OpenMode.ForWrite).Erase()


def add_radius_curves(alignment, radius):
    """Insert a free curve at each remaining Line-Line PI."""
    warnings = []

    if not radius or float(radius) <= 0.0:
        return warnings

    failed_pairs = set()
    max_iterations = 200

    for _ in range(max_iterations):
        entities = alignment.Entities
        pair = None

        for i in range(entities.Count - 1):
            first = entities.GetEntityByOrder(i)
            second = entities.GetEntityByOrder(i + 1)

            if (first.EntityType == CivDb.AlignmentEntityType.Line and
                    second.EntityType == CivDb.AlignmentEntityType.Line):
                key = (first.EntityId, second.EntityId)
                if key not in failed_pairs:
                    pair = key
                    break

        if pair is None:
            break

        previous_id, next_id = pair
        try:
            entities.AddFreeCurve(
                previous_id,
                next_id,
                float(radius),
                CivDb.CurveParamType.Radius,
                False,
                CivDb.CurveType.Compound
            )
        except Exception as ex:
            failed_pairs.add(pair)
            warnings.append(
                'PI between entities {0}/{1}: {2}'.format(
                    previous_id, next_id, str(ex)
                )
            )

    return warnings


# -----------------------------------------------------------------------------
# MAIN
# -----------------------------------------------------------------------------
doc = AcAppServ.Application.DocumentManager.MdiActiveDocument
db = doc.Database
ed = doc.Editor

alignmentName = None
alignmentId = None
message = None

select_options = AcEd.PromptEntityOptions(
    '\nSelect a polyline to convert to an alignment: '
)
select_options.SetRejectMessage('\nMust be a Polyline (LWPOLYLINE).')
select_options.AddAllowedClass(clr.GetClrType(AcDb.Polyline), True)
select_result = ed.GetEntity(select_options)

if select_result.Status != AcEd.PromptStatus.OK:
    message = 'No polyline selected.'
else:
    name_options = AcEd.PromptStringOptions(
        '\nEnter a name for the new alignment: '
    )
    name_options.AllowSpaces = True
    name_options.DefaultValue = DEFAULT_ALIGNMENT_NAME
    name_options.UseDefaultValue = True
    name_result = ed.GetString(name_options)

    if name_result.Status != AcEd.PromptStatus.OK:
        message = 'No alignment name entered.'
    else:
        new_name = name_result.StringResult

        with doc.LockDocument():
            with db.TransactionManager.StartTransaction() as tr:
                try:
                    civil_doc = CivAppServ.CivilApplication.ActiveDocument

                    # Alignment style and default label set
                    alignment_style_id, alignment_style_status = get_or_create_alignment_style_id(
                        civil_doc.Styles.AlignmentStyles,
                        alignmentStyleName
                    )

                    label_set_id = AcDb.ObjectId.Null
                    label_sets = civil_doc.Styles.LabelSetStyles.AlignmentLabelSetStyles
                    if label_sets.Count > 0:
                        label_set_id = label_sets[0]

                    # Convert selected polyline to alignment
                    polyline_options = CivDb.PolylineOptions()
                    polyline_options.PlineId = select_result.ObjectId
                    polyline_options.EraseExistingEntities = ERASE_SOURCE_POLYLINE
                    polyline_options.AddCurvesBetweenTangents = ADD_CURVES_DURING_CONVERSION

                    alignmentId = CivDb.Alignment.Create(
                        civil_doc,
                        polyline_options,
                        new_name,
                        AcDb.ObjectId.Null,   # site
                        db.Clayer,
                        alignment_style_id,
                        label_set_id
                    )

                    alignment = tr.GetObject(alignmentId, AcDb.OpenMode.ForWrite)
                    alignmentName = alignment.Name

                    # Replace inherited station groups with explicit groups below
                    remove_station_label_groups(alignment, tr)

                    # Add curves at sharp Line-Line PIs
                    curve_warnings = add_radius_curves(alignment, curveRadius)

                    # Resolve major/minor station label styles
                    label_styles = civil_doc.Styles.LabelStyles.AlignmentLabelStyles
                    major_style_id, major_style_status = clone_label_style_safely(
                        label_styles.MajorStationLabelStyles, majorLabelStyleName, tr
                    )
                    # Minor labels are never modified; use requested existing style or first native style.
                    minor_styles = label_styles.MinorStationLabelStyles
                    try:
                        minor_style_id = minor_styles[minorLabelStyleName] if minorLabelStyleName else minor_styles[0]
                        minor_style_status = 'existing'
                    except:
                        minor_style_id = minor_styles[0] if minor_styles.Count else AcDb.ObjectId.Null
                        minor_style_status = 'fallback'


                    # Force the major label to match the requested MWP appearance.
                    # Colour is intentionally left untouched / ByLayer as requested.
                    label_style_notes = configure_major_station_style_safe(
                        major_style_id, tr
                    )

                    # Create major station group, then minor group linked to it
                    if not major_style_id.IsNull:
                        major_group_id = CivDb.AlignmentStationLabelGroup.CreateMajor(
                            major_style_id,
                            alignmentId,
                            MAJOR_STATION_INCREMENT
                        )

                        if not minor_style_id.IsNull:
                            CivDb.AlignmentMinorStationLabelGroup.Create(
                                minor_style_id,
                                major_group_id,
                                MINOR_STATION_INCREMENT
                            )

                    # Build non-fatal warnings
                    warnings = []

                    if label_style_notes:
                        warnings.append('label-style notes: ' + '; '.join(label_style_notes))

                    if curve_warnings:
                        warnings.append(
                            'curve insertion at radius {0}: {1} PI(s) failed - {2}'.format(
                                curveRadius,
                                len(curve_warnings),
                                '; '.join(curve_warnings)
                            )
                        )

                    if alignmentStyleName and alignment_style_status == 'created':
                        warnings.append("alignment style '{0}' was missing and has been created".format(alignmentStyleName))
                    elif alignmentStyleName and alignment_style_status == 'fallback':
                        warnings.append("alignment style '{0}' could not be created; first available style used".format(alignmentStyleName))

                    if major_style_status == 'cloned-native':
                        warnings.append("major station label style cloned safely as '{0}_SAFE'".format(majorLabelStyleName or 'MWP - Perpendicular with Tick'))
                    elif major_style_status == 'no-base-style':
                        warnings.append('no native Major Station label style was available to clone')

                    if minorLabelStyleName and minor_style_status == 'fallback':
                        warnings.append("minor station label style '{0}' could not be created; first available style used".format(minorLabelStyleName))

                    if warnings:
                        message = 'Warning: ' + '; '.join(warnings)

                    tr.Commit()

                except Exception as ex:
                    exc_type, exc_value, exc_tb = sys.exc_info()
                    line_no = exc_tb.tb_lineno if exc_tb is not None else -1
                    message = 'Line {0}: {1}: {2}'.format(
                        line_no,
                        exc_type.__name__ if hasattr(exc_type, '__name__') else str(exc_type),
                        exc_value
                    )
                    tr.Abort()

OUT = alignmentName, alignmentId, message
# ----------------------------------------
watch = Watch(polyline_to_alignment)
