# Dynamo graph C6.0 - CreateProfileView-V1.dyn "C6.02 - CreateProfileView" (Dynamo 3.7.0.11777)
# v2.0 - Prompts the user to pick an Alignment, looks up a Surface and Profile View style by name, a profile name, and a point in the drawing; creates a Surface Profile from the alignment/surface, then a Profile View there in that style. Clears the Profile View's default bottom bands and replaces them with four Profile Data bands (Profile 2 Levels, Profile 1 Levels, Level Difference, Chainage) by style name, linked to the created profile.
# packages: DynamoIronPython2.7 3.2.1

surface_Name = StringInput("24974-MWP-EXISTING SURFACE")  # graph input
profile_View_Style = StringInput("MWP - SITE SECTION")  # graph input
band_Profile2Levels_Style = StringInput("Profile 2 Levels")  # graph input
band_Profile1Levels_Style = StringInput("Profile 1 Levels")  # graph input
band_LevelDifference_Style = StringInput("Level Difference")  # graph input
band_Chainage_Style = StringInput("Chainage")  # graph input
profile_Style = StringInput("MWP-Existing Ground")  # graph input
offset_Distance = DoubleInput(-1)  # graph input
weeding_Distance = DoubleInput(5)  # graph input
angle_Threshold_Degrees = DoubleInput(2)  # graph input
curve_Radius = DoubleInput(12)  # graph input
profile_NewProfileNameInput = StringInput("MWP-Road Design")  # graph input
create_profile_view = Python(IN[0]=surface_Name, IN[1]=profile_View_Style, IN[2]=band_Profile2Levels_Style, IN[3]=band_Profile1Levels_Style, IN[4]=band_LevelDifference_Style, IN[5]=band_Chainage_Style, IN[6]=profile_Style, IN[7]=offset_Distance, IN[8]=weeding_Distance, IN[9]=angle_Threshold_Degrees, IN[10]=curve_Radius, IN[11]=profile_NewProfileNameInput)  # IronPython2
# ---------- create_profile_view.python (426 lines) ----------
# CreateProfileView v3.21
import sys
import math
import System
import clr
clr.AddReference('AcMgd')
clr.AddReference('AcDbMgd')
clr.AddReference('AcCoreMgd')
clr.AddReference('AeccDbMgd')

import Autodesk.AutoCAD.ApplicationServices as AcAppServ
import Autodesk.AutoCAD.DatabaseServices as AcDb
import Autodesk.AutoCAD.EditorInput as AcEd
import Autodesk.Civil.ApplicationServices as CivAppServ
import Autodesk.Civil.DatabaseServices as CivDb
import Autodesk.Civil.DatabaseServices.Styles as CivDbStyles
import Autodesk.AutoCAD.Geometry as AcGe

surfaceName = IN[0]
profileViewStyleName = IN[1]
band_Profile2LevelsStyle = IN[2]
band_Profile1LevelsStyle = IN[3]
band_LevelDifferenceStyle = IN[4]
band_ChainageStyle = IN[5]
profileStyleName = IN[6]
offsetDistance = IN[7]
weedingDistance = IN[8]
angleThresholdDegInput = IN[9]
curveRadiusInputParam = IN[10]
newProfileNameInput = IN[11] if len(IN) > 11 else None

doc = AcAppServ.Application.DocumentManager.MdiActiveDocument
db = doc.Database
ed = doc.Editor

def _safeCall(obj, methodName, args=None):
    try:
        m = getattr(obj, methodName)
        return m(*(args or []))
    except AttributeError:
        mi = obj.GetType().GetMethod(methodName)
        if mi is None:
            return None
        if args:
            return mi.Invoke(obj, System.Array[object](args))
        return mi.Invoke(obj, None)

def _safeProp(obj, propName):
    try:
        return getattr(obj, propName)
    except AttributeError:
        pi = obj.GetType().GetProperty(propName)
        if pi is None:
            raise
        return pi.GetValue(obj, None)

def _safeIndex(obj, i):
    try:
        return obj[i]
    except (AttributeError, TypeError):
        mi = obj.GetType().GetMethod("get_Item")
        if mi is None:
            raise
        return mi.Invoke(obj, System.Array[object]([i]))

profileName = None
profileViewName = None
profileViewId = None
errorMsg = None

peo = AcEd.PromptEntityOptions("\nSelect an alignment to create a profile view for: ")
peo.SetRejectMessage("\nMust be an Alignment.")
peo.AddAllowedClass(clr.GetClrType(CivDb.Alignment), True)

result = ed.GetEntity(peo)

if result.Status == AcEd.PromptStatus.OK:
    newProfileName = None
    if newProfileNameInput is not None and str(newProfileNameInput).strip() != "":
        newProfileName = str(newProfileNameInput).strip()
    else:
        pso = AcEd.PromptStringOptions("\nEnter a name for the new profile: ")
        pso.AllowSpaces = True
        pso.DefaultValue = "MWP-Road Design"
        pso.UseDefaultValue = True
        nameResult = ed.GetString(pso)
        if nameResult.Status == AcEd.PromptStatus.OK:
            newProfileName = nameResult.StringResult

    if newProfileName:
        ppo = AcEd.PromptPointOptions("\nSpecify profile view origin: ")
        pointResult = ed.GetPoint(ppo)

        if pointResult.Status == AcEd.PromptStatus.OK:
            insertPoint = pointResult.Value
            with doc.LockDocument():
                with db.TransactionManager.StartTransaction() as tr:
                    try:
                        civilDoc = CivAppServ.CivilApplication.ActiveDocument
                        alignmentId = result.ObjectId

                        surfaceIds = civilDoc.GetSurfaceIds()
                        surfaceId = AcDb.ObjectId.Null
                        surfaceMatched = False
                        if surfaceName:
                            for sid in surfaceIds:
                                sObj = tr.GetObject(sid, AcDb.OpenMode.ForRead)
                                if sObj.Name.strip().lower() == str(surfaceName).strip().lower():
                                    surfaceId = sid
                                    surfaceMatched = True
                                    break
                        if surfaceId.IsNull and surfaceIds.Count > 0:
                            surfaceId = surfaceIds[0]

                        if surfaceId.IsNull:
                            errorMsg = "No surfaces found in the drawing."
                        else:
                            styleId = AcDb.ObjectId.Null
                            styleMatched = False
                            if profileStyleName:
                                try:
                                    candidateStyleId = civilDoc.Styles.ProfileStyles[str(profileStyleName)]
                                    if not candidateStyleId.IsNull:
                                        styleId = candidateStyleId
                                        styleMatched = True
                                except:
                                    pass
                            if styleId.IsNull and civilDoc.Styles.ProfileStyles.Count > 0:
                                styleId = civilDoc.Styles.ProfileStyles[0]

                            labelSetId = AcDb.ObjectId.Null
                            if civilDoc.Styles.LabelSetStyles.ProfileLabelSetStyles.Count > 0:
                                labelSetId = civilDoc.Styles.LabelSetStyles.ProfileLabelSetStyles[0]

                            layerId = db.Clayer

                            baseProfileName = newProfileName
                            profileNameSuffix = 1
                            while True:
                                try:
                                    profileId = CivDb.Profile.CreateFromSurface(
                                        newProfileName, alignmentId, surfaceId, layerId, styleId, labelSetId
                                    )
                                    break
                                except Exception as ex:
                                    exMsg = str(ex).lower()
                                    if not ("already exists" in exMsg or "duplicate" in exMsg) or profileNameSuffix > 50:
                                        raise
                                    profileNameSuffix += 1
                                    newProfileName = "{0}_{1}".format(baseProfileName, profileNameSuffix)

                            profileEntity = tr.GetObject(profileId, AcDb.OpenMode.ForRead)
                            profileName = profileEntity.Name

                            profileLabelErrors = []
                            labelGroupDiag = []

                            def _processLabelGroups(sourceLabel, entity):
                                if entity is None:
                                    return
                                try:
                                    groupIds = _safeCall(entity, "GetLabelGroupIds")
                                    if groupIds is not None:
                                        for lgId in groupIds:
                                            try:
                                                lgObj = tr.GetObject(lgId, AcDb.OpenMode.ForWrite)
                                                typeName = lgObj.GetType().Name
                                                typeNameLower = typeName.lower()
                                                erased = False
                                                if "tangent" in typeNameLower or "straight" in typeNameLower or "line" in typeNameLower:
                                                    lgObj.Erase()
                                                    erased = True
                                                labelGroupDiag.append("{0}: {1}{2}".format(sourceLabel, typeName, " (ERASED)" if erased else ""))
                                            except Exception as ex:
                                                profileLabelErrors.append("Failed to process {0} label group {1}: {2}".format(sourceLabel, lgId, ex))
                                except Exception as ex:
                                    profileLabelErrors.append("{0} label group cleanup skipped: {1}".format(sourceLabel, ex))

                            _processLabelGroups("Profile", profileEntity)
                            try:
                                alignmentEntity = tr.GetObject(alignmentId, AcDb.OpenMode.ForRead)
                                _processLabelGroups("Alignment", alignmentEntity)
                            except Exception as ex:
                                profileLabelErrors.append("Alignment label group cleanup failed: {0}".format(ex))

                            offsetProfileErrors = []
                            offsetProfileId = AcDb.ObjectId.Null
                            offsetProfileName = None
                            try:
                                if offsetDistance is not None:
                                    offsetProfileNameBase = newProfileName + " Offset"
                                    offsetProfileNameFinal = offsetProfileNameBase
                                    offsetSuffix = 1
                                    while True:
                                        try:
                                            offsetProfileId = CivDb.Profile.CreateByLayout(
                                                offsetProfileNameFinal, alignmentId, layerId, styleId, labelSetId
                                            )
                                            break
                                        except Exception as ex:
                                            exMsg = str(ex).lower()
                                            if not ("already exists" in exMsg or "duplicate" in exMsg) or offsetSuffix > 50:
                                                raise
                                            offsetSuffix += 1
                                            offsetProfileNameFinal = "{0}_{1}".format(offsetProfileNameBase, offsetSuffix)

                                    offsetProfileEntity = tr.GetObject(offsetProfileId, AcDb.OpenMode.ForWrite)
                                    offsetProfileName = offsetProfileEntity.Name

                                    srcPVIs = _safeProp(profileEntity, "PVIs")
                                    pviCount = _safeProp(srcPVIs, "Count")
                                    dstPVIs = _safeProp(offsetProfileEntity, "PVIs")

                                    minSpacing = float(weedingDistance) if weedingDistance else 0.0
                                    curveRadiusInput = float(curveRadiusInputParam) if curveRadiusInputParam is not None else 100.0
                                    angleThresholdDeg = float(angleThresholdDegInput) if angleThresholdDegInput is not None else 10.0

                                    keptPoints = []
                                    lastKeptStation = None
                                    for i in range(pviCount):
                                        try:
                                            pviObj = _safeIndex(srcPVIs, i)
                                            station = float(_safeProp(pviObj, "Station"))
                                            elevation = float(_safeProp(pviObj, "Elevation"))
                                            isEndpoint = (i == 0 or i == pviCount - 1)
                                            if not isEndpoint and lastKeptStation is not None and (station - lastKeptStation) < minSpacing:
                                                continue
                                            keptPoints.append((station, elevation))
                                            lastKeptStation = station
                                        except Exception as ex:
                                            offsetProfileErrors.append("Failed to read PVI {0}: {1}".format(i, ex))

                                    # SINGLE-PASS PVI ADDITION (RADIUS BASED)
                                    addedCount = len(keptPoints)
                                    curveCount = 0
                                    maxAngleSeen = 0.0

                                    for k in range(addedCount):
                                        station, elevation = keptPoints[k]
                                        targetElevation = elevation + float(offsetDistance)
                                        isEndpoint = (k == 0 or k == addedCount - 1)

                                        if isEndpoint:
                                            dstPVIs.AddPVI(station, targetElevation)
                                        else:
                                            prevStation, prevElevation = keptPoints[k - 1]
                                            nextStation, nextElevation = keptPoints[k + 1]

                                            grade1 = (elevation - prevElevation) / (station - prevStation) if (station - prevStation) != 0 else 0.0
                                            grade2 = (nextElevation - elevation) / (nextStation - station) if (nextStation - station) != 0 else 0.0
                                            angleDeg = abs(math.degrees(math.atan(grade2) - math.atan(grade1)))

                                            if angleDeg > maxAngleSeen:
                                                maxAngleSeen = angleDeg

                                            if angleDeg > angleThresholdDeg:
                                                maxAllowedLen = min(station - prevStation, nextStation - station) * 0.80
                                                angleRad = math.radians(angleDeg)
                                                maxAllowedRadius = (maxAllowedLen / angleRad) if angleRad > 0 else curveRadiusInput
                                                targetRadius = min(curveRadiusInput, maxAllowedRadius)

                                                if targetRadius >= 0.5:
                                                    try:
                                                        dstPVIs.AddPVIArc(station, targetElevation, targetRadius)
                                                        curveCount += 1
                                                    except Exception:
                                                        dstPVIs.AddPVI(station, targetElevation)
                                                else:
                                                    dstPVIs.AddPVI(station, targetElevation)
                                            else:
                                                dstPVIs.AddPVI(station, targetElevation)

                                    offsetProfileErrors.append("Offset profile '{0}' PVIs added: {1}/{2} (weeded to {3}m spacing, {4} arc curves >{5} deg, max angle {6:.2f} deg)".format(
                                        offsetProfileName, addedCount, pviCount, minSpacing, curveCount, angleThresholdDeg, maxAngleSeen))
                            except Exception as ex:
                                offsetProfileErrors.append("Offset profile creation failed: {0}".format(ex))

                            pvStyleId = AcDb.ObjectId.Null
                            pvStyleMatched = False
                            if profileViewStyleName:
                                try:
                                    candidatePvStyleId = civilDoc.Styles.ProfileViewStyles[str(profileViewStyleName)]
                                    if not candidatePvStyleId.IsNull:
                                        pvStyleId = candidatePvStyleId
                                        pvStyleMatched = True
                                except:
                                    pass
                            if pvStyleId.IsNull and civilDoc.Styles.ProfileViewStyles.Count > 0:
                                pvStyleId = civilDoc.Styles.ProfileViewStyles[0]

                            pvBandSetId = AcDb.ObjectId.Null
                            if civilDoc.Styles.ProfileViewBandSetStyles.Count > 0:
                                pvBandSetId = civilDoc.Styles.ProfileViewBandSetStyles[0]

                            baseProfileViewName = newProfileName + " Profile View"
                            newProfileViewName = baseProfileViewName
                            profileViewNameSuffix = 1
                            while True:
                                try:
                                    profileViewId = CivDb.ProfileView.Create(
                                        alignmentId, insertPoint, newProfileViewName, pvBandSetId, pvStyleId
                                    )
                                    break
                                except Exception as ex:
                                    exMsg = str(ex).lower()
                                    if not ("already exists" in exMsg or "duplicate" in exMsg) or profileViewNameSuffix > 50:
                                        raise
                                    profileViewNameSuffix += 1
                                    newProfileViewName = "{0}_{1}".format(baseProfileViewName, profileViewNameSuffix)

                            profileViewEntity = tr.GetObject(profileViewId, AcDb.OpenMode.ForWrite)
                            profileViewName = profileViewEntity.Name

                            _processLabelGroups("ProfileView", profileViewEntity)

                            bandRequests = [
                                ("Profile 2 Levels", band_Profile2LevelsStyle),
                                ("Profile 1 Levels", band_Profile1LevelsStyle),
                                ("Level Difference", band_LevelDifferenceStyle),
                                ("Chainage", band_ChainageStyle),
                            ]
                            bandErrors = []
                            bandsResolved = []
                            for bandType, bandStyleName in bandRequests:
                                if not bandStyleName:
                                    continue
                                try:
                                    civilDoc.Styles.BandStyles.ProfileViewProfileDataBandStyles[str(bandStyleName)]
                                    bandsResolved.append(bandType)
                                except Exception as ex:
                                    bandErrors.append("{0}: style '{1}' not found: {2}".format(bandType, bandStyleName, ex))

                            bandsAdded = []
                            try:
                                currentBottom = profileViewEntity.Bands.GetBottomBandItems()
                                originalBottomCount = currentBottom.Count

                                bandTypeEnumType = None
                                for m in currentBottom.GetType().GetMethods():
                                    if m.Name == "Add" and len(m.GetParameters()) == 2:
                                        bandTypeEnumType = m.GetParameters()[0].ParameterType
                                        break
                                profileDataBandType = None
                                if bandTypeEnumType is not None:
                                    enumNames = list(System.Enum.GetNames(bandTypeEnumType))
                                    matchedName = None
                                    for n in enumNames:
                                        if n.lower().replace(" ", "") == "profiledata":
                                            matchedName = n
                                            break
                                    if matchedName is not None:
                                        profileDataBandType = System.Enum.Parse(bandTypeEnumType, matchedName)

                                for bandType, bandStyleName in bandRequests:
                                    if bandType not in bandsResolved:
                                        continue
                                    try:
                                        if profileDataBandType is None:
                                            raise Exception("Could not resolve BandType enum")
                                        currentBottom.Add(profileDataBandType, str(bandStyleName))
                                        newItem = currentBottom[currentBottom.Count - 1]
                                        try:
                                            newItem.Gap = 0.0
                                        except Exception as ex:
                                            bandErrors.append("{0}: gap error: {1}".format(bandType, ex))
                                        bandsAdded.append(bandType)
                                    except Exception as ex:
                                        bandErrors.append("{0}: add failed: {1}".format(bandType, ex))

                                for i in range(originalBottomCount - 1, -1, -1):
                                    try:
                                        currentBottom.RemoveAt(i)
                                    except Exception as ex:
                                        bandErrors.append("Failed to remove original band {0}: {1}".format(i, ex))

                                profileViewEntity.Bands.SetBottomBandItems(currentBottom)
                            except Exception as ex:
                                bandErrors.append("Bottom band update failed: {0}".format(ex))

                            try:
                                currentTop = profileViewEntity.Bands.GetTopBandItems()
                                if currentTop is not None and currentTop.Count > 0:
                                    topCountBefore = currentTop.Count
                                    for i in range(topCountBefore - 1, -1, -1):
                                        try:
                                            currentTop.RemoveAt(i)
                                        except Exception as ex:
                                            bandErrors.append("Failed to remove top band {0}: {1}".format(i, ex))
                                    profileViewEntity.Bands.SetTopBandItems(currentTop)
                            except Exception as ex:
                                bandErrors.append("Top band clear failed: {0}".format(ex))

                            warnings = []
                            if surfaceName and not surfaceMatched:
                                warnings.append("surface '{0}' not found, used default".format(surfaceName))
                            if profileStyleName and not styleMatched:
                                warnings.append("profile style '{0}' not found, used default".format(profileStyleName))
                            if profileViewStyleName and not pvStyleMatched:
                                warnings.append("profile view style '{0}' not found, used default".format(profileViewStyleName))
                            if bandsAdded:
                                warnings.append("bands added: " + ", ".join(bandsAdded))
                            if bandErrors:
                                warnings.append("band errors: " + " | ".join(bandErrors))
                            if profileLabelErrors:
                                warnings.append("label cleanup errors: " + " | ".join(profileLabelErrors))
                            if labelGroupDiag:
                                warnings.append("label groups removed: " + " | ".join(labelGroupDiag))
                            if offsetProfileErrors:
                                warnings.append("offset profile: " + " | ".join(offsetProfileErrors))
                            if warnings:
                                errorMsg = "Warning: " + "; ".join(warnings)

                        tr.Commit()
                    except Exception as ex:
                        excType, excValue, excTb = sys.exc_info()
                        lineNo = excTb.tb_lineno if excTb is not None else -1
                        errorMsg = "Line {0}: {1}: {2}".format(lineNo, excType, excValue)
                        tr.Abort()
        else:
            errorMsg = "No insertion point specified."
    else:
        errorMsg = "No profile name entered."
else:
    errorMsg = "No alignment selected."

OUT = profileName, profileViewName, profileViewId, errorMsg
# ----------------------------------------
watch = Watch(create_profile_view)
