# Dynamo graph 7.0 TwoPolylineCenterline.dyn (Dynamo 3.7.0.11777)
# Selects two boundary polylines of a corridor (e.g. a cable route swath) in Civil 3D and draws the midpoint centerline back into the drawing on its own layer.
# packages: DynamoIronPython2.7 3.2.1

python_script = Python()  # IronPython2
# ---------- python_script.python (93 lines) ----------
import clr
clr.AddReference('AcMgd')
clr.AddReference('AcDbMgd')
clr.AddReference('AcCoreMgd')

from Autodesk.AutoCAD.ApplicationServices import Application
from Autodesk.AutoCAD.DatabaseServices import Transaction, OpenMode, Polyline, BlockTable, BlockTableRecord, LayerTable, LayerTableRecord
from Autodesk.AutoCAD.EditorInput import PromptEntityOptions, PromptStatus
from Autodesk.AutoCAD.Geometry import Point2d

doc = Application.DocumentManager.MdiActiveDocument
db = doc.Database
ed = doc.Editor

LAYER_NAME = "Proposed Cable Route Centerline"

def pick_polyline(prompt):
    opts = PromptEntityOptions(prompt)
    opts.SetRejectMessage("\nSelect a polyline (LWPOLYLINE).")
    opts.AddAllowedClass(Polyline, True)
    res = ed.GetEntity(opts)
    if res.Status != PromptStatus.OK:
        raise Exception("Selection cancelled by user.")
    return res.ObjectId

def dist(a, b):
    return ((a[0] - b[0]) ** 2 + (a[1] - b[1]) ** 2) ** 0.5

def closest_point_on_polyline(pt, poly):
    best_pt, best_dist = None, float('inf')
    for i in range(len(poly) - 1):
        x1, y1 = poly[i]
        x2, y2 = poly[i + 1]
        dx, dy = x2 - x1, y2 - y1
        seg_len_sq = dx * dx + dy * dy
        t = 0.0 if seg_len_sq == 0 else ((pt[0] - x1) * dx + (pt[1] - y1) * dy) / seg_len_sq
        t = max(0.0, min(1.0, t))
        px, py = x1 + t * dx, y1 + t * dy
        d = dist(pt, (px, py))
        if d < best_dist:
            best_dist, best_pt = d, (px, py)
    return best_pt, best_dist

oid1 = pick_polyline("\nSelect the FIRST edge of the corridor: ")
oid2 = pick_polyline("\nSelect the SECOND edge of the corridor: ")

tr = db.TransactionManager.StartTransaction()
try:
    with doc.LockDocument():
        pl1 = tr.GetObject(oid1, OpenMode.ForRead)
        pl2 = tr.GetObject(oid2, OpenMode.ForRead)
        pts1 = [(pl1.GetPoint2dAt(i).X, pl1.GetPoint2dAt(i).Y) for i in range(pl1.NumberOfVertices)]
        pts2 = [(pl2.GetPoint2dAt(i).X, pl2.GetPoint2dAt(i).Y) for i in range(pl2.NumberOfVertices)]

        # align direction so both polylines run the same way before pairing
        if dist(pts1[-1], pts2[0]) > dist(pts1[-1], pts2[-1]):
            pts2 = list(reversed(pts2))

        centerline, widths = [], []
        for p in pts1:
            cp, d = closest_point_on_polyline(p, pts2)
            centerline.append(((p[0] + cp[0]) / 2.0, (p[1] + cp[1]) / 2.0))
            widths.append(d)

        lt = tr.GetObject(db.LayerTableId, OpenMode.ForRead)
        if not lt.Has(LAYER_NAME):
            lt.UpgradeOpen()
            ltr = LayerTableRecord()
            ltr.Name = LAYER_NAME
            lt.Add(ltr)
            tr.AddNewlyCreatedDBObject(ltr, True)

        bt = tr.GetObject(db.BlockTableId, OpenMode.ForRead)
        btr = tr.GetObject(bt[BlockTableRecord.ModelSpace], OpenMode.ForWrite)

        new_pl = Polyline()
        for i, (x, y) in enumerate(centerline):
            new_pl.AddVertexAt(i, Point2d(x, y), 0, 0, 0)
        new_pl.Layer = LAYER_NAME

        btr.AppendEntity(new_pl)
        tr.AddNewlyCreatedDBObject(new_pl, True)

        tr.Commit()
    total_length = sum(dist(centerline[i], centerline[i - 1]) for i in range(1, len(centerline)))
finally:
    tr.Dispose()

OUT = {
    "CenterlinePoints": centerline,
    "CorridorWidths": widths,
    "TotalLength": total_length
}
# ----------------------------------------
