# Dynamo graph C8.01 Add_MWPNEZ_ChainageLevel_Labels_Close Civil After Running.dyn "Add_MWP-NEZ_ChainageLevel_Labels" (Dynamo 3.0.0.0)

label_style_name = StringInput("MWP-NEZ", Name="Label style name")  # graph input
marker_style_name = StringInput("Basic Circle with Cross", Name="Marker style name")  # graph input
add_mwp_nez_chainage_level = Python(IN[0]=label_style_name, IN[1]=marker_style_name, Name="Add MWP-NEZ Chainage & Level Labels")  # "Add MWP-NEZ Chainage & Level Labels"; IronPython2
# ---------- add_mwp_nez_chainage_level.python (180 lines) ----------
"""
Dynamo for Civil 3D - Python Script node (engine: IronPython2)

NOTE: this node is IronPython2, not CPython3. Touching
Application.DocumentManager/Document pulls in the Autodesk.AutoCAD.Interop
COM assembly, and Dynamo's CPython3 (pythonnet) engine cannot load it in
this Civil3D build ("Could not load type ... AcWindowState ...") even with
an explicit clr.AddReference. IronPython2's CLR hosting resolves it fine,
which is why every working Civil3D-API Dynamo example uses it for this kind
of call.

NOTE 2: in this Civil3D build the managed LabelStyle/MarkerStyle/ProfileView
wrappers' .Name getter is present in metadata but not actually bound
("Property Get method was not found" even via reflection) - confirmed via a
diagnostic dump. Each object's .AcadObject is the real COM Automation object
(IAeccLabelStyle / IAeccMarkerStyle / IAeccProfileView), which IronPython2
can late-bind directly, so .AcadObject.Name is used instead everywhere a
style/view name is needed.

NOTE 3: DO NOT DRAG/GRIP-EDIT labels this script creates. Confirmed with the
user: StationElevationLabel.Create() objects crash Civil3D on drag in this
build even after a full save/close/reopen, while natively UI-created
Chainage and Level labels drag fine - this reproduces with or without the
SetReferenceTextTarget call below, so it is not what causes it. This is a
defect in how this OEM build handles API-created label objects, not
something fixable from this script - the native "Add Labels" command
evidently sets up internal state that the bare API call skips. Treat the
station/elevation this script places each label at as final.

Prompts you to select one or more Profile Views on screen, then adds a
"Chainage and Level" (StationElevationLabel) at the start station of every
profile line plotted in each selected view, using the given label/marker
styles.

Inputs:
  IN[0] : label style name  (string, default "MWP-NEZ")
  IN[1] : marker style name (string, default "Basic Circle with Cross")

Output:
  OUT   : list[str] run report - one line per profile view / error
"""
import clr
from System import Array

clr.AddReference('AcMgd')
clr.AddReference('AcCoreMgd')
clr.AddReference('AcDbMgd')
clr.AddReference('AeccDbMgd')

from Autodesk.AutoCAD.ApplicationServices import Application
from Autodesk.AutoCAD.DatabaseServices import OpenMode, TypedValue
from Autodesk.AutoCAD.EditorInput import PromptSelectionOptions, SelectionFilter
from Autodesk.Civil.ApplicationServices import CivilDocument
from Autodesk.Civil.DatabaseServices import StationElevationLabel

label_style_name = IN[0] if IN[0] else "MWP-NEZ"
marker_style_name = IN[1] if IN[1] else "Basic Circle with Cross"

report = []

doc = Application.DocumentManager.MdiActiveDocument
db = doc.Database
ed = doc.Editor

# Only let AECC_PROFILE_VIEW entities be picked, so a stray pick can't grab something else.
filterData = SelectionFilter(Array[TypedValue]([TypedValue(0, "AECC_PROFILE_VIEW")]))
opts = PromptSelectionOptions()
opts.MessageForAdding = "Select Profile View(s) to add MWP-NEZ chainage/level labels to: "

selResult = ed.GetSelection(opts, filterData)

if str(selResult.Status) != "OK" or selResult.Value.Count == 0:
    report.append("No Profile Views selected - nothing done.")
else:
    with doc.LockDocument():
        with db.TransactionManager.StartTransaction() as tr:
            civilDoc = CivilDocument.GetCivilDocument(db)

            # Resolve the label style ObjectId by name (via the COM AcadObject - see NOTE 2).
            labelStyleId = None
            for sid in civilDoc.Styles.LabelStyles.ProfileViewLabelStyles.StationElevationLabelStyles:
                style = tr.GetObject(sid, OpenMode.ForRead)
                try:
                    name = style.AcadObject.Name
                except Exception:
                    name = None
                if name == label_style_name:
                    labelStyleId = sid
                    break

            # Resolve the marker style ObjectId by name (via the COM AcadObject - see NOTE 2).
            markerStyleId = None
            for sid in civilDoc.Styles.MarkerStyles:
                style = tr.GetObject(sid, OpenMode.ForRead)
                try:
                    name = style.AcadObject.Name
                except Exception:
                    name = None
                if name == marker_style_name:
                    markerStyleId = sid
                    break

            if labelStyleId is None:
                report.append("ERROR: label style '{}' not found under Profile View > Station Elevation styles.".format(label_style_name))
            if markerStyleId is None:
                report.append("ERROR: marker style '{}' not found.".format(marker_style_name))

            if labelStyleId is not None and markerStyleId is not None:
                createdTotal = 0
                for selObj in selResult.Value:
                    pvId = selObj.ObjectId
                    pv = tr.GetObject(pvId, OpenMode.ForWrite)
                    alignment = tr.GetObject(pv.AlignmentId, OpenMode.ForRead)
                    startStation = pv.StationStart
                    try:
                        pv_name = pv.AcadObject.Name
                    except Exception:
                        pv_name = pvId.Handle.ToString()

                    # Which profiles are actually plotted in this view.
                    profileIds = []
                    try:
                        for go in pv.GraphOverrides:
                            if go.Draw:
                                profileIds.append(go.ProfileId)
                    except Exception:
                        profileIds = []

                    if not profileIds:
                        # No explicit overrides recorded -> all profiles on the alignment are shown.
                        profileIds = list(alignment.GetProfileIds())

                    createdHere = 0
                    for profId in profileIds:
                        try:
                            profile = tr.GetObject(profId, OpenMode.ForRead)
                            elev = profile.ElevationAt(startStation)
                            newLabelId = StationElevationLabel.Create(pvId, labelStyleId, markerStyleId, startStation, elev)
                            createdHere += 1

                            # Bind the label's Reference Text component(s) to the profile's parent
                            # alignment - this is what populates "Reference Text Objects" > alignment
                            # name/N,E in Properties, matching the MWP-NEZ example. Confirmed this is
                            # NOT the cause of the drag-crash in NOTE 3 (plain labels crash too), so
                            # it's safe to include as long as the "never drag" rule is followed.
                            try:
                                newLabel = tr.GetObject(newLabelId, OpenMode.ForWrite)
                                compIds = newLabel.GetTextComponentIds()
                            except Exception:
                                compIds = []
                            boundCount = 0
                            for compId in compIds:
                                try:
                                    newLabel.SetReferenceTextTarget(compId, pv.AlignmentId)
                                    boundCount += 1
                                except Exception:
                                    pass
                            if compIds and boundCount == 0:
                                report.append("  '{}' station {:.3f}: label created but no text component accepted the alignment reference".format(pv_name, startStation))
                        except Exception as ex:
                            report.append("  skip '{}' profile {}: {}".format(pv_name, profId, str(ex)))

                    createdTotal += createdHere
                    report.append("{} : start CH {:.3f} -> {} label(s) created".format(pv_name, startStation, createdHere))

                report.append("TOTAL labels created: {}".format(createdTotal))

                if createdTotal > 0:
                    report.append(
                        "NOTE: do NOT drag/grip-edit these labels - confirmed this crashes Civil3D "
                        "in this build even after a save/close/reopen (pre-existing, UI-created "
                        "labels drag fine; only ones this script creates via the API are affected). "
                        "Treat the placement above as final."
                    )

            tr.Commit()

ed.Regen()

OUT = report
# ----------------------------------------
watch = Watch(add_mwp_nez_chainage_level, Name="Watch")  # graph output
