# Dynamo graph R9 - Place_Aerial_Image_SharedCoords_V11.dyn "R19 - Place_Aerial_Image_SharedCoords_V11" (Dynamo 3.7.0.11777)
# On run a file window opens: select the QGIS GeoTIFF (.tif); position and size are read from it, then the Revit image is resized the Revit raster image and places its top-left corner there using shared coordinates (ITM). Open the Site plan (or select the image), Create=True, Run.

# group: 1 INPUTS
# NOTE: When you run, a question window asks if the TIF is from QGIS (Yes continues), then a file window opens - select the GeoTIFF exported from QGIS (right-click aerial layer > Export > Save As > GeoTIFF, CRS EPSG:2157, resolution 0.5, Create VRT OFF). The window may appear behind Revit - check the taskbar. The start folder is just where the window opens. The Revit image is found by the tif file name. Create = False is a dry run.
start_folder_for_file_window = StringInput("C:/Users/Conor.mcenery/Documents/Map_2026")  # graph input
create = BoolSelector(true)  # graph input

# group: 2 PLACE IMAGE
# NOTE: Open the Site plan view first. If the .tif is not already in the view the graph inserts it for you (or select an existing image to move that one). Needs Revit shared coordinates set to ITM (EPSG:2157). Sets image width/height in metres and moves its TOP-LEFT corner to the file's E/N. Units: metres.
place_image_from_geotiff = Python(IN[0]=start_folder_for_file_window, IN[1]=create)  # "Place image from GeoTIFF (CPython3)"; CPython3
# ---------- place_image_from_geotiff.python (269 lines) ----------
"""Revit Dynamo CPython3. Place a Revit raster image at the real-world position and size stored in a QGIS GeoTIFF (.tif).
IN[0] start folder for the file window (text)
IN[1] Create (bool)
On every run a file window opens - select the QGIS GeoTIFF (.tif). Cancel = nothing happens.
The Revit image is found by the TIF's own name (selected image wins). Position/size come from the TIF, then the project's
shared coordinates (Survey Point / project location) place it, so it works for any CRS, e.g. ITM EPSG:2157."""
import clr
import math
import os
import struct
clr.AddReference('RevitAPI')
clr.AddReference('RevitAPIUI')
clr.AddReference('RevitServices')
clr.AddReference('System.Windows.Forms')
from System.Windows.Forms import OpenFileDialog, DialogResult, MessageBox, MessageBoxButtons, MessageBoxIcon
from Autodesk.Revit.DB import *
from RevitServices.Persistence import DocumentManager
from RevitServices.Transactions import TransactionManager

M = 1.0 / 0.3048  # metres -> feet (Revit internal)


def read_geotiff(path):
    """Top-left corner, pixel size, pixel count from GeoTIFF tags (ModelPixelScale + ModelTiepoint)."""
    f = open(path, 'rb')
    h = f.read(8)
    bo = '<' if h[:2] == b'II' else '>'
    f.seek(struct.unpack(bo + 'I', h[4:8])[0])
    n = struct.unpack(bo + 'H', f.read(2))[0]
    tags = {}
    for _ in range(n):
        tag, typ, cnt, val = struct.unpack(bo + 'HHI4s', f.read(12))
        size = {3: 2, 4: 4, 12: 8}.get(typ, 1) * cnt
        pos = f.tell()
        if size > 4:
            f.seek(struct.unpack(bo + 'I', val)[0])
            data = f.read(size)
            f.seek(pos)
        else:
            data = val[:size]
        fmt = {3: 'H', 4: 'I', 12: 'd'}.get(typ)
        if fmt:
            tags[tag] = struct.unpack(bo + fmt * cnt, data)
    f.close()
    if 33550 not in tags or 33922 not in tags:
        raise Exception('No GeoTIFF georeferencing in %s' % path)
    px, py = tags[33550][0], tags[33550][1]
    i, j, _, e, nn = tags[33922][:5]
    return e - i * px, nn + j * py, px, py, tags[256][0], tags[257][0]

def jpeg_size(path):
    data = open(path, 'rb').read(2000000)
    k = 2
    while k < len(data) - 9:
        if data[k:k + 1] != b'\xff':
            k += 1
            continue
        m = ord(data[k + 1:k + 2])
        if m in (0xC0, 0xC1, 0xC2):
            h, w = struct.unpack('>HH', data[k + 5:k + 9])
            return w, h
        k += 2 + struct.unpack('>H', data[k + 2:k + 4])[0]
    raise Exception('Could not read JPEG size: %s' % path)

def read_world(path):
    base, ext = os.path.splitext(path)
    for e in ('.wld', '.jgw', '.pgw', '.tfw', ext + 'w'):
        w = base + e
        if os.path.exists(w):
            a, d, b, e2, x, y = [float(v) for v in open(w).read().split()[:6]]
            return w, a, e2, x, y
    return None

def georef(path):
    """Returns (top-left E, top-left N, width m, height m, source description)."""
    head = open(path, 'rb').read(4)
    if head[:2] in (b'II', b'MM'):
        e, n, px, py, cols, rows = read_geotiff(path)
        return e, n, abs(px) * cols, abs(py) * rows, 'GeoTIFF tags, %d x %d px' % (cols, rows)
    w = read_world(path)
    if not w:
        raise Exception('No world file next to %s' % path)
    wf, a, e2, x, y = w
    cols, rows = jpeg_size(path)
    # world file refers to the CENTRE of the top-left pixel
    return x - a / 2.0, y - e2 / 2.0, abs(a) * cols, abs(e2) * rows, 'world file %s, %d x %d px' % (os.path.basename(wf), cols, rows)



def confirm_source():
    """Pop-up asking whether the TIF came from QGIS (Raster > Conversion). True = continue."""
    msg = ('Is the TIF from QGIS (Raster > Conversion, or Layer > Export > Save As)?' + chr(10) + chr(10) +
           'It must be a GeoTIFF in the SAME coordinate system as this Revit model (e.g. ITM, EPSG:2157), in metres.' + chr(10) + chr(10) +
           'Yes = pick the TIF now      No = cancel')
    r = MessageBox.Show(msg, 'TIF from QGIS?', MessageBoxButtons.YesNo, MessageBoxIcon.Question)
    return r == DialogResult.Yes

def browse_tif(folder):
    """Open a file window; returns the chosen path or None if cancelled."""
    dlg = OpenFileDialog()
    dlg.Title = 'Select the TIF image exported from QGIS'
    dlg.Filter = 'TIF image from QGIS (*.tif;*.tiff)|*.tif;*.tiff|All files (*.*)|*.*'
    if folder and os.path.isdir(folder):
        dlg.InitialDirectory = folder
    if dlg.ShowDialog() == DialogResult.OK:
        return dlg.FileName
    return None

def pick_tif(folder, name):
    """Returns the .tif path: the named one, or the newest georeferenced one in the folder."""
    if os.path.isfile(folder):
        folder = os.path.dirname(folder)
    if not os.path.isdir(folder):
        raise Exception('Folder not found: %s' % folder)
    tifs = [os.path.join(folder, f) for f in os.listdir(folder) if f.lower().endswith(('.tif', '.tiff'))]
    if not tifs:
        raise Exception('No .tif in %s - export a GeoTIFF from QGIS into this folder' % folder)
    name = (name or '').strip()
    if name:
        n = name.lower()
        hit = [t for t in tifs if os.path.basename(t).lower() in (n, n + '.tif', n + '.tiff')]
        if not hit:
            hit = [t for t in tifs if n in os.path.basename(t).lower()]
        if not hit:
            raise Exception('No .tif named "%s" in %s' % (name, folder))
        tifs = hit
    tifs.sort(key=os.path.getmtime, reverse=True)
    for t in tifs:
        try:
            georef(t)
            return t, len(tifs)
        except Exception:
            continue
    raise Exception('No georeferenced .tif found in %s' % folder)

def shared_en(doc, x, y):
    """Shared (E, N) in feet of an internal point."""
    p = doc.ActiveProjectLocation.GetProjectPosition(XYZ(x, y, 0))
    return p.EastWest, p.NorthSouth

def internal_from_shared(doc, e_ft, n_ft):
    """Invert shared<-internal (translation + rotation) with two probe points."""
    e0, n0 = shared_en(doc, 0, 0)
    ex, nx = shared_en(doc, 1, 0)
    ey, ny = shared_en(doc, 0, 1)
    a, b, c, d = ex - e0, ey - e0, nx - n0, ny - n0   # J = [[a,b],[c,d]]
    det = a * d - b * c
    if abs(det) < 1e-9:
        raise Exception('Project location is degenerate - set shared coordinates first')
    de, dn = e_ft - e0, n_ft - n0
    x = (d * de - b * dn) / det
    y = (-c * de + a * dn) / det
    # internal direction of shared north (for image rotation)
    nxv = (-b) / det
    nyv = a / det
    return x, y, math.atan2(-nxv, nyv)

def ename(e):
    """Element name under Dynamo CPython3 (plain .Name can raise 'property cannot be read'). None if unreadable."""
    for how in (
        lambda: clr.GetClrType(Element).GetProperty('Name').GetValue(e, None),
        lambda: Element.Name.__get__(e),
        lambda: e.Name,
        lambda: ImageType.Path.__get__(e),
    ):
        try:
            v = how()
            if v:
                return str(v)
        except Exception:
            pass
    return None

def find_image(doc, uidoc, view, name_filter):
    """Selected image, else the image in this view named like the TIF. None if there is none (it will be inserted)."""
    sel = [doc.GetElement(i) for i in uidoc.Selection.GetElementIds()]
    sel = [e for e in sel if isinstance(e, ImageInstance)]
    if len(sel) == 1:
        return sel[0]
    if len(sel) > 1:
        raise Exception('More than one image selected - select just one')
    flt = (name_filter or '').lower()
    all_imgs = list(FilteredElementCollector(doc, view.Id).OfClass(ImageInstance))
    found, unreadable = [], []
    for img in all_imgs:
        n = ename(doc.GetElement(img.GetTypeId()))
        if n is None:
            unreadable.append(img)
        elif flt in n.lower():
            found.append(img)
    if not found and len(unreadable) == 1 and len(all_imgs) == 1:
        found = unreadable   # name unreadable: the only image in this view
    if len(found) > 1:
        raise Exception('%d images match "%s" - select the one you want first' % (len(found), name_filter))
    return found[0] if found else None

def find_image_type(doc, name_filter):
    """Existing Revit image type named like the TIF (so it is not imported twice)."""
    flt = (name_filter or '').lower()
    for t in FilteredElementCollector(doc).OfClass(ImageType):
        n = ename(t)
        if n is not None and flt in n.lower():
            return t
    return None

def insert_image(doc, view, path, name_filter, x, y):
    """Insert the TIF into the active view (top-left at x,y). Reuses an existing image type if there is one."""
    itype = find_image_type(doc, name_filter)
    if itype is None:
        itype = ImageType.Create(doc, ImageTypeOptions(path, False, ImageTypeSource.Import))
    return ImageInstance.Create(doc, view, itype.Id, ImagePlacementOptions(XYZ(x, y, 0), BoxPlacement.TopLeft))

def run():
    folder, create = IN[0], IN[1]
    try:
        if not confirm_source():
            return 'Cancelled - export the TIF from QGIS (Raster > Conversion / Export > Save As, EPSG:2157) and run again'
        path = browse_tif(folder)
    except Exception:
        path = pick_tif(folder, '')[0]   # no window available: newest .tif in the folder
    if not path:
        return 'Cancelled - no file selected'
    name_filter = os.path.splitext(os.path.basename(path))[0]
    e_m, n_m, w_m, h_m, src = georef(path)
    doc = DocumentManager.Instance.CurrentDBDocument
    uidoc = DocumentManager.Instance.CurrentUIApplication.ActiveUIDocument
    view = doc.ActiveView
    img = find_image(doc, uidoc, view, name_filter)

    tx, ty, phi = internal_from_shared(doc, e_m * M, n_m * M)
    if img is not None:
        what = 'Image: %s (already in view - will be resized and moved)' % (ename(doc.GetElement(img.GetTypeId())) or '(name unreadable)')
    else:
        what = 'Image: none in this view - the TIF will be inserted into "%s"' % view.Name
    lines = ['TIF: %s' % path, 'Source: %s' % src, what,
             'Target top-left E %.3f  N %.3f m  (internal %.3f, %.3f m)' % (e_m, n_m, tx / M, ty / M),
             'Size %.3f x %.3f m   rotation to grid %.4f deg' % (w_m, h_m, math.degrees(phi))]
    if not create:
        return lines + ['READY - set Create to True and Run']

    TransactionManager.Instance.EnsureInTransaction(doc)
    try:
        if img is None:
            img = insert_image(doc, view, path, name_filter, tx, ty)
            lines.append('Inserted the TIF into this view')
        try:
            img.LockProportions = False   # TIF aspect is exact; size both sides
        except Exception:
            pass
        img.Width = w_m * M
        img.Height = h_m * M
        doc.Regenerate()
        # place the TOP-LEFT corner exactly (bounding box can be empty for images, so no bbox maths)
        img.SetLocation(XYZ(tx, ty, 0), BoxPlacement.TopLeft)
        if abs(phi) > 1e-6:   # project rotated to true north: turn the image about its top-left corner
            ElementTransformUtils.RotateElement(doc, img.Id, Line.CreateBound(XYZ(tx, ty, 0), XYZ(tx, ty, 1)), phi)
        doc.Regenerate()
        TransactionManager.Instance.TransactionTaskDone()
    except:
        TransactionManager.Instance.ForceCloseTransaction()
        raise
    # verify: shared coords of the top-left corner now
    tl = img.GetLocation(BoxPlacement.TopLeft)
    e1, n1 = shared_en(doc, tl.X, tl.Y)
    lines.append('DONE - image width %.3f m, height %.3f m' % (img.Width / M, img.Height / M))
    lines.append('Top-left now E %.3f  N %.3f m' % (e1 / M, n1 / M))
    return lines

OUT = run()
# ----------------------------------------

# group: 3 RESULT
# Shows source, target E/N, size and the E/N of the top-left corner after placement - compare with the file values.
result_check = Watch(place_image_from_geotiff)
